# Dynamo graph 00_Auditoria de assemblies.dyn (Dynamo 4.0.2.3852)
# Diagnostico de assemblies: nombre, elementos, tamano local (bbox), escala sugerida y origen del transform.

actualizar_correr_de_nuevo = BoolSelector(true)  # graph input
py_auditar_assemblies = Python(IN[0]=actualizar_correr_de_nuevo)  # CPython3
# ---------- py_auditar_assemblies.python (60 lines) ----------
# 00_Auditoria de assemblies - Diagnostico de assemblies (Revit 2027 / Dynamo 4 / CPython3)
refresh = IN[0]  # solo fuerza la re-ejecucion desde Dynamo Player

import clr
clr.AddReference('RevitAPI')
clr.AddReference('RevitServices')
from Autodesk.Revit.DB import FilteredElementCollector, AssemblyInstance, UnitUtils, UnitTypeId, XYZ
from RevitServices.Persistence import DocumentManager

doc = DocumentManager.Instance.CurrentDBDocument

def to_m(v):
    return UnitUtils.ConvertFromInternalUnits(v, UnitTypeId.Meters)

rows = []
ais = list(FilteredElementCollector(doc).OfClass(AssemblyInstance))
rows.append('Assemblies encontrados: {}'.format(len(ais)))
rows.append('nombre | elementos | ancho x largo x alto (bbox local) | escala | origen del transform')
rows.append('-' * 80)

for ai in sorted(ais, key=lambda a: a.AssemblyTypeName):
    try:
        t = ai.GetTransform()
        tinv = t.Inverse
        members = list(ai.GetMemberIds())
        mins = [float('inf')] * 3
        maxs = [float('-inf')] * 3
        for mid in members:
            el = doc.GetElement(mid)
            bb = el.get_BoundingBox(None)
            if bb is None:
                continue
            for x in (bb.Min.X, bb.Max.X):
                for y in (bb.Min.Y, bb.Max.Y):
                    for z in (bb.Min.Z, bb.Max.Z):
                        p = tinv.OfPoint(XYZ(x, y, z))
                        vals = (p.X, p.Y, p.Z)
                        for i in range(3):
                            if vals[i] < mins[i]:
                                mins[i] = vals[i]
                            if vals[i] > maxs[i]:
                                maxs[i] = vals[i]
        if mins[0] == float('inf'):
            rows.append('{} | sin geometria con bounding box'.format(ai.AssemblyTypeName))
            continue
        dx = to_m(maxs[0] - mins[0])
        dy = to_m(maxs[1] - mins[1])
        dz = to_m(maxs[2] - mins[2])
        escala = 50 if (dx > 3.0 or dy > 3.0) else 20
        o = t.Origin
        rows.append('{} | {} elem | {:.2f} x {:.2f} x {:.2f} m | 1:{} | ({:.2f}, {:.2f}, {:.2f}) m'.format(
            ai.AssemblyTypeName, len(members), dx, dy, dz, escala,
            to_m(o.X), to_m(o.Y), to_m(o.Z)))
    except Exception as e:
        rows.append('{} | ERROR: {}'.format(ai.AssemblyTypeName, e))

if len(ais) == 0:
    rows.append('No hay assemblies en el documento activo.')

OUT = rows
# ----------------------------------------
reporte = Watch(py_auditar_assemblies)  # graph output
