# Dynamo graph 00_Vistas de assembly.dyn (Dynamo 4.0.2.3852)
# Por assembly: 1 planta NIPB + N plantas T.A. + 1 planta P.T., todas sobre niveles que el proyectista modela (N.I.P.B._<assembly>, P.T._<assembly>, T.A._<assembly>_NN) + 1 elevacion por cada eje MARCADO con el parametro ASSEMBLY (parametro de proyecto de texto en la categoria Grids, con el nombre del assembly escrito en cada eje). Escribe un nombre en "04. Subcarpeta" y se crea un tipo de vista con ese nombre para agrupar todo en el Project Browser. Idempotente: salta las vistas que ya existen (usa "Recrear" para rehacerlas).

n01_procesar_todos_los_assemblies = BoolSelector(true)  # "01. Procesar TODOS los assemblies"; graph input
n02_filtro_por_nombre_si_todos = StringInput("")  # "02. Filtro por nombre (si TODOS = False)"; graph input
n03_recrear_vistas_existentes = BoolSelector(false)  # "03. Recrear vistas existentes (borra y rehace)"; graph input
n10_offset_del_corte_nipb_sobre = IntegerSlider(100, range=0..500 step 10)  # "10. Offset del corte NIPB sobre el nivel N.I.P.B._<assembly> (cm)"; graph input
n13_offset_del_corte_sobre_los = IntegerSlider(100, range=0..500 step 10)  # "13. Offset del corte sobre los niveles T.A._<assembly> y P.T._<assembly> (cm)"; graph input
n05_tipo_de_vista_base_se_duplica = StringInput("02_ESTRUCTURAS")  # "05. Tipo de vista BASE (se duplica para la subcarpeta)"; graph input
n06_view_template_plantas_t_a_y_p = StringInput("DISP.GRAL_1/150_PLAN")  # "06. View template - PLANTAS T.A. y P.T. (vacio = ninguno)"; graph input
n15_margen_del_crop_mm = IntegerSlider(10, range=0..100 step 1)  # "15. Margen del crop (mm)"; graph input
n09_escala_de_las_plantas_1_n = IntegerSlider(75, range=10..500 step 5)  # "09. Escala de las PLANTAS (1:N)"; graph input
n16_far_clip_de_las_elevaciones = IntegerSlider(5500, range=500..30000 step 500)  # "16. Far Clip de las elevaciones (mm)"; graph input
n14_profundidad_de_las_plantas = IntegerSlider(50, range=10..1000 step 10)  # "14. Profundidad de las plantas bajo el nivel (cm)"; graph input
n00_subcarpeta_juego_de_vistas = StringInput("")  # "00. Subcarpeta / juego de vistas (vacio = sin subcarpeta)"; graph input
n08_view_template_elevaciones_de = StringInput("ESTRUCTURAS_1/50")  # "08. View template - ELEVACIONES DE EJE (vacio = ninguno)"; graph input
n07_view_template_nipb_debe = StringInput("ESTRUCTURAS_1/50")  # "07. View template - NIPB (debe mostrar conexiones)"; graph input
n09b_escala_de_los_cortes_1_n = IntegerSlider(75, range=10..500 step 5)  # "09b. Escala de los CORTES (1:N)"; graph input
py_nipb_plantas_t_a_elevaciones = Python(IN[0]=n01_procesar_todos_los_assemblies, IN[1]=n02_filtro_por_nombre_si_todos, IN[2]=n03_recrear_vistas_existentes, IN[3]=n10_offset_del_corte_nipb_sobre, IN[4]=n13_offset_del_corte_sobre_los, IN[5]=n05_tipo_de_vista_base_se_duplica, IN[6]=n06_view_template_plantas_t_a_y_p, IN[7]=n15_margen_del_crop_mm, IN[8]=n09_escala_de_las_plantas_1_n, IN[9]=n16_far_clip_de_las_elevaciones, IN[10]=n14_profundidad_de_las_plantas, IN[11]=n00_subcarpeta_juego_de_vistas, IN[12]=n08_view_template_elevaciones_de, IN[13]=n07_view_template_nipb_debe, IN[14]=n09b_escala_de_los_cortes_1_n)  # "PY | NIPB + plantas T.A. + elevaciones de eje"; PythonNet3
# ---------- py_nipb_plantas_t_a_elevaciones.python (2123 lines) ----------
# 00_Vistas de assembly - ACERO: plantas NIPB, P.T. y T.A. sobre niveles modelados
# + una elevacion por cada eje MARCADO con el parametro ASSEMBLY (ver ejes_del_assembly).
# Revit 2027 / Dynamo 4 / CPython3
# IN[0]  = procesar todos los assemblies (bool)
# IN[1]  = filtro por nombre si IN[0] es False (parcial, separado por comas)
# IN[2]  = recrear vistas existentes (bool) - borra y vuelve a crear
# IN[3]  = offset del plano de corte NIPB sobre el nivel N.I.P.B._<assembly> (cm)
# IN[4]  = offset del plano de corte sobre el nivel T.A._... y sobre el P.T._... (cm)
# IN[5]  = nombre del tipo de vista, comun a plantas y elevaciones (ej. 02_ESTRUCTURAS);
#          para las elevaciones se resuelve como ViewFamilyType de Section
# IN[6]  = view template de las PLANTAS T.A. y P.T. (vacio = ninguno; si no existe, avisa)
# IN[7]  = margen del crop sobre el borde del assembly, en mm de papel
# IN[8]  = escala de las PLANTAS (1:N)
# IN[14] = escala de los CORTES (1:N); vacio = la misma que las plantas
# IN[9]  = Far Clip Offset (mm) de las ELEVACIONES de eje (las plantas usan IN[10])
# IN[10] = profundidad de las PLANTAS por debajo de su nivel (cm)
# IN[11] = subcarpeta del Project Browser: se crea un TIPO DE VISTA con ese nombre
#          (duplicado del tipo base de IN[5]) y se asigna a todas las vistas, que es
#          lo que hace aparecer el nodo en el browser. Vacio = usar el tipo de IN[5].
# IN[12] = view template de las ELEVACIONES DE EJE (vacio = ninguno; si no existe, avisa)
# IN[13] = view template de la NIPB (debe mostrar Structural Connections)
#
# Los dos inputs del clustering geometrico de T.A. -tolerancia de agrupacion y minimo
# de vigas por nivel- se eliminaron el 2026-08-10 junto con el clustering: los niveles
# ahora los modela el proyectista. Por eso las etiquetas del Player saltan de la 10 a
# la 13: se prefirio dejar el hueco antes que renumerar referencias ya documentadas.

# NOTA DE DISEÑO (2026-07-28): las plantas NO se crean con AssemblyViewUtils.
# Una vista de assembly limita lo que muestra a los MIEMBROS del assembly y por eso
# nunca dibuja datums: verificado en el modelo real, la planta de assembly devolvia
# 0 ejes mientras una ViewPlan normal del mismo sector devolvia 54. Sin ejes visibles
# tampoco se ven las cotas entre ejes de 03, porque sus referencias son los ejes.
# Por eso las plantas son ViewPlan normales, recortadas al assembly y AISLADAS a sus
# miembros + los ejes marcados con ASSEMBLY - la misma tecnica que ya funcionaba en las
# elevaciones de eje.

import clr
import math
clr.AddReference('RevitAPI')
clr.AddReference('RevitServices')
from Autodesk.Revit.DB import (FilteredElementCollector, AssemblyInstance,
                               View, UnitUtils, UnitTypeId, XYZ, Element,
                               BuiltInParameter, BuiltInCategory,
                               ElementId, ViewFamilyType, ViewFamily, StorageType,
                               BoundingBoxXYZ, ViewDetailLevel, Options, Solid,
                               GeometryInstance, FamilyInstance, ViewSection,
                               Grid, Line, Transform, ViewPlan, Level,
                               PlanViewPlane, OverrideGraphicSettings,
                               GraphicsStyleType, SharedParameterElement)
from RevitServices.Persistence import DocumentManager
from RevitServices.Transactions import TransactionManager
from System.Collections.Generic import List
from System import Guid

doc = DocumentManager.Instance.CurrentDBDocument

process_all = bool(IN[0])
filter_text = (IN[1] or '').strip()
recreate = bool(IN[2])
off_nipb = float(IN[3]) / 30.48        # cm -> pies
off_ta = float(IN[4]) / 30.48          # cm -> pies
sec_type_text = (IN[5] or '').strip()
tpl_text_planta = (IN[6] or '').strip()
crop_margin_mm = float(IN[7])
escala_planta = int(IN[8]) if IN[8] else 75
# Desde el 2026-09-19 los cortes tienen su propia escala: una elevacion de eje suele
# necesitar mas detalle que la planta del mismo assembly. Vacio = la de las plantas, asi
# una corrida vieja se comporta igual que antes de separarlas.
escala_corte = int(IN[14]) if IN[14] else escala_planta


def escala_de(v):
    # ViewPlan -> planta; cualquier otra cosa que cree este graph es un corte
    return escala_planta if isinstance(v, ViewPlan) else escala_corte
far_clip = float(IN[9]) / 304.8 if IN[9] else 5500.0 / 304.8   # mm -> pies
# El MISMO nombre de tipo sirve para plantas y elevaciones: son ViewFamilyType
# distintos (Floor Plan vs Section) que en este proyecto se llaman igual
# ("02_ESTRUCTURAS"). Cada uno se resuelve dentro de su propia ViewFamily.
plan_type_text = sec_type_text
prof_planta = float(IN[10]) / 30.48 if IN[10] else 50.0 / 30.48   # cm -> pies
CHARS_PROHIBIDOS = ':;|?~`<>' + chr(92) + chr(91) + chr(93) + '{}'


def limpiar_nombre(s):
    # Revit RECHAZA estos caracteres en el nombre de cualquier elemento. Es la causa del
    # bug del 2026-09-17: la marca de juego se escribia entre corchetes y set_name tiraba
    # excepcion, que subia hasta el except del assembly y abortaba la corrida entera
    # -quedaba la planta NIPB sin renombrar y NINGUNA elevacion-.
    return ''.join(c for c in (s or '') if c not in CHARS_PROHIBIDOS).strip()


nombre_carpeta = limpiar_nombre(IN[11])

# MARCA DE JUEGO (2026-09-17). El nombre de la subcarpeta entra en el NOMBRE de cada vista,
# no solo en su tipo. Antes la identidad de una vista era su nombre pelado, asi que volver a
# correr 00 en un proyecto ya maquetado caia sobre las MISMAS vistas: se las reutilizaba y se
# les reaplicaban los ajustes, o con "recrear" se las borraba y se iban de la lamina, tirando
# abajo el trabajo del modelador que ya las habia acotado y ordenado.
#
# Con la marca, correr 00 con OTRO nombre de carpeta crea un JUEGO NUEVO de vistas y deja el
# anterior intacto. Revit exige nombres de vista unicos, asi que meter la marca en el nombre
# no es una preferencia: es la unica forma de que dos juegos convivan.
#
# Va al FINAL a proposito: 01..05 buscan sus vistas con startswith(tname + SUF_*), y un
# sufijo no rompe ninguno de esos prefijos. Los tres graphs de anotacion ya saltan lo que
# esta hecho -03 con ya_cotas/ya_marcas, 04 y 05 con su input "rehacer"-, asi que con dos
# juegos conviviendo anotan el nuevo y respetan el viejo, sin necesidad de un input mas.
# PARENTESIS, no corchetes: Revit rechaza [ ] en el nombre de un elemento, y el rechazo
# abortaba la corrida entera. Los parentesis son legales -el propio Revit los usa para
# desduplicar, "NIVEL(1)"-.
MARCA_JUEGO = ' ({})'.format(nombre_carpeta) if nombre_carpeta else ''


def vname_de(base):
    # nombre final de una vista: su nombre de siempre mas la marca del juego
    return base + MARCA_JUEGO


# Nombres que Revit le pone solo a un assembly recien creado: "Structural Framing 001",
# "Assembly 3"... Si el modelador no lo renombro, NADA del pipeline puede funcionar, porque
# los niveles y el marcado de los ejes se anclan al nombre del assembly.
def nombre_automatico(tname):
    n = (tname or '').strip()
    if not n:
        return False
    # termina en un numero y lo de antes no parece un codigo de obra (ES-1001)
    partes = n.rsplit(' ', 1)
    if len(partes) != 2 or not partes[1].isdigit():
        return False
    cabeza = partes[0].strip().lower()
    return cabeza in ('structural framing', 'structural columns', 'structural connections',
                      'assembly', 'multi-category', 'generic models', 'structural foundations')

def juego_de(vname):
    # la marca que lleva ese nombre al final, o '' si no lleva ninguna
    if vname.endswith(')'):
        i = vname.rfind(' (')
        if i >= 0:
            return vname[i:]
    return ''


def es_de_este_juego(vname):
    # NO alcanza con vname.endswith(MARCA_JUEGO): con la carpeta vacia la marca es '' y
    # endswith('') da True para TODO, asi que "recrear" sin carpeta se llevaria puestas
    # las vistas de todos los juegos del proyecto. Hay que comparar la marca completa.
    return juego_de(vname) == MARCA_JUEGO
tpl_text_elevacion = (IN[12] or '').strip()
# La NIPB lleva su PROPIO template, distinto al de las plantas T.A.
#
# POR QUE (medido el 2026-07-29 con un test controlado sobre ES-1001): la vista
# ES-1001 - NIPB, con template DISP.GRAL_1/150_PLAN, mostraba 0 elementos de
# Structural Connections; la elevacion ES-1001 - EJE 3a, del MISMO assembly, con
# el mismo aislamiento y con template ESTRUCTURAS_1/50, mostraba 96. Mismo
# documento, misma geometria: la unica variable era el template.
#
# DISP.GRAL_1/150_PLAN apaga esa categoria -a 1:150 las sillas de anclaje serian
# ruido- y como el template controla V/G, SetCategoryHidden ni siquiera puede
# sobrescribirlo: Revit responde "Category cannot be hidden". Sin las sillas la
# NIPB queda con 4 columnas flotando, que es el sintoma de "sale muy arriba y sin
# profundidad". La unica salida real es darle a la NIPB un template que las muestre.
tpl_text_nipb = (IN[13] or '').strip()

# Holgura del plano Top por encima del plano de corte. NO puede ser cero: un View
# Range con Top == Cut es degenerado y colapsa el espesor del CropBox, dejando la
# vista sin dibujar (Revit ni siquiera la puede abrir). 10 cm alcanzan para que el
# rango sea valido sin arrastrar el nivel de arriba a la planta.
HOLGURA_TOP = 10.0 / 30.48   # cm -> pies

# Separacion minima que se deja entre el plano de corte (o el fondo) de una planta
# T.A. y el nivel T.A. vecino. Evita que una planta dibuje el nivel de al lado
# cuando los niveles estan mas juntos que el offset del corte.
SEP_NIVEL = 20.0 / 30.48     # cm -> pies

# El View Depth baja MAS que el Bottom. Lo que cae en esa franja Revit lo dibuja con el
# estilo <Beyond> -linea mas fina- en vez de con el grafismo normal de la planta.
#
# Es la diferencia entre mostrar y mostrar como contexto. En una planta T.A. la trama del
# nivel propio tiene que leerse como el dibujo principal, y lo que cuelga por debajo
# -vigas secundarias mas bajas, el nivel de abajo asomando- tiene que estar pero sin
# competir. Con Bottom y View Depth pegados en el mismo valor, como estaba hasta el
# 2026-08-11, todo salia con el mismo peso de linea: medido en ES-1001 - T.A. 01, la
# vista mezclaba las vigas de AMT_T.A.-01 (z 10,74 a 11,73 pies) con las de AMT_T.A.-02
# (z 12,06 a 13,04) sin ninguna diferencia grafica entre los dos pisos.
#
# Solo aplica a las plantas T.A.: la NIPB y la P.T. siguen con Bottom == View Depth.
PROF_BEYOND = 50.0 / 30.48   # cm -> pies

# --- Grafismo uniforme de las vigas en planta (ver unificar_corte_con_proyeccion) ---
# Revit dibuja con el grafico de CUT lo que el plano de corte rebana, y con el de
# PROJECTION lo que queda por debajo. Son dos ajustes distintos de la misma categoria en
# Object Styles, y con colores distintos una misma tanda de vigas sale de dos colores.
#
# Medido el 2026-08-11 en ES-1001 - T.A. 01: el nivel esta en z 13,06 pies y el plano de
# corte en 16,34; las vigas C25x17,9 de la banda 15,72 a 16,54 lo cruzan 6 cm por debajo
# de su tope, asi que salen con el grafico de Cut mientras el resto de la planta sale con
# el de Projection.
#
# Bajar el corte no sirve: las dejaria POR ENCIMA y desaparecerian. Subirlo tampoco es
# robusto, porque depende de cuanto sobresalga la viga mas alta de cada assembly. Lo que
# se hace es copiar el grafismo de Projection de la categoria al override de Cut de la
# vista, que no depende de ningun numero.
#
# El color NO se escribe aca: se lee de la propia categoria en runtime, asi que sigue
# siendo un estandar del proyecto y no un valor de este script.
UNIFICAR_GRAFISMO_VIGAS = True
CATS_GRAFISMO_UNIFORME = ('OST_StructuralFraming',)

# --- Que se oculta en las plantas BASE: la NIPB y la P.T. (ver ocultar_en_planta_base) ---
# Las dos miran la zona de anclaje y les sirve lo mismo: a esas cotas lo que se documenta
# son las placas y las sillas, no la trama de vigas ni la escalera.
#
# A la cota de la placa base la escalera no dice nada: lo unico que interesa de ella
# son sus placas de anclaje. Pero la escalera es UNA familia con todo anidado adentro,
# asi que ocultarla entera se lleva puestas las placas. De ahi las dos listas.
#
# Medido el 2026-08-11 en el modelo de referencia: el contenedor ESCALERA METALICA
# (id 6950307) va de z 3,08 a 16,60 pies y sus dos VM ANGULO (6950324 y 6950325) caen
# dentro, en z 3,30 a 3,83 -o sea al pie de la escalera, justo a la cota de la NIPB.
#
# El match es por CONTIENE, sin tildes y sin distinguir mayusculas, porque el modelador
# nombra cada escalera distinto: en este modelo conviven ESCALERA METALICA (con tilde),
# ESCALERA METALICA_1 ESC y ESCALERA METALICA1. Con nombre exacto habria que listar las
# tres y la proxima variante volveria a fallar.
#
# Ojo con la excepcion: PILAR ANGULO tambien vive anidado en la escalera y tambien
# termina en ANGULO. Hoy queda fuera de la NIPB por altura (z 12,6 pies), pero salvar
# ANGULO a secas lo dejaria entrar. Por eso la excepcion es VM ANGULO completo.
#
# PLACA salva las placas de trabajo -S-Placa Vertical y compania-, que tienen que verse
# SIEMPRE en la P.T. Hoy no hace falta para que se vean: son Structural Connections, o
# sea justo la categoria que estas plantas existen para mostrar, y CATS_OCULTAR_BASE solo
# tapa framing. Esta en la lista para que la garantia sea EXPLICITA y no dependa de ese
# accidente: si manana alguien agrega OST_StructConnections a CATS_OCULTAR_BASE, o si una
# placa termina anidada dentro de una familia que matchee FAMS_OCULTAR_BASE, la excepcion
# la sigue salvando en vez de que desaparezca en silencio.
#
# El match suelto por PLACA es a proposito -el modelador la nombra S-Placa Vertical o
# algo con PLACA- y es seguro: medido el 2026-08-11, las 387 instancias del modelo cuya
# familia contiene PLACA son 362 Structural Connections y 25 Generic Model, y NINGUNA es
# Structural Framing, asi que la excepcion no le abre la puerta a ninguna viga.
#
# Vacio FAMS_OCULTAR_BASE = no se oculta nada por familia y las plantas base quedan
# como estaban; lo mismo CATS_OCULTAR_BASE por categoria.
FAMS_OCULTAR_BASE = ('ESCALERA',)
FAMS_SALVAR_BASE = ('VM ANGULO', 'PLACA')

# Categorias que se ocultan ENTERAS en las plantas base, con las mismas excepciones de
# FAMS_SALVAR_BASE. A esas cotas una viga no aporta: lo que se documenta
# ahi son las placas y las sillas, que son Structural Connections. Las columnas NO
# estan en esta lista -son Structural Columns, otra categoria- asi que se siguen viendo
# apoyadas sobre su placa.
#
# Esta lista y FAMS_SALVAR_BASE estan ACOPLADAS: VM ANGULO es Structural Framing, o sea
# que sin la excepcion esta regla se llevaria puestas justo las placas de anclaje que el
# bloque de arriba se ocupa de salvar. La excepcion gana sobre las dos reglas y por eso
# se evalua al final.
#
# Casi todo lo que oculta FAMS_OCULTAR_BASE tambien es framing, pero las dos reglas se
# componen y ninguna sobra: la baranda de la escalera es categoria Balusters y el
# grating y los detail items tampoco son framing.
#
# Son nombres de BuiltInCategory; uno que no exista se ignora con aviso en el log.
CATS_OCULTAR_BASE = ('OST_StructuralFraming',)

# --- Piezas diagonales en las plantas T.A. (ver ocultar_diagonales_ta) ---
# En una planta T.A. lo que se documenta es la trama HORIZONTAL de ese nivel. Las
# diagonales que cuelgan por debajo de las vigas -arriostramientos- se dibujan
# cruzadas sobre la planta y la ensucian, y aparecen justamente cuando se baja la
# profundidad de la vista para alcanzar las vigas mas bajas.
#
# El criterio es GEOMETRICO, por la pendiente de la curva de ubicacion, y no por
# nombre de familia: medido el 2026-08-11, en este modelo no existe ninguna familia
# que se llame RIOSTRA, DIAGONAL ni BRACE -las diagonales son perfiles comunes
# colocados inclinados- asi que no hay ningun nombre al que agarrarse.
#
# Una pieza VERTICAL no cuenta como diagonal: en planta es un punto y es informacion
# legitima (montantes, columnas cortas). Solo se ocultan las inclinadas.
OCULTAR_DIAGONALES_TA = True
ANG_DIAGONAL_GRADOS = 15.0   # mas inclinada que esto respecto de la horizontal
TOL_PUNTO = 0.0033           # pies (~1 mm): por debajo de esto la pieza es un punto en planta

CAT_FRAMING = ElementId(BuiltInCategory.OST_StructuralFraming).Value

# las etiquetas de la NIPB y de la P.T. son ademas las llaves con las que el bucle de
# aislamiento reconoce cuales de las plantas llevan las reglas de arriba: si fueran
# literales sueltos, renombrar una etiqueta apagaria su regla en silencio.
ETIQ_NIPB = 'planta NIPB'
ETIQ_PT = 'planta P.T.'     # + correlativo: la etiqueta identifica a UNA vista

log = []

# --- contrato de nombres (lo usan 01, 02, 03, 04, 06 y 07 para encontrar las vistas) ---
# El NOMBRE INTERNO de la vista es estable y correlativo; el TITULO EN LAMINA
# (Title on Sheet / VIEW_DESCRIPTION) es el legible y puede llevar la cota.
SUF_NIPB = ' - NIPB'
SUF_PT = ' - P.T. '        # + correlativo de 2 digitos, ascendente por altura
SUF_TA = ' - T.A. '        # + correlativo de 2 digitos, ascendente por altura
SUF_EJE = ' - EJE '        # + nombre del eje
TIT_NIPB = ' - PLANTA N.I.P.B.'
TIT_PT = ' - PLANTA P.T. (EL. {})'
TIT_TA = ' - PLANTA T.A. (EL. {})'
TIT_EJE = ' - ELEVACION EJE {}'

def to_m(v):
    return UnitUtils.ConvertFromInternalUnits(v, UnitTypeId.Meters)


def fmt_cota(m):
    # formato chileno (punto de miles, coma decimal), igual que las vistas que ya
    # existen en el modelo: "PLANTA ESTRUCTURA EL. 2.305,25 T.A."
    s = '{:,.2f}'.format(m)
    return s.replace(',', '@').replace('.', ',').replace('@', '.')


def elem_name(e):
    try:
        return e.Name
    except Exception:
        return Element.Name.__get__(e)


def set_name(e, name):
    try:
        e.Name = name
        return True
    except Exception:
        pass
    try:
        Element.Name.__set__(e, name)
        return True
    except Exception as ex:
        # NO se relanza: una vista con el nombre equivocado es un problema, pero abortar
        # el assembly completo es peor, y sin este log la causa es invisible.
        log.append('ERROR: Revit rechazo el nombre "{}" ({}). No admite {} en el nombre '
                   'de un elemento.'.format(name, ex, CHARS_PROHIBIDOS))
        return False


# --- tipo de vista para las elevaciones de eje (debe ser ViewFamily.Section) ---
sec_vft = None
tipos_section = [t for t in FilteredElementCollector(doc).OfClass(ViewFamilyType)
                 if t.ViewFamily == ViewFamily.Section]
if sec_type_text:
    low = sec_type_text.lower()
    for t in tipos_section:
        if elem_name(t).lower() == low:
            sec_vft = t
            break
    if sec_vft is None:
        log.append('AVISO: no existe el tipo de vista de seccion {}; se usa el primero disponible.'.format(sec_type_text))
        log.append('Tipos de Section en este proyecto: ' + ', '.join(sorted(elem_name(t) for t in tipos_section)))
if sec_vft is None:
    if tipos_section:
        sec_vft = sorted(tipos_section, key=lambda t: elem_name(t))[0]
    else:
        log.append('ERROR: no hay ningun ViewFamilyType de tipo Section en el proyecto; no se pueden crear elevaciones de eje.')

# --- tipo de vista para las plantas (StructuralPlan o FloorPlan) ---
plan_vft = None
FAMILIAS_PLAN = (ViewFamily.StructuralPlan, ViewFamily.FloorPlan)
tipos_plan = [t for t in FilteredElementCollector(doc).OfClass(ViewFamilyType)
              if t.ViewFamily in FAMILIAS_PLAN]
if plan_type_text:
    lowp = plan_type_text.lower()
    for t in tipos_plan:
        if elem_name(t).lower() == lowp:
            plan_vft = t
            break
    if plan_vft is None:
        log.append('AVISO: no existe el tipo de vista de planta {}; se usa el primero disponible.'.format(plan_type_text))
        log.append('Tipos de planta en este proyecto: ' + ', '.join(sorted(elem_name(t) for t in tipos_plan)))
if plan_vft is None:
    # se prefiere StructuralPlan sobre FloorPlan
    estructurales = [t for t in tipos_plan if t.ViewFamily == ViewFamily.StructuralPlan]
    fuente = estructurales if estructurales else tipos_plan
    if fuente:
        plan_vft = sorted(fuente, key=lambda t: elem_name(t))[0]
    else:
        log.append('ERROR: no hay ningun ViewFamilyType de planta (StructuralPlan/FloorPlan) en el proyecto.')


def tipo_carpeta(base_vft, familias, etiqueta, sufijo_alterno=''):
    # "Subcarpeta del Project Browser" = un TIPO DE VISTA propio.
    #
    # El Project Browser agrupa las vistas por "Family and Type", asi que la forma
    # de conseguir un nodo propio SIN depender de que alguien configure a mano un
    # esquema de Browser Organization es crear un ViewFamilyType con ese nombre y
    # asignarselo a todas las vistas. Se duplica del tipo base (input 05) para
    # heredar su grafismo.
    #
    # OJO: la ViewFamily (Floor Plans / Sections) es un nivel de agrupacion POR
    # ENCIMA del tipo, asi que esto da DOS nodos con el mismo nombre -uno con las
    # plantas y otro con las elevaciones-, no una carpeta unica con todo. Una
    # carpeta unica que mezcle ambas solo se logra con un esquema de Browser
    # Organization que agrupe por un parametro compartido.
    #
    # Duplicate() necesita una transaccion abierta: se llama desde el bloque
    # principal, no aca arriba.
    if not nombre_carpeta or base_vft is None:
        return base_vft

    # REVIT NO ADMITE DOS ViewFamilyType CON EL MISMO NOMBRE, ni siquiera en familias
    # distintas (2026-09-17). Las plantas se llaman primero y se quedan con el nombre
    # pelado; cuando le tocaba a las elevaciones, Duplicate() tiraba excepcion, se
    # capturaba y se devolvia el tipo base: las elevaciones quedaban FUERA de la carpeta
    # mientras las plantas entraban. Visto en el modelo real: un tipo "TEST" de plantas y
    # las 17 elevaciones en el tipo "Assembly".
    #
    # Por eso cada familia trae su propio nombre alterno y se prueban en orden.
    posibles = [nombre_carpeta]
    if sufijo_alterno:
        posibles.append(nombre_carpeta + sufijo_alterno)
    bajos = [n.lower() for n in posibles]

    tomados = set()
    for t in FilteredElementCollector(doc).OfClass(ViewFamilyType):
        nm = elem_name(t).lower()
        # reutilizar: sirve cualquiera de los nombres posibles, con tal de que sea de
        # ESTA familia. Sin esto, cada corrida crearia un tipo nuevo.
        if t.ViewFamily in familias and nm in bajos:
            return t
        tomados.add(nm)

    for nom in posibles:
        if nom.lower() in tomados:
            continue
        try:
            nuevo = base_vft.Duplicate(nom)
            log.append('Carpeta "{}": tipo de vista "{}" creado para {} (duplicado de "{}").'.format(
                nombre_carpeta, nom, etiqueta, elem_name(base_vft)))
            return nuevo
        except Exception as e:
            log.append('AVISO: no se pudo crear el tipo de vista "{}" para {}: {}'.format(nom, etiqueta, e))
    log.append('ERROR: {} se quedan en el tipo base "{}" y NO entran en la carpeta "{}"; '
               'los nombres {} ya estan tomados por otra familia de vistas.'.format(
                   etiqueta, elem_name(base_vft), nombre_carpeta, ' y '.join(posibles)))
    return base_vft

# --- niveles: DEFINEN la cota de cada planta y anclan su View Range ---
# Desde el 2026-08-10 el nivel manda: la planta se crea sobre el Level modelado y los
# offsets del View Range se miden desde su elevacion. Ver niveles_del_assembly().
def elev_nivel(l):
    # SIEMPRE ProjectElevation, NUNCA Elevation.
    # Este modelo usa "Elevation Base = Shared": los niveles reportan la cota real
    # del sitio (~7546 pies = 2300 m, el salar) mientras la geometria vive cerca del
    # origen del proyecto (una columna medida da Z = 3,84 a 10,83 pies). Anclar el
    # View Range con Elevation mandaba el plano de corte ~7538 pies fuera del modelo:
    # las plantas salian VACIAS y, sin plano de corte que cruzara sus extensiones,
    # los ejes tampoco se dibujaban. ProjectElevation va siempre en coordenadas de
    # proyecto, el mismo sistema en el que se mide la geometria.
    try:
        return l.ProjectElevation
    except Exception:
        return l.Elevation


niveles = sorted(FilteredElementCollector(doc).OfClass(Level), key=elev_nivel)
if not niveles:
    log.append('ERROR: el proyecto no tiene ningun Level; ViewPlan.Create no puede crear plantas.')
else:
    try:
        _l0 = niveles[0]
        if abs(_l0.Elevation - _l0.ProjectElevation) > 0.01:
            log.append('NOTA: el modelo usa cota compartida (nivel {}: Elevation {} m vs ProjectElevation {} m).'.format(
                elem_name(_l0), fmt_cota(to_m(_l0.Elevation)), fmt_cota(to_m(_l0.ProjectElevation))))
            log.append('      El View Range se ancla con ProjectElevation, que es el sistema de la geometria.')
    except Exception:
        pass


# --- view templates: uno para plantas, otro para elevaciones de eje ---
templates = [t for t in FilteredElementCollector(doc).OfClass(View) if t.IsTemplate]


def resolver_template(nombre, etiqueta):
    if not nombre:
        log.append('Sin view template para {} (campo vacio).'.format(etiqueta))
        return None
    low = nombre.lower()
    for t in templates:
        if elem_name(t).lower() == low:
            return t
    cands = [t for t in templates if low in elem_name(t).lower()]
    if len(cands) == 1:
        return cands[0]
    log.append('AVISO: no existe un view template de {} que coincida con {}; esas vistas quedan sin template.'.format(etiqueta, nombre))
    return None


view_template_planta = resolver_template(tpl_text_planta, 'las plantas')
view_template_elevacion = resolver_template(tpl_text_elevacion, 'las elevaciones de eje')
view_template_nipb = resolver_template(tpl_text_nipb, 'la planta NIPB')
if templates:
    log.append('Templates cargados en el proyecto: ' + ', '.join(sorted(elem_name(t) for t in templates)))
else:
    log.append('AVISO: no hay ningun view template cargado en este proyecto.')

# --- assemblies unicos por tipo ---
by_type = {}
for ai in FilteredElementCollector(doc).OfClass(AssemblyInstance):
    by_type.setdefault(ai.AssemblyTypeName, []).append(ai)

if not by_type:
    log.append('AVISO: no hay ningun Assembly en el modelo. Todo este pipeline es assembly-driven:')
    log.append('  crea los assemblies en Revit (Modificar > Crear ensamblaje) y vuelve a correr.')

if process_all:
    targets = sorted(by_type.keys())
else:
    tokens = [t.strip().lower() for t in filter_text.split(',') if t.strip()]
    if tokens:
        targets = [n for n in sorted(by_type.keys())
                   if any(tok in n.lower() for tok in tokens)]
    else:
        targets = []
        log.append('ERROR: "Procesar todos" esta en False y el filtro esta vacio.')
    log.append('Filtro "{}": {} assemblies seleccionados.'.format(filter_text, len(targets)))

# vistas existentes por nombre (para idempotencia)
view_ids = {}
for v in FilteredElementCollector(doc).OfClass(View):
    if not v.IsTemplate:
        view_ids[elem_name(v)] = v.Id


def member_solid_bbox(el):
    # bounding box de el a partir de su geometria SOLIDA real (Volume > 0), en vez
    # de Element.get_BoundingBox() - que puede devolver un bbox "fantasma" (de
    # referencias/work planes) para elementos con geometria vacia o degenerada.
    # Devuelve None si el elemento no tiene ningun solido valido, asi el llamador
    # puede excluirlo del calculo en vez de heredar un tamaño inventado.
    opt = Options()
    opt.DetailLevel = ViewDetailLevel.Fine
    try:
        geo = el.get_Geometry(opt)
    except Exception:
        geo = None
    if geo is None:
        return None
    minx = miny = minz = float('inf')
    maxx = maxy = maxz = float('-inf')
    hay = False

    def puntos(solid, trf):
        sbb = solid.GetBoundingBox()
        for x in (sbb.Min.X, sbb.Max.X):
            for y in (sbb.Min.Y, sbb.Max.Y):
                for z in (sbb.Min.Z, sbb.Max.Z):
                    p = sbb.Transform.OfPoint(XYZ(x, y, z))
                    if trf is not None:
                        p = trf.OfPoint(p)
                    yield p

    pts = []
    for g in geo:
        if isinstance(g, Solid) and g.Volume > 1e-9:
            pts.extend(list(puntos(g, None)))
        elif isinstance(g, GeometryInstance):
            for sg in g.GetSymbolGeometry():
                if isinstance(sg, Solid) and sg.Volume > 1e-9:
                    pts.extend(list(puntos(sg, g.Transform)))
    for p in pts:
        hay = True
        if p.X < minx: minx = p.X
        if p.X > maxx: maxx = p.X
        if p.Y < miny: miny = p.Y
        if p.Y > maxy: maxy = p.Y
        if p.Z < minz: minz = p.Z
        if p.Z > maxz: maxz = p.Z
    if not hay:
        return None

    class _BB(object):
        pass
    r = _BB()
    r.Min = XYZ(minx, miny, minz)
    r.Max = XYZ(maxx, maxy, maxz)
    return r


def instancias_recursivas(ai):
    # TODAS las FamilyInstance del assembly (contenedores y hojas, cualquier
    # profundidad de anidamiento).
    vistos = set()
    resultado = []
    stack = list(ai.GetMemberIds())
    while stack:
        eid = stack.pop()
        if eid.Value in vistos:
            continue
        vistos.add(eid.Value)
        el = doc.GetElement(eid)
        if el is None or not isinstance(el, FamilyInstance):
            continue
        resultado.append(el)
        try:
            stack.extend(list(el.GetSubComponentIds()))
        except Exception:
            pass
    return resultado


def ids_recursivos(ai):
    # TODOS los ElementId del assembly (cualquier clase, cualquier profundidad).
    # Se usa para aislar el assembly en las elevaciones de eje, que son secciones
    # normales del modelo (no vistas de assembly) y por defecto muestran todo.
    vistos = set()
    resultado = []
    stack = list(ai.GetMemberIds())
    while stack:
        eid = stack.pop()
        if eid.Value in vistos:
            continue
        vistos.add(eid.Value)
        resultado.append(eid)
        el = doc.GetElement(eid)
        if isinstance(el, FamilyInstance):
            try:
                stack.extend(list(el.GetSubComponentIds()))
            except Exception:
                pass
    # --- Structural Connections: sillas de anclaje, placas base y pernos ---
    # NO siempre figuran en GetMemberIds() aunque pertenezcan al assembly, y sin
    # ellas en la lista de aislamiento ConvertTemporaryHideIsolateToPermanent las
    # deja ocultas PARA SIEMPRE. Ese era el motivo real de que la NIPB saliera
    # "vacia y muy arriba": medido el 2026-07-29 sobre ES-1001 - NIPB, la vista
    # contenia 4 columnas, 2 vigas y 5 ejes, con las 95 sillas/placas/pernos del
    # assembly invisibles, aunque el View Range era correcto y el template NO
    # controlaba V/G (Visibility/Graphics Overrides salia isReadOnly = False).
    #
    # Element.AssemblyInstanceId es la pertenencia REAL al assembly, mas confiable
    # que GetMemberIds() para estas categorias.
    try:
        aid = ai.Id.Value
        col = FilteredElementCollector(doc).OfCategory(
            BuiltInCategory.OST_StructConnections).WhereElementIsNotElementType()
        for e in col:
            try:
                if e.AssemblyInstanceId.Value != aid:
                    continue
                if e.Id.Value in vistos:
                    continue
                vistos.add(e.Id.Value)
                resultado.append(e.Id)
            except Exception:
                pass
    except Exception:
        pass
    return resultado


# --- marcado del parametro ASSEMBLY ------------------------------------------------------
# Mismo criterio que 06: el GUID NO es fijo. El parametro se rehizo el 2026-09-21 para
# separarlo de DESCRIPCION_ITEM, y los proyectos anteriores siguen con el viejo.
GUIDS_ASSEMBLY = [Guid('93330cd2-7f31-401b-91b7-106c6c1d4454'),   # separado de DESCRIPCION_ITEM
                  Guid('92fdc373-364b-4440-8198-f8093299f73a')]   # el viejo, que la pisaba
GUID_COLISION = GUIDS_ASSEMBLY[1]
ID_CAT_GRIDS = ElementId(BuiltInCategory.OST_Grids).Value


def resolver_guid_assembly():
    # Por GUID y no por nombre: hay un segundo parametro llamado ASSEMBLY -no compartido,
    # solo en Grids- que el modelador llena a mano y que este mismo graph lee para saber que
    # ejes llevan elevacion. Buscar por nombre devolveria ese.
    for g in GUIDS_ASSEMBLY:
        if SharedParameterElement.Lookup(doc, g) is not None:
            return g
    return None


GUID_ASSEMBLY = resolver_guid_assembly()
if GUID_ASSEMBLY is not None and GUID_ASSEMBLY.Equals(GUID_COLISION):
    # NO se escribe. Ese GUID lo comparten ASSEMBLY y DESCRIPCION_ITEM: escribir el nombre
    # del assembly pisaria la descripcion de cada pieza, y ya paso una vez con 1.269 de
    # ellas. El proyecto tiene que actualizar el parametro compartido primero.
    log.append('=' * 78)
    log.append('NO se marco el parametro ASSEMBLY de las piezas, a proposito.')
    log.append('  En este proyecto ASSEMBLY todavia es el parametro compartido VIEJO, que')
    log.append('  comparte GUID con DESCRIPCION_ITEM. Escribirlo borraria la descripcion de')
    log.append('  cada pieza.')
    log.append('  Hay que cargar el parametro compartido ASSEMBLY nuevo')
    log.append('  (93330cd2-7f31-401b-91b7-106c6c1d4454) y volver a correr este paso.')
    log.append('=' * 78)
    GUID_ASSEMBLY = None
elif GUID_ASSEMBLY is None:
    log.append('AVISO: el parametro compartido ASSEMBLY no esta cargado, asi que las piezas '
               'no se marcan y la tabla del paso 06 va a salir vacia. Cargalo con Manage > '
               'Shared Parameters y vinculalo a las categorias de modelo.')


def marcar_miembros(ai, tname):
    # Escribe el nombre del assembly en el ASSEMBLY de cada miembro. Es lo que hace que la
    # tabla de 06 salga completa: esa tabla FILTRA por este parametro, asi que una pieza sin
    # marcar no aparece y su material no se cuenta.
    #
    # Las piezas ANIDADAS dentro de una familia lo tienen de SOLO LECTURA a proposito:
    # heredan el valor del padre en cuanto el padre lo tiene. Por eso alcanza con marcar lo
    # escribible; las de solo lectura no son un error, son las que van a heredar.
    #
    # Se marca solo la instancia que se documenta y no todas las del mismo tipo: la tabla
    # muestra el contenido de UN assembly y multiplica por CANT=N. Marcando las N se veria
    # el triple en las cantidades.
    if GUID_ASSEMBLY is None:
        return 0, 0
    marcados = 0
    heredan = 0
    for eid in ids_recursivos(ai):
        el = doc.GetElement(eid)
        if el is None:
            continue
        try:
            if el.Category is not None and el.Category.Id.Value == ID_CAT_GRIDS:
                continue     # el ASSEMBLY de los ejes es OTRO parametro y va a mano
        except Exception:
            pass
        try:
            p = el.get_Parameter(GUID_ASSEMBLY)
        except Exception:
            p = None
        if p is None:
            continue
        if p.IsReadOnly:
            heredan += 1
            continue
        try:
            if p.AsString() != tname:
                p.Set(tname)
            marcados += 1
        except Exception:
            pass
    return marcados, heredan


def bbox_con_anidados(el):
    # bbox solido de el INCLUYENDO sus sub-componentes anidados (recursivo). Los
    # contenedores (familias cuya geometria real vive en anidadas mas profundas)
    # devuelven None con member_solid_bbox a secas.
    pila = [el]
    vistos = set()
    minx = miny = minz = float('inf')
    maxx = maxy = maxz = float('-inf')
    hay = False
    while pila:
        e = pila.pop()
        if e is None:
            continue
        try:
            eid = e.Id.Value
        except Exception:
            eid = None
        if eid is not None:
            if eid in vistos:
                continue
            vistos.add(eid)
        bb = member_solid_bbox(e)
        if bb is not None:
            hay = True
            if bb.Min.X < minx: minx = bb.Min.X
            if bb.Max.X > maxx: maxx = bb.Max.X
            if bb.Min.Y < miny: miny = bb.Min.Y
            if bb.Max.Y > maxy: maxy = bb.Max.Y
            if bb.Min.Z < minz: minz = bb.Min.Z
            if bb.Max.Z > maxz: maxz = bb.Max.Z
        if isinstance(e, FamilyInstance):
            try:
                for sid in e.GetSubComponentIds():
                    pila.append(doc.GetElement(sid))
            except Exception:
                pass
    if not hay:
        return None

    class _BB(object):
        pass
    r = _BB()
    r.Min = XYZ(minx, miny, minz)
    r.Max = XYZ(maxx, maxy, maxz)
    return r


def bbox_assembly(ai):
    # bbox de MUNDO del assembly completo, medido sobre geometria solida real.
    minx = miny = minz = float('inf')
    maxx = maxy = maxz = float('-inf')
    hay = False
    for mid in ai.GetMemberIds():
        el = doc.GetElement(mid)
        bb = bbox_con_anidados(el) if el is not None else None
        if bb is None:
            continue
        hay = True
        if bb.Min.X < minx: minx = bb.Min.X
        if bb.Max.X > maxx: maxx = bb.Max.X
        if bb.Min.Y < miny: miny = bb.Min.Y
        if bb.Max.Y > maxy: maxy = bb.Max.Y
        if bb.Min.Z < minz: minz = bb.Min.Z
        if bb.Max.Z > maxz: maxz = bb.Max.Z
    if not hay:
        return None

    class _BB(object):
        pass
    r = _BB()
    r.Min = XYZ(minx, miny, minz)
    r.Max = XYZ(maxx, maxy, maxz)
    return r


# ------------------------------------------------ niveles del assembly (por nombre)

# Los niveles los MODELAN los proyectistas y su nombre declara a que assembly
# pertenecen. 00 ya no los adivina.
#
# POR QUE (2026-08-10): las plantas T.A. salian de un clustering geometrico de los
# topes de viga (tops_de_vigas + agrupar_por_altura + z_dominante +
# filtrar_grupos_minoritarios, todas eliminadas junto con sus dos inputs de
# tolerancia). Gerencia decidio que los niveles se modelen explicitamente para tener
# el modelo ordenado, asi que el criterio pasa a ser el nombre del nivel. Es el mismo
# trato que el parametro ASSEMBLY de los ejes: el modelador declara, el graph obedece.
PREF_NIPB = 'N.I.P.B._'     # nivel inferior placa base: uno por assembly
PREF_PT = 'P.T._'           # punto de trabajo: uno por assembly
PREF_TA = 'T.A._'           # tope de acero: N por assembly, correlativo ADELANTE

# Cuanto puede alejarse el nivel N.I.P.B. modelado de la cara mas baja real del
# assembly antes de que valga la pena avisar. No descarta nada: manda el nivel.
TOL_NIVEL = 20.0 / 30.48    # cm -> pies


def parte_serie(lname, pref, tname):
    # UN solo formato para las tres clases: "<prefijo><assembly>", o bien
    # "<prefijo><correlativo>_<assembly>" con el correlativo ADELANTE del nombre del
    # assembly. El primero de una serie puede no llevarlo.
    #
    # Asi los escriben los modeladores. Medido el 2026-09-16 sobre los dos modelos
    # reales: T.A._ES-1001 / T.A._2_ES-1001 en uno, y T.A._01_ES-1001 /
    # P.T._01_ES-1001 / P.T._02_ES-1001 en el otro. Las dos formas calzan.
    #
    # El nombre tiene que EMPEZAR con el prefijo y TERMINAR con el assembly. No
    # alcanza con mencionarlos: el modelo esta lleno de niveles viejos que hablan de
    # T.A. o N.I.P.B. sin ser de esta convencion ("RLO_T.A. ES-1002",
    # "AMT_T.A.-01_EST. TOLVA") y esos NO son plantas de assembly.
    #
    # -> False si el nivel no es de esta clase y de este assembly.
    # -> lo que haya entre el prefijo y el assembly si lo es ('' cuando no hay nada).
    #
    # Las dos preguntas -que calza y cual es su correlativo- salen del MISMO parseo a
    # proposito: con dos funciones separadas podian contestar distinto.
    n = (lname or '').strip()
    if not n.lower().startswith(pref.lower()):
        return False
    resto = n[len(pref):]
    base = tname.strip()
    if len(resto) < len(base) or resto[len(resto) - len(base):].lower() != base.lower():
        return False
    medio = resto[:len(resto) - len(base)]
    # El medio, si lo hay, tiene que cerrar en "_". Sin eso el assembly ES-100 se
    # robaria "T.A._ES-1001", donde el medio quedaria en un "1" suelto.
    if medio and not medio.endswith('_'):
        return False
    return medio.rstrip('_').strip()


def calza_serie(lname, pref, tname):
    return parte_serie(lname, pref, tname) is not False


def solo_alfanum(s):
    # Solo para DETECTAR typos, nunca para decidir que nivel genera planta: compara
    # ignorando todo lo que no sea letra o numero, asi "T.A._ES_1001_01" (guion bajo
    # en vez de guion) y "T.A._ES 1001_01" siguen delatando al assembly ES-1001 y caen
    # en la lista de sospechosos en vez de desaparecer sin ningun aviso.
    #
    # parte_serie sigue siendo estricto A PROPOSITO: si el matcher aceptara nombres
    # aproximados, un "T.A._ES_1001" podria generar una planta del assembly equivocado
    # a la cota equivocada y en silencio, y 01/02/03/06 construyen todos encima. Un
    # aviso cuesta un renombre en Revit; un match errado cuesta un plano mal emitido.
    return ''.join(c for c in (s or '').lower() if c.isalnum())


def niveles_del_assembly(tname):
    # -> (nivel NIPB, [niveles P.T. de abajo hacia arriba], [niveles T.A. idem])
    # `niveles` ya viene ordenado por ProjectElevation, asi que las dos series salen
    # ascendentes sin volver a ordenar.
    #
    # El N.I.P.B. es UNO por assembly -es el nivel inferior de las placas base, no hay
    # dos-. Los P.T. y los T.A. son N: desde el 2026-09-16 los puntos de trabajo
    # tambien, porque el modelo real trae dos en ES-1001 (EL. 69,155 y 70,355).
    nipb = []
    pt = []
    ta = []
    sospechosos = []
    for l in niveles:
        n = elem_name(l)
        if calza_serie(n, PREF_NIPB, tname):
            nipb.append(l)
        elif calza_serie(n, PREF_PT, tname):
            pt.append(l)
        elif calza_serie(n, PREF_TA, tname):
            ta.append(l)
        elif solo_alfanum(tname) in solo_alfanum(n):
            # nombra al assembly pero no arranca con ningun prefijo valido: puede ser
            # un nivel viejo (legitimo, no es planta) o un typo como "T.A_ES-1001" o
            # "T.A._ES_1001_01". No se adivina cual, pero tampoco se lo esconde.
            sospechosos.append(n)

    if len(nipb) > 1:
        log.append('AVISO {}: hay {} niveles "{}..."; el N.I.P.B. es uno solo por assembly, '
                   'se usa el mas bajo ({}).'.format(
                       tname, len(nipb), PREF_NIPB + tname, elem_name(nipb[0])))
    if not nipb:
        log.append('AVISO {}: no existe el nivel "{}"; el assembly se queda sin planta NIPB.'.format(
            tname, PREF_NIPB + tname))
    # P.T. y T.A. comparten forma y tratamiento: N por assembly, ascendentes por cota.
    for pref, serie, clase in ((PREF_PT, pt, 'P.T.'), (PREF_TA, ta, 'T.A.')):
        if not serie:
            log.append('AVISO {}: no existe ningun nivel "{}" ni "{}N_{}"; el assembly se '
                       'queda sin plantas {}.'.format(
                           tname, pref + tname, pref, tname, clase))
            continue
        log.append('{}: {} nivel(es) {} -> {}'.format(
            tname, len(serie), clase, ', '.join('{} (EL. {})'.format(
                elem_name(l), fmt_cota(to_m(elev_nivel(l)))) for l in serie)))
        # El correlativo de la VISTA sale de la ALTURA, no del nombre: asi 01, 02 y 06
        # siguen viendo una serie 01..NN sin huecos ni repetidos pase lo que pase en el
        # modelo. El correlativo del nivel es la numeracion que escribe el proyectista,
        # y lo unico que se comprueba es que coincida con esa posicion.
        #
        # La cota NO se escribe en el nombre del nivel: ya va en el titulo de la vista
        # ("PLANTA T.A. (EL. 2.304,18)") y ponerla en los dos lados es duplicarla.
        for i, l in enumerate(serie):
            # el nivel pelado es el primero de la serie: declara un 1 implicito
            suf = parte_serie(elem_name(l), pref, tname) or '1'
            if suf.isdigit() and suf.lstrip('0') != str(i + 1):
                log.append('   {}: el nivel {} dice "{}" pero por altura es el {:02d}; '
                           'la vista se llama {} {:02d}.'.format(
                               tname, elem_name(l), suf, i + 1, clase, i + 1))
    if sospechosos:
        log.append('AVISO {}: {} nivel(es) nombran al assembly sin empezar por ningun prefijo, '
                   'asi que NO generan planta -> {}. Si alguno deberia generarla, corregir el '
                   'nombre en Revit ("{}", "{}" o "{}").'.format(
                       tname, len(sospechosos), ', '.join(sospechosos),
                       PREF_NIPB + tname, PREF_PT + tname, PREF_TA + tname))
    return (nipb[0] if nipb else None, pt, ta)


# ------------------------------------------------- que ejes llevan elevacion

# Parametro de PROYECTO (texto) en la categoria Grids con el NOMBRE DEL ASSEMBLY al
# que pertenece el eje. Es lo unico que decide que elevaciones se crean: quien arma
# el plano marca los ejes y 00 hace exactamente esos, ni uno mas.
#
# POR QUE se reemplazo el criterio geometrico (2026-08-10): antes la elevacion se
# hacia si el eje cruzaba la huella y ademas tenia una viga o columna a menos de
# 30 cm. Salian demasiadas elevaciones, porque el test de cruce mide contra el
# RECTANGULO del bounding box, bastante mas grande que la huella real (un assembly
# en L o alargado en diagonal deja pasar ejes que no tocan nada). Ninguna tolerancia
# arreglaba el criterio: medido el 2026-08-04, subirla a 1 m no rescato ninguna de
# las 10 elevaciones vacias y arruino las que si andaban. El marcado en el eje es
# explicito y lo controla el proyectista.
PARAM_EJE_ASSEMBLY = 'ASSEMBLY'

_idx_ejes = None            # {nombre de assembly en minusculas: [Grid, ...]}
_valores_ejes = set()       # los valores tal cual, para poder listarlos en el log
_param_presente = [False]   # el parametro existe en al menos un eje
_param_poblado = [False]    # ...y ademas alguien le escribio algo


def texto_param(el, nombre):
    # instancia primero, tipo despues: si manana el parametro se define de tipo,
    # el graph sigue leyendolo sin tocar nada.
    p = el.LookupParameter(nombre)
    if p is None:
        try:
            t = doc.GetElement(el.GetTypeId())
            p = t.LookupParameter(nombre) if t is not None else None
        except Exception:
            p = None
    if p is None:
        return None
    _param_presente[0] = True
    try:
        if p.StorageType == StorageType.String:
            v = p.AsString()
        else:
            v = p.AsValueString()
    except Exception:
        return ''
    return (v or '').strip()


def indice_ejes_por_assembly():
    # se arma UNA sola vez para toda la corrida: recorrer todos los Grid por cada
    # assembly seria O(ejes x assemblies) sin ninguna necesidad.
    global _idx_ejes
    if _idx_ejes is not None:
        return _idx_ejes
    _idx_ejes = {}
    for g in FilteredElementCollector(doc).OfClass(Grid):
        v = texto_param(g, PARAM_EJE_ASSEMBLY)
        if not v:
            continue
        _param_poblado[0] = True
        # nadie mas filtra por forma, asi que el filtro de "linea
        # recta" hay que rehacerlo aca: crear_elevacion_eje alinea la caja de seccion
        # con la direccion del eje y con un arco esa direccion no existe.
        try:
            c = g.Curve
        except Exception:
            c = None
        if c is None or not isinstance(c, Line):
            log.append('AVISO: el eje {} esta marcado con {} = "{}" pero no es una linea recta; '
                       'se omite su elevacion.'.format(elem_name(g), PARAM_EJE_ASSEMBLY, v))
            continue
        _valores_ejes.add(v)
        _idx_ejes.setdefault(v.lower(), []).append(g)
    for k in _idx_ejes:
        _idx_ejes[k].sort(key=lambda g: elem_name(g))
    return _idx_ejes


def ejes_del_assembly(tname):
    # Los ejes marcados con este assembly, y solamente esos. Sin match no se crea
    # ninguna elevacion: es un marcado explicito, no un default que se pueda adivinar.
    #
    # ⚠ Esta lista contesta las DOS preguntas: que ejes llevan elevacion y que
    # ejes se ven en las vistas del assembly, porque el aislamiento de plantas y
    # elevaciones se arma con ella. Los ejes de otros sectores no entran, o sea que
    # quedan ocultos: es el pedido de gerencia y de paso limpia las plantas.
    #
    # 03 enciende la categoria Grids en estas vistas y necesita los ejes transversales
    # para sus cadenas de cotas; los del propio assembly siguen ahi. Pero un eje que no
    # entre en el aislamiento queda oculto PARA SIEMPRE y 03 no lo puede recuperar
    # encendiendo la categoria: si falta un eje en una planta es marcado faltante en el
    # modelo, no un problema de 03.
    idx = indice_ejes_por_assembly()
    res = idx.get(tname.strip().lower(), [])
    if res:
        log.append('{}: {} eje(s) marcados con {} -> {}'.format(
            tname, len(res), PARAM_EJE_ASSEMBLY, ', '.join(elem_name(g) for g in res)))
    elif not _param_presente[0]:
        log.append('ERROR {}: ningun eje del modelo tiene el parametro {}, asi que no hay '
                   'forma de saber que ejes le tocan y el assembly queda SIN ELEVACIONES. '
                   'Agregalo como parametro de proyecto de texto en la categoria Grids y '
                   'escribi el nombre del assembly en cada eje.'.format(tname, PARAM_EJE_ASSEMBLY))
    elif not _param_poblado[0]:
        log.append('ERROR {}: el parametro {} existe en los ejes pero esta vacio en todos; '
                   'el assembly queda SIN ELEVACIONES.'.format(tname, PARAM_EJE_ASSEMBLY))
    else:
        log.append('AVISO {}: ningun eje tiene {} = "{}"; el assembly queda sin elevaciones. '
                   'Valores que si aparecen en los ejes del modelo: {}.'.format(
                       tname, PARAM_EJE_ASSEMBLY, tname,
                       ', '.join(sorted(_valores_ejes))))
    return res


# ---------------------------------------------------------------- ajustes de vista

_viewers = None


def _indice_viewers():
    idx = {}
    for ve in FilteredElementCollector(doc).OfCategory(BuiltInCategory.OST_Viewers):
        try:
            idx[elem_name(ve)] = ve.Id
        except Exception:
            pass
    return idx


def find_viewer(vname):
    # marcador de la vista (categoria Views/Viewers), comparte nombre con la vista.
    #
    # El indice guarda ElementId, NO el Element. Guardando el Element, con "recrear"
    # activo el cache quedaba con marcadores YA BORRADOS -las elevaciones viejas se
    # eliminan y se rehacen con el mismo nombre- y al pedirle .Id a uno de esos
    # objetos muertos Revit tiraba "The referenced object is not valid, possibly
    # because it has been deleted from the database". Esa excepcion abortaba el
    # assembly ENTERO: visto el 2026-07-29, ES-1003 creo sus 15 elevaciones y murio
    # justo antes de aislar sus plantas. Con ElementId, doc.GetElement devuelve None
    # para un id borrado y el caso se maneja como cualquier otro miss del cache.
    global _viewers
    if _viewers is None:
        _viewers = _indice_viewers()
    vid = _viewers.get(vname)
    el = doc.GetElement(vid) if vid is not None else None
    if el is not None:
        return el
    # puede ser una vista recien creada en esta corrida, o un id ya borrado
    _viewers = _indice_viewers()
    vid = _viewers.get(vname)
    return doc.GetElement(vid) if vid is not None else None


def aplicar_far_clip(v, tname, label):
    # Far Clip Offset fijo (input), igual para plantas y elevaciones. Si el modo de
    # recorte lejano esta en "sin recorte" (0), el offset no haria nada, asi que se
    # activa: 0 = No clip, 1 = Clip without line, 2 = Clip with line.
    try:
        pa = v.get_Parameter(BuiltInParameter.VIEWER_BOUND_ACTIVE_FAR)
        if pa is not None and not pa.IsReadOnly and pa.AsInteger() == 0:
            pa.Set(1)
    except Exception:
        pass
    try:
        p = v.get_Parameter(BuiltInParameter.VIEWER_BOUND_OFFSET_FAR)
        if p is not None and not p.IsReadOnly:
            p.Set(far_clip)
    except Exception as e:
        log.append('AVISO {}: no se pudo fijar el Far Clip de {}: {}'.format(tname, label, e))


def fijar_view_range(vplan, z_corte, z_fondo, level, tname, label, beyond=0.0):
    # En una ViewPlan la profundidad no la controla el Far Clip Offset sino el
    # View Range. Todos los planos se anclan al MISMO nivel y se expresan como
    # offset respecto a su elevacion, asi que el nivel elegido es indiferente
    # (solo es el origen de coordenadas del rango).
    #   Top    = Cut + HOLGURA_TOP
    #   Bottom = View Depth = z_fondo
    # El fondo se mide desde el NIVEL MODELADO de la planta (N.I.P.B., P.T. o el
    # T.A. que le toca), no desde el plano de corte: el corte va un
    # offset por encima del nivel y no tiene por que arrastrar la profundidad.
    # El Far Clip Offset del input NO se usa aca; es solo para las elevaciones.
    #
    # ORDEN ESTRICTO (2026-07-28): Revit exige Top >= Cut >= Bottom >= ViewDepth.
    # Antes se ponia Top = Cut y eso rompia la vista entera: con el rango de altura
    # colapsado a cero, el CropBox que ajustar_crop_a_assembly() lee justo despues
    # hereda un espesor nulo (Min.Z == Max.Z) y el BoundingBoxXYZ queda degenerado.
    # Sintoma: la planta no dibuja NADA y Revit ni siquiera puede abrirla, aunque
    # FilteredElementCollector(doc, view.Id) siga contando elementos visibles.
    e = elev_nivel(level)
    corte = z_corte - e
    fondo = z_fondo - e
    if fondo > corte - HOLGURA_TOP:
        # el fondo quedo por encima (o pegado) al corte: se fuerza un rango sano
        log.append('AVISO {}: el fondo de {} quedaba sobre el plano de corte; se baja a {:.2f} m bajo el corte.'.format(
            tname, label, to_m(prof_planta)))
        fondo = corte - max(prof_planta, HOLGURA_TOP)
    top = corte + HOLGURA_TOP
    # Revit exige Bottom >= View Depth, y beyond nunca es negativo, asi que el orden
    # estricto Top >= Cut >= Bottom >= View Depth se mantiene por construccion.
    profundidad = fondo - (beyond if beyond > 0 else 0.0)
    try:
        vr = vplan.GetViewRange()
        for plano, off in ((PlanViewPlane.TopClipPlane, top),
                           (PlanViewPlane.CutPlane, corte),
                           (PlanViewPlane.BottomClipPlane, fondo),
                           (PlanViewPlane.ViewDepthPlane, profundidad)):
            vr.SetLevelId(plano, level.Id)
            vr.SetOffset(plano, off)
        vplan.SetViewRange(vr)
        extra = ''
        if profundidad < fondo:
            extra = ', mas {:.2f} m como <Beyond> hasta EL. {}'.format(
                to_m(fondo - profundidad), fmt_cota(to_m(z_fondo - (fondo - profundidad))))
        log.append('{}: {} cortada en EL. {}, fondo en EL. {} ({:.2f} m de profundidad, top +{:.2f} m{}).'.format(
            tname, label, fmt_cota(to_m(z_corte)), fmt_cota(to_m(z_fondo)),
            to_m(z_corte - z_fondo), to_m(HOLGURA_TOP), extra))
    except Exception as ex:
        log.append('ERROR {}: no se pudo fijar el View Range de {}: {}'.format(tname, label, ex))


def ajustar_crop_a_assembly(v, ai, tname, label):
    # recorta el crop (ancho y alto, en los ejes propios de la vista) al borde
    # del assembly + margen de papel. El Annotation Crop se desactiva para que
    # cotas/tags/leaders, que viven por fuera del borde, no queden cortados.
    bb = v.CropBox
    inv = bb.Transform.Inverse
    minx = miny = float('inf')
    maxx = maxy = float('-inf')
    hay_geo = False
    for mid in ai.GetMemberIds():
        el = doc.GetElement(mid)
        mbb = bbox_con_anidados(el) if el is not None else None
        if mbb is None:
            continue
        hay_geo = True
        for x in (mbb.Min.X, mbb.Max.X):
            for y in (mbb.Min.Y, mbb.Max.Y):
                for z in (mbb.Min.Z, mbb.Max.Z):
                    p = inv.OfPoint(XYZ(x, y, z))
                    if p.X < minx: minx = p.X
                    if p.X > maxx: maxx = p.X
                    if p.Y < miny: miny = p.Y
                    if p.Y > maxy: maxy = p.Y
    if not hay_geo:
        log.append('AVISO {}: sin geometria para ajustar el crop de {}.'.format(tname, label))
        return
    margen = crop_margin_mm / 304.8 * (v.Scale if v.Scale > 0 else 1)
    # El espesor en Z se hereda del crop actual, pero NUNCA puede quedar en cero:
    # un BoundingBoxXYZ degenerado deja la vista sin dibujar. En una planta el Z del
    # crop lo deriva Revit del View Range, asi que si el rango venia colapsado esto
    # es la ultima linea de defensa (ver nota en fijar_view_range).
    zmin_c = bb.Min.Z
    zmax_c = bb.Max.Z
    if zmax_c - zmin_c < 1e-6:
        zmin_c = zmin_c - 1.0
        zmax_c = zmax_c + 1.0
        log.append('AVISO {}: el crop de {} venia con espesor cero; se le dio 2 m.'.format(tname, label))
    nuevo = BoundingBoxXYZ()
    nuevo.Transform = bb.Transform
    nuevo.Min = XYZ(minx - margen, miny - margen, zmin_c)
    nuevo.Max = XYZ(maxx + margen, maxy + margen, zmax_c)
    v.CropBox = nuevo
    # El Annotation Crop se deja INACTIVO a proposito: asi cotas, tags y leaders,
    # que viven por fuera del borde del assembly, no quedan cortados. El precio es
    # que Revit lo auto-expande hasta abarcar toda la anotacion -por eso el recuadro
    # punteado queda lejos del acero-, pero el marco que se regula desde el Player
    # es el CropBox de aca arriba, no este.
    try:
        mgr = v.GetCropRegionShapeManager()
        mgr.IsAnnotationCropActive = False
    except Exception:
        pass
    log.append('   crop de {}: {:.2f} x {:.2f} m.'.format(
        label, to_m(maxx - minx + 2 * margen), to_m(maxy - miny + 2 * margen)))


def preparar_vista(v, tname, label, es_nipb=False):
    # ajustes comunes a toda vista creada por este graph
    # El tipo de vista es lo que define la carpeta del Project Browser, y se
    # reaplica tambien a las vistas que YA existian: asi cambiar el nombre de la
    # carpeta no obliga a recrearlas. Va primero, porque cambiar el tipo puede
    # arrastrar propiedades que los ajustes de mas abajo vuelven a fijar.
    try:
        objetivo = plan_vft if isinstance(v, ViewPlan) else sec_vft
        if objetivo is not None and v.GetTypeId() != objetivo.Id:
            v.ChangeTypeId(objetivo.Id)
    except Exception as e:
        log.append('AVISO {}: no se pudo cambiar el tipo de vista de {}: {}'.format(tname, label, e))
    try:
        v.Scale = escala_de(v)
    except Exception:
        pass
    try:
        v.DetailLevel = ViewDetailLevel.Fine
    except Exception:
        pass
    try:
        # "Crop View" (recorte de geometria) activo, pero SIN dibujar el rectangulo:
        # sin el recorte la vista ocupa su extension completa y 01/02 calculan
        # bloques mucho mas grandes de lo real.
        if not v.CropBoxActive:
            v.CropBoxActive = True
        if v.CropBoxVisible:
            v.CropBoxVisible = False
    except Exception as e:
        log.append('ERROR {} activando Crop View en {}: {}'.format(tname, label, e))
    if es_nipb:
        objetivo_tpl = view_template_nipb
    elif isinstance(v, ViewPlan):
        objetivo_tpl = view_template_planta
    else:
        objetivo_tpl = view_template_elevacion
    if objetivo_tpl is not None:
        try:
            if v.ViewTemplateId != objetivo_tpl.Id:
                v.ViewTemplateId = objetivo_tpl.Id
            # la escala la manda el input, no el template
            if v.Scale != escala_de(v):
                v.Scale = escala_de(v)
        except Exception as e:
            log.append('ERROR {} aplicando template a {}: {}'.format(tname, label, e))
    # Far Clip despues del template: si el template trae su propio valor, gana el input.
    # Se aplica a TODA vista que crea este graph - plantas y elevaciones por igual.
    aplicar_far_clip(v, tname, label)
    # Las conexiones (sillas de anclaje, placas base, pernos) se encienden en las
    # PLANTAS: son el contenido principal de la NIPB. Va despues del template,
    # porque es al template a quien hay que ganarle.
    if isinstance(v, ViewPlan):
        encender_conexiones(v, tname, label)
        # Las plantas salen sin simbolos de corte: las marcas de las elevaciones
        # de eje ensucian el dibujo del acero.
        ocultar_simbolos_corte(v, tname, label)



def set_titulo(v, texto):
    # titulo mostrado en lamina (Title on Sheet), sin tocar el nombre interno
    p = v.get_Parameter(BuiltInParameter.VIEW_DESCRIPTION)
    if p is None or p.IsReadOnly:
        return
    if p.AsString() != texto:
        p.Set(texto)


_aviso_conex = [False]


def encender_conexiones(v, tname, label):
    # Las sillas de anclaje, placas base y pernos son Structural CONNECTIONS, no
    # Structural Framing. El template de disposicion general las apaga (a 1:150
    # serian ruido) y sin ellas la NIPB queda vacia.
    #
    # Verificado el 2026-07-29 consultando la vista ES-1001 - NIPB ya creada: solo
    # contenia 4 columnas, 2 vigas y 5 ejes, con las 95 sillas/placas/pernos del
    # assembly INVISIBLES. El View Range estaba bien (esos 6 elementos son
    # exactamente lo que vive entre EL. 0,67 y EL. 2,17); lo que fallaba era la
    # visibilidad por categoria. Sintoma reportado: la NIPB "sale muy arriba y sin
    # profundidad", porque quedan columnas flotando sin su base.
    #
    # Se llama SIEMPRE, sin preguntar antes por GetCategoryHidden: ese getter
    # devuelve el flag propio de la vista, que puede ser False mientras el view
    # template igual apaga la categoria por V/G overrides. Preguntando primero, el
    # if daba False y no se corregia nada (visto el 2026-07-29).
    try:
        cat = ElementId(BuiltInCategory.OST_StructConnections)
        v.SetCategoryHidden(cat, False)
    except Exception as e:
        # Revit contesta "Category cannot be hidden" cuando el view template controla
        # V/G: la visibilidad de la categoria la manda el template y la vista no la
        # puede sobrescribir. No hay forma de arreglarlo por API sobre esta vista;
        # hay que cambiarle el template. Se avisa una sola vez por corrida para no
        # llenar el log con la misma linea por cada planta.
        if not _aviso_conex[0]:
            _aviso_conex[0] = True
            log.append('AVISO: el view template de {} no deja mostrar Structural Connections'.format(label))
            log.append('       (sillas de anclaje, placas base, pernos): el template controla V/G.')
            log.append('       Si faltan las sillas en la NIPB, elegir en el input 07 un template que')
            log.append('       las muestre. Verificado: ESTRUCTURAS_1/50 las muestra; DISP.GRAL_1/150_PLAN no.')


_aviso_secc = [False]


def ocultar_simbolos_corte(v, tname=None, label=None):
    # Apaga la categoria Sections: el SIMBOLO de corte (linea, cabeza, cola y
    # burbuja). No borra ni afecta a las elevaciones en si, solo su marca.
    #
    # En las ELEVACIONES evita que las otras elevaciones del mismo assembly las
    # crucen. En las PLANTAS es preferencia de dibujo: los marcadores se siguen
    # incluyendo en el aislamiento, asi que basta volver a encender la categoria
    # en la vista (o quitar esta llamada) para recuperarlos.
    try:
        cat = ElementId(BuiltInCategory.OST_Sections)
        if v.CanCategoryBeHidden(cat):
            v.SetCategoryHidden(cat, True)
        elif tname is not None and not _aviso_secc[0]:
            _aviso_secc[0] = True
            log.append('AVISO {}: la categoria Sections no se puede ocultar en {};'.format(tname, label))
            log.append('       la controla el view template, hay que apagarla ahi.')
    except Exception as e:
        if tname is not None and not _aviso_secc[0]:
            _aviso_secc[0] = True
            log.append('AVISO {}: no se pudo ocultar el simbolo de seccion en {}: {}'.format(tname, label, e))


PARAM_CANTIDAD = 'Cantidad_Inserto'
_param_avisado = [False]


def set_cantidad(v, cantidad, tname):
    p = v.LookupParameter(PARAM_CANTIDAD)
    if p is None:
        if not _param_avisado[0]:
            _param_avisado[0] = True
            log.append('AVISO: las vistas no tienen el parametro {} (agregarlo como parametro de proyecto en la categoria Views).'.format(PARAM_CANTIDAD))
        return
    if p.IsReadOnly:
        return
    st = p.StorageType
    if st == StorageType.Integer:
        p.Set(int(cantidad))
    elif st == StorageType.Double:
        p.Set(float(cantidad))
    else:
        p.Set(str(cantidad))


# ---------------------------------------------------------------- creacion

def borrar_si_toca(vname, tname, label):
    # devuelve la vista existente si hay que conservarla, None si hay que crearla
    if vname not in view_ids:
        return None, False
    if recreate:
        try:
            doc.Delete(view_ids[vname])
        except Exception:
            # Revit NO deja borrar la vista activa ni una abierta en pestaña.
            # Visto el 2026-07-29: con ES-1001 - NIPB abierta en pantalla mientras
            # corria el graph, doc.Delete tiraba "ElementId cannot be deleted" y la
            # excepcion subia hasta el try del assembly, que hacia continue: ES-1001
            # se quedaba SIN NINGUNA vista (ni NIPB, ni T.A., ni elevaciones).
            # Ahora se reutiliza la vista existente y la corrida sigue.
            log.append('AVISO {}: no se pudo borrar {}; probablemente esta abierta en Revit.'.format(tname, label))
            log.append('       Cerrar esa vista y volver a correr si se quiere rehacerla desde cero.')
            log.append('       Por ahora se reutiliza la existente y se le reaplican los ajustes.')
            return doc.GetElement(view_ids[vname]), True
        del view_ids[vname]
        log.append('{}: {} anterior eliminada (tambien su viewport si estaba en un sheet).'.format(tname, label))
        return None, False
    return doc.GetElement(view_ids[vname]), True


def limpiar_sobrantes(tname):
    # con "recrear" activo se borran TODAS las T.A. y elevaciones previas del
    # assembly, no solo las que esta corrida va a volver a crear: el clustering
    # puede devolver menos grupos que antes (o cruzar menos ejes) y las vistas
    # sobrantes quedarian huerfanas con un nombre correlativo que ya no aplica.
    pref_pt = tname + SUF_PT
    pref_ta = tname + SUF_TA
    pref_eje = tname + SUF_EJE
    for vname in list(view_ids.keys()):
        # solo las de ESTE juego, comparando la marca COMPLETA (ver es_de_este_juego)
        if not es_de_este_juego(vname):
            continue
        if (vname.startswith(pref_pt) or vname.startswith(pref_ta)
                or vname.startswith(pref_eje)):
            try:
                doc.Delete(view_ids[vname])
                del view_ids[vname]
            except Exception:
                pass


def nueva_planta(vname, level):
    # ViewPlan normal (no vista de assembly): es la unica forma de que los ejes se
    # dibujen y de que 03 pueda acotarlos. El recorte al assembly lo hace el
    # CropBox y el filtrado por assembly lo hace aislar_assembly().
    if plan_vft is None or not niveles:
        return None
    v = ViewPlan.Create(doc, plan_vft.Id, level.Id)
    set_name(v, vname)
    return v


def crear_planta(ai, tname, level, vname, etiqueta, titulo, z_corte, z_fondo,
                 es_nipb=False, cantidad=None, beyond=0.0):
    # Crea (o reajusta) una planta anclada a un Level MODELADO. Las tres clases de
    # planta -NIPB, P.T. y T.A.- comparten todo salvo el nivel, el corte y el titulo,
    # asi que el cuerpo vive una sola vez aca.
    #
    # Una planta ya existente NO se salta entera: se le vuelven a aplicar escala,
    # template, view range, crop y titulo. Si se hiciera "continue", las vistas de
    # corridas viejas quedarian congeladas con los defaults de entonces.
    global plantas_creadas, saltadas
    v, saltar = borrar_si_toca(vname, tname, etiqueta)
    if saltar:
        saltadas += 1
    else:
        v = nueva_planta(vname, level)
        if v is None:
            log.append('ERROR {}: no se pudo crear la {}.'.format(tname, etiqueta))
            return None
        view_ids[vname] = v.Id
        plantas_creadas += 1
        log.append('OK {}: {} creada sobre el nivel {}, escala 1:{}.'.format(
            tname, etiqueta, elem_name(level), escala_planta))
    if v is None:
        return None
    preparar_vista(v, tname, etiqueta, es_nipb)
    # despues de preparar_vista, que es quien aplica el view template: al template hay que
    # ganarle, igual que con las categorias que enciende esta misma funcion.
    unificar_corte_con_proyeccion(v, tname, etiqueta)
    fijar_view_range(v, z_corte, z_fondo, level, tname, etiqueta, beyond)
    ajustar_crop_a_assembly(v, ai, tname, etiqueta)
    set_titulo(v, titulo)
    if cantidad is not None:
        set_cantidad(v, cantidad, tname)
    return v


def crear_elevacion_eje(ai, g, bb, tname):
    # Seccion real del modelo alineada con el eje. No es una vista de assembly
    # (AssemblyViewUtils solo ofrece orientaciones fijas: HorizontalDetail y
    # DetailSection A-D, que no sirven para "una elevacion por cada eje"), asi
    # que el aislamiento del assembly se hace explicito mas abajo.
    gname = elem_name(g)
    vname = vname_de(tname + SUF_EJE + gname)
    existente, saltar = borrar_si_toca(vname, tname, 'elevacion del eje ' + gname)
    if saltar:
        return existente, True
    if sec_vft is None:
        return None, False

    c = g.Curve
    d = c.GetEndPoint(1) - c.GetEndPoint(0)
    d = XYZ(d.X, d.Y, 0.0)
    if d.GetLength() < 1e-9:
        log.append('AVISO {}: el eje {} es degenerado en planta; se omite.'.format(tname, gname))
        return None, False
    d = d.Normalize()
    up = XYZ.BasisZ
    n = d.CrossProduct(up).Normalize()   # horizontal, perpendicular al eje
    origen = XYZ(c.GetEndPoint(0).X, c.GetEndPoint(0).Y, 0.0)

    # extension del assembly en el sistema local de la elevacion
    lxmin = lymin = lzmin = float('inf')
    lxmax = lymax = lzmax = float('-inf')
    for mid in ai.GetMemberIds():
        el = doc.GetElement(mid)
        mbb = bbox_con_anidados(el) if el is not None else None
        if mbb is None:
            continue
        for x in (mbb.Min.X, mbb.Max.X):
            for y in (mbb.Min.Y, mbb.Max.Y):
                for z in (mbb.Min.Z, mbb.Max.Z):
                    p = XYZ(x, y, z)
                    rel = p - origen
                    lx = rel.DotProduct(d)
                    ly = p.Z
                    lz = rel.DotProduct(n)
                    if lx < lxmin: lxmin = lx
                    if lx > lxmax: lxmax = lx
                    if ly < lymin: lymin = ly
                    if ly > lymax: lymax = ly
                    if lz < lzmin: lzmin = lz
                    if lz > lzmax: lzmax = lz
    if lxmin == float('inf'):
        log.append('AVISO {}: sin geometria para la elevacion del eje {}.'.format(tname, gname))
        return None, False

    m = crop_margin_mm / 304.8 * escala_corte
    t = Transform.Identity
    t.BasisX = d          # a lo largo del eje = horizontal en la vista
    t.BasisY = up         # vertical en la vista
    t.BasisZ = n          # hacia el observador (BasisX x BasisY = n, sistema derecho)
    t.Origin = origen
    caja = BoundingBoxXYZ()
    caja.Transform = t
    caja.Min = XYZ(lxmin - m, lymin - m, lzmin - m)
    caja.Max = XYZ(lxmax + m, lymax + m, lzmax + m)

    v = ViewSection.CreateSection(doc, sec_vft.Id, caja)
    set_name(v, vname)
    view_ids[vname] = v.Id
    return v, False


def _norm(s):
    # comparacion tolerante: sin tildes y sin distinguir mayusculas ni espacios de mas.
    # El modelador escribe ESCALERA METALICA con tilde y la constante no la lleva.
    try:
        import unicodedata
        s = unicodedata.normalize('NFD', s)
        s = ''.join(c for c in s if not unicodedata.combining(c))
    except Exception:
        pass
    return s.strip().upper()


def familia_de(el):
    # nombre de la FAMILIA (no del tipo). Un elemento de sistema no tiene Symbol y
    # devuelve cadena vacia, con lo que queda fuera de la regla.
    try:
        return el.Symbol.FamilyName
    except Exception:
        return ''


def ocultar_en_planta_base(v, ai, tname, label):
    # Solo en las plantas BASE (la NIPB y la P.T.), que miran la misma zona de anclaje.
    # Se oculta una pieza si su familia -o la de algun contenedor suyo- matchea
    # FAMS_OCULTAR_BASE, O si su categoria esta en CATS_OCULTAR_BASE.
    # FAMS_SALVAR_BASE gana sobre las dos reglas y se evalua al final.
    #
    # POR QUE HideElements y no dejarlas fuera del aislamiento: el aislamiento de
    # aislar_assembly es de ida (ConvertTemporaryHideIsolateToPermanent) y para
    # revertirlo hay que Recrear la vista. Esta regla depende de un nombre de familia
    # que el modelador va a querer corregir, asi que cada corrida DESOCULTA primero los
    # miembros del assembly y vuelve a decidir de cero: cambiar la constante y volver a
    # correr alcanza, sin recrear nada.
    #
    # Desocultar solo MIEMBROS es lo que hace segura esa pasada: los miembros son
    # justamente lo que el aislamiento dejo visible, asi que lo unico que se revierte
    # es lo que oculto una corrida anterior de esta misma funcion.
    ocultar = [_norm(x) for x in FAMS_OCULTAR_BASE if x and x.strip()]
    salvar = [_norm(x) for x in FAMS_SALVAR_BASE if x and x.strip()]
    cats_ocultar = set()
    for nombre in CATS_OCULTAR_BASE:
        try:
            cats_ocultar.add(ElementId(getattr(BuiltInCategory, nombre)).Value)
        except Exception:
            log.append('AVISO: la categoria {} de CATS_OCULTAR_BASE no existe en esta '
                       'version de Revit; se ignora.'.format(nombre))
    if not ocultar and not cats_ocultar:
        return

    miembros = ids_recursivos(ai)
    desocultar_miembros(v, ai, tname, label)

    ids = List[ElementId]()
    salvadas = 0
    nombres = {}
    for eid in miembros:
        el = doc.GetElement(eid)
        if el is None:
            continue
        fam = _norm(familia_de(el))
        # La regla por CATEGORIA no necesita nombre de familia -un elemento de sistema
        # no tiene Symbol y familia_de devuelve cadena vacia-, asi que se evalua sola.
        # Las reglas por nombre son seguras con fam vacio: nada esta contenido en ''.
        por_categoria = False
        try:
            c = el.Category
            por_categoria = c is not None and c.Id.Value in cats_ocultar
        except Exception:
            por_categoria = False
        propia = False
        for o in ocultar:
            if o in fam:
                propia = True
                break
        heredada = False
        if not propia:
            # una pieza anidada -VM ESCALERAS, los peldanos, las placas- no lleva
            # ESCALERA en su propio nombre de familia: se mira la del contenedor,
            # subiendo la cadena hasta la raiz.
            try:
                sup = el.SuperComponent
            except Exception:
                sup = None
            while sup is not None:
                fsup = _norm(familia_de(sup))
                for o in ocultar:
                    if o in fsup:
                        heredada = True
                        break
                if heredada:
                    break
                try:
                    sup = sup.SuperComponent
                except Exception:
                    sup = None
        if not (propia or heredada or por_categoria):
            continue
        es_salvada = False
        for s in salvar:
            if s in fam:
                es_salvada = True
                break
        if es_salvada:
            salvadas += 1
            continue
        try:
            if not el.CanBeHidden(v):
                continue
        except Exception:
            pass
        ids.Add(eid)
        clave = fam if fam else 'SIN FAMILIA'
        nombres[clave] = nombres.get(clave, 0) + 1

    if ids.Count == 0:
        log.append('   {}: nada que ocultar en {} - ningun miembro del assembly cae en las '
                   'reglas de las plantas base ({} por familia, {} por categoria). Si la escalera se '
                   've igual, no es miembro de este assembly y el aislamiento ya deberia '
                   'estar tapandola.'.format(
                       tname, label, ', '.join(FAMS_OCULTAR_BASE) or 'nada',
                       ', '.join(CATS_OCULTAR_BASE) or 'nada'))
        return
    try:
        v.HideElements(ids)
        detalle = ', '.join('{} x{}'.format(k, nombres[k]) for k in sorted(nombres))
        log.append('   {}: {} pieza(s) ocultas en {} ({}); {} pieza(s) salvadas por {}.'.format(
            tname, ids.Count, label, detalle, salvadas, ', '.join(FAMS_SALVAR_BASE)))
    except Exception as e:
        log.append('AVISO {}: no se pudieron ocultar las piezas de escalera en {}: {}'.format(
            tname, label, e))


def desocultar_miembros(v, ai, tname, label):
    # Revierte lo que oculto una corrida anterior, para que las reglas de ocultamiento
    # se recalculen de cero. Se limita a los MIEMBROS del assembly, que son justamente
    # lo que el aislamiento dejo visible: asi nunca se deshace un ocultamiento del
    # aislamiento permanente, que es de ida y no se puede recuperar.
    volver = List[ElementId]()
    for eid in ids_recursivos(ai):
        el = doc.GetElement(eid)
        if el is None:
            continue
        try:
            if el.IsHidden(v):
                volver.Add(eid)
        except Exception:
            pass
    if not volver.Count:
        return
    try:
        v.UnhideElements(volver)
        doc.Regenerate()
    except Exception as e:
        log.append('AVISO {}: no se pudo revertir el ocultamiento previo en {}: {}'.format(
            tname, label, e))


def curva_de(el):
    try:
        return el.Location.Curve
    except Exception:
        return None


def ocultar_diagonales_ta(v, ai, tname, label, z_nivel, z_fondo, z_piso):
    # Solo en las plantas T.A. Oculta las piezas de Structural Framing cuya curva de
    # ubicacion este mas inclinada que ANG_DIAGONAL_GRADOS respecto de la horizontal.
    # Mismo mecanismo reversible que ocultar_en_planta_base, por el mismo motivo.
    #
    # De paso MIDE lo que el View Range esta dejando afuera: las piezas horizontales
    # que quedan enteras por debajo del fondo de la vista no se dibujan, y son la
    # respuesta a por que una planta no muestra toda su trama. El log dice cuanta
    # profundidad haria falta, en vez de dejarlo a prueba y error.
    if not OCULTAR_DIAGONALES_TA:
        return
    tan_lim = math.tan(math.radians(ANG_DIAGONAL_GRADOS))
    desocultar_miembros(v, ai, tname, label)

    ids = List[ElementId]()
    topes_fuera = []
    for eid in ids_recursivos(ai):
        el = doc.GetElement(eid)
        if el is None:
            continue
        try:
            c = el.Category
            if c is None or c.Id.Value != CAT_FRAMING:
                continue
        except Exception:
            continue
        cur = curva_de(el)
        if cur is None:
            continue
        try:
            p0 = cur.GetEndPoint(0)
            p1 = cur.GetEndPoint(1)
        except Exception:
            continue
        dz = abs(p1.Z - p0.Z)
        dh = math.sqrt((p1.X - p0.X) ** 2 + (p1.Y - p0.Y) ** 2)
        if dh <= TOL_PUNTO:
            continue          # vertical: en planta es un punto, se deja
        if dz > dh * tan_lim:
            try:
                if not el.CanBeHidden(v):
                    continue
            except Exception:
                pass
            ids.Add(eid)
            continue
        # horizontal: se mide si el View Range la esta dejando fuera. El piso acota la
        # medicion al hueco entre este nivel y el T.A. de abajo, para no reportar la
        # trama entera de los niveles inferiores del assembly.
        bb = bbox_con_anidados(el)
        if bb is not None and bb.Max.Z < z_fondo and bb.Max.Z > z_piso:
            topes_fuera.append(bb.Max.Z)

    if ids.Count:
        try:
            v.HideElements(ids)
            log.append('   {}: {} pieza(s) diagonal(es) ocultas en {} (mas de {:.0f} grados '
                       'respecto de la horizontal).'.format(
                           tname, ids.Count, label, ANG_DIAGONAL_GRADOS))
        except Exception as e:
            log.append('AVISO {}: no se pudieron ocultar las diagonales de {}: {}'.format(
                tname, label, e))
    if topes_fuera:
        falta = to_m(z_nivel - max(topes_fuera))
        log.append('   {}: OJO, {} pieza(s) HORIZONTAL(es) de {} quedan fuera del View '
                   'Range; la mas alta tiene su tope {:.2f} m bajo el nivel. Para verlas hay '
                   'que subir la profundidad de las plantas a mas de {:.0f} cm.'.format(
                       tname, len(topes_fuera), label, falta, falta * 100.0))


def unificar_corte_con_proyeccion(v, tname, label):
    # Hace que lo CORTADO se dibuje igual que lo proyectado, por categoria y solo en esta
    # vista. Asi una tanda de vigas no sale de dos colores segun la rebane o no el plano
    # de corte. Ver el bloque de CATS_GRAFISMO_UNIFORME para el porque.
    if not UNIFICAR_GRAFISMO_VIGAS:
        return
    for nombre in CATS_GRAFISMO_UNIFORME:
        try:
            bic = getattr(BuiltInCategory, nombre)
        except Exception:
            log.append('AVISO: la categoria {} de CATS_GRAFISMO_UNIFORME no existe en esta '
                       'version de Revit; se ignora.'.format(nombre))
            continue
        try:
            cat = doc.Settings.Categories.get_Item(bic)
        except Exception:
            cat = None
        if cat is None:
            continue
        ogs = OverrideGraphicSettings()
        detalle = []
        try:
            color = cat.LineColor
            if color is not None and color.IsValid:
                ogs.SetCutLineColor(color)
                detalle.append('RGB {},{},{}'.format(color.Red, color.Green, color.Blue))
        except Exception:
            pass
        try:
            peso = cat.GetLineWeight(GraphicsStyleType.Projection)
            if peso is not None and peso > 0:
                ogs.SetCutLineWeight(peso)
                detalle.append('peso {}'.format(peso))
        except Exception:
            pass
        try:
            pat = cat.GetLinePatternId(GraphicsStyleType.Projection)
            if pat is not None:
                ogs.SetCutLinePatternId(pat)
        except Exception:
            pass
        try:
            v.SetCategoryOverrides(List[ElementId]([cat.Id]), ogs)
            log.append('   {}: en {} el corte de {} se dibuja como la proyeccion ({}).'.format(
                tname, label, nombre, ', '.join(detalle) if detalle else 'sin datos de la categoria'))
        except Exception as e:
            # si un view template controla V/G, la API no deja sobrescribir y lo dice
            log.append('AVISO {}: no se pudo unificar el grafismo de {} en {}: {}'.format(
                tname, nombre, label, e))


def aislar_assembly(v, ai, grids, tname, label, extra=None):
    # La elevacion es una seccion normal: por defecto muestra TODO el modelo
    # dentro de la caja. Se aisla el assembly y se convierte el aislamiento
    # temporal en permanente, que es lo unico que sobrevive al cierre de la vista.
    # Se incluyen todos los ejes DEL ASSEMBLY (los marcados con ASSEMBLY), no solo el
    # propio: 03 enciende la categoria Grids en estas vistas y los ejes transversales
    # deben poder verse para sus cadenas de cotas. Los ejes de otros sectores quedan
    # fuera a proposito. Ojo: un eje que no entre en este aislamiento queda oculto para
    # siempre y 03 no lo puede recuperar encendiendo la categoria.
    ids = List[ElementId]()
    for eid in ids_recursivos(ai):
        ids.Add(eid)
    for g in (grids or []):
        if g is not None:
            ids.Add(g.Id)
    for eid in (extra or []):
        ids.Add(eid)
    if ids.Count == 0:
        log.append('AVISO {}: {} sin miembros que aislar.'.format(tname, label))
        return
    if isinstance(v, ViewPlan):
        log.append('   {}: {} elemento(s) aislados en {} (miembros + conexiones + ejes).'.format(
            tname, ids.Count, label))
    try:
        v.IsolateElementsTemporary(ids)
        doc.Regenerate()
        v.ConvertTemporaryHideIsolateToPermanent()
    except Exception as e:
        log.append('ERROR {} aislando el assembly en {}: {}'.format(tname, label, e))


# ---------------------------------------------------------------- main

plantas_creadas = 0
elevs_creadas = 0
saltadas = 0
resumen = []
# para el bloque de ayuda del final: que le falto a cada assembly que no genero vistas
sin_ninguna_vista = []
sin_ejes_marcados = set()
sin_niveles = set()
TransactionManager.Instance.EnsureInTransaction(doc)
try:
    # La subcarpeta del Project Browser se materializa como un tipo de vista propio
    # (ver tipo_carpeta). Tiene que resolverse DENTRO de la transaccion porque
    # duplica un ViewFamilyType, y antes del bucle para que todas las vistas de esta
    # corrida nazcan ya con el tipo correcto.
    if nombre_carpeta:
        # las plantas primero, asi que en un proyecto limpio se quedan con el nombre
        # pelado y las elevaciones caen al alterno. El orden es estable entre corridas.
        plan_vft = tipo_carpeta(plan_vft, FAMILIAS_PLAN, 'las plantas', ' PL')
        sec_vft = tipo_carpeta(sec_vft, (ViewFamily.Section,), 'las elevaciones', ' SEC')
        # Regenerate obligatorio: sin esto, las vistas creadas en ESTA MISMA corrida
        # (ViewPlan.Create / ViewSection.CreateSection con el Id del tipo recien
        # duplicado) nacian con el tipo BASE en vez del nuevo -Revit no deja el tipo
        # recien duplicado listo para usarse en otras creaciones de la misma
        # transaccion hasta que se regenera-. Verificado 2026-07-29: sin esta linea
        # habia que correr el graph dos veces (la 2da corrida ya encontraba el tipo
        # existente por nombre y preparar_vista lo reasignaba).
        doc.Regenerate()

    for tname in targets:
        insts = by_type[tname]
        ai = insts[0]
        if len(insts) > 1:
            log.append('AVISO {}: {} instancias del mismo tipo, se documenta la primera.'.format(tname, len(insts)))
        try:
            # ANTES que las vistas: es lo que hace que la tabla del paso 06 salga completa,
            # y conviene que quede hecho aunque despues falle la creacion de alguna vista.
            marcados, heredan = marcar_miembros(ai, tname)
            if marcados or heredan:
                log.append('{}: ASSEMBLY marcado en {} pieza(s){}.'.format(
                    tname, marcados,
                    '; otras {} lo heredan de su familia padre'.format(heredan)
                    if heredan else ''))

            bb = bbox_assembly(ai)
            if bb is None:
                log.append('ERROR {}: sin geometria solida valida en ningun miembro; se omite el assembly.'.format(tname))
                continue
            zmin = bb.Min.Z
            zmax = bb.Max.Z

            if recreate:
                limpiar_sobrantes(tname)

            # los ejes se resuelven ANTES que las vistas: plantas y elevaciones se aislan
            # a los miembros del assembly MAS estos ejes, y sin ellos en la lista de
            # aislamiento no habria forma de que se dibujen.
            #
            # UNA sola lista para las dos preguntas: que ejes llevan elevacion y que ejes
            # se ven en las vistas del assembly. Los ejes de otros sectores quedan fuera
            # del aislamiento, o sea ocultos.
            ejes = ejes_del_assembly(tname)

            # ---------- 1. plantas sobre los niveles MODELADOS ----------
            # NIPB, P.T. y T.A. salen de niveles que los proyectistas crean con un
            # nombre que declara el assembly. Si un nivel no esta, esa planta no se
            # hace: no se inventa una cota de reemplazo.
            lv_nipb, lv_pt, lv_ta = niveles_del_assembly(tname)
            plantas = []   # (vista, etiqueta) para aislar al final
            # NIPB + las N P.T.: las plantas que miran la zona de anclaje. Se arma
            # sobre la marcha porque las etiquetas de las P.T. llevan correlativo.
            etiquetas_base = [ETIQ_NIPB]
            datos_ta = {}  # etiqueta -> (z del nivel, z del fondo, z del T.A. de abajo)

            # ---------- 1a. planta NIPB ----------
            if lv_nipb is not None:
                z_lvl = elev_nivel(lv_nipb)
                # el nivel N.I.P.B. deberia caer sobre la cara mas baja del assembly;
                # si no, o el nivel esta mal puesto o el assembly no es el que se cree.
                # Se avisa y se sigue: manda el nivel modelado, que es todo el punto.
                if abs(z_lvl - zmin) > TOL_NIVEL:
                    log.append('AVISO {}: el nivel {} esta en EL. {} y la cara mas baja del assembly en EL. {} ({:.2f} m de diferencia); manda el nivel.'.format(
                        tname, elem_name(lv_nipb), fmt_cota(to_m(z_lvl)),
                        fmt_cota(to_m(zmin)), to_m(abs(z_lvl - zmin))))
                v_pl = crear_planta(ai, tname, lv_nipb, vname_de(tname + SUF_NIPB), ETIQ_NIPB,
                                    tname + TIT_NIPB, z_lvl + off_nipb, z_lvl - prof_planta,
                                    True, len(insts))
                if v_pl is not None:
                    plantas.append((v_pl, ETIQ_NIPB))

            # ---------- 1b. plantas P.T. (punto de trabajo) ----------
            # Van entre la NIPB y las T.A., que es el orden con el que 01 cuenta las
            # laminas y 02 las coloca. Usan el offset de corte de las T.A.: son
            # plantas de trabajo, no la de placas base, y no tienen input propio.
            #
            # Son N por assembly desde el 2026-09-16, igual que las T.A. Antes era una
            # sola y la vista se llamaba "<assembly> - P.T." a secas; ahora lleva
            # correlativo por altura, asi que 01 y 02 las buscan por PREFIJO.
            for i_pt, lv in enumerate(lv_pt):
                z_lvl = elev_nivel(lv)
                etiqueta_pt = '{} {:02d}'.format(ETIQ_PT, i_pt + 1)
                v_pl = crear_planta(ai, tname, lv,
                                    vname_de('{}{}{:02d}'.format(tname, SUF_PT, i_pt + 1)),
                                    etiqueta_pt,
                                    tname + TIT_PT.format(fmt_cota(to_m(z_lvl))),
                                    z_lvl + off_ta, z_lvl - prof_planta)
                if v_pl is not None:
                    plantas.append((v_pl, etiqueta_pt))
                    etiquetas_base.append(etiqueta_pt)

            # ---------- 1c. plantas T.A., una por nivel, de abajo hacia arriba ----------
            zdoms = [elev_nivel(l) for l in lv_ta]
            n_ta = 0
            for gi, lv in enumerate(lv_ta):
                n_ta += 1
                zdom = zdoms[gi]
                etiqueta_ta = 'planta T.A. {:02d}'.format(n_ta)
                # RECORTE CONTRA EL NIVEL DE ARRIBA (2026-07-29): el offset del corte
                # es fijo (1 m por defecto) pero la separacion entre niveles no. En
                # ES-1002 los dos T.A. estan a 1,05 m, asi que el corte de la planta 01
                # caia POR ENCIMA de las vigas del T.A. 02 y la planta dibujaba los dos
                # niveles superpuestos. El corte nunca llega al nivel de arriba.
                z_corte_ta = zdom + off_ta
                if gi + 1 < len(zdoms):
                    limite = zdoms[gi + 1] - SEP_NIVEL
                    if z_corte_ta > limite:
                        z_corte_ta = limite
                        log.append('   {}: corte de {} bajado a EL. {} para no alcanzar el nivel de arriba (EL. {}).'.format(
                            tname, etiqueta_ta, fmt_cota(to_m(z_corte_ta)), fmt_cota(to_m(zdoms[gi + 1]))))
                # y el fondo nunca baja hasta el nivel de abajo, por lo mismo
                z_fondo_ta = zdom - prof_planta
                if gi > 0:
                    piso = zdoms[gi - 1] + SEP_NIVEL
                    if z_fondo_ta < piso:
                        z_fondo_ta = piso
                        log.append('   {}: fondo de {} subido a EL. {} para no alcanzar el nivel de abajo (EL. {}).'.format(
                            tname, etiqueta_ta, fmt_cota(to_m(z_fondo_ta)), fmt_cota(to_m(zdoms[gi - 1]))))
                z_piso_ta = zdoms[gi - 1] if gi > 0 else float('-inf')
                v_pl = crear_planta(ai, tname, lv, vname_de('{}{}{:02d}'.format(tname, SUF_TA, n_ta)),
                                    etiqueta_ta, tname + TIT_TA.format(fmt_cota(to_m(zdom))),
                                    z_corte_ta, z_fondo_ta, beyond=PROF_BEYOND)
                if v_pl is not None:
                    plantas.append((v_pl, etiqueta_ta))
                    # lo que la vista DIBUJA llega hasta el View Depth, no hasta el
                    # Bottom: la medicion de piezas fuera de rango usa el plano de abajo.
                    datos_ta[etiqueta_ta] = (zdom, z_fondo_ta - PROF_BEYOND, z_piso_ta)

            # ---------- 3. elevaciones de eje ----------
            for g in ejes:
                gname = elem_name(g)
                label = 'elevacion del eje ' + gname
                try:
                    velev, saltar = crear_elevacion_eje(ai, g, bb, tname)
                    if velev is None:
                        continue
                    # Una elevacion ya existente NO se salta entera: se le vuelven a
                    # aplicar escala, template, far clip, aislamiento y titulo. Antes
                    # se hacia "continue" y las vistas creadas por corridas viejas
                    # quedaban congeladas con los defaults de entonces (visto el
                    # 2026-07-28: elevaciones con template ESTRUCTURAS_1/50, escala
                    # 1:100 y far clip 8550 mm mucho despues de cambiar los defaults).
                    if saltar:
                        saltadas += 1
                    else:
                        elevs_creadas += 1
                    preparar_vista(velev, tname, label)
                    aislar_assembly(velev, ai, ejes, tname, label)
                    ocultar_simbolos_corte(velev)
                    try:
                        mgr = velev.GetCropRegionShapeManager()
                        mgr.IsAnnotationCropActive = False
                    except Exception:
                        pass
                    set_titulo(velev, tname + TIT_EJE.format(gname))
                    log.append('{} {}: {}.'.format(
                        'OK' if not saltar else '  ', tname,
                        label + (' creada' if not saltar else ' ya existia, ajustes reaplicados')))
                except Exception as e:
                    log.append('ERROR {} creando {}: {}'.format(tname, label, e))

            # ---------- 4. aislar las plantas ----------
            # Se hace AL FINAL, cuando las elevaciones ya existen, para poder incluir
            # sus marcadores (categoria Views/Viewers) en el aislamiento: si quedaran
            # fuera, las plantas no mostrarian las marcas de seccion que referencian
            # a las elevaciones.
            marcadores = []
            for g in ejes:
                # defensivo: un marcador que no se pueda resolver no puede costar
                # el aislamiento de TODAS las plantas del assembly
                try:
                    mk = find_viewer(vname_de(tname + SUF_EJE + elem_name(g)))
                    if mk is not None:
                        marcadores.append(mk.Id)
                except Exception:
                    pass
            for v_pl, etiqueta in plantas:
                aislar_assembly(v_pl, ai, ejes, tname, etiqueta, marcadores)
                # SOLO en la NIPB y en la P.T.: la escalera y las vigas se ocultan y quedan
                # las placas de anclaje. Las dos plantas miran la zona de anclaje y les
                # sirve el mismo criterio. En las T.A. y en las elevaciones no se aplica:
                # ahi la trama de vigas y la escalera son justamente lo que se documenta.
                if etiqueta in etiquetas_base:
                    try:
                        ocultar_en_planta_base(v_pl, ai, tname, etiqueta)
                    except Exception as e:
                        log.append('ERROR {}: ocultando la escalera en {}: {}'.format(
                            tname, etiqueta, e))
                # SOLO en las T.A.: se ocultan las diagonales y se mide lo que el View
                # Range deja afuera. La P.T. no entra: no esta en datos_ta.
                elif etiqueta in datos_ta:
                    zn, zf, zp = datos_ta[etiqueta]
                    try:
                        ocultar_diagonales_ta(v_pl, ai, tname, etiqueta, zn, zf, zp)
                    except Exception as e:
                        log.append('ERROR {}: ocultando las diagonales en {}: {}'.format(
                            tname, etiqueta, e))

            if not plantas and not ejes:
                sin_ninguna_vista.append(tname)
            if not ejes:
                sin_ejes_marcados.add(tname)
            if lv_nipb is None and not lv_pt and not lv_ta:
                sin_niveles.add(tname)
            resumen.append('{}: {} planta(s) [NIPB {} | P.T. {} | T.A. {}] + {} elevacion(es) = {} vista(s).'.format(
                tname, len(plantas),
                'si' if lv_nipb is not None else 'NO',
                len(lv_pt),
                n_ta, len(ejes), len(plantas) + len(ejes)))
        except Exception as e:
            log.append('ERROR {}: {}'.format(tname, e))
finally:
    TransactionManager.Instance.TransactionTaskDone()

# --- ayuda al modelador cuando un assembly no genero NINGUNA vista -------------------------
# La causa siempre es la misma -falta preparar el modelo- pero antes se deducia juntando
# cuatro avisos sueltos repartidos por el log. Aca va junto, arriba de todo, con el nombre
# del assembly ya puesto en los ejemplos para que se pueda copiar y pegar.
ayuda = []
for tname in sin_ninguna_vista:
    ejemplo = tname if not nombre_automatico(tname) else 'ES-1002'
    ayuda.append('=' * 78)
    ayuda.append('{}: NO SE CREO NINGUNA VISTA. Falta preparar el modelo.'.format(tname))
    paso = 0
    if nombre_automatico(tname):
        paso += 1
        ayuda.append('  {}. EMPEZAR POR ACA: el assembly conserva el nombre automatico de '
                     'Revit.'.format(paso))
        ayuda.append('     Renombralo a su codigo de obra (ej. "{}") ANTES de lo demas: los '
                     'niveles'.format(ejemplo))
        ayuda.append('     y el marcado de los ejes se anclan a ese nombre, y si lo cambias '
                     'despues')
        ayuda.append('     hay que rehacerlos.')
    if tname in sin_ejes_marcados:
        paso += 1
        ayuda.append('  {}. Ningun eje tiene el parametro ASSEMBLY -> sin elevaciones.'.format(paso))
        ayuda.append('     Crealo como parametro de PROYECTO, de TEXTO, en la categoria Grids,')
        ayuda.append('     y escribi "{}" en cada eje que deba llevar elevacion.'.format(ejemplo))
        ayuda.append('     Solo los que marques se documentan: no se adivina por geometria.')
    if tname in sin_niveles:
        paso += 1
        ayuda.append('  {}. Faltan los niveles -> sin plantas. Con ese nombre serian:'.format(paso))
        ayuda.append('       N.I.P.B._{}        (uno solo)'.format(ejemplo))
        ayuda.append('       P.T._01_{}         (los que haga falta, 01, 02...)'.format(ejemplo))
        ayuda.append('       T.A._01_{}         (idem)'.format(ejemplo))
        ayuda.append('     El correlativo va ADELANTE del nombre del assembly.')
    ayuda.append('=' * 78)

log.insert(0, 'Assemblies procesados: {} | plantas creadas: {} | elevaciones creadas: {} | saltadas: {}'.format(
    len(targets), plantas_creadas, elevs_creadas, saltadas))
for i, linea in enumerate(resumen):
    log.insert(1 + i, '  ' + linea)
for i, linea in enumerate(ayuda):
    log.insert(i, linea)
OUT = log
# ----------------------------------------
log = Watch(py_nipb_plantas_t_a_elevaciones)  # graph output
