# Dynamo graph 01_Calcular y crear laminas.dyn (Dynamo 4.0.2.3852)
# Calcula cuantas laminas hacen falta para las vistas de assembly pendientes (simulando el mismo empaquetado que 02_Colocar vistas en laminas) y crea esa cantidad exacta, con la vineta y numeracion elegidas.

vineta_title_block_elegir_del = FamilyTypes("BIOS_E_VINE_A1_NOVANDINO:Formato-DETALLE")  # "Vineta (Title Block) - elegir del dropdown"; graph input
numero_del_primer_sheet = StringInput("A1")  # graph input
nombre_del_primer_sheet = StringInput("A1")  # graph input
procesar_todos_los_assemblies = BoolSelector(true)  # graph input
filtro_assemblies_si_todos_false = StringInput("")  # graph input
margen_y_separacion_mm = IntegerSlider(5, range=0..50 step 1)  # graph input
reserva_para_la_tabla_lado = IntegerSlider(150, range=0..400 step 10)  # "Reserva para la tabla, lado derecho (mm)"; graph input
subcarpeta_juego_de_vistas_vacio = StringInput("")  # "Subcarpeta / juego de vistas (vacio = sin subcarpeta)"; graph input
py_calcular_y_crear_laminas_1 = Python(IN[0]=vineta_title_block_elegir_del, IN[1]=numero_del_primer_sheet, IN[2]=nombre_del_primer_sheet, IN[3]=procesar_todos_los_assemblies, IN[4]=filtro_assemblies_si_todos_false, IN[5]=margen_y_separacion_mm, IN[6]=reserva_para_la_tabla_lado, IN[7]=subcarpeta_juego_de_vistas_vacio)  # "PY | Calcular y crear laminas (1 assembly por lamina)"; PythonNet3
# ---------- py_calcular_y_crear_laminas_1.python (342 lines) ----------
# 01_Calcular y crear laminas - ACERO
# Calcula cuantas laminas hacen falta para las vistas de assembly pendientes,
# simulando EXACTAMENTE el mismo empaquetado que 02_Colocar vistas en laminas, y
# crea esa cantidad con la numeracion incremental de siempre.
#
# Regla de aislamiento (estandar del proyecto): cada lamina contiene vistas de UN
# SOLO assembly. Las vistas de un assembly fluyen por tantas laminas como haga
# falta, pero el assembly siguiente SIEMPRE empieza en una lamina nueva.
#
# La tabla de cantidades (06) va unicamente en la PRIMERA lamina de cada assembly,
# asi que la reserva del lado derecho solo se descuenta en esa lamina; las
# siguientes del mismo assembly aprovechan el ancho completo.
#
# Revit 2027 / Dynamo 4 / CPython3
# IN[0] = tipo de vineta (dropdown Family Types)
# IN[1] = numero del primer sheet
# IN[2] = nombre del primer sheet
# IN[3] = procesar todos los assemblies (bool)
# IN[4] = filtro de assemblies si IN[3] es False (parcial, comas)
# IN[5] = margen y separacion entre vistas (mm) - debe coincidir con el mismo
#         input de 02_Colocar vistas en laminas para que el calculo sea exacto
# IN[6] = reserva del lado derecho para la tabla de 06 (mm) - idem, debe coincidir

import clr
import re
clr.AddReference('RevitAPI')
clr.AddReference('RevitServices')
from Autodesk.Revit.DB import (FilteredElementCollector, AssemblyInstance, ViewSheet,
                               Viewport, View, BuiltInCategory, Element, ElementId)
from RevitServices.Persistence import DocumentManager
from RevitServices.Transactions import TransactionManager

doc = DocumentManager.Instance.CurrentDBDocument

tb_type = UnwrapElement(IN[0])
first_number = (IN[1] or '').strip()
first_name = (IN[2] or '').strip()
process_all = bool(IN[3])
filter_text = (IN[4] or '').strip()
margin = float(IN[5]) / 304.8
right_reserve = float(IN[6]) / 304.8
juego_vistas = (IN[7] or '').strip()
# --- juego de vistas (2026-09-17) ---------------------------------------------------------
# 00 escribe el nombre de la subcarpeta al final del nombre de cada vista que crea:
# "ES-1001 - T.A. 01 (REV_B)". Sirve para que correr 00 con otro nombre de carpeta genere un
# juego NUEVO en vez de caer sobre las vistas ya maquetadas y acotadas.
#
# Este input dice sobre CUAL de esos juegos trabajar. Vacio = el juego sin marca, que es el
# que crea 00 cuando la subcarpeta se deja en blanco.
#
# Sin esto, 01 y 02 recogian cualquier vista que no estuviera colocada: alcanzaba para el
# caso normal, pero si un juego viejo tenia vistas sueltas se mezclaban con las nuevas en la
# misma lamina.
MARCA_JUEGO = ' ({})'.format(juego_vistas) if juego_vistas else ''


def juego_de(vname):
    # la marca que lleva ese nombre al final, o '' si no lleva ninguna
    if vname.endswith(')'):
        i = vname.rfind(' (')
        if i >= 0:
            return vname[i:]
    return ''


def es_de_este_juego(vname):
    # NO alcanza con endswith(MARCA_JUEGO): con la marca vacia, endswith('') da True para
    # TODO y se colarian las vistas de los demas juegos. Hay que comparar la marca completa.
    return juego_de(vname) == MARCA_JUEGO



log = []

# --- contrato de nombres con 00_Vistas de assembly ---
SUF_NIPB = ' - NIPB'
SUF_PT = ' - P.T. '        # + correlativo: son N por assembly, como las T.A.
SUF_TA = ' - T.A. '
SUF_EJE = ' - EJE '

# alto reservado bajo cada vista para su titulo (mm de papel)
label_h_planta = 12.0 / 304.8
label_h_elev = (12.0 + 14.0) / 304.8


def elem_name(e):
    try:
        return e.Name
    except Exception:
        return Element.Name.__get__(e)


def es_elevacion(nombre):
    return SUF_EJE in nombre


def clave_natural(s):
    # ordena "2" antes que "13" y "13a" despues de "13"
    partes = re.split('(\\d+)', s)
    return [(1, int(p), '') if p.isdigit() else (0, 0, p.lower()) for p in partes if p != '']


def tb_label(t):
    try:
        return '{} : {}'.format(t.FamilyName, elem_name(t))
    except Exception:
        return 'Id ' + str(t.Id)


def list_titleblocks():
    col = (FilteredElementCollector(doc)
           .OfCategory(BuiltInCategory.OST_TitleBlocks)
           .WhereElementIsElementType())
    return list(col)


def paper_size(v):
    # tamaño en papel (pies) = crop del modelo / escala
    cb = v.CropBox
    s = v.Scale if v.Scale > 0 else 1
    return ((cb.Max.X - cb.Min.X) / s, (cb.Max.Y - cb.Min.Y) / s)


def tamano_con_titulo(v):
    w, h = paper_size(v)
    return (w, h + (label_h_elev if es_elevacion(elem_name(v)) else label_h_planta))


def usable_rect(sheet, con_reserva):
    # area util = bbox de la vineta menos margenes. La reserva derecha (tabla de
    # 06) solo se descuenta en la PRIMERA lamina de cada assembly.
    reserva = right_reserve if con_reserva else 0.0
    col = FilteredElementCollector(doc, sheet.Id).OfCategory(BuiltInCategory.OST_TitleBlocks)
    tb = col.FirstElement()
    if tb is not None:
        bb = tb.get_BoundingBox(sheet)
        if bb is not None:
            return (bb.Min.X + margin, bb.Min.Y + margin,
                    bb.Max.X - margin - reserva, bb.Max.Y - margin)
    o = sheet.Outline
    return (o.Min.U + margin, o.Min.V + margin,
            o.Max.U - margin - reserva, o.Max.V - margin)


def empaquetar(tamanos, rect_1, rect_n, margin):
    # Flujo izquierda->derecha, arriba->abajo. Cuando una vista no cabe a lo ancho
    # salta de fila; cuando no cabe a lo alto salta a la lamina siguiente DEL MISMO
    # assembly (que ya no descuenta la reserva de la tabla).
    # Devuelve (posiciones, n_laminas, avisos) con posiciones = [(idx, x_izq, y_sup)].
    pos = []
    avisos = []
    idx = 0
    x0, y0, x1, y1 = rect_1
    cx, cy, row_h = x0, y1, 0.0
    for w, h in tamanos:
        if cx > x0 and cx + w > x1:
            cx = x0
            cy -= row_h + margin
            row_h = 0.0
        fresco = (abs(cx - x0) < 1e-9 and abs(cy - y1) < 1e-9)
        if cy - h < y0 and not fresco:
            idx += 1
            x0, y0, x1, y1 = rect_n
            cx, cy, row_h = x0, y1, 0.0
            fresco = True
        if fresco and (w > (x1 - x0) or h > (y1 - y0)):
            avisos.append((w, h))
        pos.append((idx, cx, cy))
        cx += w + margin
        if h > row_h:
            row_h = h
    return pos, idx + 1, avisos


def bump(text, steps):
    # incrementa el ULTIMO bloque numerico conservando el ancho (ceros a la izquierda)
    last = None
    for m in re.finditer('\\d+', text):
        last = m
    if last is None:
        return '{} {:02d}'.format(text, steps + 1)
    width = len(last.group(0))
    val = int(last.group(0)) + steps
    return text[:last.start()] + str(val).zfill(width) + text[last.end():]


# --- validar la vineta seleccionada ---
tb_cat_id = ElementId(BuiltInCategory.OST_TitleBlocks)
is_tb = (tb_type is not None
         and tb_type.Category is not None
         and tb_type.Category.Id == tb_cat_id)

if not is_tb:
    log.append('ERROR: el tipo seleccionado en el dropdown NO es una vineta (Title Block).')
    log.append('Selecciona una de estas vinetas cargadas en el proyecto:')
    tbs = list_titleblocks()
    if not tbs:
        log.append('  (no hay vinetas cargadas en el proyecto)')
    for t in tbs:
        log.append('  - ' + tb_label(t))
    OUT = log
else:
    by_type = {}
    for ai in FilteredElementCollector(doc).OfClass(AssemblyInstance):
        by_type.setdefault(ai.AssemblyTypeName, []).append(ai)

    names = sorted(by_type.keys())
    if not names:
        log.append('AVISO: no hay ningun Assembly en el modelo; no hay nada que calcular.')
    if not process_all:
        tokens = [t.strip().lower() for t in filter_text.split(',') if t.strip()]
        if tokens:
            names = [n for n in names if any(tok in n.lower() for tok in tokens)]
        else:
            names = []
            log.append('ERROR: "Todos" esta en False y el filtro esta vacio.')

    view_by_name = {}
    for v in FilteredElementCollector(doc).OfClass(View):
        if not v.IsTemplate:
            view_by_name[elem_name(v)] = v

    placed_ids = set()
    for vp in FilteredElementCollector(doc).OfClass(Viewport):
        placed_ids.add(vp.ViewId.Value)

    def vistas_pendientes(nombre):
        # orden de lamina: NIPB -> P.T. -> plantas T.A. ascendentes -> elevaciones de eje
        #
        # TODO por prefijo, ni un solo nombre exacto: desde el 2026-09-17 el nombre de la
        # vista puede llevar la marca del juego al final ("ES-1001 - NIPB [REV_B]"), asi que
        # un get() por nombre exacto no encontraria nada. Como las ya colocadas se saltan,
        # una corrida nueva recoge unicamente el juego que todavia no esta en ninguna lamina.
        res = []
        nipbs = sorted(k for k in view_by_name if es_de_este_juego(k) and k.startswith(nombre + SUF_NIPB))
        if not nipbs:
            log.append('AVISO: no existe la vista "{}" (corre 00_Vistas de assembly).'.format(nombre + SUF_NIPB))
        for n in nipbs:
            if view_by_name[n].Id.Value not in placed_ids:
                res.append(view_by_name[n])
        # las P.T. (punto de trabajo) van SEGUNDAS, entre la NIPB y las T.A. Desde el
        # 2026-09-16 son N por assembly, igual que las T.A., asi que se buscan por
        # PREFIJO y no por nombre exacto: un assembly puede traer "- P.T. 01" y
        # "- P.T. 02". El orden alfabetico del correlativo de 2 digitos es el orden
        # por altura, que es como 00 las numero.
        pts = sorted(k for k in view_by_name if es_de_este_juego(k) and k.startswith(nombre + SUF_PT))
        if not pts:
            log.append('AVISO: no existe ninguna vista "{}..." (corre 00_Vistas de assembly).'.format(nombre + SUF_PT))
        for n in pts:
            if view_by_name[n].Id.Value not in placed_ids:
                res.append(view_by_name[n])
        for n in sorted(k for k in view_by_name if es_de_este_juego(k) and k.startswith(nombre + SUF_TA)):
            if view_by_name[n].Id.Value not in placed_ids:
                res.append(view_by_name[n])
        ejes = [k for k in view_by_name if es_de_este_juego(k) and k.startswith(nombre + SUF_EJE)]
        ejes.sort(key=lambda k: clave_natural(k[len(nombre + SUF_EJE):]))
        for n in ejes:
            if view_by_name[n].Id.Value not in placed_ids:
                res.append(view_by_name[n])
        return res

    pendientes = {}
    for n in names:
        vs = vistas_pendientes(n)
        if vs:
            pendientes[n] = vs

    if not pendientes:
        log.append('No hay vistas pendientes de colocar; no se creo ninguna lamina.')
        OUT = log
    else:
        created = 0
        sheets_needed = 0
        TransactionManager.Instance.EnsureInTransaction(doc)
        try:
            if hasattr(tb_type, 'IsActive') and not tb_type.IsActive:
                tb_type.Activate()

            # --- medir el area util real de esta vineta con una lamina de prueba ---
            probe = ViewSheet.Create(doc, tb_type.Id)
            doc.Regenerate()
            rect_1 = usable_rect(probe, True)
            rect_n = usable_rect(probe, False)
            doc.Delete(probe.Id)

            # --- simulacion en seco, assembly por assembly ---
            for n in sorted(pendientes.keys()):
                vistas = pendientes[n]
                tamanos = [tamano_con_titulo(v) for v in vistas]
                pos, n_lam, avisos = empaquetar(tamanos, rect_1, rect_n, margin)
                sheets_needed += n_lam
                for w, h in avisos:
                    log.append('AVISO {}: una vista de {:.0f} x {:.0f} mm en papel excede el area util de una lamina completa; ocupara una lamina para si sola.'.format(
                        n, w * 304.8, h * 304.8))
                log.append('{}: {} vista(s) -> {} lamina(s).'.format(n, len(vistas), n_lam))

            # --- crear esa cantidad de laminas, con la numeracion de siempre ---
            if not first_number:
                first_number = 'A-001'
                log.append('AVISO: numero inicial vacio, se usa A-001.')
            if not first_name:
                first_name = 'SIN NOMBRE 01'
                log.append('AVISO: nombre inicial vacio, se usa SIN NOMBRE 01.')

            existing = set()
            for vs in FilteredElementCollector(doc).OfClass(ViewSheet):
                existing.add(vs.SheetNumber)

            plan = []
            produced = 0
            offset = 0
            while produced < sheets_needed and offset < sheets_needed + 1000:
                num = first_number if offset == 0 else bump(first_number, offset)
                offset += 1
                if num in existing:
                    log.append('AVISO: el numero {} ya existe en el proyecto, se salta.'.format(num))
                    continue
                name = first_name if produced == 0 else bump(first_name, produced)
                plan.append((num, name))
                existing.add(num)
                produced += 1

            for num, name in plan:
                try:
                    sheet = ViewSheet.Create(doc, tb_type.Id)
                    sheet.SheetNumber = num
                    try:
                        sheet.Name = name
                    except Exception:
                        Element.Name.__set__(sheet, name)
                    created += 1
                    log.append('OK: {}  |  {}'.format(num, name))
                except Exception as e:
                    log.append('ERROR creando {}: {}'.format(num, e))
        finally:
            TransactionManager.Instance.TransactionTaskDone()

        log.insert(0, 'Vineta usada: ' + tb_label(tb_type))
        log.insert(1, 'Assemblies con vistas pendientes: {} | laminas necesarias: {} | creadas: {}'.format(
            len(pendientes), sheets_needed, created))
        log.append('Listo. Ahora corre 02_Colocar vistas en laminas para distribuir las vistas.')
        OUT = log
# ----------------------------------------
log = Watch(py_calcular_y_crear_laminas_1)  # graph output
