# Dynamo graph 01_Crear laminas.dyn (Dynamo 4.0.2.3852)
# Crea N sheets: viñeta elegida por dropdown, primer numero/nombre manual, resto autoincremental (incrementa el ultimo bloque numerico conservando ceros).

viñeta_title_block_elegir_del = FamilyTypes("BIOS_E_VINE_A1_NOVANDINO:Formato-DETALLE")  # "Viñeta (Title Block) — elegir del dropdown"; graph input
numero_del_primer_sheet = StringInput("prueba 0101")  # graph input
nombre_del_primer_sheet = StringInput("test")  # graph input
cantidad_de_sheets = IntegerSlider(1, range=1..30 step 1)  # graph input
py_crear_sheets = Python(IN[0]=viñeta_title_block_elegir_del, IN[1]=numero_del_primer_sheet, IN[2]=nombre_del_primer_sheet, IN[3]=cantidad_de_sheets)  # PythonNet3
# ---------- py_crear_sheets.python (121 lines) ----------
# 01_Crear laminas - Creacion de sheets con numeracion autoincremental
# Revit 2027 / Dynamo 4 / CPython3
# IN[0] = tipo de viñeta (dropdown Family Types)
# IN[1] = numero del primer sheet
# IN[2] = nombre del primer sheet
# IN[3] = cantidad de sheets

import clr
import re
clr.AddReference('RevitAPI')
clr.AddReference('RevitServices')
from Autodesk.Revit.DB import (FilteredElementCollector, BuiltInCategory,
                               ViewSheet, ElementId, Element)
from RevitServices.Persistence import DocumentManager
from RevitServices.Transactions import TransactionManager

doc = DocumentManager.Instance.CurrentDBDocument

tb_type = UnwrapElement(IN[0])
first_number = (IN[1] or '').strip()
first_name = (IN[2] or '').strip()
count = int(IN[3])
if count < 1:
    count = 1

log = []

def elem_name(e):
    try:
        return e.Name
    except Exception:
        return Element.Name.__get__(e)

def tb_label(t):
    try:
        return '{} : {}'.format(t.FamilyName, elem_name(t))
    except Exception:
        return 'Id ' + str(t.Id)

def list_titleblocks():
    col = (FilteredElementCollector(doc)
           .OfCategory(BuiltInCategory.OST_TitleBlocks)
           .WhereElementIsElementType())
    return list(col)

# --- validacion de la viñeta seleccionada ---
tb_cat_id = ElementId(BuiltInCategory.OST_TitleBlocks)
is_tb = (tb_type is not None
         and tb_type.Category is not None
         and tb_type.Category.Id == tb_cat_id)

if not is_tb:
    log.append('ERROR: el tipo seleccionado en el dropdown NO es una viñeta (Title Block).')
    log.append('Selecciona una de estas viñetas cargadas en el proyecto:')
    tbs = list_titleblocks()
    if not tbs:
        log.append('  (no hay viñetas cargadas en el proyecto)')
    for t in tbs:
        log.append('  - ' + tb_label(t))
    OUT = log
else:
    if not first_number:
        first_number = 'A-001'
        log.append('AVISO: numero inicial vacio, se usa A-001.')
    if not first_name:
        first_name = 'SIN NOMBRE 01'
        log.append('AVISO: nombre inicial vacio, se usa SIN NOMBRE 01.')

    def bump(text, steps):
        # incrementa el ULTIMO bloque numerico conservando el ancho (ceros a la izquierda)
        last = None
        for m in re.finditer('\\d+', text):
            last = m
        if last is None:
            return '{} {:02d}'.format(text, steps + 1)
        width = len(last.group(0))
        val = int(last.group(0)) + steps
        return text[:last.start()] + str(val).zfill(width) + text[last.end():]

    existing = set()
    for vs in FilteredElementCollector(doc).OfClass(ViewSheet):
        existing.add(vs.SheetNumber)

    # planificar numeros/nombres saltando numeros ya ocupados
    plan = []
    produced = 0
    offset = 0
    while produced < count and offset < count + 1000:
        num = first_number if offset == 0 else bump(first_number, offset)
        offset += 1
        if num in existing:
            log.append('AVISO: el numero {} ya existe en el proyecto, se salta.'.format(num))
            continue
        name = first_name if produced == 0 else bump(first_name, produced)
        plan.append((num, name))
        existing.add(num)
        produced += 1

    created = 0
    TransactionManager.Instance.EnsureInTransaction(doc)
    try:
        if hasattr(tb_type, 'IsActive') and not tb_type.IsActive:
            tb_type.Activate()
        for num, name in plan:
            try:
                sheet = ViewSheet.Create(doc, tb_type.Id)
                sheet.SheetNumber = num
                try:
                    sheet.Name = name
                except Exception:
                    Element.Name.__set__(sheet, name)
                created += 1
                log.append('OK: {}  |  {}'.format(num, name))
            except Exception as e:
                log.append('ERROR creando {}: {}'.format(num, e))
    finally:
        TransactionManager.Instance.TransactionTaskDone()

    log.insert(0, 'Viñeta usada: ' + tb_label(tb_type))
    log.insert(1, 'Sheets creados: {} de {}'.format(created, count))
    OUT = log
# ----------------------------------------
log = Watch(py_crear_sheets)  # graph output
