# Dynamo graph 02_Colocar vistas en laminas.dyn (Dynamo 4.0.2.3852)
# Coloca las vistas de assembly en los sheets destino: por cada assembly, planta arriba y corte abajo centrados en el mismo eje vertical; los bloques se reparten en grilla y pasan al siguiente sheet cuando uno se llena. Si el tipo de viewport con titulo no existe todavia en el proyecto, lo crea (duplicando uno existente, con Show Title y familia de View Title configuradas).

sheets_destino_numeros_con_coma = StringInput("test")  # "Sheets destino (numeros con coma, o prefijo)"; graph input
procesar_todos_los_assemblies = BoolSelector(true)  # graph input
filtro_assemblies_si_todos_false = StringInput("")  # graph input
margen_y_separacion_mm = IntegerSlider(5, range=0..50 step 1)  # graph input
reserva_para_la_tabla_lado = IntegerSlider(150, range=0..400 step 10)  # "Reserva para la tabla, lado derecho (mm)"; graph input
tipo_de_viewport_para_plantas = StringInput("C_Titulo_General")  # graph input
tipo_de_viewport_para = StringInput("C_Titulo_Seccion")  # "Tipo de viewport para elevaciones de eje"; graph input
separacion_titulo_elevaciones_mm = IntegerSlider(19, range=0..60 step 1)  # graph input
subcarpeta_juego_de_vistas_vacio = StringInput("")  # "Subcarpeta / juego de vistas (vacio = sin subcarpeta)"; graph input
py_colocar_vistas_flujo_por = Python(IN[0]=sheets_destino_numeros_con_coma, IN[1]=procesar_todos_los_assemblies, IN[2]=filtro_assemblies_si_todos_false, IN[3]=margen_y_separacion_mm, IN[4]=reserva_para_la_tabla_lado, IN[5]=tipo_de_viewport_para_plantas, IN[6]=tipo_de_viewport_para, IN[7]=separacion_titulo_elevaciones_mm, IN[8]=subcarpeta_juego_de_vistas_vacio)  # "PY | Colocar vistas (flujo por assembly)"; PythonNet3
# ---------- py_colocar_vistas_flujo_por.python (612 lines) ----------
# 02_Colocar vistas en laminas - ACERO
#
# Regla de aislamiento (estandar del proyecto): cada lamina lleva vistas de UN SOLO
# assembly. Por assembly se colocan, en este orden y fluyendo de izquierda a derecha
# y de arriba hacia abajo: la planta NIPB, las plantas T.A. en orden ascendente y
# luego una elevacion por cada eje que cruza el assembly. Cuando se llena la lamina
# se sigue en la siguiente, y el assembly SIGUIENTE siempre arranca en una lamina
# nueva (nunca se mezclan dos assemblies en la misma lamina).
#
# La tabla de cantidades (06) va solo en la PRIMERA lamina de cada assembly, asi que
# la reserva del lado derecho se descuenta unicamente en esa lamina; las siguientes
# del mismo assembly usan el ancho completo.
#
# Leyendas: por cada sheet destino se colocan, en la esquina INFERIOR DERECHA del
# area util, las vistas de tipo Legend cuyo nombre coincida con el nombre de TIPO de
# familia (Symbol.Name) de algun miembro del assembly de ese sheet. Cada sheet recibe
# su PROPIO duplicado de la leyenda ("{tipo} - {sheet}") porque Cantidad_Inserto es un
# parametro de la VISTA y 07 debe poder escribir una cantidad distinta por lamina.
#
# Revit 2027 / Dynamo 4 / CPython3
# IN[0] = sheets destino: numeros separados por coma, o un prefijo comun
# IN[1] = procesar todos los assemblies (bool)
# IN[2] = filtro de assemblies si IN[1] es False (parcial, comas)
# IN[3] = margen y separacion entre vistas (mm)
# IN[4] = reserva del lado derecho para la tabla de 06 (mm)
# IN[5] = tipo de viewport para las PLANTAS (NIPB y T.A.)
# IN[6] = tipo de viewport para las ELEVACIONES de eje
# IN[7] = separacion del titulo bajo las elevaciones (mm)

import clr
import re
clr.AddReference('RevitAPI')
clr.AddReference('RevitServices')
from Autodesk.Revit.DB import (FilteredElementCollector, AssemblyInstance, ViewSheet,
                               Viewport, View, ViewType, BuiltInCategory, XYZ, Element,
                               ElementType, BuiltInParameter, FamilySymbol, FamilyInstance,
                               ViewDuplicateOption, StorageType)
from RevitServices.Persistence import DocumentManager
from RevitServices.Transactions import TransactionManager

doc = DocumentManager.Instance.CurrentDBDocument

sheets_text = (IN[0] or '').strip()
process_all = bool(IN[1])
filter_text = (IN[2] or '').strip()
margin = float(IN[3]) / 304.8
right_reserve = float(IN[4]) / 304.8
vp_type_text = (IN[5] or '').strip()
vp_type_text_elev = (IN[6] or '').strip()
gap_elev = float(IN[7]) / 304.8       # separacion del titulo bajo las elevaciones
juego_vistas = (IN[8] or '').strip()
# --- juego de vistas (2026-09-17) ---------------------------------------------------------
# 00 escribe el nombre de la subcarpeta al final del nombre de cada vista que crea:
# "ES-1001 - T.A. 01 (REV_B)". Sirve para que correr 00 con otro nombre de carpeta genere un
# juego NUEVO en vez de caer sobre las vistas ya maquetadas y acotadas.
#
# Este input dice sobre CUAL de esos juegos trabajar. Vacio = el juego sin marca, que es el
# que crea 00 cuando la subcarpeta se deja en blanco.
#
# Sin esto, 01 y 02 recogian cualquier vista que no estuviera colocada: alcanzaba para el
# caso normal, pero si un juego viejo tenia vistas sueltas se mezclaban con las nuevas en la
# misma lamina.
MARCA_JUEGO = ' ({})'.format(juego_vistas) if juego_vistas else ''


def juego_de(vname):
    # la marca que lleva ese nombre al final, o '' si no lleva ninguna
    if vname.endswith(')'):
        i = vname.rfind(' (')
        if i >= 0:
            return vname[i:]
    return ''


def es_de_este_juego(vname):
    # NO alcanza con endswith(MARCA_JUEGO): con la marca vacia, endswith('') da True para
    # TODO y se colarian las vistas de los demas juegos. Hay que comparar la marca completa.
    return juego_de(vname) == MARCA_JUEGO


gap_planta = 5.0 / 304.8

label_h_planta = 12.0 / 304.8
label_h_elev = (12.0 + 14.0) / 304.8

log = []

# --- contrato de nombres con 00_Vistas de assembly ---
SUF_NIPB = ' - NIPB'
SUF_PT = ' - P.T. '        # + correlativo: son N por assembly, como las T.A.
SUF_TA = ' - T.A. '
SUF_EJE = ' - EJE '


def elem_name(e):
    try:
        return e.Name
    except Exception:
        return Element.Name.__get__(e)


def es_elevacion(nombre):
    return SUF_EJE in nombre


def nombre_del_eje(nombre):
    i = nombre.find(SUF_EJE)
    if i < 0:
        return None
    return nombre[i + len(SUF_EJE):]


def assembly_de_vista(nombre):
    if nombre.endswith(SUF_NIPB):
        return nombre[:-len(SUF_NIPB)]
    if nombre.endswith(SUF_PT):
        return nombre[:-len(SUF_PT)]
    for suf in (SUF_TA, SUF_EJE):
        i = nombre.find(suf)
        if i > 0:
            return nombre[:i]
    return nombre


def clave_natural(s):
    partes = re.split('(\\d+)', s)
    return [(1, int(p), '') if p.isdigit() else (0, 0, p.lower()) for p in partes if p != '']


# --- tipos de viewport (plantas y elevaciones) ---
vp_types = [t for t in FilteredElementCollector(doc).OfClass(ElementType)
            if t.FamilyName == 'Viewport']


def crear_tipo_viewport(nombre):
    # bootstrap: el tipo no existe todavia en el proyecto -> se crea duplicando uno
    # existente y se configura para que muestre titulo (Show Title + familia de
    # View Title). Asi el graph queda autosuficiente en un proyecto nuevo.
    base = vp_types[0]
    nuevo = base.Duplicate(nombre)
    vp_types.append(nuevo)
    log.append('Tipo de viewport {} creado (duplicado de {}).'.format(nombre, elem_name(base)))
    p = nuevo.get_Parameter(BuiltInParameter.VIEWPORT_ATTR_SHOW_LABEL)
    if p is not None and not p.IsReadOnly and p.AsInteger() != 1:
        p.Set(1)
    pt = nuevo.get_Parameter(BuiltInParameter.VIEWPORT_ATTR_LABEL_TAG)
    if pt is not None and (pt.AsElementId() is None or pt.AsElementId().Value < 0):
        labels = list(FilteredElementCollector(doc).OfClass(FamilySymbol)
                      .OfCategory(BuiltInCategory.OST_ViewportLabel))
        if labels:
            pt.Set(labels[0].Id)
        else:
            log.append('AVISO: no hay ninguna familia View Title cargada en el proyecto; el tipo {} mostrara la linea pero no el texto.'.format(nombre))
            log.append('Carga una (Insertar > Cargar familia > Anotaciones > titulo de vista) y re-corre.')
    return nuevo


def buscar_tipo_viewport(texto, uso):
    if not texto:
        return None
    low = texto.lower()
    for t in vp_types:
        if elem_name(t).lower() == low:
            return t
    cands = [t for t in vp_types if low in elem_name(t).lower()]
    if len(cands) == 1:
        return cands[0]
    if len(cands) > 1:
        log.append('AVISO: hay {} tipos de viewport que coinciden parcialmente con "{}" (para {}); se usa el tipo por defecto.'.format(len(cands), texto, uso))
        log.append('Tipos disponibles: ' + ', '.join(sorted(elem_name(t) for t in vp_types)))
        return None
    return crear_tipo_viewport(texto)


vp_type = None
vp_type_elev = None
vp_type_leyenda = None

# --- sheets destino, ordenados por numero ---
all_sheets = {}
for s in FilteredElementCollector(doc).OfClass(ViewSheet):
    all_sheets[s.SheetNumber] = s

target_sheets = []
seen = set()
for tok in [t.strip() for t in sheets_text.split(',') if t.strip()]:
    if tok in all_sheets:
        matches = [all_sheets[tok]]
    else:
        matches = [s for n, s in all_sheets.items() if n.startswith(tok)]
    for s in matches:
        if s.SheetNumber not in seen:
            seen.add(s.SheetNumber)
            target_sheets.append(s)
target_sheets.sort(key=lambda s: s.SheetNumber)

if not target_sheets:
    log.append('ERROR: ningun sheet coincide con "{}".'.format(sheets_text))
    log.append('Sheets del proyecto: ' + ', '.join(sorted(all_sheets.keys())[:30]))
    OUT = log
else:
    # by_type: TODOS los tipos de assembly del proyecto (no solo los del filtro de
    # esta corrida) - hace falta para las leyendas, que deben matchear tambien
    # assemblies colocados en corridas anteriores con otro filtro.
    by_type = {}
    for ai in FilteredElementCollector(doc).OfClass(AssemblyInstance):
        by_type.setdefault(ai.AssemblyTypeName, []).append(ai)
    names = sorted(by_type.keys())
    if not names:
        log.append('AVISO: no hay ningun Assembly en el modelo.')
    if not process_all:
        tokens = [t.strip().lower() for t in filter_text.split(',') if t.strip()]
        if tokens:
            names = [n for n in names if any(tok in n.lower() for tok in tokens)]
        else:
            names = []
            log.append('ERROR: "Todos" esta en False y el filtro esta vacio.')

    view_by_name = {}
    for v in FilteredElementCollector(doc).OfClass(View):
        if not v.IsTemplate:
            view_by_name[elem_name(v)] = v

    placed_ids = set()
    vp_by_view = {}
    for vp in FilteredElementCollector(doc).OfClass(Viewport):
        placed_ids.add(vp.ViewId.Value)
        vp_by_view[vp.ViewId.Value] = vp

    def paper_size(v):
        cb = v.CropBox
        s = v.Scale if v.Scale > 0 else 1
        return ((cb.Max.X - cb.Min.X) / s, (cb.Max.Y - cb.Min.Y) / s)

    def tamano_con_titulo(v):
        w, h = paper_size(v)
        return (w, h + (label_h_elev if es_elevacion(elem_name(v)) else label_h_planta))

    def usable_rect(sheet, con_reserva):
        reserva = right_reserve if con_reserva else 0.0
        col = FilteredElementCollector(doc, sheet.Id).OfCategory(BuiltInCategory.OST_TitleBlocks)
        tb = col.FirstElement()
        if tb is not None:
            bb = tb.get_BoundingBox(sheet)
            if bb is not None:
                return (bb.Min.X + margin, bb.Min.Y + margin,
                        bb.Max.X - margin - reserva, bb.Max.Y - margin)
        o = sheet.Outline
        return (o.Min.U + margin, o.Min.V + margin,
                o.Max.U - margin - reserva, o.Max.V - margin)

    def empaquetar(tamanos, rect_1, rect_n, margin):
        # identico al de 01_Calcular y crear laminas: si los dos difieren, 01
        # calcula una cantidad de laminas que no coincide con lo que 02 coloca.
        pos = []
        avisos = []
        idx = 0
        x0, y0, x1, y1 = rect_1
        cx, cy, row_h = x0, y1, 0.0
        for w, h in tamanos:
            if cx > x0 and cx + w > x1:
                cx = x0
                cy -= row_h + margin
                row_h = 0.0
            fresco = (abs(cx - x0) < 1e-9 and abs(cy - y1) < 1e-9)
            if cy - h < y0 and not fresco:
                idx += 1
                x0, y0, x1, y1 = rect_n
                cx, cy, row_h = x0, y1, 0.0
                fresco = True
            if fresco and (w > (x1 - x0) or h > (y1 - y0)):
                avisos.append((w, h))
            pos.append((idx, cx, cy))
            cx += w + margin
            if h > row_h:
                row_h = h
        return pos, idx + 1, avisos

    def vistas_pendientes(nombre):
        # orden de lamina: NIPB -> P.T. -> plantas T.A. ascendentes -> elevaciones de eje
        #
        # TODO por prefijo, ni un solo nombre exacto: desde el 2026-09-17 el nombre de la
        # vista puede llevar la marca del juego al final ("ES-1001 - NIPB [REV_B]"), asi que
        # un get() por nombre exacto no encontraria nada. Como las ya colocadas se saltan,
        # una corrida nueva recoge unicamente el juego que todavia no esta en ninguna lamina.
        res = []
        nipbs = sorted(k for k in view_by_name if es_de_este_juego(k) and k.startswith(nombre + SUF_NIPB))
        if not nipbs:
            log.append('AVISO: no existe la vista "{}" (corre 00_Vistas de assembly).'.format(nombre + SUF_NIPB))
        for n in nipbs:
            if view_by_name[n].Id.Value in placed_ids:
                log.append('AVISO: "{}" ya esta en un sheet, se salta.'.format(n))
            else:
                res.append(view_by_name[n])
        # las P.T. (punto de trabajo) van SEGUNDAS, entre la NIPB y las T.A. Desde el
        # 2026-09-16 son N por assembly, igual que las T.A., asi que se buscan por
        # PREFIJO y no por nombre exacto: un assembly puede traer "- P.T. 01" y
        # "- P.T. 02". El orden alfabetico del correlativo de 2 digitos es el orden
        # por altura, que es como 00 las numero.
        pts = sorted(k for k in view_by_name if es_de_este_juego(k) and k.startswith(nombre + SUF_PT))
        if not pts:
            log.append('AVISO: no existe ninguna vista "{}..." (corre 00_Vistas de assembly).'.format(nombre + SUF_PT))
        for n in pts:
            if view_by_name[n].Id.Value in placed_ids:
                log.append('AVISO: "{}" ya esta en un sheet, se salta.'.format(n))
            else:
                res.append(view_by_name[n])
        for n in sorted(k for k in view_by_name if es_de_este_juego(k) and k.startswith(nombre + SUF_TA)):
            if view_by_name[n].Id.Value not in placed_ids:
                res.append(view_by_name[n])
        ejes = [k for k in view_by_name if es_de_este_juego(k) and k.startswith(nombre + SUF_EJE)]
        ejes.sort(key=lambda k: clave_natural(nombre_del_eje(k) or ''))
        for n in ejes:
            if view_by_name[n].Id.Value not in placed_ids:
                res.append(view_by_name[n])
        return res

    def numero_detalle(vp, v, sheet):
        # En acero la elevacion se identifica por su EJE, no por una letra
        # correlativa: el Detail Number es lo que muestra el simbolo de corte en la
        # planta, asi que ponerle el nombre del eje deja la marca de la planta y el
        # titulo de la elevacion diciendo lo mismo ("EJE 13a"). Si el numero ya esta
        # usado en ese sheet, se cae a un correlativo para no romper la unicidad.
        g = nombre_del_eje(elem_name(v))
        if not g:
            return
        usados = set()
        for vpid in sheet.GetAllViewports():
            if vpid.Value == vp.Id.Value:
                continue
            ovp = doc.GetElement(vpid)
            try:
                dn = ovp.get_Parameter(BuiltInParameter.VIEWPORT_DETAIL_NUMBER).AsString()
                if dn:
                    usados.add(dn)
            except Exception:
                pass
        destino = g
        k = 2
        while destino in usados:
            destino = '{}({})'.format(g, k)
            k += 1
        try:
            p = vp.get_Parameter(BuiltInParameter.VIEWPORT_DETAIL_NUMBER)
            if p is not None and not p.IsReadOnly:
                p.Set(destino)
        except Exception:
            pass

    def colocar_vista(v, x_izq, y_sup, sheet):
        # coloca la vista y la reposiciona con su tamaño REAL ya colocado
        # (Viewport.GetBoxOutline(), que SI incluye anotaciones fuera del CropBox -
        # cotas, spot elevations, tags - porque el Annotation Crop esta desactivado),
        # alineando su esquina superior izquierda con (x_izq, y_sup).
        w_v = paper_size(v)[0]
        h_v = paper_size(v)[1]
        centro = XYZ(x_izq + w_v / 2.0, y_sup - h_v / 2.0, 0.0)
        try:
            vp = Viewport.Create(doc, sheet.Id, v.Id, centro)
        except Exception as e:
            log.append('ERROR colocando "{}": {}'.format(elem_name(v), e))
            return 0
        if vp is None:
            log.append('ERROR: Revit no permitio colocar "{}" en {}.'.format(elem_name(v), sheet.SheetNumber))
            return 0
        elev = es_elevacion(elem_name(v))
        t_apl = vp_type_elev if elev else vp_type
        if t_apl is not None:
            try:
                if vp.GetTypeId() != t_apl.Id:
                    vp.ChangeTypeId(t_apl.Id)
                vp.LabelOffset = XYZ(0.0, -(gap_elev if elev else gap_planta), 0.0)
                vp.LabelLineLength = w_v
            except Exception:
                pass
        if elev:
            numero_detalle(vp, v, sheet)
        try:
            ob = vp.GetBoxOutline()
            centro_actual = vp.GetBoxCenter()
            dx = x_izq - ob.MinimumPoint.X
            dy = y_sup - ob.MaximumPoint.Y
            vp.SetBoxCenter(XYZ(centro_actual.X + dx, centro_actual.Y + dy, 0.0))
        except Exception:
            pass
        log.append('OK: "{}" -> sheet {}'.format(elem_name(v), sheet.SheetNumber))
        return 1

    def familias_recursivas(ai):
        # nombres de TIPO (Symbol.Name, no Family.Name) de TODOS los miembros del
        # assembly, a cualquier profundidad - para matchear leyendas, que llevan el
        # nombre del TIPO de familia.
        vistos = set()
        nombres = set()
        stack = list(ai.GetMemberIds())
        while stack:
            eid = stack.pop()
            if eid.Value in vistos:
                continue
            vistos.add(eid.Value)
            el = doc.GetElement(eid)
            if el is None or not isinstance(el, FamilyInstance):
                continue
            try:
                nombres.add(el.Symbol.Name)
            except Exception:
                pass
            try:
                stack.extend(el.GetSubComponentIds())
            except Exception:
                pass
        return nombres

    legend_by_name = {}
    for v in FilteredElementCollector(doc).OfClass(View):
        if not v.IsTemplate and v.ViewType == ViewType.Legend:
            legend_by_name[elem_name(v).lower()] = v

    def duplicado_leyenda(lv_orig, nombre_base, sheet):
        # una Legend colocada en varios sheets comparte UN solo Cantidad_Inserto (es
        # un parametro de la VISTA): si 07 escribiera la suma de cada lamina en la
        # misma vista, ganaria la ultima procesada y todas mostrarian ese numero. Por
        # eso cada sheet recibe su PROPIO duplicado, "{tipo} - {sheet}".
        dup_name = '{} - {}'.format(nombre_base, sheet.SheetNumber)
        dup = legend_by_name.get(dup_name.lower())
        if dup is not None:
            return dup
        dup = doc.GetElement(lv_orig.Duplicate(ViewDuplicateOption.WithDetailing))
        try:
            dup.Name = dup_name
        except Exception:
            Element.Name.__set__(dup, dup_name)
        p = dup.get_Parameter(BuiltInParameter.VIEW_DESCRIPTION)
        if p is not None and not p.IsReadOnly:
            p.Set(nombre_base)
        pc = dup.LookupParameter('Cantidad_Inserto')
        if pc is not None and not pc.IsReadOnly:
            try:
                if pc.StorageType == StorageType.Integer:
                    pc.Set(0)
                elif pc.StorageType == StorageType.Double:
                    pc.Set(0.0)
                else:
                    pc.Set('0')
            except Exception:
                pass
        legend_by_name[dup_name.lower()] = dup
        return dup

    def assemblies_en_sheet(sheet):
        tipos = set()
        for vpid in sheet.GetAllViewports():
            vp_s = doc.GetElement(vpid)
            v_s = doc.GetElement(vp_s.ViewId)
            if v_s is None:
                continue
            base = assembly_de_vista(elem_name(v_s))
            if base in by_type:
                tipos.add(base)
        return tipos

    def colocar_leyendas(sheet, familias_vistas_global):
        # esquina INFERIOR DERECHA del area util, empacando de derecha a izquierda y
        # de abajo hacia arriba (direccion opuesta a la grilla de vistas). Se usa el
        # area util SIN reserva: la reserva la ocupa la tabla, arriba a la derecha.
        tipos = assemblies_en_sheet(sheet)
        if not tipos:
            return 0
        familias = set()
        for tn in tipos:
            familias |= familias_recursivas(by_type[tn][0])
        familias_vistas_global |= familias
        nombres_match = sorted(n for n in familias if n.lower() in legend_by_name)
        if not nombres_match:
            return 0
        vp_por_vista = {}
        for vpid in sheet.GetAllViewports():
            vp_s2 = doc.GetElement(vpid)
            vp_por_vista[vp_s2.ViewId.Value] = vp_s2
        x0, y0, x1, y1 = usable_rect(sheet, False)
        cx, cy, row_h = x1, y0, 0.0
        n_ok = 0
        for nombre in nombres_match:
            lv_orig = legend_by_name[nombre.lower()]
            try:
                lv = duplicado_leyenda(lv_orig, nombre, sheet)
            except Exception as e:
                log.append('ERROR duplicando la leyenda "{}" para el sheet {}: {}'.format(nombre, sheet.SheetNumber, e))
                continue
            if lv.Id.Value in vp_por_vista:
                continue
            centro_previo = None
            vp_viejo = vp_por_vista.get(lv_orig.Id.Value)
            if vp_viejo is not None:
                centro_previo = vp_viejo.GetBoxCenter()
                doc.Delete(vp_viejo.Id)
            try:
                # las leyendas no tienen un CropBox confiable: se colocan en un punto
                # provisorio, se mide el tamaño REAL ya colocado y recien ahi se
                # reposicionan a su lugar final.
                vp = Viewport.Create(doc, sheet.Id, lv.Id,
                                     centro_previo if centro_previo is not None else XYZ(cx, cy, 0.0))
                if vp is None:
                    log.append('ERROR: Revit no permitio colocar la leyenda "{}" en {}.'.format(elem_name(lv), sheet.SheetNumber))
                    continue
                if vp_type_leyenda is not None and vp.GetTypeId() != vp_type_leyenda.Id:
                    vp.ChangeTypeId(vp_type_leyenda.Id)
                if centro_previo is not None:
                    vp.SetBoxCenter(centro_previo)
                    n_ok += 1
                    log.append('OK: leyenda "{}" migrada a duplicado propio en sheet {}.'.format(nombre, sheet.SheetNumber))
                    continue
                ob = vp.GetBoxOutline()
                w = ob.MaximumPoint.X - ob.MinimumPoint.X
                h = ob.MaximumPoint.Y - ob.MinimumPoint.Y
                if cx < x1 and cx - w < x0:
                    cx = x1
                    cy += row_h + margin
                    row_h = 0.0
                if cy + h > y1:
                    log.append('AVISO: leyenda "{}" no cabe en el area util del sheet {}; se coloca igual.'.format(elem_name(lv), sheet.SheetNumber))
                vp.SetBoxCenter(XYZ(cx - w / 2.0, cy + h / 2.0, 0.0))
                n_ok += 1
                log.append('OK: leyenda "{}" -> sheet {}'.format(elem_name(lv), sheet.SheetNumber))
            except Exception as e:
                log.append('ERROR colocando la leyenda "{}": {}'.format(elem_name(lv), e))
                continue
            cx -= w + margin
            if h > row_h:
                row_h = h
        return n_ok

    pendientes = {}
    for n in names:
        vs = vistas_pendientes(n)
        if vs:
            pendientes[n] = vs

    total_vistas = sum(len(v) for v in pendientes.values())
    placed = 0
    overflow = []
    total_leyendas = 0

    TransactionManager.Instance.EnsureInTransaction(doc)
    try:
        vp_type = buscar_tipo_viewport(vp_type_text, 'plantas')
        vp_type_elev = buscar_tipo_viewport(vp_type_text_elev, 'elevaciones')
        # tipo de viewport para leyendas: fijo (estandar de oficina, no es input)
        vp_type_leyenda = buscar_tipo_viewport('C_Titulo_General', 'leyendas')

        # laminas disponibles = las del filtro que todavia no tienen ningun viewport.
        # Un assembly nunca se mezcla con otro, asi que solo se usan laminas vacias.
        libres = []
        for sh in target_sheets:
            if len(list(sh.GetAllViewports())) > 0:
                log.append('AVISO: sheet {} ya tiene vistas colocadas, se omite.'.format(sh.SheetNumber))
            else:
                libres.append(sh)

        si = 0
        for n in sorted(pendientes.keys()):
            vistas = pendientes[n]
            if si >= len(libres):
                for v in vistas:
                    overflow.append(elem_name(v))
                continue
            rect_1 = usable_rect(libres[si], True)
            rect_n = usable_rect(libres[si], False)
            tamanos = [tamano_con_titulo(v) for v in vistas]
            pos, n_lam, avisos = empaquetar(tamanos, rect_1, rect_n, margin)
            for w, h in avisos:
                log.append('AVISO {}: una vista de {:.0f} x {:.0f} mm en papel excede el area util de la lamina; se coloca igual.'.format(
                    n, w * 304.8, h * 304.8))
            if si + n_lam > len(libres):
                faltan = si + n_lam - len(libres)
                log.append('AVISO {}: faltan {} lamina(s) libres para este assembly.'.format(n, faltan))
            usadas = []
            for k in range(n_lam):
                if si + k < len(libres):
                    usadas.append(libres[si + k])
            for (idx, x, y), v in zip(pos, vistas):
                if idx >= len(usadas):
                    overflow.append(elem_name(v))
                    continue
                placed += colocar_vista(v, x, y, usadas[idx])
            log.append('{}: {} vista(s) en {}.'.format(
                n, len(vistas), ', '.join(s.SheetNumber for s in usadas) if usadas else '(sin lamina)'))
            si += n_lam

        # --- leyendas: por cada sheet destino, independiente de si sus assemblies se
        # colocaron en esta corrida o en una anterior ---
        # doc.Regenerate() es necesario: los viewports recien colocados arriba (misma
        # transaccion) no aparecen todavia en sheet.GetAllViewports() sin esto.
        doc.Regenerate()
        familias_vistas_global = set()
        if not legend_by_name:
            log.append('AVISO: no hay ninguna vista de tipo Legend en el proyecto; no se colocan leyendas.')
        else:
            for sh in target_sheets:
                total_leyendas += colocar_leyendas(sh, familias_vistas_global)
            if total_leyendas == 0:
                log.append('AVISO: ninguna leyenda coincidio por nombre con un tipo de familia de los assemblies.')
                log.append('Leyendas cargadas: ' + (', '.join(sorted(elem_name(v) for v in legend_by_name.values())) if legend_by_name else '(ninguna)'))
                log.append('Nombres de tipo encontrados: ' + (', '.join(sorted(familias_vistas_global)) if familias_vistas_global else '(ninguno)'))
    finally:
        TransactionManager.Instance.TransactionTaskDone()

    if overflow:
        log.append('SIN ESPACIO para {} vistas: {}'.format(len(overflow), ', '.join(overflow)))
        log.append('Corre 01_Calcular y crear laminas para agregar las que falten y vuelve a correr este graph (lo ya colocado se respeta).')
    log.insert(0, 'Vistas colocadas: {} de {} | Leyendas colocadas: {}'.format(placed, total_vistas, total_leyendas))
    OUT = log
# ----------------------------------------
log = Watch(py_colocar_vistas_flujo_por)  # graph output
