# Dynamo graph 02_Vistas de assembly.dyn (Dynamo 4.0.2.3852)
# Por assembly: crea vista de planta (HorizontalDetail) y corte transversal (DetailSectionA), renombra y asigna escala automatica (>3 m -> 1:50, si no 1:20). Idempotente.

procesar_todos_los_assemblies = BoolSelector(true)  # graph input
filtro_por_nombre_si_todos_false = StringInput("FN-1001, PD-1002")  # graph input
recrear_vistas_existentes_borra = BoolSelector(false)  # "Recrear vistas existentes (borra y rehace)"; graph input
py_crear_planta_corte_por = Python(IN[0]=procesar_todos_los_assemblies, IN[1]=filtro_por_nombre_si_todos_false, IN[2]=recrear_vistas_existentes_borra)  # "PY | Crear planta + corte por assembly"; CPython3
# ---------- py_crear_planta_corte_por.python (124 lines) ----------
# 02_Vistas de assembly - Planta + corte por assembly, escala automatica
# Revit 2027 / Dynamo 4 / CPython3
# IN[0] = procesar todos los assemblies (bool)
# IN[1] = filtro por nombre si IN[0] es False (parcial, separado por comas)
# IN[2] = recrear vistas existentes (bool) - borra y vuelve a crear

import clr
clr.AddReference('RevitAPI')
clr.AddReference('RevitServices')
from Autodesk.Revit.DB import (FilteredElementCollector, AssemblyInstance,
                               AssemblyViewUtils, AssemblyDetailViewOrientation,
                               View, UnitUtils, UnitTypeId, XYZ, Element)
from RevitServices.Persistence import DocumentManager
from RevitServices.Transactions import TransactionManager

doc = DocumentManager.Instance.CurrentDBDocument

process_all = bool(IN[0])
filter_text = (IN[1] or '').strip()
recreate = bool(IN[2])

log = []
SUFIJO_CORTE = ' - CORTE A'

def to_m(v):
    return UnitUtils.ConvertFromInternalUnits(v, UnitTypeId.Meters)

def elem_name(e):
    try:
        return e.Name
    except Exception:
        return Element.Name.__get__(e)

def set_name(e, name):
    try:
        e.Name = name
    except Exception:
        Element.Name.__set__(e, name)

# --- assemblies unicos por tipo ---
by_type = {}
for ai in FilteredElementCollector(doc).OfClass(AssemblyInstance):
    by_type.setdefault(ai.AssemblyTypeName, []).append(ai)

if process_all:
    targets = sorted(by_type.keys())
else:
    tokens = [t.strip().lower() for t in filter_text.split(',') if t.strip()]
    if tokens:
        targets = [n for n in sorted(by_type.keys())
                   if any(tok in n.lower() for tok in tokens)]
    else:
        targets = []
        log.append('ERROR: \"Procesar todos\" esta en False y el filtro esta vacio.')
    log.append('Filtro \"{}\": {} assemblies seleccionados.'.format(filter_text, len(targets)))

# vistas existentes por nombre (para idempotencia)
view_ids = {}
for v in FilteredElementCollector(doc).OfClass(View):
    if not v.IsTemplate:
        view_ids[elem_name(v)] = v.Id

def local_size(ai):
    # bbox de los miembros en coordenadas locales del assembly, en metros
    t = ai.GetTransform()
    tinv = t.Inverse
    mins = [float('inf')] * 3
    maxs = [float('-inf')] * 3
    for mid in ai.GetMemberIds():
        el = doc.GetElement(mid)
        bb = el.get_BoundingBox(None)
        if bb is None:
            continue
        for x in (bb.Min.X, bb.Max.X):
            for y in (bb.Min.Y, bb.Max.Y):
                for z in (bb.Min.Z, bb.Max.Z):
                    p = tinv.OfPoint(XYZ(x, y, z))
                    vals = (p.X, p.Y, p.Z)
                    for i in range(3):
                        if vals[i] < mins[i]:
                            mins[i] = vals[i]
                        if vals[i] > maxs[i]:
                            maxs[i] = vals[i]
    if mins[0] == float('inf'):
        return None
    return [to_m(maxs[i] - mins[i]) for i in range(3)]

created = 0
skipped = 0
TransactionManager.Instance.EnsureInTransaction(doc)
try:
    for tname in targets:
        insts = by_type[tname]
        ai = insts[0]
        if len(insts) > 1:
            log.append('AVISO {}: {} instancias del mismo tipo, se documenta la primera.'.format(tname, len(insts)))
        try:
            size = local_size(ai)
            scale = 50 if size is not None and (size[0] > 3.0 or size[1] > 3.0) else 20
            jobs = ((tname, AssemblyDetailViewOrientation.HorizontalDetail, 'planta'),
                    (tname + SUFIJO_CORTE, AssemblyDetailViewOrientation.DetailSectionA, 'corte'))
            for vname, orient, label in jobs:
                if vname in view_ids:
                    if recreate:
                        doc.Delete(view_ids[vname])
                        del view_ids[vname]
                        log.append('{}: {} anterior eliminada (tambien su viewport si estaba en un sheet).'.format(tname, label))
                    else:
                        log.append('{}: {} ya existe, se salta.'.format(tname, label))
                        skipped += 1
                        continue
                v = AssemblyViewUtils.CreateDetailSection(doc, ai.Id, orient)
                set_name(v, vname)
                v.Scale = scale
                view_ids[vname] = v.Id
                created += 1
                log.append('OK {}: {} creada, escala 1:{}.'.format(tname, label, scale))
        except Exception as e:
            log.append('ERROR {}: {}'.format(tname, e))
finally:
    TransactionManager.Instance.TransactionTaskDone()

log.insert(0, 'Assemblies procesados: {} | vistas creadas: {} | saltadas: {}'.format(len(targets), created, skipped))
OUT = log
# ----------------------------------------
log = Watch(py_crear_planta_corte_por)  # graph output
