# Dynamo graph 03_Colocar vistas en laminas.dyn (Dynamo 4.0.2.3852)
# Coloca las vistas de assembly (planta + corte) en los sheets destino, en grilla por filas con margenes respecto a la viñeta, pasando al siguiente sheet cuando uno se llena.

sheets_destino_numeros_con_coma = StringInput("test")  # "Sheets destino (numeros con coma, o prefijo)"; graph input
procesar_todos_los_assemblies = BoolSelector(true)  # graph input
filtro_assemblies_si_todos_false = StringInput("")  # graph input
margen_y_separacion_mm = IntegerSlider(5, range=5..50 step 1)  # graph input
reserva_lado_derecho_mm = IntegerSlider(100, range=0..200 step 5)  # graph input
tipo_de_viewport_con_titulo = StringInput("C_ConTitulo")  # graph input
py_colocar_viewports_en_grilla = Python(IN[0]=sheets_destino_numeros_con_coma, IN[1]=procesar_todos_los_assemblies, IN[2]=filtro_assemblies_si_todos_false, IN[3]=margen_y_separacion_mm, IN[4]=reserva_lado_derecho_mm, IN[5]=tipo_de_viewport_con_titulo)  # PythonNet3
# ---------- py_colocar_viewports_en_grilla.python (202 lines) ----------
# 03_Colocar vistas en laminas - Distribuye vistas de assemblies en sheets, en grilla por filas
# Revit 2027 / Dynamo 4 / CPython3
# IN[0] = sheets destino: numeros separados por coma, o un prefijo comun
# IN[1] = procesar todos los assemblies (bool)
# IN[2] = filtro de assemblies si IN[1] es False (parcial, comas)
# IN[3] = margen y separacion entre vistas (mm)
# IN[4] = reserva en el lado derecho del sheet (mm), p/ cajetin lateral de la viñeta
# IN[5] = nombre del tipo de viewport con titulo (vacio = tipo por defecto)

import clr
clr.AddReference('RevitAPI')
clr.AddReference('RevitServices')
from Autodesk.Revit.DB import (FilteredElementCollector, AssemblyInstance, ViewSheet,
                               Viewport, View, BuiltInCategory, XYZ, Element,
                               ElementType)
from RevitServices.Persistence import DocumentManager
from RevitServices.Transactions import TransactionManager

doc = DocumentManager.Instance.CurrentDBDocument

sheets_text = (IN[0] or '').strip()
process_all = bool(IN[1])
filter_text = (IN[2] or '').strip()
margin = float(IN[3]) / 304.8
right_reserve = float(IN[4]) / 304.8
vp_type_text = (IN[5] or '').strip()
label_h = 12.0 / 304.8  # reserva bajo cada vista para el titulo del viewport

log = []
SUFIJO_CORTE = ' - CORTE A'

def elem_name(e):
    try:
        return e.Name
    except Exception:
        return Element.Name.__get__(e)

# --- tipo de viewport con titulo ---
vp_type = None
if vp_type_text:
    vp_types = [t for t in FilteredElementCollector(doc).OfClass(ElementType)
                if t.FamilyName == 'Viewport']
    low = vp_type_text.lower()
    for t in vp_types:
        if elem_name(t).lower() == low:
            vp_type = t
            break
    if vp_type is None:
        cands = [t for t in vp_types if low in elem_name(t).lower()]
        if len(cands) == 1:
            vp_type = cands[0]
    if vp_type is None:
        log.append('AVISO: no existe un tipo de viewport que coincida con {}; se usa el tipo por defecto.'.format(vp_type_text))
        log.append('Tipos disponibles: ' + ', '.join(sorted(elem_name(t) for t in vp_types)))

# --- sheets destino, ordenados por numero ---
all_sheets = {}
for s in FilteredElementCollector(doc).OfClass(ViewSheet):
    all_sheets[s.SheetNumber] = s

target_sheets = []
seen = set()
for tok in [t.strip() for t in sheets_text.split(',') if t.strip()]:
    if tok in all_sheets:
        matches = [all_sheets[tok]]
    else:
        matches = [s for n, s in all_sheets.items() if n.startswith(tok)]
    for s in matches:
        if s.SheetNumber not in seen:
            seen.add(s.SheetNumber)
            target_sheets.append(s)
target_sheets.sort(key=lambda s: s.SheetNumber)

if not target_sheets:
    log.append('ERROR: ningun sheet coincide con \"{}\".'.format(sheets_text))
    log.append('Sheets del proyecto: ' + ', '.join(sorted(all_sheets.keys())[:30]))
    OUT = log
else:
    # --- vistas a colocar, en orden por assembly: planta y luego corte ---
    names = sorted(set(ai.AssemblyTypeName
                       for ai in FilteredElementCollector(doc).OfClass(AssemblyInstance)))
    if not process_all:
        tokens = [t.strip().lower() for t in filter_text.split(',') if t.strip()]
        if tokens:
            names = [n for n in names if any(tok in n.lower() for tok in tokens)]
        else:
            names = []
            log.append('ERROR: \"Todos\" esta en False y el filtro esta vacio.')

    view_by_name = {}
    for v in FilteredElementCollector(doc).OfClass(View):
        if not v.IsTemplate:
            view_by_name[elem_name(v)] = v

    placed_ids = set()
    for vp in FilteredElementCollector(doc).OfClass(Viewport):
        placed_ids.add(vp.ViewId.Value)

    queue = []
    for n in names:
        for vname in (n, n + SUFIJO_CORTE):
            v = view_by_name.get(vname)
            if v is None:
                log.append('AVISO: no existe la vista \"{}\" (corre 02_Vistas de assembly).'.format(vname))
            elif v.Id.Value in placed_ids:
                log.append('AVISO: \"{}\" ya esta en un sheet, se salta.'.format(vname))
            else:
                queue.append(v)

    def usable_rect(sheet):
        # area util = bbox de la viñeta menos margenes (y reserva derecha)
        col = FilteredElementCollector(doc, sheet.Id).OfCategory(BuiltInCategory.OST_TitleBlocks)
        tb = col.FirstElement()
        if tb is not None:
            bb = tb.get_BoundingBox(sheet)
            if bb is not None:
                return (bb.Min.X + margin, bb.Min.Y + margin,
                        bb.Max.X - margin - right_reserve, bb.Max.Y - margin)
        o = sheet.Outline
        return (o.Min.U + margin, o.Min.V + margin,
                o.Max.U - margin - right_reserve, o.Max.V - margin)

    def paper_size(v):
        # tamaño en papel (pies) = crop del modelo / escala
        cb = v.CropBox
        s = v.Scale if v.Scale > 0 else 1
        return ((cb.Max.X - cb.Min.X) / s, (cb.Max.Y - cb.Min.Y) / s)

    placed = 0
    overflow = []
    si = 0
    state = None

    TransactionManager.Instance.EnsureInTransaction(doc)
    try:
        for v in queue:
            w, h = paper_size(v)
            hh = h + label_h
            done = False
            while not done:
                if state is None:
                    while si < len(target_sheets):
                        sh = target_sheets[si]
                        if len(list(sh.GetAllViewports())) > 0:
                            log.append('AVISO: sheet {} ya tiene vistas colocadas, se omite.'.format(sh.SheetNumber))
                            si += 1
                            continue
                        x0, y0, x1, y1 = usable_rect(sh)
                        state = {'sh': sh, 'x0': x0, 'y0': y0, 'x1': x1, 'y1': y1,
                                 'cx': x0, 'cy': y1, 'row_h': 0.0}
                        break
                    if state is None:
                        overflow.append(elem_name(v))
                        done = True
                        continue
                # salto de fila si no cabe a lo ancho
                if state['cx'] > state['x0'] and state['cx'] + w > state['x1']:
                    state['cx'] = state['x0']
                    state['cy'] -= state['row_h'] + margin
                    state['row_h'] = 0.0
                if state['cy'] - hh < state['y0'] or state['cx'] + w > state['x1']:
                    fresh = (state['cx'] == state['x0'] and state['cy'] == state['y1'])
                    too_big = (state['x1'] - state['x0'] < w) or (state['y1'] - state['y0'] < hh)
                    if fresh and too_big:
                        log.append('ERROR: \"{}\" ({:.0f} x {:.0f} mm en papel) no cabe ni en un sheet vacio.'.format(
                            elem_name(v), w * 304.8, hh * 304.8))
                        done = True
                        continue
                    si += 1
                    state = None
                    continue
                center = XYZ(state['cx'] + w / 2.0, state['cy'] - h / 2.0, 0.0)
                try:
                    vp = Viewport.Create(doc, state['sh'].Id, v.Id, center)
                    if vp is None:
                        log.append('ERROR: Revit no permitio colocar \"{}\" en {}.'.format(elem_name(v), state['sh'].SheetNumber))
                    else:
                        if vp_type is not None:
                            if vp.GetTypeId() != vp_type.Id:
                                vp.ChangeTypeId(vp_type.Id)
                            try:
                                # titulo alineado bajo el borde inferior izquierdo de la vista
                                vp.LabelOffset = XYZ(0.0, -5.0 / 304.8, 0.0)
                                vp.LabelLineLength = w
                            except Exception:
                                pass
                        placed += 1
                        log.append('OK: \"{}\" -> sheet {}'.format(elem_name(v), state['sh'].SheetNumber))
                        state['cx'] += w + margin
                        if hh > state['row_h']:
                            state['row_h'] = hh
                except Exception as e:
                    log.append('ERROR colocando \"{}\": {}'.format(elem_name(v), e))
                done = True
    finally:
        TransactionManager.Instance.TransactionTaskDone()

    if overflow:
        log.append('SIN ESPACIO para {} vistas: {}'.format(len(overflow), ', '.join(overflow)))
        log.append('Crea mas sheets con 01_Crear laminas y vuelve a correr este graph (lo ya colocado se respeta).')
    log.insert(0, 'Vistas colocadas: {} de {}'.format(placed, len(queue)))
    OUT = log
# ----------------------------------------
log = Watch(py_colocar_viewports_en_grilla)  # graph output
