# Dynamo graph 03_Ejes y cotas entre ejes.dyn (Dynamo 4.0.2.3852)
# Por assembly: enciende los ejes en plantas y elevaciones dejando una sola burbuja por eje, en las elevaciones deja solo los dos ejes extremos recortados al alto del assembly, dibuja el eje de cada viga en las plantas T.A. y en las elevaciones como linea L-CENTER, y acota entre ejes estructurales y entre ejes de viga.

procesar_todos_los_assemblies = BoolSelector(true)  # graph input
filtro_por_nombre_si_todos_false = StringInput("")  # graph input
cadena_entre_ejes_separacion_al = IntegerSlider(20, range=0..100 step 1)  # "Cadena entre ejes: separacion al borde del assembly (mm)"; graph input
cadena_entre_ejes_horizontal = BoolSelector(true)  # "Cadena entre ejes: horizontal (arriba)"; graph input
cadena_entre_ejes_vertical = BoolSelector(true)  # "Cadena entre ejes: vertical (izquierda)"; graph input
mostrar_ejes_tambien_en_las = BoolSelector(true)  # "Mostrar ejes tambien en las elevaciones"; graph input
eje_de_vigas_dibujar_en_las = BoolSelector(true)  # "Eje de vigas: dibujar en las plantas"; graph input
eje_de_vigas_estilo_de_linea = StringInput("L-CENTER")  # graph input
eje_de_vigas_redibujar_los = BoolSelector(false)  # "Eje de vigas: redibujar los existentes"; graph input
eje_de_vigas_acotar_entre_ejes = BoolSelector(true)  # "Eje de vigas: acotar entre ejes de viga"; graph input
eje_de_vigas_separacion_de_su = IntegerSlider(8, range=2..30 step 1)  # "Eje de vigas: separacion de su cadena a la de ejes (mm)"; graph input
eje_de_vigas_separacion_minima = IntegerSlider(5, range=0..20 step 1)  # "Eje de vigas: separacion minima entre cotas (mm)"; graph input
burbujas_de_eje_solo_arriba_y_a = BoolSelector(true)  # "Burbujas de eje: solo arriba y a la izquierda"; graph input
elevaciones_dejar_solo_los_dos = BoolSelector(false)  # "Elevaciones: dejar solo los dos ejes extremos"; graph input
elevaciones_recortar_la = BoolSelector(true)  # "Elevaciones: recortar la extension de los ejes"; graph input
elevaciones_el_eje_sobresale_por = IntegerSlider(3, range=0..30 step 1)  # "Elevaciones: el eje sobresale por ARRIBA (mm)"; graph input
elevaciones_el_eje_sobresale_por_2 = IntegerSlider(2, range=0..30 step 1)  # "Elevaciones: el eje sobresale por ABAJO (mm)"; graph input
elevaciones_cotas_de_altura_y = BoolSelector(true)  # "Elevaciones: cotas de altura y linea de terreno"; graph input
elevaciones_tipos_de_spot = StringInput("T.A. ELEVACION, P.T. ELEVACION, nipb ELEVACIÓN inf")  # "Elevaciones: tipos de Spot Elevation (T.A., P.T., N.I.P.B.)"; graph input
elevaciones_familias_que_no_son = StringInput("GRATING")  # "Elevaciones: familias que NO son viga (parcial, comas)"; graph input
elevaciones_rehacer_la_anotacion = BoolSelector(false)  # "Elevaciones: rehacer la anotacion existente"; graph input
nipb_rotular_las_conexiones = BoolSelector(true)  # "NIPB: rotular las conexiones (placas base, sillas)"; graph input
nipb_tipo_de_c_multicat_del = StringInput("ELEMENTO_TBL")  # "NIPB: tipo de C-MultiCat del rotulo"; graph input
nipb_rehacer_los_rotulos = BoolSelector(false)  # "NIPB: rehacer los rotulos existentes"; graph input
n00_subcarpeta_juego_de_vistas = StringInput("")  # "00. Subcarpeta / juego de vistas (vacio = sin subcarpeta)"; graph input
py_ejes_visibles_eje_de_vigas = Python(IN[0]=procesar_todos_los_assemblies, IN[1]=filtro_por_nombre_si_todos_false, IN[2]=cadena_entre_ejes_separacion_al, IN[3]=cadena_entre_ejes_horizontal, IN[4]=cadena_entre_ejes_vertical, IN[5]=mostrar_ejes_tambien_en_las, IN[6]=eje_de_vigas_dibujar_en_las, IN[7]=eje_de_vigas_estilo_de_linea, IN[8]=eje_de_vigas_redibujar_los, IN[9]=eje_de_vigas_acotar_entre_ejes, IN[10]=eje_de_vigas_separacion_de_su, IN[11]=eje_de_vigas_separacion_minima, IN[12]=burbujas_de_eje_solo_arriba_y_a, IN[13]=elevaciones_dejar_solo_los_dos, IN[14]=elevaciones_recortar_la, IN[15]=elevaciones_el_eje_sobresale_por, IN[16]=elevaciones_el_eje_sobresale_por_2, IN[17]=elevaciones_cotas_de_altura_y, IN[18]=elevaciones_tipos_de_spot, IN[19]=elevaciones_familias_que_no_son, IN[20]=elevaciones_rehacer_la_anotacion, IN[21]=nipb_rotular_las_conexiones, IN[22]=nipb_tipo_de_c_multicat_del, IN[23]=nipb_rehacer_los_rotulos, IN[24]=n00_subcarpeta_juego_de_vistas)  # "PY | Ejes visibles + eje de vigas + cadenas de cotas"; PythonNet3
# ---------- py_ejes_visibles_eje_de_vigas.python (2531 lines) ----------
# 03_Ejes y cotas entre ejes - ACERO
#
# Reemplaza por completo el 03 de fundaciones (cotas de ancho/largo/altura y spot
# elevations sobre Structural Foundation), que no aplica a estructura metalica.
#
# Hace cuatro cosas:
#   1. Enciende la categoria Grids en las plantas (NIPB y T.A.) y en las elevaciones
#      de eje del assembly, para que los ejes se vean.
#   2. En cada planta T.A. dibuja el EJE de cada viga como una detail line roja con
#      el estilo L-CENTER. En la NIPB no: a esa cota hay placas base, pernos y
#      sillas, no vigas.
#   3. Arma dos familias de cadenas de cotas, nunca por debajo:
#      - entre EJES ESTRUCTURALES: en TODAS las plantas (NIPB y T.A.), horizontal
#        por encima y vertical a la izquierda, por fuera del borde del assembly.
#      - entre EJES DE VIGA: solo en las T.A., por dentro de las anteriores (mas
#        cerca de la planta), horizontal arriba y vertical a AMBOS lados. Las vigas
#        se reparten por mitades - las de la mitad izquierda se acotan a la izquierda
#        y las de la derecha a la derecha - porque una planta de vigas extensa
#        amontona demasiado texto si todo se acota hacia un solo lado.
#   4. En las ELEVACIONES de eje deja solo los dos ejes extremos y les recorta la
#      extension al alto del assembly, con la burbuja arriba. Un eje de por medio
#      no aporta nada en una elevacion (la posicion ya se acota en planta) y en
#      cambio tapa la estructura con lineas verticales.
#   5. Acota la ALTURA de la elevacion (base del assembly, T.A. y altura maxima) y pone
#      un Spot Elevation en T.A., P.T. y N.I.P.B. Toda esta anotacion se apoya en
#      detail lines propias -no en las caras del acero-, por el mismo motivo que la
#      cadena de vigas en planta usa L-CENTER: una referencia de cara se acepta al
#      crear la cota o la marca y despues Revit la descarta al comitear, sin error.
#   6. Rotula la NIPB: un Multi-Category Tag (por defecto el tipo ELEMENTO_TBL) sobre
#      cada Structural Connection del assembly que la vista muestre. Es lo unico que
#      hay a esa cota -placas base, sillas de anclaje, atiesadores, pernos- y es lo
#      unico que 05 no rotula, porque 05 solo toca vigas y columnas.
#
# Entre ejes estructurales se acota eje contra eje (no borde-eje-borde): es lo que
# pide el estandar ("cotas asociadas entre ejes") y evita depender de caras de la
# geometria, que en acero son poco fiables como referencia (pernos, planchas,
# conexiones). La cadena de vigas referencia las propias detail lines L-CENTER que
# dibuja el punto 2, por el mismo motivo.
#
# Revit 2027 / Dynamo 4 / CPython3
# IN[0] = procesar todos los assemblies (bool)
# IN[1] = filtro por nombre si IN[0] es False (parcial, comas)
# IN[2] = separacion de la cadena respecto al borde del assembly, en mm de papel
# IN[3] = cadena horizontal entre ejes, por encima de la planta (bool)
# IN[4] = cadena vertical entre ejes, a la izquierda de la planta (bool)
# IN[5] = mostrar los ejes tambien en las elevaciones de eje (bool)
# IN[6] = dibujar el eje de cada viga en las plantas T.A. (bool)
# IN[7] = nombre del estilo de linea para ese eje (string, ej. L-CENTER)
# IN[8] = redibujar: borra los ejes de viga previos de ese estilo y los rehace (bool)
# IN[9] = acotar entre ejes de viga: arriba y a ambos lados (bool)
# IN[10] = separacion entre la cadena de vigas y la de ejes, en mm de papel
# IN[11] = separacion minima entre dos cotas de la cadena de vigas, en mm de papel
# IN[12] = dejar una sola burbuja por eje: arriba y a la izquierda (bool)
# IN[13] = en las elevaciones, dejar solo los dos ejes extremos (bool)
# IN[14] = en las elevaciones, recortar la extension de los ejes (bool)
# IN[15] = cuanto sobresale el eje POR ENCIMA del assembly, en mm de papel
# IN[16] = cuanto sobresale el eje POR DEBAJO del assembly, en mm de papel
# IN[17] = cotas de altura y linea de terreno en las elevaciones (bool)
# IN[18] = tipos de Spot Elevation para T.A., P.T. y N.I.P.B. (3 nombres separados
#          por coma; vacio = no poner marcas de nivel)
# IN[19] = familias que NO son viga aunque sean Structural Framing (parcial, comas)
# IN[20] = rehacer la anotacion de las elevaciones: borra cotas, marcas y linea de
#          terreno previas antes de redibujarlas (bool)
# IN[21] = rotular las conexiones de la planta NIPB (bool)
# IN[22] = tipo de Multi-Category Tag para ese rotulo (string, ej. ELEMENTO_TBL)
# IN[23] = rehacer los rotulos de la NIPB que ya existan (bool)

import math
import clr
clr.AddReference('RevitAPI')
clr.AddReference('RevitServices')
from Autodesk.Revit.DB import (FilteredElementCollector, AssemblyInstance, View,
                               Grid, Line, XYZ, Reference, ReferenceArray, Dimension,
                               Element, ElementId, BuiltInCategory, Options,
                               ViewDetailLevel, Solid, GeometryInstance, FamilyInstance,
                               FailureProcessingResult, FailureSeverity,
                               Color, GraphicsStyleType, CurveElement, LinePatternElement,
                               DatumEnds, DatumExtentType, PlanarFace, SpotDimension,
                               SpotDimensionType, FamilySymbol, IndependentTag,
                               TagOrientation, Level, ViewPlan, StorageType)
from System.Collections.Generic import List
from RevitServices.Persistence import DocumentManager
from RevitServices.Transactions import TransactionManager

doc = DocumentManager.Instance.CurrentDBDocument

process_all = bool(IN[0])
filter_text = (IN[1] or '').strip()
offset_mm = float(IN[2])
chain_h = bool(IN[3])
chain_v = bool(IN[4])
ejes_en_elev = bool(IN[5])
dibujar_eje_viga = bool(IN[6])
estilo_pedido = (IN[7] or '').strip() or 'L-CENTER'
redibujar_eje_viga = bool(IN[8])
chain_vigas = bool(IN[9])
sep_cadenas_mm = float(IN[10])
sep_min_cota_mm = float(IN[11])
burbuja_unica = bool(IN[12])
solo_extremos = bool(IN[13])
recortar_ejes_elev = bool(IN[14])
ext_arriba_mm = float(IN[15])
ext_abajo_mm = float(IN[16])
cotas_altura = bool(IN[17])
tipos_spot = [t.strip() for t in (IN[18] or '').split(',') if t.strip()]
fam_no_viga = [t.strip().lower() for t in (IN[19] or '').split(',') if t.strip()]
rehacer_elev = bool(IN[20])
rotular_conexiones = bool(IN[21])
tipo_tag_nipb = (IN[22] or '').strip()
rehacer_nipb = bool(IN[23])
juego_vistas = (IN[24] or '').strip()

# --- juego de vistas (2026-09-19) ---------------------------------------------------------
# 00 escribe el nombre de la subcarpeta al final del nombre de cada vista que crea:
# "ES-1001 - T.A. 01 (REV_B)". Asi correr 00 con otra subcarpeta genera un juego NUEVO en vez
# de caer sobre las vistas ya maquetadas y acotadas.
#
# Este input dice sobre CUAL de esos juegos trabajar. Vacio = el juego sin marca, el que crea
# 00 cuando la subcarpeta se deja en blanco. Sin el, este graph anotaba los dos juegos.
MARCA_JUEGO = ' ({})'.format(juego_vistas) if juego_vistas else ''


def juego_de(vname):
    # la marca que lleva ese nombre al final, o '' si no lleva ninguna
    if vname.endswith(')'):
        i = vname.rfind(' (')
        if i >= 0:
            return vname[i:]
    return ''


def es_de_este_juego(vname):
    # NO alcanza con endswith(MARCA_JUEGO): con la marca vacia, endswith('') da True para
    # TODO y se colarian las vistas de los demas juegos. Hay que comparar la marca completa.
    return juego_de(vname) == MARCA_JUEGO


log = []

# --- contrato de nombres con 00_Vistas de assembly ---
SUF_NIPB = ' - NIPB'
SUF_TA = ' - T.A. '
SUF_EJE = ' - EJE '

# --- niveles modelados: MISMO contrato de nombres que 00_Vistas de assembly ---
# Desde el 2026-08-11 las marcas de nivel de las elevaciones salen de estos Level y no
# de la geometria. El modelo declara y el pipeline obedece: es el mismo contrato con el
# que 00 decide que plantas hace, asi que una marca de una elevacion ya no puede
# contradecir a la planta que 00 genero sobre el mismo nivel.
PREF_NIPB_LV = 'N.I.P.B._'
PREF_PT_LV = 'P.T._'
PREF_TA_LV = 'T.A._'

# Cuanto puede sobresalir una marca del alto de lo que la vista dibuja y seguir
# poniendose. Del orden del canto de una viga, para no perder el nivel que coincide
# justo con el borde de la geometria.
MARGEN_MARCA = 1.0   # pies (~300 mm)

# Cota TOTAL de la cadena entre ejes: la misma medida de punta a punta, en una sola cota,
# por fuera de la cadena. Se agrega ADEMAS de los tramos, que es como se acota un plano:
# los tramos dan la modulacion y el total da la dimension general del sector.
#
# Va como Dimension APARTE y no como una referencia mas de la cadena: una Dimension de
# Revit con 3 o mas referencias dibuja los TRAMOS, asi que el total no se puede pedir
# sobre la misma cadena. Y solo tiene sentido con 3 ejes o mas: con 2, la cadena YA es el
# total y repetirlo seria dibujar dos veces la misma medida.
#
# Si alguna vez se quisiera el total EN VEZ de los tramos, no es esta constante: seria no
# pasarle a dibujar_cadena la lista completa de ejes.
COTA_TOTAL_EJES = True

# Que muestra la cadena entre ejes de cada lado.
#
# ARRIBA solo la cota total: los tramos entre ejes competian con la cadena de EJES DE VIGA,
# que corre justo debajo y en ES-1001 trae 13 tramos (algunos de 425 y 575 mm). Dos filas de
# tramos apiladas no se leen, y de las dos la que aporta es la de vigas: la modulacion entre
# ejes ya queda dicha por la total mas las burbujas.
#
# A LA IZQUIERDA se dejan las dos, porque ahi no hay nada compitiendo -la cadena de vigas
# vertical va por la DERECHA- y la modulacion entre ejes se lee sin problema.
SOLO_TOTAL_ARRIBA = True
SOLO_TOTAL_IZQUIERDA = False

PARALELO = 0.99
# Revit exige que TODAS las referencias de una cadena sean paralelas ENTRE SI, y una
# sola viga fuera de escuadra hace que rechace la cadena entera al comitear con
# "The References of the highlighted Dimension are no longer parallel".
#
# Su criterio para las cotas es MUCHISIMO mas estricto que Application.AngularTolerance
# (0.1 grados). Medido en ES-1003 / T.A. 01 el 2026-08-03: dos ejes de viga desviados
# 1.45e-4 rad (0.0083 grados) bastaron para que borrara una cadena de 16 referencias.
# Como las vigas bien modeladas coinciden entre si a 1e-15 rad, hay diez ordenes de
# magnitud de margen para cortar; 1e-5 rad son 0.1 mm sobre 10 m.
TOL_PARALELO = 1e-5   # rad, angulo maximo admitido ENTRE DOS referencias de una cadena
TOL_EJE = 0.016    # pies (~5 mm): ejes a menos de esto se consideran el mismo
TOL_LINEA = 0.0033  # pies (~1 mm): por debajo de esto la viga es un punto en planta
TOL_CARA = 0.0066   # pies (~2 mm): una cara horizontal esta "a esa cota" si cae aca dentro
TOL_TOPE = 0.033    # pies (~10 mm): que tan parejo tienen que estar los topes de dos vigas
                    # para considerarlas del mismo nivel (el acero se modela con
                    # contraflechas y tolerancias de milimetros)
TOL_NIPB = 0.656    # pies (~200 mm): que tan lejos del nivel N.I.P.B. declarado puede
                    # estar el fondo de pieza que se usa como apoyo de la cota. Mas que
                    # esto y no hay contra que acotar: se vuelve al fondo del assembly.
TOL_BASE = 0.164    # pies (~50 mm): que tan arriba de la placa base puede arrancar la
                    # silla de anclaje y seguir contando como parte de la base
TOL_PLANO = 1.0     # pies (~300 mm): grosor de la "capa" de profundidad con la que se
                    # decide que pieza esta sobre el plano de la elevacion
PORC_NIVEL = 0.40   # un tope de viga es un T.A. si acumula al menos este porcentaje de
                    # los metros de viga del nivel dominante (mismo criterio que 00)
MAX_CANDIDATOS = 8  # piezas que se prueban antes de dar un plano por irresoluble

CAT_FRAMING = ElementId(BuiltInCategory.OST_StructuralFraming).Value
CAT_CONEXIONES = ElementId(BuiltInCategory.OST_StructConnections).Value

CATS_BARANDA = set()
for _n in ('OST_StairsRailing', 'OST_Railings', 'OST_RailingSystem'):
    try:
        CATS_BARANDA.add(ElementId(getattr(BuiltInCategory, _n)).Value)
    except Exception:
        pass


def excluida_de_viga(nombres):
    # el grating es Structural Framing igual que una viga (familia
    # C-GRATING ARRIGONI ARS-5) y su tope queda 32 mm POR ENCIMA del tope de acero: si
    # entrara en la votacion, el T.A. saldria en la cara del grating y no en la viga.
    return any(t in nombres for t in fam_no_viga)


def elem_name(e):
    try:
        return e.Name
    except Exception:
        return Element.Name.__get__(e)


def member_solid_bbox(el):
    # bbox a partir de la geometria SOLIDA real (Volume > 0): Element.get_BoundingBox
    # puede devolver un bbox "fantasma" para elementos con geometria degenerada.
    opt = Options()
    opt.DetailLevel = ViewDetailLevel.Fine
    try:
        geo = el.get_Geometry(opt)
    except Exception:
        geo = None
    if geo is None:
        return None
    pts = []

    def puntos(solid, trf):
        sbb = solid.GetBoundingBox()
        for x in (sbb.Min.X, sbb.Max.X):
            for y in (sbb.Min.Y, sbb.Max.Y):
                for z in (sbb.Min.Z, sbb.Max.Z):
                    p = sbb.Transform.OfPoint(XYZ(x, y, z))
                    if trf is not None:
                        p = trf.OfPoint(p)
                    yield p

    for g in geo:
        if isinstance(g, Solid) and g.Volume > 1e-9:
            pts.extend(list(puntos(g, None)))
        elif isinstance(g, GeometryInstance):
            for sg in g.GetSymbolGeometry():
                if isinstance(sg, Solid) and sg.Volume > 1e-9:
                    pts.extend(list(puntos(sg, g.Transform)))
    if not pts:
        return None
    minx = min(p.X for p in pts)
    maxx = max(p.X for p in pts)
    miny = min(p.Y for p in pts)
    maxy = max(p.Y for p in pts)
    minz = min(p.Z for p in pts)
    maxz = max(p.Z for p in pts)

    class _BB(object):
        pass
    r = _BB()
    r.Min = XYZ(minx, miny, minz)
    r.Max = XYZ(maxx, maxy, maxz)
    return r


def miembros_recursivos(ai):
    # todos los elementos del assembly, incluidas las familias anidadas a cualquier
    # profundidad. Se usa para el bbox y para saber que vigas son "de este assembly".
    res = []
    pila = [doc.GetElement(mid) for mid in ai.GetMemberIds()]
    vistos = set()
    while pila:
        el = pila.pop()
        if el is None:
            continue
        try:
            eid = el.Id.Value
        except Exception:
            eid = None
        if eid is not None:
            if eid in vistos:
                continue
            vistos.add(eid)
        res.append(el)
        if isinstance(el, FamilyInstance):
            try:
                for sid in el.GetSubComponentIds():
                    pila.append(doc.GetElement(sid))
            except Exception:
                pass
    return res


def bbox_de(bbs):
    # bbox de mundo del assembly a partir de los bbox ya calculados de sus miembros
    pts = []
    for bb in bbs.values():
        pts.append(bb.Min)
        pts.append(bb.Max)
    if not pts:
        return None

    class _BB(object):
        pass
    r = _BB()
    r.Min = XYZ(min(p.X for p in pts), min(p.Y for p in pts), min(p.Z for p in pts))
    r.Max = XYZ(max(p.X for p in pts), max(p.Y for p in pts), max(p.Z for p in pts))
    return r


PARAM_EJE_ASSEMBLY = 'ASSEMBLY'

_idx_ejes = None            # {nombre de assembly en minusculas: [Grid, ...]}
_valores_ejes = set()       # los valores tal cual, para poder listarlos en el log
_param_presente = [False]   # el parametro existe en al menos un eje
_param_poblado = [False]    # ...y ademas alguien le escribio algo


def texto_param(el, nombre):
    # instancia primero, tipo despues: si manana el parametro se define de tipo, el graph
    # sigue leyendolo sin tocar nada. Copiado tal cual de 00.
    p = el.LookupParameter(nombre)
    if p is None:
        try:
            t = doc.GetElement(el.GetTypeId())
            p = t.LookupParameter(nombre) if t is not None else None
        except Exception:
            p = None
    if p is None:
        return None
    _param_presente[0] = True
    try:
        if p.StorageType == StorageType.String:
            v = p.AsString()
        else:
            v = p.AsValueString()
    except Exception:
        return ''
    return (v or '').strip()


def indice_ejes_por_assembly():
    # se arma UNA sola vez para toda la corrida: recorrer todos los Grid por cada assembly
    # seria O(ejes x assemblies) sin ninguna necesidad.
    global _idx_ejes
    if _idx_ejes is not None:
        return _idx_ejes
    _idx_ejes = {}
    for g in FilteredElementCollector(doc).OfClass(Grid):
        v = texto_param(g, PARAM_EJE_ASSEMBLY)
        if not v:
            continue
        _param_poblado[0] = True
        try:
            c = g.Curve
        except Exception:
            c = None
        if c is None or not isinstance(c, Line):
            continue
        _valores_ejes.add(v)
        _idx_ejes.setdefault(v.lower(), []).append(g)
    for k in _idx_ejes:
        _idx_ejes[k].sort(key=lambda g: elem_name(g))
    return _idx_ejes


def ejes_del_assembly(tname):
    # Los ejes MARCADOS con este assembly, y solamente esos. Mismo criterio que 00.
    #
    # âš  Hasta el 2026-08-11 esto era un test GEOMETRICO -recorte Liang-Barsky del eje
    # contra el rectangulo del bounding box en planta- y el comentario afirmaba que era el
    # mismo criterio de 00. Dejo de serlo el 2026-08-10, cuando 00 paso al parametro
    # ASSEMBLY, y nadie actualizo 03.
    #
    # La consecuencia no era solo acotar de mas: el rectangulo del bbox es bastante mas
    # grande que la huella real, asi que 03 devolvia ejes de OTROS sectores, y encima
    # ejes_de_elevacion los DESOCULTABA -revirtiendo el aislamiento permanente que habia
    # dejado 00-. Un eje ajeno al assembly reaparecia en el corte y ademas entraba en la
    # cadena de cotas.
    #
    # Ahora los dos graphs leen el mismo marcado, que es la unica forma de que no se
    # contradigan.
    idx = indice_ejes_por_assembly()
    res = idx.get(tname.strip().lower(), [])
    if res:
        log.append('{}: {} eje(s) marcados con {} -> {}'.format(
            tname, len(res), PARAM_EJE_ASSEMBLY, ', '.join(elem_name(g) for g in res)))
    elif not _param_presente[0]:
        log.append('ERROR {}: ningun eje del modelo tiene el parametro {}; sin el no hay '
                   'forma de saber que ejes le tocan al assembly. Agregalo como parametro '
                   'de proyecto, de texto, en la categoria Grids.'.format(
                       tname, PARAM_EJE_ASSEMBLY))
    elif not _param_poblado[0]:
        log.append('ERROR {}: el parametro {} existe en los ejes pero esta vacio en todos; '
                   'el assembly se queda sin ejes.'.format(tname, PARAM_EJE_ASSEMBLY))
    else:
        log.append('AVISO {}: ningun eje tiene {} = {}; el assembly se queda sin cadena '
                   'entre ejes. Valores que si aparecen en los ejes del modelo: {}.'.format(
                       tname, PARAM_EJE_ASSEMBLY, tname, ', '.join(sorted(_valores_ejes))))
    return res


ID_CAT_GRIDS = ElementId(BuiltInCategory.OST_Grids)
ID_CAT_LINES = ElementId(BuiltInCategory.OST_Lines)
ID_CAT_COTAS = ElementId(BuiltInCategory.OST_Dimensions)
ID_CAT_MARCAS = ElementId(BuiltInCategory.OST_SpotElevations)
ID_CAT_TAGS = ElementId(BuiltInCategory.OST_MultiCategoryTags)


def encender_categoria(v, cat_id, nombre, tname, label):
    # ⚠ Una anotacion creada en una vista que tiene su categoria APAGADA existe en el
    # modelo pero no se dibuja, y FilteredElementCollector(doc, view.Id) tampoco la
    # devuelve: desde el script parece que nunca se creo, y la idempotencia la vuelve a
    # crear en cada corrida. Medido el 2026-08-04: las 54 cotas de altura estaban en el
    # documento (ids 765xxxx) y ninguna se veia, porque el view template ESTRUCTURAS
    # trae Dimensions apagada. Es la misma trampa que ya estaba resuelta para Lines.
    try:
        if not v.GetCategoryHidden(cat_id):
            return False
        v.SetCategoryHidden(cat_id, False)
        log.append('{}: {} - se encendio la categoria {} (estaba apagada).'.format(
            tname, label, nombre))
        return True
    except Exception as e:
        log.append('AVISO {}: la categoria {} esta apagada en {} y no se pudo encender ({}). '
                   'Las anotaciones se crean pero NO se ven: hay que encenderla en el view template.'.format(
                       tname, nombre, label, e))
        return False


def mostrar_ejes(v, tname, label):
    # enciende la categoria Grids en la vista. En las elevaciones de eje, 00 ya
    # incluyo los ejes en el aislamiento permanente; sin eso, encender la categoria
    # no bastaria porque el elemento quedaria oculto uno por uno.
    try:
        if v.GetCategoryHidden(ID_CAT_GRIDS):
            if v.CanCategoryBeHidden(ID_CAT_GRIDS):
                v.SetCategoryHidden(ID_CAT_GRIDS, False)
                return True
    except Exception as e:
        log.append('AVISO {}: no se pudo encender la categoria Grids en {}: {}'.format(tname, label, e))
    return False


def burbuja_arriba_izquierda(v, grids, tname, label):
    # deja una sola burbuja por eje: la del extremo de ARRIBA en los ejes verticales de
    # la vista y la del extremo IZQUIERDO en los horizontales. ShowBubbleInView y
    # HideBubbleInView son especificos de la vista, asi que las demas vistas del
    # proyecto siguen mostrando las burbujas que ya tenian.
    rd = v.RightDirection
    ud = v.UpDirection
    hechos = 0
    fallidos = 0
    for g in grids:
        try:
            c = g.Curve
            d = c.GetEndPoint(1) - c.GetEndPoint(0)
            du = d.DotProduct(ud)
            dr = d.DotProduct(rd)
            # que extremo se conserva lo decide el eje que MAS separa a los dos: en un
            # eje casi vertical manda la altura, en uno casi horizontal manda el ancho.
            if abs(du) >= abs(dr):
                queda_el_1 = du > 0          # el extremo 1 es el de mas arriba
            else:
                queda_el_1 = dr < 0          # el extremo 1 es el de mas a la izquierda
            buena = DatumEnds.End1 if queda_el_1 else DatumEnds.End0
            mala = DatumEnds.End0 if queda_el_1 else DatumEnds.End1
            g.ShowBubbleInView(buena, v)
            g.HideBubbleInView(mala, v)
            hechos += 1
        except Exception:
            fallidos += 1
    if fallidos:
        log.append('AVISO {}: no se pudo ajustar la burbuja de {} eje(s) en {}.'.format(
            tname, fallidos, label))
    return hechos


# ------------------------------------------------- ejes en las elevaciones

def ejes_visibles_en_elevacion(v, grids):
    # de todos los ejes que cruzan el assembly, los que la elevacion DIBUJA: los
    # perpendiculares al papel, que cortan el plano de la vista en una linea vertical.
    # El eje de la propia elevacion corre a lo largo del papel y Revit no lo dibuja
    # (su plano es paralelo al de la vista), asi que queda fuera solo.
    #
    # Un eje perpendicular tiene todos sus puntos a la misma distancia sobre la
    # horizontal del papel: esa distancia es su posicion en la elevacion.
    rd = v.RightDirection
    res = []
    for g in grids:
        try:
            c = g.Curve
            d = c.GetEndPoint(1) - c.GetEndPoint(0)
            d = XYZ(d.X, d.Y, 0.0)
            if d.GetLength() < 1e-9:
                continue
            if abs(d.Normalize().DotProduct(rd)) > 1.0 - PARALELO:
                continue
            res.append((c.GetEndPoint(0).DotProduct(rd), g))
        except Exception:
            pass
    res.sort(key=lambda it: it[0])
    return res


def corte_con_el_plano_de_vista(g, v):
    # donde la recta del eje atraviesa el plano de la elevacion. La linea que se ve en
    # el papel es la vertical que pasa por ahi, y tiene que estar EN ese plano o Revit
    # rechaza la curva.
    try:
        c = g.Curve
        p = c.GetEndPoint(0)
        d = c.Direction
        vd = v.ViewDirection
        den = d.DotProduct(vd)
        if abs(den) < 1e-9:
            return None
        return p.Add(d.Multiply((v.Origin - p).DotProduct(vd) / den))
    except Exception:
        return None


def recortar_eje_en_elevacion(g, v, z_bajo, z_alto):
    # extension especifica de la vista: el eje deja de cruzar la elevacion de lado a
    # lado y queda del alto del assembly, con la burbuja arriba. La extension 3D del
    # eje (que es global, de toda la planta industrial) no se toca: SetCurveInView
    # con ViewSpecific solo afecta a ESTA vista.
    q = corte_con_el_plano_de_vista(g, v)
    if q is None:
        return False
    linea = Line.CreateBound(XYZ(q.X, q.Y, z_bajo), XYZ(q.X, q.Y, z_alto))
    g.SetDatumExtentType(DatumEnds.End0, v, DatumExtentType.ViewSpecific)
    g.SetDatumExtentType(DatumEnds.End1, v, DatumExtentType.ViewSpecific)
    g.SetCurveInView(DatumExtentType.ViewSpecific, v, linea)
    # cual de los dos extremos quedo arriba se lee de vuelta en vez de darlo por
    # supuesto: si Revit invirtiera la curva, la burbuja iria al pie del eje.
    arriba = DatumEnds.End1
    try:
        curvas = g.GetCurvesInView(DatumExtentType.ViewSpecific, v)
        if curvas is not None and curvas.Count > 0:
            cc = curvas[0]
            if cc.GetEndPoint(0).Z > cc.GetEndPoint(1).Z:
                arriba = DatumEnds.End0
    except Exception:
        pass
    abajo = DatumEnds.End0 if arriba == DatumEnds.End1 else DatumEnds.End1
    g.ShowBubbleInView(arriba, v)
    g.HideBubbleInView(abajo, v)
    return True


def ejes_de_elevacion(v, grids, bb, tname, label):
    # deja la elevacion con los dos ejes de los extremos, recortados al alto del
    # assembly. Devuelve (ocultados, recortados).
    visibles = ejes_visibles_en_elevacion(v, grids)
    if not visibles:
        log.append('AVISO {}: ningun eje se dibuja en {} (todos corren a lo largo de la vista).'.format(
            tname, label))
        return 0, 0

    # primero se recuperan los que oculto una corrida anterior: si el assembly o los
    # ejes cambiaron, los extremos pueden ser otros y los de antes tienen que volver.
    devueltos = []
    for _, g in visibles:
        try:
            if g.IsHidden(v):
                devueltos.append(g.Id)
        except Exception:
            pass
    if devueltos:
        try:
            v.UnhideElements(List[ElementId](devueltos))
        except Exception as e:
            log.append('AVISO {}: no se pudieron recuperar {} eje(s) ocultos en {}: {}'.format(
                tname, len(devueltos), label, e))

    recortados = 0
    if not recortar_ejes_elev:
        # apagar el input tiene que devolver los ejes a su largo real, no dejarlos
        # congelados con el recorte de una corrida anterior.
        for _, g in visibles:
            try:
                g.SetDatumExtentType(DatumEnds.End0, v, DatumExtentType.Model)
                g.SetDatumExtentType(DatumEnds.End1, v, DatumExtentType.Model)
            except Exception:
                pass
    else:
        esc = v.Scale if v.Scale > 0 else 1
        z_alto = bb.Max.Z + ext_arriba_mm / 304.8 * esc
        z_bajo = bb.Min.Z - ext_abajo_mm / 304.8 * esc
        fallidos = 0
        ultimo = None
        for _, g in visibles:
            try:
                if recortar_eje_en_elevacion(g, v, z_bajo, z_alto):
                    recortados += 1
            except Exception as e:
                fallidos += 1
                ultimo = e
        if fallidos:
            log.append('AVISO {}: no se pudo recortar {} eje(s) en {}: {}'.format(
                tname, fallidos, label, ultimo))

    ocultados = 0
    if solo_extremos and len(visibles) > 2:
        # la posicion de los ejes de por medio ya esta acotada en las plantas; aqui
        # solo sirven los dos extremos, como referencia del ancho de la estructura.
        sobran = [g.Id for _, g in visibles[1:-1]]
        try:
            v.HideElements(List[ElementId](sobran))
            ocultados = len(sobran)
        except Exception as e:
            log.append('AVISO {}: no se pudieron ocultar los ejes intermedios de {}: {}'.format(
                tname, label, e))
    if ocultados or recortados:
        log.append('OK {}: {} - {} eje(s) visibles, {} recortado(s), {} oculto(s); quedan {}.'.format(
            tname, label, len(visibles), recortados, ocultados,
            ', '.join(elem_name(g) for _, g in
                      ([visibles[0], visibles[-1]] if ocultados else visibles))))
    return ocultados, recortados


# ------------------------------------------------- altura de la elevacion

def punto_en_elevacion(v, pos_rd, z):
    # punto del PLANO de la elevacion a "pos_rd" sobre la horizontal del papel y a la
    # cota z. Toda cota o linea de detalle de la vista tiene que caer en este plano.
    rd = v.RightDirection
    o = v.Origin
    p = o.Add(rd.Multiply(pos_rd - o.DotProduct(rd)))
    return XYZ(p.X, p.Y, z)


def caras_del_elemento(el, view=None):
    # caras de la geometria solida del elemento, entrando a las instancias por
    # GetInstanceGeometry: las referencias de la geometria de SIMBOLO no sirven para
    # acotar (son del tipo, no de la pieza), las de instancia si.
    #
    # Con "view" se pide la geometria TAL COMO LA DIBUJA esa vista, y las referencias
    # que salen son las que la vista puede resolver. Sin vista salen referencias de
    # modelo, que a una cota le bastan pero a una marca de nivel puede que no.
    # ⚠ View y DetailLevel son excluyentes: fijar los dos lanza excepcion.
    opt = Options()
    opt.ComputeReferences = True
    if view is not None:
        opt.View = view
    else:
        opt.DetailLevel = ViewDetailLevel.Fine
    try:
        geo = el.get_Geometry(opt)
    except Exception:
        return
    if geo is None:
        return
    for g in geo:
        try:
            if isinstance(g, Solid):
                if g.Volume > 1e-9:
                    for f in g.Faces:
                        yield f
            elif isinstance(g, GeometryInstance):
                for sg in g.GetInstanceGeometry():
                    if isinstance(sg, Solid) and sg.Volume > 1e-9:
                        for f in sg.Faces:
                            yield f
        except Exception:
            pass


def cara_horizontal(el, z, hacia_arriba, view=None):
    # la cara horizontal MAS GRANDE del elemento a la cota z. Se acota contra caras y
    # no contra niveles porque de los cinco planos que pide el plano-tipo (tope de
    # baranda, T.A., fondo de viga, P.T., N.I.P.B.) solo dos son niveles del modelo:
    # los otros tres son geometria y nada mas.
    mejor = None
    mejor_area = 0.0
    for f in caras_del_elemento(el, view):
        try:
            if not isinstance(f, PlanarFace):
                continue
            n = f.FaceNormal
            if abs(abs(n.Z) - 1.0) > 1e-3:
                continue
            if (n.Z > 0) != hacia_arriba:
                continue
            if abs(f.Origin.Z - z) > TOL_CARA:
                continue
            if f.Reference is None:
                continue
            if f.Area > mejor_area:
                mejor_area = f.Area
                mejor = f
        except Exception:
            pass
    return mejor


def orden_candidatos(v, ids, bbs):
    # para CONFIRMAR que una altura es real (tiene una cara horizontal genuina y no es
    # geometria degenerada) conviene mirar primero los elementos que la elevacion
    # DIBUJA de verdad: los que estan sobre el plano de la vista, y dentro de la misma
    # capa de profundidad el de mas a la derecha. La anotacion en si (cota o marca de
    # nivel) despues se apoya en una detail line propia, no en la cara de este
    # candidato - ver linea_de_apoyo.
    rd = v.RightDirection
    vd = v.ViewDirection
    o = v.Origin
    res = []
    for eid in ids:
        b = bbs.get(eid)
        if b is None:
            continue
        c = XYZ((b.Min.X + b.Max.X) / 2.0, (b.Min.Y + b.Max.Y) / 2.0,
                (b.Min.Z + b.Max.Z) / 2.0)
        capa = int(abs((c - o).DotProduct(vd)) / TOL_PLANO)
        der = max(XYZ(x, y, 0.0).DotProduct(rd)
                  for x in (b.Min.X, b.Max.X) for y in (b.Min.Y, b.Max.Y))
        res.append((capa, -der, eid))
    res.sort()
    return [eid for _, _, eid in res]


def primera_cara(candidatos, z, hacia_arriba):
    # primer candidato que ofrezca una cara utilizable a esa cota. Se prueban varios
    # porque una pieza puede tener el bbox a la cota pero la cara recortada o inclinada
    # (cartelas, planchas de conexion, perfiles con corte en angulo).
    for eid in candidatos[:MAX_CANDIDATOS]:
        el = doc.GetElement(ElementId(eid))
        if el is None:
            continue
        c = cara_horizontal(el, z, hacia_arriba)
        if c is not None:
            return c
    return None


def niveles_de_viga(v, tops, bbs, cats, fams):
    # los T.A. de la elevacion: los topes de VIGA, agrupados en cubetas y votados por
    # METROS de viga, no por cantidad de piezas ni por altura maxima.
    #
    # ⚠ La altura maxima no sirve: medido en ES-1003 / EJE E el 2026-08-04, la pieza mas
    # alta de la vista es un marco OR100x14,4 de 100 mm de canto del apoyo del SPE, 2,4 m
    # POR ENCIMA de la plataforma. Tomando el maximo, el T.A. salia en EL. 2306,267 en vez
    # de 2303,900 y la cadena de cotas entera colgaba de ahi. Es el mismo criterio con el
    # que 00 elige el nivel dominante de una planta T.A., y por el mismo motivo.
    #
    # Se devuelve una lista de arriba hacia abajo, no un solo nivel: si en la elevacion
    # hay vigas a alturas distintas, cada altura lleva su propia marca.
    cubetas = {}
    for eid in tops:
        if cats.get(eid) != CAT_FRAMING:
            continue
        if excluida_de_viga(fams.get(eid, '')):
            continue
        b = bbs.get(eid)
        if b is None:
            continue
        # el largo EN PLANTA del bbox hace de "metros de viga": una columna es un punto
        # en planta y aporta ~0, asi que no vota por el T.A. de la plataforma.
        largo = math.hypot(b.Max.X - b.Min.X, b.Max.Y - b.Min.Y)
        k = int(round(tops[eid] / TOL_TOPE))
        acc = cubetas.get(k)
        if acc is None:
            cubetas[k] = [largo, tops[eid], [eid]]
        else:
            acc[0] += largo
            acc[1] = max(acc[1], tops[eid])
            acc[2].append(eid)
    if not cubetas:
        return [], []
    mejor = max(a[0] for a in cubetas.values())
    niveles = []
    descartados = []
    for k in sorted(cubetas.keys(), reverse=True):
        metros, z, ids = cubetas[k]
        if mejor > 0 and metros < PORC_NIVEL * mejor:
            descartados.append('{:.0f} mm ({:.1f} m de viga)'.format(z * 304.8, metros * 0.3048))
            continue
        cands = orden_candidatos(v, ids, bbs)
        cara = primera_cara(cands, z, True)
        if cara is None:
            descartados.append('{:.0f} mm (sin cara horizontal)'.format(z * 304.8))
            continue
        niveles.append((z, cara, cands, True, ids))
    return niveles, descartados


_niveles_doc = None


def niveles_doc():
    # Levels del proyecto ordenados por ProjectElevation. Se resuelve una sola vez.
    global _niveles_doc
    if _niveles_doc is None:
        _niveles_doc = sorted(
            [l for l in FilteredElementCollector(doc).OfClass(Level)],
            key=lambda l: l.ProjectElevation)
    return _niveles_doc


def parte_serie(lname, pref, tname):
    # UN solo formato para las tres clases de nivel: "<prefijo><assembly>", o bien
    # "<prefijo><correlativo>_<assembly>" con el correlativo ADELANTE del nombre del
    # assembly; el primero de una serie puede no llevarlo. No alcanza con que el
    # nombre los mencione: el modelo esta lleno de niveles viejos que hablan de T.A. o
    # N.I.P.B. sin ser de esta convencion (RLO_T.A. ES-1002, AMT_T.A.-01_EST. TOLVA).
    #
    # Copiado tal cual de 00: si los dos graphs no leen los niveles igual, las marcas
    # de una elevacion pueden apuntar a una cota que la planta de 00 nunca uso.
    #
    # -> False si el nivel no es de esta clase y de este assembly.
    # -> lo que haya entre el prefijo y el assembly si lo es ('' cuando no hay nada).
    n = (lname or '').strip()
    if not n.lower().startswith(pref.lower()):
        return False
    resto = n[len(pref):]
    base = tname.strip()
    if len(resto) < len(base) or resto[len(resto) - len(base):].lower() != base.lower():
        return False
    medio = resto[:len(resto) - len(base)]
    # El medio, si lo hay, tiene que cerrar en "_", o ES-100 se robaria T.A._ES-1001.
    if medio and not medio.endswith('_'):
        return False
    return medio.rstrip('_').strip()


def calza_serie(lname, pref, tname):
    return parte_serie(lname, pref, tname) is not False


def niveles_del_assembly(tname):
    # -> (z del N.I.P.B., [z de los P.T. ascendentes], [z de los T.A. ascendentes]) en
    # coordenadas de PROYECTO.
    #
    # SIEMPRE ProjectElevation, NUNCA Elevation: este modelo usa Elevation Base = Shared
    # y los niveles reportan la cota del sitio (~7546 pies = 2300 m, el salar) mientras
    # la geometria vive cerca del origen. Mezclarlas manda la marca 2300 m fuera de la
    # vista. Es la misma trampa documentada en 00 para el View Range.
    #
    # Sin nivel no hay marca: no se inventa una cota de reemplazo, igual que 00 no
    # inventa una planta. El log dice cual falta.
    #
    # El N.I.P.B. es uno por assembly; los P.T. y los T.A. son N, y desde el 2026-09-16
    # eso vale tambien para los puntos de trabajo (el modelo real trae dos en ES-1001).
    nipb = []
    pt = []
    ta = []
    for l in niveles_doc():
        n = elem_name(l)
        if calza_serie(n, PREF_NIPB_LV, tname):
            nipb.append(l)
        elif calza_serie(n, PREF_PT_LV, tname):
            pt.append(l)
        elif calza_serie(n, PREF_TA_LV, tname):
            ta.append(l)
    # niveles_doc viene ordenado, asi que el primero es el mas bajo y las dos series
    # salen ascendentes sin volver a ordenar.
    z_nipb = nipb[0].ProjectElevation if nipb else None
    z_pt = [l.ProjectElevation for l in pt]
    z_ta = [l.ProjectElevation for l in ta]

    def fmt(z):
        return '{:.0f} mm'.format(z * 304.8) if z is not None else '(falta)'

    log.append('DIAG {}: niveles modelados -> N.I.P.B. {} | P.T. {} | T.A. {}.'.format(
        tname, fmt(z_nipb),
        ', '.join(fmt(z) for z in z_pt) or '(faltan)',
        ', '.join(fmt(z) for z in z_ta) or '(faltan)'))
    faltan = []
    if z_nipb is None:
        faltan.append(PREF_NIPB_LV + tname)
    if not z_pt:
        faltan.append(PREF_PT_LV + tname)
    if not z_ta:
        faltan.append(PREF_TA_LV + tname)
    if faltan:
        log.append('AVISO {}: faltan niveles modelados ({}); esas marcas no se ponen en '
                   'ninguna elevacion del assembly.'.format(tname, ', '.join(faltan)))
    return z_nipb, z_pt, z_ta


def planos_de_altura(v, ids_vista, bbs, cats, fams):
    # los planos que acota el plano-tipo, sacados de la geometria que la elevacion
    # muestra. Cada uno es (z, cara, candidatos, mira_hacia_arriba); los que no tengan
    # una cara utilizable quedan fuera y constan en el log.
    tops = {}
    bots = {}
    for eid in ids_vista:
        b = bbs.get(eid)
        if b is not None:
            tops[eid] = b.Max.Z
            bots[eid] = b.Min.Z
    res = {'niveles': [], 'descartados': []}
    if not tops:
        return res

    res['niveles'], res['descartados'] = niveles_de_viga(v, tops, bbs, cats, fams)

    def plano(pool, clave_z, z, arriba):
        ids = [e for e in pool if abs(clave_z[e] - z) <= TOL_TOPE]
        cands = orden_candidatos(v, ids, bbs)
        cara = primera_cara(cands, z, arriba)
        return None if cara is None else (z, cara, cands, arriba)

    # N.I.P.B. = la parte MAS BAJA del assembly, por debajo de las sillas de anclaje
    z_nipb = min(bots.values())
    res['N.I.P.B.'] = plano(list(bots.keys()), bots, z_nipb, False)

    # P.T. = tope de la silla de anclaje. En la vista del modelador no hay hormigon: lo
    # unico que hay a esa cota son los Structural Connections que arrancan en la placa
    # base, y su tope es el piso terminado.
    base = [e for e in tops
            if cats.get(e) == CAT_CONEXIONES and bots[e] <= z_nipb + TOL_BASE]
    if base:
        z_pt = max(tops[e] for e in base)
        if (z_pt - z_nipb) >= TOL_BASE:   # placa base sola, sin silla: no hay P.T.
            res['P.T.'] = plano(base, tops, z_pt, True)

    if res['niveles']:
        z_ta, _, _, _, ids_ta = res['niveles'][0]
        # fondo de viga: la cara inferior mas baja de las VIGAS del nivel de arriba.
        # ⚠ Se descartan las piezas mas altas que largas: una columna modelada como
        # Structural Framing llega al T.A. igual que una viga, pero su cara inferior
        # esta en la placa base. Medido en ES-1003 / EJE 14a el 2026-08-04: el fondo
        # salia en 1162 mm (12 mm sobre la N.I.P.B.) en vez de 3098 mm.
        horizontales = []
        for e in ids_ta:
            b = bbs.get(e)
            if b is None:
                continue
            if math.hypot(b.Max.X - b.Min.X, b.Max.Y - b.Min.Y) > (b.Max.Z - b.Min.Z):
                horizontales.append(e)
        if not horizontales:
            horizontales = list(ids_ta)
        z_fondo = min(bots[e] for e in horizontales)
        res['fondo'] = plano(horizontales, bots, z_fondo, False)
        # tope de baranda: solo cuenta si de verdad sobresale del T.A.
        barandas = [e for e in tops if cats.get(e) in CATS_BARANDA]
        if barandas:
            z_bar = max(tops[e] for e in barandas)
            if z_bar > z_ta + TOL_BASE:
                res['baranda'] = plano(barandas, tops, z_bar, True)
                if res.get('baranda') is None:
                    res['descartados'].append(
                        'baranda {:.0f} mm (sin cara horizontal: el pasamanos suele ser tubo redondo)'.format(
                            z_bar * 304.8))
    return res


def alturas_para_cotar(ids_vista, bbs, niveles, z_nipb_declarado=None):
    # los tres planos que se acotan en una elevacion de eje: la N.I.P.B., el tope de acero
    # y la altura maxima de la pieza mas alta.
    tops = []
    bots = []
    for eid in ids_vista:
        b = bbs.get(eid)
        if b is not None:
            tops.append(b.Max.Z)
            bots.append(b.Min.Z)
    if not tops:
        return []

    # La base es la N.I.P.B., o sea la BASE DE LA SILLA, no lo mas bajo del assembly.
    #
    # min(bots) agarraba la LLAVE DE CORTE -que no siempre va y que suele quedar embebida
    # en el hormigon- y los pernos de anclaje. Medido en ES-1001 el 2026-09-22: nivel
    # declarado 55 mm, fondo de la silla -195 mm, base que se usaba -322 mm. La cota total
    # salia 377 mm mas larga de lo que corresponde.
    #
    # Manda el nivel DECLARADO, el mismo contrato de nombres que las marcas leen desde el
    # 2026-08-11. Pero la cota necesita una CARA real contra la cual apoyarse, asi que se
    # usa el fondo de pieza MAS CERCANO a ese nivel y no el nivel exacto.
    z_base = min(bots)
    if z_nipb_declarado is not None:
        cercano = min(bots, key=lambda z: abs(z - z_nipb_declarado))
        if abs(cercano - z_nipb_declarado) <= TOL_NIPB:
            z_base = cercano
        else:
            log.append('AVISO: la N.I.P.B. declarada ({:.0f} mm) no tiene ninguna cara a '
                       'menos de {:.0f} mm; la cota de altura arranca del fondo del '
                       'assembly ({:.0f} mm), que puede ser la llave de corte.'.format(
                           z_nipb_declarado * 304.8, TOL_NIPB * 304.8, z_base * 304.8))
    res = [('base', z_base), ('altura maxima', max(tops))]
    if niveles:
        res.append(('T.A.', niveles[0][0]))
    res.sort(key=lambda it: it[1])
    out = []
    for k, z in res:
        if not out or (z - out[-1][1]) > TOL_CARA:
            out.append((k, z))
    return out


def linea_de_apoyo(v, z, extremos, tname, label):
    # ⚠ TODA la anotacion vertical de la elevacion -cotas Y marcas de nivel- se apoya
    # en una DETAIL LINE propia, no en las caras del acero.
    #
    # Una cota o una marca contra cara se crea sin error -NewDimension/NewSpotElevation
    # devuelven el objeto y la verificacion post-commit lo encuentra vivo- y despues
    # desaparece, cuando Dynamo cierra su propia transaccion con el manejador de fallas
    # ya desuscrito: ni anotacion ni mensaje de error. Medido el 2026-08-04: 54 cotas
    # "OK" en el log y CERO en el modelo, mientras las cadenas en planta -que
    # referencian ejes y detail lines- sobrevivian todas.
    #
    # Con las marcas de nivel esto ademas explica una asimetria muy concreta: en
    # ES-1003, las 7 elevaciones de eje HORIZONTAL (B, Ba, Ca, E, Ea, Va, Vb) sacaron
    # su marca T.A. porque miran a lo ANCHO de la plataforma (poca profundidad, pocos
    # candidatos superpuestos); de las 8 de eje VERTICAL (13a...18a), que miran a lo
    # LARGO y ven decenas de vigas repetidas apiladas en profundidad, solo UNA lo logro
    # - el resto se quedo sin marca por mas candidatos y puntos que se probaran contra
    # las caras. Una detail line propia no depende de cuantas vigas se superpongan.
    if gs_eje is None:
        return None, None, False
    try:
        dc = doc.Create.NewDetailCurve(v, Line.CreateBound(
            punto_en_elevacion(v, extremos[0], z), punto_en_elevacion(v, extremos[1], z)))
        dc.LineStyle = gs_eje
        ids_lineas.append(dc.Id)
    except Exception as e:
        log.append('ERROR {}: no se pudo dibujar una linea de apoyo en {}: {}'.format(
            tname, label, e))
        return None, None, False
    # sin regenerar, GeometryCurve.Reference de una linea recien creada viene nula
    doc.Regenerate()
    try:
        ref = dc.GeometryCurve.Reference
        c = dc.GeometryCurve
        punto = c.Evaluate(0.5, True)
    except Exception:
        ref = None
        punto = None
    if ref is None:
        return None, None, False
    return ref, punto, True


def obtener_apoyo(cache, v, z, extremos, tname, label):
    # una sola linea por altura: si la cota y una marca de nivel caen a la misma cota
    # (tipico de T.A.), comparten la misma detail line en vez de dibujar dos.
    k = int(round(z / TOL_CARA))
    if k in cache:
        ref, punto = cache[k]
        return ref, punto, False
    ref, punto, nueva = linea_de_apoyo(v, z, extremos, tname, label)
    cache[k] = (ref, punto)
    return ref, punto, nueva


def dibujar_cota_vertical(v, tramos, pos_rd, tname, etiqueta):
    # tramos = [(z, Reference)] de una misma vertical. La linea de cota se dibuja a
    # pos_rd sobre la horizontal del papel, ya desplazada por fuera de la estructura.
    if len(tramos) < 2:
        log.append('AVISO {}: menos de 2 referencias para la cota {}; no se acota.'.format(
            tname, etiqueta))
        return 0
    # dos planos a la misma cota (el fondo de un nivel puede coincidir con el tope del
    # de abajo) dan un tramo de cero y Revit rechaza la cadena entera al comitear
    tramos = sorted(tramos, key=lambda t: t[0])
    filtrados = []
    for z, ref in tramos:
        if not filtrados or (z - filtrados[-1][0]) > TOL_CARA:
            filtrados.append((z, ref))
    tramos = filtrados
    if len(tramos) < 2:
        log.append('AVISO {}: las referencias de la cota {} estan a la misma altura.'.format(
            tname, etiqueta))
        return 0
    ra = ReferenceArray()
    for z, ref in tramos:
        ra.Append(ref)
    p1 = punto_en_elevacion(v, pos_rd, tramos[0][0])
    p2 = punto_en_elevacion(v, pos_rd, tramos[-1][0])
    if p1.DistanceTo(p2) < 1e-6:
        log.append('AVISO {}: la cota {} quedaria de largo cero.'.format(tname, etiqueta))
        return 0
    dim = doc.Create.NewDimension(v, Line.CreateBound(p1, p2), ra)
    creadas.append((tname, etiqueta, dim.Id))
    log.append('OK {}: cota {} con {} referencias, {:.0f} mm.'.format(
        tname, etiqueta, len(tramos), (tramos[-1][0] - tramos[0][0]) * 304.8))
    return 1


_spot_cache = {}


def tipo_spot(nombre):
    # Si el tipo pedido NO existe no se devuelve None: se usa el mas parecido que haya y se
    # avisa. Quedarse sin marcas es una perdida silenciosa de informacion en el plano, y los
    # nombres que trae el input son los del estandar, que un proyecto nuevo puede no tener
    # todavia. Paso el 2026-09-22: las tres clases quedaron sin marca por esto.
    #
    # La sigla (T.A. / P.T. / N.I.P.B.) la escribe igual marca_de_nivel(), asi que la marca
    # se entiende aunque el tipo sea generico.
    if nombre in _spot_cache:
        return _spot_cache[nombre]
    t = None
    todos = []
    for st in FilteredElementCollector(doc).OfClass(SpotDimensionType):
        n = elem_name(st)
        todos.append((n, st))
        if n.strip().lower() == nombre.strip().lower():
            t = st
    disponibles = ', '.join(sorted(set(n for n, _s in todos))) or '(ninguno)'
    if t is None and todos:
        # se prefiere uno que hable de ELEVACION: en un proyecto tipico conviven tipos de
        # COORDENADA y de elevacion, y el de coordenadas daria un texto que no es una cota.
        todos.sort(key=lambda x: (0 if 'elev' in x[0].lower() else 1, x[0]))
        t = todos[0][1]
        log.append('AVISO: no existe el tipo de Spot Elevation "{}"; se usa "{}" en su lugar. '
                   'Disponibles: {}.'.format(nombre, elem_name(t), disponibles))
    elif t is None:
        log.append('ERROR: el proyecto no tiene NINGUN tipo de Spot Elevation, asi que no se '
                   'pueden poner marcas de nivel.')
    _spot_cache[nombre] = t
    return t


# Marcas a las que hay que escribirles la sigla: (ElementId, sigla). Se llena al crear
# y se vacia al final, ver escribir_prefijos_pendientes().
_prefijos_pendientes = []


def escribir_prefijos_pendientes(tname, label):
    # Se escribe DESPUES de crear todas las marcas y de UN solo Regenerate.
    #
    # Recien creada, una SpotDimension no acepta el valor del prefijo: Parameter.Set()
    # devuelve False SIN lanzar excepcion, asi que el texto se perdia en silencio. Paso el
    # 2026-09-22: las 68 marcas quedaron con el prefijo vacio y el log no dijo nada.
    #
    # Un Regenerate por marca seria correcto pero carisimo en un modelo grande; uno solo al
    # final alcanza.
    if not _prefijos_pendientes:
        return
    try:
        doc.Regenerate()
    except Exception:
        pass
    puestos = 0
    fallados = []
    for eid, sigla in _prefijos_pendientes:
        sd = doc.GetElement(eid)
        if sd is None:
            continue
        p = param_prefijo_marca(sd)
        if p is None:
            fallados.append(sigla + ': no expone un prefijo editable')
            continue
        try:
            if p.Set(sigla + ' '):
                puestos += 1
            else:
                fallados.append(sigla + ': Revit rechazo el valor')
        except Exception as e:
            fallados.append('{}: {}'.format(sigla, e))
    del _prefijos_pendientes[:]
    if fallados:
        log.append('AVISO {}: {} marca(s) de {} quedaron sin sigla ({}).'.format(
            tname, len(fallados), label, '; '.join(sorted(set(fallados))[:4])))
    if puestos:
        log.append('{}: {} - sigla escrita en {} marca(s).'.format(tname, label, puestos))


def sigla_ya_en_el_tipo(st, sigla):
    # ¿el tipo YA dice la sigla? Se miran su nombre y el del SIMBOLO que dibuja, porque el
    # texto fijo de la marca vive en el simbolo: en este proyecto el tipo "C.L. ELEVACION"
    # usa el simbolo "C.L.", y por eso las tres clases de nivel salian identicas.
    s = (sigla or '').strip().lower()
    if not s:
        return True
    nombres = []
    try:
        nombres.append(elem_name(st))
    except Exception:
        pass
    try:
        p = st.LookupParameter('Symbol')
        if p is not None and p.StorageType == StorageType.ElementId:
            sym = doc.GetElement(p.AsElementId())
            if sym is not None:
                nombres.append(elem_name(sym))
    except Exception:
        pass
    return any(s in (n or '').lower() for n in nombres)


def param_prefijo_marca(sd):
    # "Single/Upper Value Prefix": es de INSTANCIA y editable; verificado en el modelo el
    # 2026-09-22 listando los parametros de una marca ya creada.
    #
    # Se busca por FORMA y no por nombre exacto para aguantar una UI en otro idioma: el
    # parametro de texto, escribible, cuyo nombre habla de prefijo y no del valor inferior.
    mejor = None
    for p in sd.Parameters:
        try:
            if p.IsReadOnly or p.StorageType != StorageType.String:
                continue
            n = (p.Definition.Name or '').lower()
        except Exception:
            continue
        if 'prefi' not in n:
            continue
        if 'lower' in n or 'bottom' in n or 'infer' in n:
            continue
        mejor = p
        if 'upper' in n or 'single' in n or 'super' in n:
            break
    return mejor


def marca_de_nivel(v, ref, punto, nombre_tipo, pos_bend, pos_end, tname, etiqueta, sigla=''):
    # Spot Elevation con directriz hacia la derecha, como en el plano-tipo, apoyada en
    # la detail line que ya resolvio "ref"/"punto" (ver linea_de_apoyo).
    #
    # La sigla ("T.A.", "P.T.", "N.I.P.B.") la pone el TIPO cuando hay un tipo por clase.
    # Si las tres clases comparten uno generico no hay forma de distinguirlas, asi que el
    # script la escribe en el prefijo de la instancia. Ver sigla_ya_en_el_tipo().
    st = tipo_spot(nombre_tipo)
    if st is None or ref is None or punto is None:
        return 0
    try:
        sd = doc.Create.NewSpotElevation(
            v, ref, punto,
            punto_en_elevacion(v, pos_bend, punto.Z),
            punto_en_elevacion(v, pos_end, punto.Z), punto, True)
    except Exception as e:
        log.append('AVISO {}: no se pudo poner la marca {}: {}'.format(tname, etiqueta, e))
        return 0
    if sd is None:
        log.append('AVISO {}: Revit no creo la marca {}.'.format(tname, etiqueta))
        return 0
    try:
        sd.ChangeTypeId(st.Id)
    except Exception as e:
        log.append('AVISO {}: la marca {} quedo con el tipo por defecto: {}'.format(
            tname, etiqueta, e))
    if sigla and not sigla_ya_en_el_tipo(st, sigla):
        # no se escribe aca: ver escribir_prefijos_pendientes()
        _prefijos_pendientes.append((sd.Id, sigla))
    creadas.append((tname, 'marca ' + etiqueta, sd.Id))
    return 1


def anotar_altura(v, label, ids_vista, bbs, cats, fams, r0, r1, off, off_dentro, tname,
                  z_niveles=(None, None, ())):
    # cotas de altura + marcas de nivel + linea de terreno de una elevacion.
    # Devuelve (cotas, marcas, lineas).
    # antes que nada, que la vista pueda MOSTRAR lo que se le va a dibujar
    encender_categoria(v, ID_CAT_COTAS, 'Dimensions', tname, label)
    encender_categoria(v, ID_CAT_MARCAS, 'Spot Elevations', tname, label)
    encender_categoria(v, ID_CAT_LINES, 'Lines', tname, label)

    planos = planos_de_altura(v, ids_vista, bbs, cats, fams)
    niveles = planos['niveles']
    otros = [k for k in ('baranda', 'fondo', 'P.T.', 'N.I.P.B.') if planos.get(k)]
    log.append('DIAG {} / {}: T.A. de viga: {} | otros planos: {}{}'.format(
        tname, label,
        ', '.join('{:.0f} mm'.format(n[0] * 304.8) for n in niveles) or '(ninguno)',
        ', '.join('{} {:.0f} mm'.format(k, planos[k][0] * 304.8) for k in otros) or '(ninguno)',
        '' if not planos['descartados'] else ' | descartados: ' + ', '.join(planos['descartados'])))

    if rehacer_elev:
        # todo lo que hay anotado en una elevacion de eje lo puso este graph (00 crea la
        # vista vacia y 05 solo agrega tags, que no se tocan), asi que se puede limpiar
        # entero sin miedo. Sin esto no se puede iterar: la anotacion de una corrida
        # anterior bloquea la siguiente por idempotencia.
        viejos = [e.Id for e in FilteredElementCollector(doc, v.Id).OfClass(Dimension)]
        if gs_eje is not None:
            viejos.extend(lineas_previas(v, gs_eje.Id))
        if viejos:
            try:
                doc.Delete(List[ElementId](viejos))
                doc.Regenerate()
                log.append('{}: {} - borrada la anotacion previa ({} elemento(s)).'.format(
                    tname, label, len(viejos)))
            except Exception as e:
                log.append('AVISO {}: no se pudo borrar la anotacion previa de {}: {}'.format(
                    tname, label, e))

    # SpotDimension hereda de Dimension, asi que un solo colector sirve para las dos
    ya_cotas = False
    ya_marcas = False
    for e in FilteredElementCollector(doc, v.Id).OfClass(Dimension):
        if isinstance(e, SpotDimension):
            ya_marcas = True
        else:
            ya_cotas = True

    # âš  Las lineas de eje de viga comparten el estilo con las lineas de APOYO de las
    # cotas, asi que una vez dibujadas no se pueden distinguir. Por eso se miran ACA,
    # antes de dibujar nada: si la elevacion ya traia lineas de ese estilo, toda su
    # anotacion es de una corrida anterior y se respeta. Con rehacer_elev ya se borraron
    # mas arriba, la lista queda vacia y se vuelve a dibujar todo.
    ya_lineas = bool(lineas_previas(v, gs_eje.Id)) if gs_eje is not None else False

    # una sola cache de "altura -> (Reference, punto)" para toda la vista: si la cota
    # y una marca caen en la misma altura (tipico de T.A.), comparten la misma detail
    # line en vez de dibujar dos.
    cache_apoyos = {}
    ext_ancha = (r0 - off, r1 + off)          # de lado a lado: linea de terreno
    ext_corta = (r0 - off * 1.3, r0 - off * 0.3)   # corta a la izquierda: cotas/marcas

    cotas = 0
    lineas = 0
    if cotas_altura and not ya_cotas:
        # z_niveles es (N.I.P.B., [P.T.], [T.A.]) del contrato de nombres; el primero
        # es el que manda para el arranque de la cota.
        alturas = alturas_para_cotar(ids_vista, bbs, niveles, z_niveles[0])
        log.append('DIAG {} / {}: alturas a cotar: {}'.format(
            tname, label,
            ', '.join('{} {:.0f} mm'.format(k, z * 304.8) for k, z in alturas) or '(ninguna)'))
        tramos = []
        for clave, z in alturas:
            ext = ext_ancha if clave == 'base' else ext_corta
            ref, punto, nueva = obtener_apoyo(cache_apoyos, v, z, ext, tname, label)
            if nueva:
                lineas += 1
            if ref is not None:
                tramos.append((z, ref))
        if len(tramos) >= 2:
            cotas += dibujar_cota_vertical(v, tramos, r0 - off, tname,
                                           '{} alturas'.format(label))
        elif alturas:
            log.append('AVISO {}: no se pudo apoyar la cota de alturas de {} en ninguna linea.'.format(
                tname, label))
    elif cotas_altura and ya_cotas:
        log.append('{}: {} ya tiene cotas, se saltan las de altura.'.format(tname, label))

    marcas = 0
    if tipos_spot and not ya_marcas:
        if len(tipos_spot) < 3:
            log.append('AVISO {}: se esperaban 3 tipos de Spot Elevation (T.A., P.T., N.I.P.B.) y llegaron {}.'.format(
                tname, len(tipos_spot)))
        # LAS MARCAS SALEN DE LOS NIVELES MODELADOS, no de la geometria de la vista.
        # Antes del 2026-08-11 el T.A. se votaba por metros de viga y el P.T. era el tope
        # de las sillas de anclaje: dos criterios geometricos que podian contradecir a la
        # planta que 00 genero sobre el Level declarado. Ahora las dos cosas leen el mismo
        # contrato de nombres.
        #
        # La votacion geometrica NO se elimina: sigue alimentando la cadena de cotas
        # (alturas_para_cotar), donde lo que se acota es lo que la vista realmente muestra.
        z_nipb, z_pt, z_ta = z_niveles
        pendientes = []
        for z in z_ta:
            pendientes.append((z, tipos_spot[0], 'T.A. {:.0f}'.format(z * 304.8), 'T.A.'))
        # los P.T. son N por assembly desde el 2026-09-16, igual que los T.A., asi que
        # la etiqueta lleva la cota para distinguir una marca de otra en el log
        if len(tipos_spot) > 1:
            for z in z_pt:
                pendientes.append((z, tipos_spot[1], 'P.T. {:.0f}'.format(z * 304.8), 'P.T.'))
        if z_nipb is not None and len(tipos_spot) > 2:
            pendientes.append((z_nipb, tipos_spot[2], 'N.I.P.B.', 'N.I.P.B.'))

        # Una elevacion de eje muestra una TAJADA del assembly: un nivel que no llega a
        # este eje no tiene estructura aca y su marca quedaria flotando en el vacio. Se
        # acota al alto de lo que la vista dibuja, con MARGEN_MARCA de holgura para no
        # perder el nivel que coincide justo con el borde.
        zs_vista = []
        for e in ids_vista:
            b = bbs.get(e)
            if b is not None:
                zs_vista.append(b.Min.Z)
                zs_vista.append(b.Max.Z)
        if pendientes and zs_vista:
            lo = min(zs_vista) - MARGEN_MARCA
            hi = max(zs_vista) + MARGEN_MARCA
            fuera = [et for z, _t, et, _s in pendientes if z < lo or z > hi]
            pendientes = [p for p in pendientes if lo <= p[0] <= hi]
            if fuera:
                log.append('{}: {} - {} marca(s) omitidas por caer fuera del alto que la '
                           'vista muestra: {}.'.format(tname, label, len(fuera), ', '.join(fuera)))
        if not pendientes:
            log.append('AVISO {}: {} se queda sin marcas de nivel - ningun Level del '
                       'assembly cae dentro de lo que la vista muestra.'.format(tname, label))
        for z, nombre, etiqueta, sigla in pendientes:
            ext = ext_ancha if etiqueta == 'N.I.P.B.' else ext_corta
            ref, punto, nueva = obtener_apoyo(cache_apoyos, v, z, ext, tname, label)
            if nueva:
                lineas += 1
            try:
                marcas += marca_de_nivel(v, ref, punto, nombre,
                                         r1 + off / 2.0, r1 + off * 1.5, tname,
                                         '{} {}'.format(label, etiqueta), sigla)
            except Exception as e:
                log.append('ERROR {}: marca de nivel {} en {}: {}'.format(tname, etiqueta, label, e))
        escribir_prefijos_pendientes(tname, label)
    elif tipos_spot and ya_marcas:
        log.append('{}: {} ya tiene marcas de nivel, se saltan.'.format(tname, label))

    # El eje de cada viga, con el MISMO criterio que en las plantas T.A.: la curva de
    # ubicacion proyectada al plano de la vista, saltando las que se proyectan en un
    # punto. Va al final para no pisar las lineas de apoyo que acaban de dibujarse.
    #
    # ids_vista ya viene filtrado contra los miembros del assembly, asi que sirve de
    # conjunto de pertenencia sin volver a calcularlo.
    if dibujar_eje_viga and gs_eje is not None:
        if ya_lineas:
            log.append('{}: {} ya tiene lineas de ese estilo, se saltan los ejes de viga.'.format(
                tname, label))
        else:
            try:
                _, n = ejes_de_viga(v, gs_eje, set(ids_vista), tname, label,
                                    saltar_previas=True)
                lineas += n
            except Exception as e:
                log.append('ERROR {}: ejes de viga en {}: {}'.format(tname, label, e))

    return cotas, marcas, lineas


# ------------------------------------------------- rotulos de la planta NIPB

def tipo_de_tag(nombre):
    # FamilySymbol de Multi-Category Tag con ese nombre de TIPO. Mismo criterio que 05:
    # en este proyecto los 11 tipos Multi-Category son todos de la familia C-MultiCat,
    # asi que alcanza con el nombre del tipo y no hace falta desambiguar por familia. Si
    # no existe, el log lista los disponibles como "Familia : Tipo" y no se rotula nada:
    # con un nombre mal escrito, rotular decenas de piezas con el tag equivocado es peor
    # que no rotular.
    disponibles = []
    elegido = None
    for fs in (FilteredElementCollector(doc).OfClass(FamilySymbol)
               .OfCategory(BuiltInCategory.OST_MultiCategoryTags)):
        n = elem_name(fs)
        try:
            disponibles.append('{} : {}'.format(fs.FamilyName, n))
        except Exception:
            disponibles.append(n)
        if n.strip().lower() == nombre.strip().lower():
            elegido = fs
    if elegido is None:
        log.append('ERROR: no existe el tag Multi-Category "{}" para rotular las NIPB. Disponibles: {}.'.format(
            nombre, ', '.join(sorted(set(disponibles))) or '(ninguno)'))
        return None
    # un simbolo que no esta activado no se puede colocar
    try:
        if not elegido.IsActive:
            elegido.Activate()
            doc.Regenerate()
    except Exception as e:
        log.append('AVISO: no se pudo activar el tag "{}": {}'.format(nombre, e))
    return elegido


def tags_previos(v, tipo_id):
    prev = []
    for t in FilteredElementCollector(doc, v.Id).OfClass(IndependentTag):
        try:
            if t.GetTypeId().Value == tipo_id.Value:
                prev.append(t.Id)
        except Exception:
            pass
    return prev


def z_de_vista(v):
    # el punto del tag tiene que caer en el plano de la vista. Con "Elevation Base =
    # Shared" el nivel y el origen de la vista no coinciden (ver 00), asi que se prueban
    # los dos y se usa el primero que Revit acepte.
    zs = [v.Origin.Z]
    try:
        lv = v.GenLevel
        if lv is not None and abs(lv.ProjectElevation - zs[0]) > 1e-9:
            zs.append(lv.ProjectElevation)
    except Exception:
        pass
    return zs


def rotular_nipb(v, label, ids_miembros, bbs, tag_type, tname):
    # Un Multi-Category Tag por cada Structural Connection del assembly que la NIPB
    # muestre: placas base, sillas de anclaje y pernos, siempre la familia contenedora
    # y nunca sus componentes internos (ver el filtro por SuperComponent mas abajo).
    # Es la unica categoria que se rotula aca a proposito: vigas y columnas ya las
    # rotula 05 en las
    # plantas T.A. y en las elevaciones de eje, y a la cota de la NIPB no dicen nada.
    #
    # ⚠ La categoria se enciende ANTES de buscar los tags previos. Un tag creado en una
    # vista con su categoria apagada existe en el modelo pero no se dibuja, y
    # FilteredElementCollector(doc, view.Id) tampoco lo devuelve: la idempotencia dejaria
    # de verlo y cada corrida apilaria tags invisibles sobre los anteriores. Es la misma
    # trampa que ya esta resuelta aca para Dimensions, Spot Elevations y Lines.
    encender_categoria(v, ID_CAT_TAGS, 'Multi-Category Tags', tname, label)

    prev = tags_previos(v, tag_type.Id)
    if prev:
        if not rehacer_nipb:
            log.append('{}: {} ya tiene {} rotulo(s), se salta.'.format(tname, label, len(prev)))
            return 0
        try:
            doc.Delete(List[ElementId](prev))
            doc.Regenerate()
        except Exception as e:
            log.append('AVISO {}: no se pudieron borrar los rotulos previos de {}: {}'.format(
                tname, label, e))

    # el colector por vista respeta el View Range y el aislamiento permanente que dejo
    # 00; el filtro contra los miembros del assembly es el cinturon de seguridad por si
    # ese aislamiento se hubiera perdido.
    candidatos = {}
    for e in (FilteredElementCollector(doc, v.Id)
              .OfCategory(BuiltInCategory.OST_StructConnections)
              .WhereElementIsNotElementType()):
        if e.Id.Value in ids_miembros:
            candidatos[e.Id.Value] = e

    # Solo la familia contenedora, nunca sus componentes internos. Una silla de anclaje
    # es una familia con piezas anidadas COMPARTIDAS (C-SillaAnclaje con sus ocho
    # C-AtiesadorSillaAnclaje) y el colector por vista devuelve cada anidada como un
    # elemento propio: sin este filtro una silla sale con nueve rotulos encimados en el
    # mismo punto en planta. Medido el 2026-08-11 en PLANTA PLACAS BASE EL. 2.301,775
    # N.I.P.B.: 36 conexiones de silla = 4 contenedores + 32 atiesadores.
    #
    # La condicion es ser hijo de OTRO candidato, no simplemente tener padre: si el
    # contenedor no fuera tageable (fuera del View Range, o la silla anidada dentro de
    # una familia de otra categoria) sus piezas se rotulan igual en vez de perderse en
    # silencio. En ES-1003 hay sillas modeladas como atiesadores sueltos, sin ningun
    # contenedor, y esas siguen recibiendo un rotulo cada una.
    #
    # Vale la jerarquia, no el nombre de la familia: da igual como termine llamandose
    # la silla de anclaje que modele el proyectista.
    piezas = []
    internas = 0
    for e in candidatos.values():
        try:
            sup = e.SuperComponent
        except Exception:
            sup = None
        if sup is not None and sup.Id.Value in candidatos:
            internas += 1
            continue
        piezas.append(e)
    if internas:
        log.append('{}: {} pieza(s) interna(s) de otra conexion en {}; se rotula solo '
                   'la familia contenedora.'.format(tname, internas, label))
    if not piezas:
        log.append('AVISO {}: {} no muestra ninguna conexion del assembly; sin rotulos. '
                   'Las sillas y placas base son Structural Connections y el template las '
                   'apaga: revisa que 00 haya encendido esa categoria en la vista.'.format(
                       tname, label))
        return 0

    zs = z_de_vista(v)
    hechos = 0
    fallidos = 0
    sin_punto = 0
    ultimo = None
    for el in piezas:
        b = bbs.get(el.Id.Value)
        if b is None:
            try:
                b = el.get_BoundingBox(None)
            except Exception:
                b = None
        if b is None:
            sin_punto += 1
            continue
        cx = (b.Min.X + b.Max.X) / 2.0
        cy = (b.Min.Y + b.Max.Y) / 2.0
        creado = None
        for z in zs:
            try:
                creado = IndependentTag.Create(doc, tag_type.Id, v.Id, Reference(el), False,
                                               TagOrientation.Horizontal, XYZ(cx, cy, z))
                break
            except Exception as e:
                ultimo = e
        if creado is None:
            fallidos += 1
            continue
        hechos += 1
    if sin_punto:
        log.append('AVISO {}: {} conexion(es) de {} sin geometria para ubicar el rotulo.'.format(
            tname, sin_punto, label))
    if fallidos:
        log.append('AVISO {}: {} rotulo(s) no se pudieron colocar en {}: {}'.format(
            tname, fallidos, label, ultimo))
    # el tag va en el centro en planta de la pieza, sin directriz. Las conexiones de una
    # misma placa base comparten ese centro, asi que sus rotulos salen encimados y hay
    # que separarlos a mano: son piezas apiladas, no hay un lugar "correcto" que el
    # script pueda calcular.
    log.append('OK {}: {} rotulo(s) "{}" en {} sobre {} conexion(es).'.format(
        tname, hechos, elem_name(tag_type), label, len(piezas)))
    return hechos


# ------------------------------------------------- eje de vigas en planta

_estilo_cache = {}


def patron_de_eje():
    # patron de linea de eje ya cargado en el proyecto; si no hay ninguno, solida.
    for lp in FilteredElementCollector(doc).OfClass(LinePatternElement):
        try:
            n = elem_name(lp).lower()
        except Exception:
            continue
        if 'center' in n or 'centro' in n or n.startswith('eje'):
            return lp.Id
    return None


def estilo_linea(nombre):
    # GraphicsStyle de la subcategoria de Lines con ese nombre. Si no existe se crea
    # roja y con patron de eje, para que el graph tambien funcione en un modelo que
    # todavia no tiene cargado el estandar. Si ya existe NO se toca: el grafismo de
    # L-CENTER es del proyecto, no de este script.
    if nombre in _estilo_cache:
        return _estilo_cache[nombre]
    gs = None
    try:
        cat = doc.Settings.Categories.get_Item(BuiltInCategory.OST_Lines)
        sub = None
        for c in cat.SubCategories:
            if c.Name.strip().lower() == nombre.strip().lower():
                sub = c
                break
        if sub is None:
            sub = doc.Settings.Categories.NewSubcategory(cat, nombre)
            sub.LineColor = Color(255, 0, 0)
            pid = patron_de_eje()
            if pid is not None:
                sub.SetLinePatternId(pid, GraphicsStyleType.Projection)
            doc.Regenerate()
            log.append('Estilo de linea "{}": no existia, se creo rojo{}.'.format(
                nombre, '' if pid is None else ' con patron de eje'))
        else:
            try:
                col = sub.LineColor
                log.append('Estilo de linea "{}": ya existe, RGB {},{},{} (se usa tal cual).'.format(
                    nombre, col.Red, col.Green, col.Blue))
            except Exception:
                log.append('Estilo de linea "{}": ya existe (se usa tal cual).'.format(nombre))
        gs = sub.GetGraphicsStyle(GraphicsStyleType.Projection)
        if gs is None:
            log.append('ERROR: el estilo de linea "{}" no tiene GraphicsStyle de proyeccion.'.format(nombre))
    except Exception as e:
        log.append('ERROR: no se pudo resolver el estilo de linea "{}": {}'.format(nombre, e))
    _estilo_cache[nombre] = gs
    return gs


def planos_candidatos(view):
    # cotas donde puede vivir una detail line de esta planta. Una planta es
    # horizontal, asi que "proyectar al plano de la vista" es fijar la Z. Lo normal
    # es view.Origin.Z; el nivel de la vista es el plan B por si Origin no cayera en
    # el plano de trabajo (Revit rechaza la curva: "must be in the plane of the view").
    zs = [view.Origin.Z]
    try:
        lv = view.GenLevel
        if lv is not None and abs(lv.ProjectElevation - zs[0]) > 1e-9:
            zs.append(lv.ProjectElevation)
    except Exception:
        pass
    return zs


def lineas_previas(view, gs_id):
    prev = []
    for e in (FilteredElementCollector(doc, view.Id)
              .OfCategory(BuiltInCategory.OST_Lines)
              .WhereElementIsNotElementType()):
        try:
            if isinstance(e, CurveElement) and e.LineStyle is not None and e.LineStyle.Id == gs_id:
                prev.append(e.Id)
        except Exception:
            pass
    return prev


def proyectores_de_vista(view):
    # Como se lleva un punto del modelo AL PLANO DE LA VISTA, que es donde tiene que
    # caer toda detail line. Es lo unico que cambia entre una planta y un corte, asi que
    # el criterio del eje de viga se escribe una sola vez y cada vista aporta su plano.
    #
    # Se devuelve una LISTA porque en las plantas la cota del plano de trabajo no siempre
    # es view.Origin.Z y hay que probar el nivel como plan B: Revit rechaza la curva con
    # un must be in the plane of the view. En una elevacion el plano es uno solo.
    if isinstance(view, ViewPlan):
        return [(lambda p, z=z: XYZ(p.X, p.Y, z)) for z in planos_candidatos(view)]
    rd = view.RightDirection
    return [lambda p: punto_en_elevacion(view, p.DotProduct(rd), p.Z)]


def ejes_de_viga(view, gs, ids_miembros, tname, label, saltar_previas=False):
    # dibuja el eje (curva de ubicacion) de cada viga VISIBLE en la planta, como
    # detail line: es especifica de la vista, asi que cada planta muestra solo los
    # ejes de las vigas de SU nivel y el modelo no se ensucia con lineas de modelo.
    # Devuelve (lineas de la vista, cuantas se crearon ahora). Las lineas se devuelven
    # tambien cuando ya existian, porque son las referencias de la cadena de vigas.
    if gs is None:
        return [], 0
    # saltar_previas: en las elevaciones el chequeo lo hace anotar_altura, que mira las
    # lineas ANTES de dibujar las de apoyo de las cotas -comparten estilo con estas y
    # despues no se pueden distinguir-.
    prev = [] if saltar_previas else lineas_previas(view, gs.Id)
    if prev:
        if not redibujar_eje_viga:
            log.append('{}: {} ya tiene {} linea(s) de eje de viga, se salta el dibujo.'.format(
                tname, label, len(prev)))
            return [doc.GetElement(i) for i in prev], 0
        try:
            doc.Delete(List[ElementId](prev))
        except Exception as e:
            log.append('AVISO {}: no se pudieron borrar los ejes previos de {}: {}'.format(tname, label, e))
    try:
        # el colector por vista respeta el View Range y el aislamiento, asi que
        # devuelve exactamente las vigas del nivel que esa planta documenta.
        vigas = [e for e in (FilteredElementCollector(doc, view.Id)
                             .OfCategory(BuiltInCategory.OST_StructuralFraming)
                             .WhereElementIsNotElementType())
                 if e.Id.Value in ids_miembros]
    except Exception as e:
        log.append('ERROR {}: no se pudieron listar las vigas de {}: {}'.format(tname, label, e))
        return [], 0
    if not vigas:
        log.append('{}: {} no muestra vigas del assembly; sin ejes que dibujar.'.format(tname, label))
        return [], 0
    # las detail lines viven en la categoria Lines: si el template la apaga, no se ven
    try:
        if view.GetCategoryHidden(ID_CAT_LINES) and view.CanCategoryBeHidden(ID_CAT_LINES):
            view.SetCategoryHidden(ID_CAT_LINES, False)
    except Exception as e:
        log.append('AVISO {}: no se pudo encender la categoria Lines en {}: {}'.format(tname, label, e))
    proyectores = proyectores_de_vista(view)
    proy_ok = proyectores[0]
    proy_fijo = False    # en cuanto una detail line entra, ese plano es EL plano
    ultimo_error = None
    dibujadas = []
    hechas = 0
    sin_curva = 0
    sin_largo = 0
    fallidas = 0
    for el in vigas:
        c = None
        try:
            loc = el.Location
            if loc is not None and hasattr(loc, 'Curve'):
                c = loc.Curve
        except Exception:
            c = None
        if c is None:
            sin_curva += 1
            continue
        try:
            if isinstance(c, Line):
                pts = [c.GetEndPoint(0), c.GetEndPoint(1)]
            else:
                pts = list(c.Tessellate())   # viga curva: poligonal en planta
        except Exception:
            sin_curva += 1
            continue
        # El largo se mide SOBRE EL PLANO DE LA VISTA, no en 3D: una viga que se proyecta
        # en un punto no tiene eje que dibujar. En una planta eso es una riostra o un
        # montante vertical; en un corte, una viga que entra hacia el fondo del papel. Es
        # el mismo criterio, dicho en el plano que a cada vista le corresponde.
        segs = []
        for a, b in zip(pts[:-1], pts[1:]):
            if proy_ok(a).DistanceTo(proy_ok(b)) >= TOL_LINEA:
                segs.append((a, b))
        if not segs:
            sin_largo += 1
            continue
        for a, b in segs:
            hecha = False
            for proy in ([proy_ok] if proy_fijo else proyectores):
                try:
                    dc = doc.Create.NewDetailCurve(view, Line.CreateBound(proy(a), proy(b)))
                    dc.LineStyle = gs
                    dibujadas.append(dc)
                    hechas += 1
                    hecha = True
                    if not proy_fijo:
                        if proy is not proyectores[0]:
                            log.append('AVISO {}: en {} las detail lines no caian en el plano de view.Origin; se uso el plan B.'.format(
                                tname, label))
                        proy_ok = proy
                        proy_fijo = True
                    break
                except Exception as e:
                    ultimo_error = e
            if not hecha:
                fallidas += 1
                if fallidas == 1:
                    log.append('ERROR {}: no se pudo dibujar el eje de una viga en {}: {}'.format(
                        tname, label, ultimo_error))
    detalles = []
    if sin_curva:
        detalles.append('{} sin curva de ubicacion'.format(sin_curva))
    if sin_largo:
        detalles.append('{} sin largo en el plano de la vista'.format(sin_largo))
    if fallidas:
        detalles.append('{} fallidas'.format(fallidas))
    log.append('OK {}: {} linea(s) de eje en {} sobre {} viga(s){}.'.format(
        tname, hechas, label, len(vigas),
        '' if not detalles else ' [' + ', '.join(detalles) + ']'))
    return dibujadas, hechas


def cadenas_existentes(v, gs):
    # que cadenas ya dibujo este graph en la vista, mirando A QUE referencia la primera
    # cota de cada cadena: un Grid es la cadena entre ejes, una detail line del estilo
    # pedido es la cadena entre ejes de viga. Asi se puede agregar la cadena de vigas a
    # una planta que ya tenia la de ejes, sin rehacer ni duplicar esa.
    res = set()
    gs_id = gs.Id if gs is not None else None
    for dim in FilteredElementCollector(doc, v.Id).OfClass(Dimension):
        try:
            primera = None
            for ref in dim.References:
                primera = ref
                break
            if primera is None:
                continue
            el = doc.GetElement(primera.ElementId)
            if el is None:
                continue
            if isinstance(el, Grid):
                res.add('ejes')
            elif (gs_id is not None and isinstance(el, CurveElement)
                  and el.LineStyle is not None and el.LineStyle.Id == gs_id):
                res.add('vigas')
        except Exception:
            pass
    return res


def orientar(e, hacia):
    # sentido canonico de una direccion: la que apunte hacia el mismo lado que "hacia"
    return e if e.DotProduct(hacia) >= 0 else e.Negate()


def perp_en_plano(e, hacia):
    # perpendicular en planta, orientada hacia donde se pide
    return orientar(XYZ(-e.Y, e.X, 0.0), hacia)


def extremos_bbox(bb, eje):
    # proyeccion minima y maxima del bbox del assembly sobre un eje cualquiera
    vals = []
    for x in (bb.Min.X, bb.Max.X):
        for y in (bb.Min.Y, bb.Max.Y):
            for z in (bb.Min.Z, bb.Max.Z):
                vals.append(XYZ(x, y, z).DotProduct(eje))
    return min(vals), max(vals)


def desvio(d, dom):
    # seno del angulo entre dos direcciones unitarias en planta. Se usa el producto
    # CRUZ y no el escalar: cerca del paralelismo el coseno pierde toda la precision
    # (cos(1e-5) y 1.0 son el mismo double), mientras que el seno vale el angulo.
    return abs(d.X * dom.Y - d.Y * dom.X)


def direccion_dominante(dcs):
    # la direccion que acumula MAS METROS de linea, no la que tienen mas piezas: es el
    # mismo criterio con el que 00 elige el nivel dominante de una planta T.A., y por el
    # mismo motivo - un par de piezas cortas fuera de escuadra no puede decidir por el
    # grupo entero. Las cubetas son tan finas como la tolerancia de paralelismo, para
    # que una viga apenas torcida caiga en OTRA cubeta y no contamine la dominante.
    cubetas = {}
    for dc in dcs:
        try:
            c = dc.GeometryCurve
            d = orientar(c.Direction, XYZ(1.0, 0.0, 0.0))
            if abs(d.X) < 1e-9 and d.Y < 0:
                d = d.Negate()
            k = int(round(math.atan2(d.Y, d.X) / TOL_PARALELO))
            acc = cubetas.get(k)
            if acc is None:
                cubetas[k] = [c.Length, d]
            else:
                acc[0] += c.Length
        except Exception:
            pass
    if not cubetas:
        return None
    return max(cubetas.values(), key=lambda a: a[0])[1]


def alinear_grupo(dcs, hacia):
    # deja solo las lineas paralelas a la direccion dominante. Lo que sobra son
    # diagonales reales (arriostramientos) o vigas mal modeladas: si entraran, Revit
    # rechazaria la cadena COMPLETA.
    #
    # El corte es a TOL_PARALELO/2 y no a TOL_PARALELO a proposito: la condicion que le
    # importa a Revit es entre CADA PAR de referencias, no contra un promedio. Dos vigas
    # desviadas +tol y -tol respecto de la dominante pasarian las dos y estarian 2*tol
    # una de otra. Con medio umbral, cualquier par queda dentro de TOL_PARALELO.
    dom = direccion_dominante(dcs)
    if dom is None:
        return None, [], 0, 0.0
    dom = orientar(dom, hacia)
    ok = []
    fuera = 0
    peor = 0.0
    for dc in dcs:
        try:
            s = desvio(dc.GeometryCurve.Direction, dom)
            if s <= TOL_PARALELO / 2.0:
                ok.append(dc)
            else:
                fuera += 1
                if s > peor:
                    peor = s
        except Exception:
            fuera += 1
    return dom, ok, fuera, peor


def dibujar_cadena(view, items, eje_medida, eje_perp, valor_perp, tname, etiqueta,
                   sep_min=TOL_EJE, sep_total=0.0, solo_total=False, punto=None):
    # items = [(posicion a lo largo de eje_medida, Reference, nombre)]. La linea de cota
    # corre a lo largo de eje_medida y se dibuja a "valor_perp" sobre eje_perp, ya
    # desplazado por fuera del borde del assembly. Los dos ejes son unitarios,
    # perpendiculares entre si y horizontales, asi que generan el plano de la planta.
    if len(items) < 2:
        log.append('AVISO {}: menos de 2 referencias para la cadena {}; no se acota.'.format(
            tname, etiqueta))
        return 0
    items.sort(key=lambda it: it[0])
    filtrados = []
    ultimo = None
    for pos, ref, nombre in items:
        if ultimo is None or pos - ultimo > sep_min:
            filtrados.append((pos, ref, nombre))
            ultimo = pos
    fusionadas = len(items) - len(filtrados)
    if len(filtrados) < 2:
        log.append('AVISO {}: las referencias de la cadena {} estan superpuestas; no se acota.'.format(
            tname, etiqueta))
        return 0
    ra = ReferenceArray()
    for pos, ref, nombre in filtrados:
        ra.Append(ref)
    if punto is None:
        # PLANTA: eje_medida y eje_perp son horizontales y generan el plano de la vista,
        # que vive a la cota del origen. En una ELEVACION el plano es otro y quien llama
        # pasa su propio constructor: es lo unico que cambia entre las dos, igual que con
        # proyectores_de_vista para el eje de viga.
        z_plano = view.Origin.Z

        def punto(pos, perp):
            p = eje_medida.Multiply(pos).Add(eje_perp.Multiply(perp))
            return XYZ(p.X, p.Y, z_plano)
    p1 = punto(filtrados[0][0], valor_perp)
    p2 = punto(filtrados[-1][0], valor_perp)
    if p1.DistanceTo(p2) < 1e-6:
        log.append('AVISO {}: la cadena {} quedaria de largo cero.'.format(tname, etiqueta))
        return 0
    n_cotas = 0
    if not solo_total:
        dim = doc.Create.NewDimension(view, Line.CreateBound(p1, p2), ra)
        creadas.append((tname, etiqueta, dim.Id))
        nombres = [n for _, _, n in filtrados if n]
        menor = min(filtrados[i + 1][0] - filtrados[i][0] for i in range(len(filtrados) - 1))
        log.append('OK {}: cadena {} con {} referencias, largo {:.2f} m, menor segmento {:.0f} mm{}{}.'.format(
            tname, etiqueta, len(filtrados), p1.DistanceTo(p2) * 0.3048, menor * 304.8,
            ', {} fusionadas por cercania'.format(fusionadas) if fusionadas else '',
            ' ({})'.format(', '.join(nombres)) if nombres else ''))
        n_cotas = 1

    # Cota TOTAL, del primer al ultimo eje, por fuera de la cadena.
    #
    # sep_total viene CON SIGNO y no en valor absoluto a proposito: la cadena de arriba se
    # desplaza con +off sobre eje_perp y la de la izquierda con -off, asi que hacia afuera
    # no es la misma direccion en las dos. Con el signo puesto por quien llama, aca alcanza
    # con sumar. Cero = no se dibuja.
    #
    # Con solo 2 ejes no se dibuja: la cadena ya es el total y serian dos cotas iguales.
    # Con solo_total la total ocupa EL LUGAR de los tramos, en vez de quedar mas afuera
    # dejando un hueco vacio adentro. Y ahi se dibuja aunque haya solo 2 ejes: es la unica
    # cota de ese lado, no una repeticion de la cadena.
    if solo_total or (sep_total and len(filtrados) > 2):
        perp_t = valor_perp if solo_total else valor_perp + sep_total
        at = punto(filtrados[0][0], perp_t)
        bt = punto(filtrados[-1][0], perp_t)
        ra_t = ReferenceArray()
        ra_t.Append(filtrados[0][1])
        ra_t.Append(filtrados[-1][1])
        try:
            dim_t = doc.Create.NewDimension(view, Line.CreateBound(at, bt), ra_t)
            creadas.append((tname, etiqueta + ' total', dim_t.Id))
            n_cotas += 1
            log.append('OK {}: cota total {} de {:.2f} m, del eje {} al {}.'.format(
                tname, etiqueta, (filtrados[-1][0] - filtrados[0][0]) * 0.3048,
                filtrados[0][2] or 'primero', filtrados[-1][2] or 'ultimo'))
        except Exception as e:
            log.append('AVISO {}: no se pudo poner la cota total de {}: {}'.format(
                tname, etiqueta, e))
    return n_cotas


def cadena_de_ejes_en_elevacion(v, grids, bb, tname, label):
    # Cadena entre ejes + cota total, ARRIBA del assembly, dentro de una elevacion de eje.
    # Misma logica que en planta: se acota contra los propios Grid, que son referencias
    # limpias -a diferencia de las caras del acero, que Revit descarta al comitear-.
    #
    # âš  Depende de que los ejes intermedios esten VISIBLES. Una cota contra un eje oculto
    # se crea sin error y no se dibuja, que es la misma trampa ya documentada para las
    # categorias apagadas. Por eso el input de dejar solo los dos extremos viene en False
    # desde el 2026-08-11: sin todos los ejes del assembly a la vista, esta cadena no
    # tiene contra que referenciarse.
    #
    # Va DESPUES de anotar_altura a proposito: con rehacer_elev, anotar_altura borra todas
    # las Dimension de la vista, asi que dibujarla antes seria dibujarla para nada.
    ya = cadenas_existentes(v, gs_eje)
    if 'ejes' in ya:
        log.append('{}: {} ya tiene cadena entre ejes, se salta.'.format(tname, label))
        return 0
    items = []
    for pos, g in ejes_visibles_en_elevacion(v, grids):
        try:
            items.append((pos, Reference(g), elem_name(g)))
        except Exception:
            pass
    if len(items) < 2:
        log.append('{}: {} dibuja menos de 2 ejes; sin cadena entre ejes.'.format(tname, label))
        return 0
    esc = v.Scale if v.Scale > 0 else 1
    off = offset_mm / 304.8 * esc
    sep_tot = (sep_cadenas_mm / 304.8 * esc) if COTA_TOTAL_EJES else 0.0
    _, z_alto = extremos_bbox(bb, XYZ.BasisZ)

    def punto(pos, perp):
        # en una elevacion la coordenada perpendicular a la linea de cota es la COTA, asi
        # que perp ya viene en Z absoluto y no como desplazamiento sobre un eje horizontal.
        return punto_en_elevacion(v, pos, perp)

    return dibujar_cadena(v, items, v.RightDirection, XYZ.BasisZ, z_alto + off,
                          tname, '{} ejes arriba'.format(label),
                          sep_total=sep_tot, punto=punto)


def items_de_ejes(grids, d_medida):
    items = []
    for g in grids:
        try:
            ref = Reference(g)
        except Exception:
            continue
        items.append((g.Curve.Evaluate(0.5, True).DotProduct(d_medida), ref, elem_name(g)))
    return items


def items_de_vigas(dcs, d_medida):
    # se acota contra las propias detail lines L-CENTER: son EL eje de la viga, estan
    # en la misma vista y son referencias limpias, a diferencia de las caras del acero.
    items = []
    for dc in dcs:
        try:
            c = dc.GeometryCurve
            ref = c.Reference
            if ref is None:
                continue
            items.append((c.Evaluate(0.5, True).DotProduct(d_medida), ref, ''))
        except Exception:
            pass
    return items


# ------------------------------------------------------------------ main

by_type = {}
for ai in FilteredElementCollector(doc).OfClass(AssemblyInstance):
    by_type.setdefault(ai.AssemblyTypeName, []).append(ai)

if not by_type:
    log.append('AVISO: no hay ningun Assembly en el modelo; nada que anotar.')

if process_all:
    targets = sorted(by_type.keys())
else:
    tokens = [t.strip().lower() for t in filter_text.split(',') if t.strip()]
    if tokens:
        targets = [n for n in sorted(by_type.keys())
                   if any(tok in n.lower() for tok in tokens)]
    else:
        targets = []
        log.append('ERROR: "Todos" esta en False y el filtro esta vacio.')

views = {}
for v in FilteredElementCollector(doc).OfClass(View):
    # solo las del juego pedido: el indice se filtra aca UNA vez y con eso quedan acotadas
    # todas las busquedas de mas abajo, sin tener que tocar cada startswith por separado.
    if not v.IsTemplate and es_de_este_juego(elem_name(v)):
        views[elem_name(v)] = v

total = 0
encendidas = 0
burbujas = 0
lineas_eje = 0
ocultos_elev = 0
recortes_elev = 0
cotas_elev = 0
marcas_elev = 0
terreno_elev = 0
tags_nipb = 0
creadas = []      # (assembly, etiqueta, id) de cada cadena, para verificar tras el commit
ids_lineas = []   # idem para los ejes de viga


fallas = {}   # descripcion de Revit -> [cantidad, ids de ejemplo]


def _resolver_fallas(sender, args):
    # al confirmar la transaccion, elimina automaticamente las cotas que Revit
    # rechaza por referencias invalidas, en vez de mostrar el dialogo bloqueante.
    # ANTES el mensaje de Revit se descartaba sin leerlo, y era justo el dato que
    # hacia falta para saber por que rechazaba una cadena: ahora se acumula y se
    # vuelca al log despues del commit.
    try:
        fa = args.GetFailuresAccessor()
        resultado = FailureProcessingResult.Continue
        for f in fa.GetFailureMessages():
            try:
                try:
                    desc = f.GetDescriptionText()
                except Exception:
                    desc = '(sin descripcion)'
                es_aviso = f.GetSeverity() == FailureSeverity.Warning
                ids = []
                try:
                    ids = [i.Value for i in f.GetFailingElementIds()]
                except Exception:
                    pass
                clave = '{}: {}'.format('AVISO' if es_aviso else 'ERROR', desc)
                acc = fallas.get(clave)
                if acc is None:
                    fallas[clave] = [1, ids[:8]]
                else:
                    acc[0] += 1
                    if len(acc[1]) < 8:
                        acc[1].extend(ids[:8 - len(acc[1])])
                if es_aviso:
                    fa.DeleteWarning(f)
                    continue
                if ids:
                    fa.DeleteElements(List[ElementId](f.GetFailingElementIds()))
                    resultado = FailureProcessingResult.ProceedWithCommit
                elif f.HasResolutions():
                    fa.ResolveFailure(f)
                    resultado = FailureProcessingResult.ProceedWithCommit
            except Exception:
                pass
        args.SetProcessingResult(resultado)
    except Exception:
        pass
app = doc.Application
app.FailuresProcessing += _resolver_fallas
TransactionManager.Instance.EnsureInTransaction(doc)
try:
    gs_eje = estilo_linea(estilo_pedido) if (
        (dibujar_eje_viga or chain_vigas or cotas_altura) and targets) else None
    # el tipo de tag se resuelve una sola vez: es una busqueda sobre todos los simbolos
    # del proyecto y no cambia entre assemblies
    tag_nipb = tipo_de_tag(tipo_tag_nipb) if (
        rotular_conexiones and tipo_tag_nipb and targets) else None
    if rotular_conexiones and not tipo_tag_nipb:
        log.append('AVISO: "NIPB: tipo de C-MultiCat del rotulo" esta vacio; no se rotula la NIPB.')
    for tname in targets:
        ai = by_type[tname][0]
        try:
            miembros = miembros_recursivos(ai)
            ids_miembros = set()
            bbs = {}          # id -> bbox solido, se reusa en las cotas de altura
            cats = {}         # id -> categoria, para separar vigas de conexiones
            fams = {}         # id -> "familia tipo" en minusculas, para excluir grating
            for el in miembros:
                try:
                    eid = el.Id.Value
                except Exception:
                    continue
                ids_miembros.add(eid)
                b = member_solid_bbox(el)
                if b is not None:
                    bbs[eid] = b
                try:
                    if el.Category is not None:
                        cats[eid] = el.Category.Id.Value
                except Exception:
                    pass
                try:
                    fams[eid] = (el.Symbol.FamilyName + ' ' + elem_name(el.Symbol)).lower()
                except Exception:
                    pass
            bb = bbox_de(bbs)
            if bb is None:
                log.append('ERROR {}: sin geometria solida valida; se omite.'.format(tname))
                continue
            ejes = ejes_del_assembly(tname)
            # una sola vez por assembly: las marcas de todas sus elevaciones salen de aca
            z_niveles_asm = niveles_del_assembly(tname)

            # el tercer elemento marca la NIPB: no lleva eje de vigas ni su cadena
            plantas = []
            v = views.get(tname + SUF_NIPB)
            if v is not None:
                plantas.append((v, 'planta NIPB', True))
            for n in sorted(k for k in views if k.startswith(tname + SUF_TA)):
                plantas.append((views[n], n[len(tname) + 3:], False))
            elevaciones = [(views[n], n[len(tname) + 3:])
                           for n in sorted(k for k in views if k.startswith(tname + SUF_EJE))]

            if not plantas:
                log.append('AVISO {}: no existen las plantas (corre 00_Vistas de assembly).'.format(tname))
                continue

            # --- 1. ejes visibles, con una sola burbuja por eje ---
            for v, label, _ in plantas:
                if mostrar_ejes(v, tname, label):
                    encendidas += 1
                if burbuja_unica and ejes:
                    burbujas += burbuja_arriba_izquierda(v, ejes, tname, label)
            if ejes_en_elev:
                for v, label in elevaciones:
                    if mostrar_ejes(v, tname, label):
                        encendidas += 1
                    if ejes:
                        try:
                            o, r = ejes_de_elevacion(v, ejes, bb, tname, label)
                            ocultos_elev += o
                            recortes_elev += r
                        except Exception as e:
                            log.append('ERROR {} ejes de la elevacion {}: {}'.format(tname, label, e))
                    if cotas_altura or tipos_spot or dibujar_eje_viga:
                        try:
                            rd = v.RightDirection
                            esc = v.Scale if v.Scale > 0 else 1
                            off = offset_mm / 304.8 * esc
                            off_dentro = off - sep_cadenas_mm / 304.8 * esc
                            if off_dentro <= 0:
                                off_dentro = off / 2.0
                            r0, r1 = extremos_bbox(bb, rd)
                            # solo se acota contra lo que la elevacion MUESTRA: Revit no
                            # acota una cara que no se ve en la vista.
                            ids_vista = [e.Id.Value for e in
                                         FilteredElementCollector(doc, v.Id).WhereElementIsNotElementType()
                                         if e.Id.Value in ids_miembros]
                            c, m, t = anotar_altura(v, label, ids_vista, bbs, cats, fams,
                                                    r0, r1, off, off_dentro, tname,
                                                    z_niveles_asm)
                            cotas_elev += c
                            marcas_elev += m
                            terreno_elev += t
                        except Exception as e:
                            log.append('ERROR {} altura de la elevacion {}: {}'.format(tname, label, e))
                    if ejes:
                        try:
                            cotas_elev += cadena_de_ejes_en_elevacion(v, ejes, bb, tname, label)
                        except Exception as e:
                            log.append('ERROR {} cadena entre ejes en {}: {}'.format(tname, label, e))

            if not ejes:
                log.append('AVISO {}: ningun eje cruza el assembly; no hay cadena entre ejes.'.format(tname))

            # --- 2. por cada planta: eje de las vigas y cadenas de cotas ---
            for v, label, es_nipb in plantas:
                rd = v.RightDirection
                ud = v.UpDirection
                esc = v.Scale if v.Scale > 0 else 1
                off = offset_mm / 304.8 * esc
                # la cadena de vigas va por DENTRO de la de ejes, mas cerca de la planta
                off_viga = off - sep_cadenas_mm / 304.8 * esc
                if off_viga <= 0:
                    off_viga = off / 2.0
                    log.append('AVISO {}: la separacion entre cadenas es mayor que la separacion al borde; la cadena de vigas de {} se pone a media distancia.'.format(
                        tname, label))

                # extension del assembly proyectada sobre los ejes de la vista
                rs = []
                us = []
                for x in (bb.Min.X, bb.Max.X):
                    for y in (bb.Min.Y, bb.Max.Y):
                        for z in (bb.Min.Z, bb.Max.Z):
                            p = XYZ(x, y, z)
                            rs.append(p.DotProduct(rd))
                            us.append(p.DotProduct(ud))
                r0, r1 = min(rs), max(rs)
                u0, u1 = min(us), max(us)

                # --- 2a. eje de cada viga como detail line (solo en las T.A.) ---
                dcs = []
                if es_nipb:
                    # a la cota de la NIPB hay placas base, pernos y sillas, no vigas:
                    # ahi el eje de viga no dice nada. Si una corrida anterior lo dibujo
                    # se limpia, y Revit se lleva de paso la cadena que lo referenciaba.
                    if gs_eje is not None:
                        prev = lineas_previas(v, gs_eje.Id)
                        if prev:
                            try:
                                doc.Delete(List[ElementId](prev))
                                doc.Regenerate()
                                log.append('{}: {} - borrados {} eje(s) de viga y su cadena; las NIPB no los llevan.'.format(
                                    tname, label, len(prev)))
                            except Exception as e:
                                log.append('AVISO {}: no se pudieron borrar los ejes de viga de {}: {}'.format(
                                    tname, label, e))
                elif dibujar_eje_viga:
                    try:
                        dcs, nuevas = ejes_de_viga(v, gs_eje, ids_miembros, tname, label)
                        lineas_eje += nuevas
                        for dc in dcs:
                            try:
                                ids_lineas.append(dc.Id)
                            except Exception:
                                pass
                    except Exception as e:
                        log.append('ERROR {} eje de vigas en {}: {}'.format(tname, label, e))
                elif chain_vigas and gs_eje is not None:
                    # sin dibujar nada: se acota contra los ejes que ya estuvieran
                    dcs = [doc.GetElement(i) for i in lineas_previas(v, gs_eje.Id)]
                if dcs:
                    # sin regenerar, GeometryCurve.Reference de una linea recien creada
                    # puede venir nula y la cadena de vigas se quedaria sin referencias
                    doc.Regenerate()

                # --- 2a bis. rotulo de las conexiones (solo en la NIPB) ---
                if es_nipb and tag_nipb is not None:
                    try:
                        tags_nipb += rotular_nipb(v, label, ids_miembros, bbs, tag_nipb, tname)
                    except Exception as e:
                        log.append('ERROR {} rotulos de la NIPB en {}: {}'.format(tname, label, e))

                # que cadenas hay YA en la vista. Se mira despues de 2a a proposito: si
                # se redibujaron los ejes, Revit se llevo por delante la cadena de vigas
                # que los referenciaba, y aqui tiene que constar que ya no esta.
                ya = cadenas_existentes(v, gs_eje)

                # --- 2b. cadena entre ejes estructurales, por fuera ---
                if ejes:
                    # un eje paralelo a "arriba" de la vista se mide a lo largo de
                    # "derecha", y su cadena va por encima del assembly; y viceversa.
                    g_para_h = []
                    g_para_v = []
                    oblicuos = []
                    for g in ejes:
                        c = g.Curve
                        d = c.GetEndPoint(1) - c.GetEndPoint(0)
                        d = XYZ(d.X, d.Y, 0.0)
                        if d.GetLength() < 1e-9:
                            continue
                        d = d.Normalize()
                        if abs(d.DotProduct(ud)) > PARALELO:
                            g_para_h.append(g)
                        elif abs(d.DotProduct(rd)) > PARALELO:
                            g_para_v.append(g)
                        else:
                            oblicuos.append(elem_name(g))
                    log.append('DIAG {} / {}: ejes para la cadena de arriba: {} | para la de la izquierda: {} | oblicuos: {}'.format(
                        tname, label, len(g_para_h), len(g_para_v), len(oblicuos)))
                    if oblicuos:
                        log.append('AVISO {}: ejes oblicuos a la vista, fuera de la cadena: {}.'.format(
                            tname, ', '.join(sorted(oblicuos))))

                    if 'ejes' in ya:
                        log.append('{}: {} ya tiene cadena entre ejes, se salta.'.format(tname, label))
                    else:
                        # La cota total va por FUERA de la cadena, a la misma separacion
                        # que se usa entre cadenas. El signo sigue al de off: la de arriba
                        # se aleja sumando y la de la izquierda restando.
                        sep_tot = (sep_cadenas_mm / 304.8 * esc) if COTA_TOTAL_EJES else 0.0
                        if chain_h:
                            try:
                                total += dibujar_cadena(v, items_de_ejes(g_para_h, rd), rd, ud, u1 + off,
                                                        tname, '{} ejes arriba'.format(label),
                                                        sep_total=sep_tot,
                                                        solo_total=SOLO_TOTAL_ARRIBA)
                            except Exception as e:
                                log.append('ERROR {} cadena de ejes horizontal en {}: {}'.format(tname, label, e))
                        if chain_v:
                            try:
                                total += dibujar_cadena(v, items_de_ejes(g_para_v, ud), ud, rd, r0 - off,
                                                        tname, '{} ejes izquierda'.format(label),
                                                        sep_total=-sep_tot,
                                                        solo_total=SOLO_TOTAL_IZQUIERDA)
                            except Exception as e:
                                log.append('ERROR {} cadena de ejes vertical en {}: {}'.format(tname, label, e))

                # --- 2c. cadena entre ejes de viga, por dentro (solo en las T.A.) ---
                if es_nipb or not chain_vigas or not dcs:
                    continue
                # Primer reparto grueso: cada eje de viga va al grupo del eje de la vista
                # al que MAS se parece, sin umbral. El filtro fino lo hace despues
                # alinear_grupo() contra la direccion dominante, que es el criterio que
                # de verdad le importa a Revit.
                g_arriba = []
                g_lados = []
                for dc in dcs:
                    try:
                        d = dc.GeometryCurve.Direction
                        if abs(d.DotProduct(ud)) >= abs(d.DotProduct(rd)):
                            g_arriba.append(dc)
                        else:
                            g_lados.append(dc)
                    except Exception:
                        pass
                dom_h, dcs_h, fuera_h, peor_h = alinear_grupo(g_arriba, ud)
                dom_v, dcs_v, fuera_v, peor_v = alinear_grupo(g_lados, rd)

                # las vigas de la mitad izquierda se acotan a la izquierda y las de la
                # derecha a la derecha: una planta extensa acotada a un solo lado
                # amontona demasiadas cotas para poder leerlas.
                dcs_izq = []
                dcs_der = []
                lo_v = hi_v = 0.0
                if dom_v is not None:
                    lo_v, hi_v = extremos_bbox(bb, dom_v)
                    centro_v = (lo_v + hi_v) / 2.0
                    for dc in dcs_v:
                        try:
                            if dc.GeometryCurve.Evaluate(0.5, True).DotProduct(dom_v) <= centro_v:
                                dcs_izq.append(dc)
                            else:
                                dcs_der.append(dc)
                        except Exception:
                            pass

                log.append('DIAG {} / {}: ejes de viga -> arriba: {} | izquierda: {} | derecha: {} | no paralelos: {} | total dibujados: {}'.format(
                    tname, label, len(dcs_h), len(dcs_izq), len(dcs_der),
                    fuera_h + fuera_v, len(dcs)))
                if fuera_h + fuera_v:
                    peor = max(peor_h, peor_v)
                    log.append('AVISO {}: {} eje(s) de viga no paralelos a la direccion dominante en {}, fuera de la cadena (desvio maximo {:.4f} grados).'.format(
                        tname, fuera_h + fuera_v, label,
                        math.degrees(math.asin(min(1.0, peor)))))
                if 'vigas' in ya:
                    log.append('{}: {} ya tiene cadena entre ejes de viga, se salta.'.format(tname, label))
                    continue

                cadenas_viga = []
                if dom_h is not None and dcs_h:
                    lo_h, hi_h = extremos_bbox(bb, dom_h)
                    cadenas_viga.append((dcs_h, perp_en_plano(dom_h, rd), dom_h,
                                         hi_h + off_viga, 'arriba'))
                if dom_v is not None:
                    m_v = perp_en_plano(dom_v, ud)
                    if dcs_izq:
                        cadenas_viga.append((dcs_izq, m_v, dom_v, lo_v - off_viga, 'izquierda'))
                    if dcs_der:
                        cadenas_viga.append((dcs_der, m_v, dom_v, hi_v + off_viga, 'derecha'))

                # dos ejes de viga a menos de esto en el papel dan cotas encimadas e
                # ilegibles; se fusionan en una sola referencia y la cota pasa a medir el
                # salto completo. Es tambien lo que evita segmentos de milimetros, que son
                # los que hacen que Revit rechace la cadena entera al comitear.
                sep_min = max(TOL_EJE, sep_min_cota_mm / 304.8 * esc)
                for dcl, eje_med, eje_perp, perp, lado in cadenas_viga:
                    try:
                        total += dibujar_cadena(v, items_de_vigas(dcl, eje_med), eje_med, eje_perp,
                                                perp, tname, '{} vigas {}'.format(label, lado),
                                                sep_min)
                    except Exception as e:
                        log.append('ERROR {} cadena de vigas {} en {}: {}'.format(tname, lado, label, e))
        except Exception as e:
            log.append('ERROR {}: {}'.format(tname, e))
finally:
    try:
        TransactionManager.Instance.TransactionTaskDone()
        # Dynamo confirma su transaccion al final del run, cuando este script ya
        # termino y el manejador de fallas se des-suscribio. Forzamos el commit
        # AQUI para que el manejador intercepte las referencias invalidas.
        TransactionManager.Instance.ForceCloseTransaction()
    finally:
        app.FailuresProcessing -= _resolver_fallas

# verificar cuales cadenas sobrevivieron al commit
descartadas = []
for tname_c, etiqueta_c, did in creadas:
    try:
        if doc.GetElement(did) is None:
            descartadas.append('{} ({}, id {})'.format(tname_c, etiqueta_c, did.Value))
    except Exception:
        pass
if descartadas:
    log.append('AVISO: {} cota(s)/marca(s) eliminadas por referencias invalidas: {}'.format(
        len(descartadas), ', '.join(descartadas)))
    log.append('Causa habitual: el eje no es visible en esa vista (Revit no acota lo que no ve).')
    log.append('Revisa que la categoria Grids este encendida y que el eje entre en el crop de la vista.')
    log.append('Si la cadena es de vigas, sube "separacion minima entre cotas": los segmentos de')
    log.append('pocos milimetros tambien hacen que Revit rechace la cadena completa.')

# idem para los ejes de viga: si el handler de fallas se llevo alguno, hay que saberlo
perdidas = 0
for lid in ids_lineas:
    try:
        if doc.GetElement(lid) is None:
            perdidas += 1
    except Exception:
        pass
if perdidas:
    log.append('AVISO: {} linea(s) de eje de viga eliminadas al comitear.'.format(perdidas))

# lo que Revit dijo textualmente al comitear: es el unico dato que explica por que
# rechaza una cadena, y hasta ahora se estaba descartando sin leerlo
if fallas:
    log.append('--- mensajes de Revit al comitear ---')
    for clave in sorted(fallas.keys()):
        n, ejemplo = fallas[clave]
        log.append('{} (x{}){}'.format(
            clave, n,
            ' | elementos: ' + ', '.join(str(i) for i in ejemplo) if ejemplo else ''))

log.insert(0, 'PLANTAS - cadenas: {} | lineas de eje de viga: {} | burbujas: {} | rotulos en las NIPB: {}'.format(
    total, lineas_eje, burbujas, tags_nipb))
log.insert(1, 'ELEVACIONES - ejes recortados: {} | ejes ocultos: {} | cotas de altura: {} | marcas de nivel: {} | lineas de terreno: {}'.format(
    recortes_elev, ocultos_elev, cotas_elev, marcas_elev, terreno_elev))
log.insert(2, 'Vistas con Grids encendido: {} | assemblies procesados: {}'.format(
    encendidas, len(targets)))
OUT = log
# ----------------------------------------
log = Watch(py_ejes_visibles_eje_de_vigas)  # graph output
