# Dynamo graph 04_Cotas generales.dyn (Dynamo 4.0.2.3852)
# Cotas generales por assembly: ancho y largo total en la planta, altura total y spot elevations (sup/inf) en el corte. Usa caras extremas de los elementos del assembly como referencias.

procesar_todos_los_assemblies = BoolSelector(true)  # graph input
filtro_por_nombre_si_todos_false = StringInput("")  # graph input
separacion_de_cotas_mm_en_papel = IntegerSlider(10, range=5..30 step 1)  # graph input
py_cotas_generales_spot = Python(IN[0]=procesar_todos_los_assemblies, IN[1]=filtro_por_nombre_si_todos_false, IN[2]=separacion_de_cotas_mm_en_papel)  # "PY | Cotas generales + spot elevations"; PythonNet3
# ---------- py_cotas_generales_spot.python (196 lines) ----------
# 04_Cotas generales - Cotas generales por assembly
# planta: ancho y largo total | corte: altura total + spot elevations sup/inf
# Revit 2027 / Dynamo 4 / CPython3
# IN[0] = procesar todos los assemblies (bool)
# IN[1] = filtro por nombre si IN[0] es False (parcial, comas)
# IN[2] = separacion de la cota respecto al assembly, en mm de papel

import clr
clr.AddReference('RevitAPI')
clr.AddReference('RevitServices')
from Autodesk.Revit.DB import (FilteredElementCollector, AssemblyInstance, View,
                               Options, ViewDetailLevel, Solid, GeometryInstance,
                               PlanarFace, ReferenceArray, Line, XYZ, UV,
                               Dimension, Element)
from RevitServices.Persistence import DocumentManager
from RevitServices.Transactions import TransactionManager

doc = DocumentManager.Instance.CurrentDBDocument

process_all = bool(IN[0])
filter_text = (IN[1] or '').strip()
offset_mm = float(IN[2])

log = []
SUFIJO_CORTE = ' - CORTE A'
PARALELO = 0.99   # tolerancia: la normal de la cara debe ser paralela a la direccion medida
MIN_DIST = 0.01   # pies: separacion minima entre las dos referencias de una cota

def elem_name(e):
    try:
        return e.Name
    except Exception:
        return Element.Name.__get__(e)

# --- assemblies objetivo (unicos por tipo, igual que 02) ---
by_type = {}
for ai in FilteredElementCollector(doc).OfClass(AssemblyInstance):
    by_type.setdefault(ai.AssemblyTypeName, []).append(ai)

if process_all:
    targets = sorted(by_type.keys())
else:
    tokens = [t.strip().lower() for t in filter_text.split(',') if t.strip()]
    if tokens:
        targets = [n for n in sorted(by_type.keys())
                   if any(tok in n.lower() for tok in tokens)]
    else:
        targets = []
        log.append('ERROR: \"Todos\" esta en False y el filtro esta vacio.')

views = {}
for v in FilteredElementCollector(doc).OfClass(View):
    if not v.IsTemplate:
        views[elem_name(v)] = v

def add_solid_faces(out, s, trf):
    for f in s.Faces:
        if isinstance(f, PlanarFace) and f.Reference is not None:
            n = f.FaceNormal
            buv = f.GetBoundingBox()
            uv = UV((buv.Min.U + buv.Max.U) / 2.0, (buv.Min.V + buv.Max.V) / 2.0)
            p = f.Evaluate(uv)
            if trf is not None:
                n = trf.OfVector(n)
                p = trf.OfPoint(p)
            out.append((f.Reference, n, p))

def collect_faces(ai):
    # caras planas con referencia de todos los miembros del assembly
    # (para familias: geometria de simbolo, cuyas referencias si son acotables)
    out = []
    opt = Options()
    opt.ComputeReferences = True
    opt.DetailLevel = ViewDetailLevel.Fine
    for mid in ai.GetMemberIds():
        el = doc.GetElement(mid)
        geo = el.get_Geometry(opt)
        if geo is None:
            continue
        for g in geo:
            if isinstance(g, Solid) and g.Volume > 1e-9:
                add_solid_faces(out, g, None)
            elif isinstance(g, GeometryInstance):
                trf = g.Transform
                for sg in g.GetSymbolGeometry():
                    if isinstance(sg, Solid) and sg.Volume > 1e-9:
                        add_solid_faces(out, sg, trf)
    return out

def extremes(faces, d):
    # las dos caras mas extremas cuya normal es paralela a d
    cands = [(ref, p) for ref, n, p in faces if abs(n.DotProduct(d)) > PARALELO]
    if len(cands) < 2:
        return None
    lo = min(cands, key=lambda c: c[1].DotProduct(d))
    hi = max(cands, key=lambda c: c[1].DotProduct(d))
    if hi[1].DotProduct(d) - lo[1].DotProduct(d) < MIN_DIST:
        return None
    return lo, hi

def dim_line(d, perp, perp_value, p_lo, p_hi):
    # linea paralela a d, desplazada a perp_value sobre el eje perp
    c = p_lo.Add(p_hi).Multiply(0.5)
    base = c.Add(perp.Multiply(perp_value - c.DotProduct(perp)))
    q1 = base.Add(d.Multiply(p_lo.DotProduct(d) - base.DotProduct(d)))
    q2 = base.Add(d.Multiply(p_hi.DotProduct(d) - base.DotProduct(d)))
    return Line.CreateBound(q1, q2)

def has_dims(v):
    return FilteredElementCollector(doc, v.Id).OfClass(Dimension).GetElementCount() > 0

def proj_range(faces, d):
    vals = [p.DotProduct(d) for ref, n, p in faces]
    return (min(vals), max(vals))

def make_dim(view, faces, d, perp, perp_value, etiqueta, tname):
    ext = extremes(faces, d)
    if ext is None:
        log.append('AVISO {}: sin caras perpendiculares para la cota de {}.'.format(tname, etiqueta))
        return 0
    (lo_ref, p_lo), (hi_ref, p_hi) = ext
    ra = ReferenceArray()
    ra.Append(lo_ref)
    ra.Append(hi_ref)
    line = dim_line(d, perp, perp_value, p_lo, p_hi)
    doc.Create.NewDimension(view, line, ra)
    log.append('OK {}: cota de {} en \"{}\".'.format(tname, etiqueta, elem_name(view)))
    return 1

total = 0
TransactionManager.Instance.EnsureInTransaction(doc)
try:
    for tname in targets:
        ai = by_type[tname][0]
        try:
            faces = collect_faces(ai)
            if not faces:
                log.append('ERROR {}: los miembros no exponen geometria con referencias.'.format(tname))
                continue
            # ---------- PLANTA: ancho y largo total ----------
            vplan = views.get(tname)
            if vplan is None:
                log.append('AVISO {}: no existe la vista de planta (corre 02_Vistas de assembly).'.format(tname))
            elif has_dims(vplan):
                log.append('{}: la planta ya tiene cotas, se salta.'.format(tname))
            else:
                rd = vplan.RightDirection
                ud = vplan.UpDirection
                off = offset_mm / 304.8 * vplan.Scale
                u0, u1 = proj_range(faces, ud)
                r0, r1 = proj_range(faces, rd)
                try:
                    total += make_dim(vplan, faces, rd, ud, u0 - off, 'ancho', tname)
                except Exception as e:
                    log.append('ERROR {} cota ancho: {}'.format(tname, e))
                try:
                    total += make_dim(vplan, faces, ud, rd, r0 - off, 'largo', tname)
                except Exception as e:
                    log.append('ERROR {} cota largo: {}'.format(tname, e))
            # ---------- CORTE: altura total + spot elevations ----------
            vsec = views.get(tname + SUFIJO_CORTE)
            if vsec is None:
                log.append('AVISO {}: no existe la vista de corte (corre 02_Vistas de assembly).'.format(tname))
            elif has_dims(vsec):
                log.append('{}: el corte ya tiene cotas, se salta.'.format(tname))
            else:
                rd = vsec.RightDirection
                z = XYZ.BasisZ
                off = offset_mm / 304.8 * vsec.Scale
                r0, r1 = proj_range(faces, rd)
                try:
                    total += make_dim(vsec, faces, z, rd, r1 + off, 'altura', tname)
                except Exception as e:
                    log.append('ERROR {} cota altura: {}'.format(tname, e))
                ext = extremes(faces, z)
                if ext is None:
                    log.append('AVISO {}: sin caras horizontales para spot elevations.'.format(tname))
                else:
                    (lo_ref, p_lo), (hi_ref, p_hi) = ext
                    pares = ((hi_ref, p_hi, 1.0, 'superior'), (lo_ref, p_lo, -1.0, 'inferior'))
                    for ref, pt, dz, tag in pares:
                        try:
                            bend = pt.Add(rd.Multiply(off)).Add(XYZ(0, 0, dz * off))
                            end = bend.Add(rd.Multiply(off))
                            doc.Create.NewSpotElevation(vsec, ref, pt, bend, end, pt, True)
                            total += 1
                            log.append('OK {}: spot elevation {}.'.format(tname, tag))
                        except Exception as e:
                            log.append('ERROR {} spot elevation {}: {}'.format(tname, tag, e))
        except Exception as e:
            log.append('ERROR {}: {}'.format(tname, e))
finally:
    TransactionManager.Instance.TransactionTaskDone()

log.insert(0, 'Anotaciones creadas: {} | assemblies procesados: {}'.format(total, len(targets)))
OUT = log
# ----------------------------------------
log = Watch(py_cotas_generales_spot)  # graph output
