# Dynamo graph 04_Grating en plantas.dyn (Dynamo 4.0.2.3852)
# Por assembly: dibuja el grating de las plantas T.A. como Filled Regions, recortadas alrededor de las vigas para que la trama se lea por debajo del acero.

n01_procesar_todos_los_assemblies = BoolSelector(true)  # "01. Procesar TODOS los assemblies"; graph input
n02_filtro_por_nombre_si_todos = StringInput("")  # "02. Filtro por nombre (si TODOS = False)"; graph input
n03_familia_del_grating_parcial = StringInput("GRATING")  # "03. Familia del grating (parcial, comas)"; graph input
n04_tipo_de_filled_region = StringInput("HATCH GRATING")  # "04. Tipo de Filled Region"; graph input
n05_separacion_de_la_trama_a_las = IntegerSlider(35, range=0..200 step 1)  # "05. Separacion de la trama a las vigas (mm de modelo)"; graph input
n06_area_minima_de_un_retazo_cm2 = IntegerSlider(100, range=0..2000 step 1)  # "06. Area minima de un retazo (cm2)"; graph input
n07_rehacer_las_regiones = BoolSelector(true)  # "07. Rehacer las regiones existentes"; graph input
n00_subcarpeta_juego_de_vistas = StringInput("")  # "00. Subcarpeta / juego de vistas (vacio = sin subcarpeta)"; graph input
py_filled_regions_de_grating_en = Python(IN[0]=n01_procesar_todos_los_assemblies, IN[1]=n02_filtro_por_nombre_si_todos, IN[2]=n03_familia_del_grating_parcial, IN[3]=n04_tipo_de_filled_region, IN[4]=n05_separacion_de_la_trama_a_las, IN[5]=n06_area_minima_de_un_retazo_cm2, IN[6]=n07_rehacer_las_regiones, IN[7]=n00_subcarpeta_juego_de_vistas)  # "PY | Filled Regions de grating en las T.A."; PythonNet3
# ---------- py_filled_regions_de_grating_en.python (714 lines) ----------
# 04_Grating en plantas - ACERO
#
# Representa el grating de acero en las plantas T.A. con Filled Regions, imitando lo
# que los modeladores hacen a mano.
#
# EL PROBLEMA. El grating esta modelado (familia C-GRATING ARRIGONI ARS-5, categoria
# Structural Framing) pero no se ve en la planta. Y aunque se encendiera no serviria:
# el T.A. es TOPE DE ACERO, o sea que el grating se apoya ENCIMA de las vigas
# (medido: vigas hasta 3,300 m y grating de 3,300 a 3,332), asi que taparia la
# estructura, que es justo lo que hay que mostrar.
#
# LO QUE HACEN LOS MODELADORES. Dibujan una Filled Region con trama de rejilla y la
# recortan alrededor de cada elemento que la cruza, para que el grating se lea POR
# DEBAJO del acero. No es una oclusion real - el grating esta arriba -, es una
# convencion de dibujo. Ademas separan la trama 35 mm de cada viga para que no quede
# sucia contra el ala.
#
# COMO SE AUTOMATIZA. Es una resta booleana 2D, y Revit no las tiene. Se hace en 3D:
# se saca la sombra en planta de cada solido (ExtrusionAnalyzer), se engorda la de los
# obstaculos, se extruyen ambas a prismas, se restan (BooleanOperationsUtils) y se
# recuperan los contornos de la cara superior del resultado.
#
# OJO CON EL LARGO DE LAS PIEZAS. El solido de una viga viene recortado en las puntas
# para dejar lugar a la union, asi que es mas corto que su eje. Restar la sombra del
# solido dejaria el hueco de cada nudo sin restar y la trama se meteria ahi. Ver
# rect_por_eje().
#
# Revit 2027 / Dynamo 4 / CPython3
# IN[0] = procesar todos los assemblies (bool)
# IN[1] = filtro por nombre si IN[0] es False (parcial, comas)
# IN[2] = filtro de familia del grating (parcial, comas)
# IN[3] = nombre del tipo de Filled Region (el log lista los que hay en el proyecto)
# IN[4] = separacion de la trama a las vigas, en mm de MODELO
# IN[5] = area minima de un retazo de trama, en cm2 (por debajo se descarta)
# IN[6] = rehacer las regiones que ya existan (bool)

import clr
clr.AddReference('RevitAPI')
clr.AddReference('RevitServices')
from Autodesk.Revit.DB import (FilteredElementCollector, AssemblyInstance, View, ViewPlan,
                               XYZ, ElementId, BuiltInCategory, Options, ViewDetailLevel, Line,
                               Solid, GeometryInstance, FamilyInstance, Element,
                               FailureProcessingResult, FailureSeverity,
                               FilledRegion, FilledRegionType, CurveLoop, Plane,
                               PlanarFace, PlanViewPlane, Transform,
                               ExtrusionAnalyzer, GeometryCreationUtilities,
                               BooleanOperationsUtils, BooleanOperationsType)
from System.Collections.Generic import List
from RevitServices.Persistence import DocumentManager
from RevitServices.Transactions import TransactionManager

doc = DocumentManager.Instance.CurrentDBDocument

process_all = bool(IN[0])
filter_text = (IN[1] or '').strip()
fam_grating = [t.strip().lower() for t in (IN[2] or 'GRATING').split(',') if t.strip()]
tipo_pedido = (IN[3] or '').strip()
sep_mm = float(IN[4])
area_min_cm2 = float(IN[5])
rehacer = bool(IN[6])
juego_vistas = (IN[7] or '').strip()

# --- juego de vistas (2026-09-19) ---------------------------------------------------------
# 00 escribe el nombre de la subcarpeta al final del nombre de cada vista que crea:
# "ES-1001 - T.A. 01 (REV_B)". Asi correr 00 con otra subcarpeta genera un juego NUEVO en vez
# de caer sobre las vistas ya maquetadas y acotadas.
#
# Este input dice sobre CUAL de esos juegos trabajar. Vacio = el juego sin marca, el que crea
# 00 cuando la subcarpeta se deja en blanco. Sin el, este graph anotaba los dos juegos.
MARCA_JUEGO = ' ({})'.format(juego_vistas) if juego_vistas else ''


def juego_de(vname):
    # la marca que lleva ese nombre al final, o '' si no lleva ninguna
    if vname.endswith(')'):
        i = vname.rfind(' (')
        if i >= 0:
            return vname[i:]
    return ''


def es_de_este_juego(vname):
    # NO alcanza con endswith(MARCA_JUEGO): con la marca vacia, endswith('') da True para
    # TODO y se colarian las vistas de los demas juegos. Hay que comparar la marca completa.
    return juego_de(vname) == MARCA_JUEGO


log = []

SUF_TA = ' - T.A. '
PIE = 304.8                 # mm por pie
ALTO = 1.0                  # pies: altura arbitraria de los prismas de trabajo
Z0 = 0.0                    # cota del plano de trabajo de las huellas
sep = sep_mm / PIE
area_min = area_min_cm2 / (30.48 * 30.48)    # cm2 -> pies2

# los obstaculos son lo que se DIBUJA de la estructura. Las conexiones (sillas, placas,
# pernos) quedan fuera a proposito: no corresponden a una planta de T.A.
CATS_OBSTACULO = [BuiltInCategory.OST_StructuralFraming,
                  BuiltInCategory.OST_StructuralColumns]


def elem_name(e):
    try:
        return e.Name
    except Exception:
        return Element.Name.__get__(e)


def nombre_familia(el):
    try:
        return el.Symbol.FamilyName
    except Exception:
        return ''


def es_grating(el):
    n = (nombre_familia(el) + ' ' + elem_name(el)).lower()
    return any(t in n for t in fam_grating)


def solidos(el):
    # GetInstanceGeometry (y no GetSymbolGeometry) porque hace falta la geometria ya
    # colocada en el mundo: lo que se va a proyectar es la posicion real de la pieza.
    opt = Options()
    opt.DetailLevel = ViewDetailLevel.Fine
    res = []
    try:
        geo = el.get_Geometry(opt)
    except Exception:
        return res
    if geo is None:
        return res
    for g in geo:
        try:
            if isinstance(g, Solid):
                if g.Volume > 1e-9:
                    res.append(g)
            elif isinstance(g, GeometryInstance):
                for sg in g.GetInstanceGeometry():
                    if isinstance(sg, Solid) and sg.Volume > 1e-9:
                        res.append(sg)
        except Exception:
            pass
    return res


def huellas(solid):
    # sombra del solido sobre el plano XY: exactamente lo que la pieza ocupa en planta,
    # con el ancho real del ala y no su eje.
    try:
        plano = Plane.CreateByNormalAndOrigin(XYZ.BasisZ, XYZ(0.0, 0.0, Z0))
        ea = ExtrusionAnalyzer.Create(solid, plano, XYZ.BasisZ)
        return list(ea.GetExtrusionBase().GetEdgesAsCurveLoops())
    except Exception:
        return []


def puntos_loop(loop):
    pts = []
    for c in loop:
        try:
            t = list(c.Tessellate())
            pts.extend(t[:-1] if len(t) > 1 else t)
        except Exception:
            pass
    return pts


def area_loop(loop):
    # formula del zapatero sobre la poligonal; sirve para comparar tamanos y para
    # decidir hacia que lado engordo un contorno.
    pts = puntos_loop(loop)
    if len(pts) < 3:
        return 0.0
    a = 0.0
    for i in range(len(pts)):
        p = pts[i]
        q = pts[(i + 1) % len(pts)]
        a += p.X * q.Y - q.X * p.Y
    return abs(a) / 2.0


def huella_exterior(solid):
    # de todos los contornos de la sombra interesa solo el exterior: los huecos de un
    # perfil no cambian lo que tapa en el dibujo.
    mejor = None
    mejor_a = 0.0
    for lp in huellas(solid):
        a = area_loop(lp)
        if a > mejor_a:
            mejor_a = a
            mejor = lp
    return mejor, mejor_a


def rect2d(loop):
    pts = puntos_loop(loop)
    if not pts:
        return None
    return (min(p.X for p in pts), min(p.Y for p in pts),
            max(p.X for p in pts), max(p.Y for p in pts))


def solapan(a, b, tol=0.0):
    return not (a[2] + tol < b[0] or b[2] + tol < a[0] or
                a[3] + tol < b[1] or b[3] + tol < a[1])


def engordar(loop, d):
    # CreateViaOffset no dice hacia que lado desplaza: depende de la orientacion del
    # contorno, que no se controla. Se prueban los dos signos y gana el que AUMENTA
    # el area, que es el que separa la trama de la viga.
    if d <= 0:
        return loop
    base = area_loop(loop)
    for signo in (1.0, -1.0):
        try:
            cand = CurveLoop.CreateViaOffset(loop, signo * d, XYZ.BasisZ)
        except Exception:
            continue
        if area_loop(cand) > base:
            return cand
    return loop


def prisma(loops, alto):
    try:
        return GeometryCreationUtilities.CreateExtrusionGeometry(
            List[CurveLoop](loops), XYZ.BasisZ, alto)
    except Exception:
        return None


def rect_por_eje(el, loops):
    # UNA PIEZA DE ACERO TIENE DOS LARGOS, y los dos son correctos: su EJE va de nudo a
    # nudo, y su SOLIDO viene recortado en las puntas para dejar lugar a la union.
    # Medido en la diagonal 5482395 el 2026-08-03: System Length 1.185,6 mm contra Cut
    # Length 883,4 mm, con Start/End Extension de -178,5 y -216,5 mm.
    #
    # Si se restara la sombra del solido, ese hueco de 300 mm en cada nudo -justo donde
    # va la union- no se restaria y la trama del grating se meteria ahi. Asi que el
    # rectangulo se arma con el ANCHO de la sombra real y el LARGO del eje completo.
    try:
        loc = el.Location
        c = loc.Curve if (loc is not None and hasattr(loc, 'Curve')) else None
    except Exception:
        c = None
    if c is None or not isinstance(c, Line):
        return None
    p0 = c.GetEndPoint(0)
    p1 = c.GetEndPoint(1)
    d = XYZ(p1.X - p0.X, p1.Y - p0.Y, 0.0)
    if d.GetLength() < 1e-6:
        return None            # vertical en planta (columna): el eje no da un rectangulo
    d = d.Normalize()
    n = XYZ(-d.Y, d.X, 0.0)
    pts = []
    for lp in loops:
        pts.extend(puntos_loop(lp))
    if len(pts) < 3:
        return None
    ns = [p.X * n.X + p.Y * n.Y for p in pts]
    n0, n1 = min(ns), max(ns)
    # el largo lo mandan los extremos del eje, pero si el solido sobresale (mensulas,
    # placas de punta) se respeta lo que sea mas largo de los dos.
    ds = [p.X * d.X + p.Y * d.Y for p in pts]
    ejes = [p0.X * d.X + p0.Y * d.Y, p1.X * d.X + p1.Y * d.Y]
    d0 = min(min(ds), min(ejes))
    d1 = max(max(ds), max(ejes))
    if d1 - d0 < 1e-6 or n1 - n0 < 1e-6:
        return None
    esquinas = []
    for di, ni in ((d0, n0), (d1, n0), (d1, n1), (d0, n1)):
        p = d.Multiply(di).Add(n.Multiply(ni))
        esquinas.append(XYZ(p.X, p.Y, Z0))
    try:
        lp = CurveLoop()
        for i in range(4):
            lp.Append(Line.CreateBound(esquinas[i], esquinas[(i + 1) % 4]))
        return lp
    except Exception:
        return None


def rect_del_pano(el):
    # El grating NO es una plancha: la familia modela las 31 barras rectangulares y las
    # 25 circulares, asi que su sombra real es un peine y no sirve como contorno. Lo que
    # se dibuja es el pano completo, asi que se toma el rectangulo que envuelve todas
    # las barras EN EL SISTEMA LOCAL de la instancia - asi tambien vale para panos
    # girados, cosa que el bounding box del mundo no daria.
    pts = []
    for s in solidos(el):
        for lp in huellas(s):
            pts.extend(puntos_loop(lp))
    if len(pts) < 3:
        return None
    try:
        tr = el.GetTransform()
        inv = tr.Inverse
    except Exception:
        tr = None
        inv = None
    if inv is not None:
        loc = [inv.OfPoint(p) for p in pts]
    else:
        loc = pts
    x0 = min(p.X for p in loc)
    x1 = max(p.X for p in loc)
    y0 = min(p.Y for p in loc)
    y1 = max(p.Y for p in loc)
    esquinas = [XYZ(x0, y0, 0.0), XYZ(x1, y0, 0.0), XYZ(x1, y1, 0.0), XYZ(x0, y1, 0.0)]
    if tr is not None:
        esquinas = [tr.OfPoint(p) for p in esquinas]
    esquinas = [XYZ(p.X, p.Y, Z0) for p in esquinas]
    try:
        lp = CurveLoop()
        for i in range(4):
            lp.Append(Line.CreateBound(esquinas[i], esquinas[(i + 1) % 4]))
        return lp
    except Exception:
        return None


def ventana_z(v):
    # franja de altura que la vista muestra de verdad. Es el mismo criterio con el que
    # Revit decide que se ve, asi que el grating que cae aca dentro es exactamente el
    # que le toca a esta planta - y hace falta calcularlo a mano porque el grating NO
    # aparece en el colector por vista (su subcategoria esta apagada).
    try:
        vr = v.GetViewRange()

        def z(plano):
            lid = vr.GetLevelId(plano)
            base = 0.0
            if lid is not None and lid != ElementId.InvalidElementId:
                lv = doc.GetElement(lid)
                if lv is not None:
                    base = lv.ProjectElevation
            return base + vr.GetOffset(plano)

        return z(PlanViewPlane.ViewDepthPlane), z(PlanViewPlane.TopClipPlane)
    except Exception:
        return None


def miembros_recursivos(ai):
    res = []
    pila = [doc.GetElement(mid) for mid in ai.GetMemberIds()]
    vistos = set()
    while pila:
        el = pila.pop()
        if el is None:
            continue
        try:
            eid = el.Id.Value
        except Exception:
            eid = None
        if eid is not None:
            if eid in vistos:
                continue
            vistos.add(eid)
        res.append(el)
        if isinstance(el, FamilyInstance):
            try:
                for sid in el.GetSubComponentIds():
                    pila.append(doc.GetElement(sid))
            except Exception:
                pass
    return res


def tipo_de_region():
    tipos = list(FilteredElementCollector(doc).OfClass(FilledRegionType))
    if not tipos:
        log.append('ERROR: el proyecto no tiene ningun tipo de Filled Region cargado.')
        return None
    nombres = sorted(elem_name(t) for t in tipos)
    log.append('Tipos de Filled Region en el proyecto: ' + ', '.join(nombres))
    if tipo_pedido:
        for t in tipos:
            if elem_name(t).strip().lower() == tipo_pedido.strip().lower():
                return t
        log.append('AVISO: no existe el tipo de Filled Region "{}"; se usa "{}".'.format(
            tipo_pedido, elem_name(tipos[0])))
    return tipos[0]


def regiones_previas(v, tipo_id):
    prev = []
    for fr in FilteredElementCollector(doc, v.Id).OfClass(FilledRegion):
        try:
            if fr.GetTypeId() == tipo_id:
                prev.append(fr.Id)
        except Exception:
            pass
    return prev


def z_de_vista(v):
    zs = [v.Origin.Z]
    try:
        lv = v.GenLevel
        if lv is not None and abs(lv.ProjectElevation - zs[0]) > 1e-9:
            zs.append(lv.ProjectElevation)
    except Exception:
        pass
    return zs


# ------------------------------------------------------------------ main

by_type = {}
for ai in FilteredElementCollector(doc).OfClass(AssemblyInstance):
    by_type.setdefault(ai.AssemblyTypeName, []).append(ai)

if not by_type:
    log.append('AVISO: no hay ningun Assembly en el modelo; nada que hacer.')

if process_all:
    targets = sorted(by_type.keys())
else:
    tokens = [t.strip().lower() for t in filter_text.split(',') if t.strip()]
    if tokens:
        targets = [n for n in sorted(by_type.keys())
                   if any(tok in n.lower() for tok in tokens)]
    else:
        targets = []
        log.append('ERROR: "Todos" esta en False y el filtro esta vacio.')

views = {}
for v in FilteredElementCollector(doc).OfClass(View):
    # solo las del juego pedido: el indice se filtra aca UNA vez y con eso quedan acotadas
    # todas las busquedas de mas abajo, sin tener que tocar cada startswith por separado.
    if not v.IsTemplate and es_de_este_juego(elem_name(v)):
        views[elem_name(v)] = v

regiones = 0
panos = 0
consumidos = 0
fallos_bool = 0
creadas_fr = []   # (assembly, planta, id del pano, id de la region) para el post-commit


def _resolver_fallas(sender, args):
    try:
        fa = args.GetFailuresAccessor()
        resultado = FailureProcessingResult.Continue
        for f in fa.GetFailureMessages():
            try:
                try:
                    desc = f.GetDescriptionText()
                except Exception:
                    desc = '(sin descripcion)'
                es_aviso = f.GetSeverity() == FailureSeverity.Warning
                clave = '{}: {}'.format('AVISO' if es_aviso else 'ERROR', desc)
                fallas[clave] = fallas.get(clave, 0) + 1
                if es_aviso:
                    fa.DeleteWarning(f)
                    continue
                ids = list(f.GetFailingElementIds())
                if ids:
                    fa.DeleteElements(List[ElementId](ids))
                    resultado = FailureProcessingResult.ProceedWithCommit
                elif f.HasResolutions():
                    fa.ResolveFailure(f)
                    resultado = FailureProcessingResult.ProceedWithCommit
            except Exception:
                pass
        args.SetProcessingResult(resultado)
    except Exception:
        pass


fallas = {}
app = doc.Application
app.FailuresProcessing += _resolver_fallas
TransactionManager.Instance.EnsureInTransaction(doc)
try:
    tipo = tipo_de_region() if targets else None
    for tname in targets:
        if tipo is None:
            break
        ai = by_type[tname][0]
        try:
            miembros = miembros_recursivos(ai)
            ids_miembros = set()
            for el in miembros:
                try:
                    ids_miembros.add(el.Id.Value)
                except Exception:
                    pass
            gratings = [el for el in miembros if es_grating(el)]
            if not gratings:
                log.append('AVISO {}: ningun miembro coincide con el filtro de familia "{}".'.format(
                    tname, ', '.join(fam_grating)))
                continue

            plantas = [(views[n], n[len(tname) + 3:])
                       for n in sorted(k for k in views if k.startswith(tname + SUF_TA))]
            if not plantas:
                log.append('AVISO {}: no existen las plantas T.A. (corre 00_Vistas de assembly).'.format(tname))
                continue

            for v, label in plantas:
                prev = regiones_previas(v, tipo.Id)
                if prev:
                    if not rehacer:
                        log.append('{}: {} ya tiene {} region(es) de grating, se salta.'.format(
                            tname, label, len(prev)))
                        continue
                    try:
                        doc.Delete(List[ElementId](prev))
                    except Exception as e:
                        log.append('AVISO {}: no se pudieron borrar las regiones previas de {}: {}'.format(
                            tname, label, e))

                franja = ventana_z(v)
                if franja is None:
                    log.append('ERROR {}: no se pudo leer el View Range de {}; se omite.'.format(tname, label))
                    continue
                z_lo, z_hi = franja

                # que panos de grating le tocan a esta planta
                mios = []
                for g in gratings:
                    try:
                        bb = g.get_BoundingBox(None)
                        if bb is None:
                            continue
                        if bb.Max.Z < z_lo or bb.Min.Z > z_hi:
                            continue
                        mios.append(g)
                    except Exception:
                        pass
                if not mios:
                    log.append('{}: {} no tiene grating en su franja de altura.'.format(tname, label))
                    continue

                # obstaculos: lo que la vista DIBUJA de la estructura del assembly
                obstaculos = []
                por_eje = 0
                for cat in CATS_OBSTACULO:
                    try:
                        col = (FilteredElementCollector(doc, v.Id).OfCategory(cat)
                               .WhereElementIsNotElementType())
                    except Exception:
                        continue
                    for el in col:
                        try:
                            if el.Id.Value not in ids_miembros or es_grating(el):
                                continue
                        except Exception:
                            continue
                        # sombra de todos los solidos de la pieza, junta
                        sombras = []
                        for s in solidos(el):
                            lp, a = huella_exterior(s)
                            if lp is not None and a > 1e-6:
                                sombras.append(lp)
                        if not sombras:
                            continue
                        # si la pieza tiene eje recto se resta el rectangulo del EJE
                        # COMPLETO; si no (columnas, piezas curvas), la sombra tal cual.
                        porEje = rect_por_eje(el, sombras)
                        candidatos = [porEje] if porEje is not None else sombras
                        if porEje is not None:
                            por_eje += 1
                        for lp in candidatos:
                            lp = engordar(lp, sep)
                            pr = prisma([lp], ALTO)
                            r = rect2d(lp)
                            if pr is not None and r is not None:
                                obstaculos.append((r, pr))

                log.append('DIAG {} / {}: {} pano(s) de grating, {} obstaculo(s) a restar ({} reconstruidos desde el eje).'.format(
                    tname, label, len(mios), len(obstaculos), por_eje))

                zs = z_de_vista(v)
                hechas_vista = 0
                for g in mios:
                    panos += 1
                    base = rect_del_pano(g)
                    if base is None:
                        log.append('AVISO {}: sin geometria util en un pano de grating de {}.'.format(tname, label))
                        continue
                    rg = rect2d(base)
                    medidas = '{:.2f} x {:.2f} m'.format(
                        (rg[2] - rg[0]) * 0.3048, (rg[3] - rg[1]) * 0.3048) if rg else '?'
                    try:
                        gid = g.Id.Value
                    except Exception:
                        gid = '?'
                    sol = prisma([base], ALTO)
                    if sol is None:
                        log.append('AVISO {}: no se pudo extruir el pano id {} ({}) en {}.'.format(
                            tname, gid, medidas, label))
                        consumidos += 1
                        continue
                    hechas_pano = 0
                    for r, pr in obstaculos:
                        if not solapan(r, rg):
                            continue
                        try:
                            nuevo = BooleanOperationsUtils.ExecuteBooleanOperation(
                                sol, pr, BooleanOperationsType.Difference)
                            if nuevo is not None:
                                sol = nuevo
                        except Exception:
                            fallos_bool += 1
                            if fallos_bool <= 5:
                                log.append('AVISO {}: una resta fallo en el pano id {} de {} (caras coincidentes); ese obstaculo no se recorto.'.format(
                                    tname, gid, label))
                    if sol is None or sol.Volume < area_min * ALTO:
                        # los obstaculos engordados se comieron el pano entero. Pasa en
                        # las tiras angostas: 300 mm de ancho contra 35 mm de separacion
                        # MAS medio ancho de ala a cada lado no dejan nada en pie.
                        log.append('AVISO {}: el pano id {} ({}) quedo consumido por los obstaculos en {}; bajá la separacion o el area minima.'.format(
                            tname, gid, medidas, label))
                        consumidos += 1
                        continue

                    # los retazos que sobreviven son las caras de arriba del resultado
                    for f in sol.Faces:
                        try:
                            if not isinstance(f, PlanarFace):
                                continue
                            if f.FaceNormal.DotProduct(XYZ.BasisZ) < 0.99:
                                continue
                            loops = list(f.GetEdgesAsCurveLoops())
                            if not loops:
                                continue
                            loops.sort(key=area_loop, reverse=True)   # el mayor es el exterior
                            if area_loop(loops[0]) < area_min:
                                continue
                            # Los huecos minusculos son esquirlas de la resta booleana, y a
                            # Revit le alcanza uno para rechazar la region ENTERA con
                            # "Can't draw Detail Filled Region". Se filtran por area, y si
                            # aun asi la rechaza se reintenta con el contorno exterior solo.
                            utiles = [loops[0]] + [lp for lp in loops[1:] if area_loop(lp) >= area_min]
                            intentos = [utiles]
                            if len(utiles) > 1:
                                intentos.append([loops[0]])
                            creada = False
                            ultimo = None
                            for i_int, cand in enumerate(intentos):
                                for z in zs:
                                    tr = Transform.CreateTranslation(XYZ(0.0, 0.0, z - f.Origin.Z))
                                    lv = [CurveLoop.CreateViaTransform(lp, tr) for lp in cand]
                                    try:
                                        fr = FilledRegion.Create(doc, tipo.Id, v.Id, List[CurveLoop](lv))
                                        creadas_fr.append((tname, label, gid, fr.Id))
                                        creada = True
                                        if i_int > 0:
                                            log.append('AVISO {}: la region del pano id {} en {} se dibujo sin sus huecos; Revit rechazaba el contorno completo.'.format(
                                                tname, gid, label))
                                        break
                                    except Exception as e:
                                        ultimo = e
                                if creada:
                                    break
                            if creada:
                                regiones += 1
                                hechas_vista += 1
                                hechas_pano += 1
                            else:
                                log.append('ERROR {}: no se pudo crear una region del pano id {} en {}: {}'.format(
                                    tname, gid, label, ultimo))
                        except Exception:
                            pass
                    if hechas_pano == 0:
                        # ningun pano puede desaparecer en silencio: si no dejo region,
                        # tiene que quedar dicho cual y de que tamano era.
                        log.append('AVISO {}: el pano id {} ({}) no dejo ninguna region en {}.'.format(
                            tname, gid, medidas, label))
                        consumidos += 1
                log.append('OK {}: {} region(es) de trama en {}.'.format(tname, hechas_vista, label))
        except Exception as e:
            log.append('ERROR {}: {}'.format(tname, e))
finally:
    try:
        TransactionManager.Instance.TransactionTaskDone()
        TransactionManager.Instance.ForceCloseTransaction()
    finally:
        app.FailuresProcessing -= _resolver_fallas

# Que regiones sobrevivieron al commit. Sin esto un paño puede figurar como creado en el
# resumen y no estar en el dibujo: Revit valida el contorno recien al confirmar, y el
# manejador de fallas borra lo que rechaza.
muertas = []
for tname_c, label_c, gid_c, fid in creadas_fr:
    try:
        if doc.GetElement(fid) is None:
            muertas.append('{} / {} (pano id {})'.format(tname_c, label_c, gid_c))
    except Exception:
        pass
if muertas:
    regiones -= len(muertas)
    consumidos += len(muertas)
    log.append('AVISO: Revit rechazo {} region(es) al comitear: {}'.format(
        len(muertas), ', '.join(muertas)))
    log.append('Causa habitual: el contorno que dejo la resta booleana tiene esquirlas o')
    log.append('huecos degenerados. Subi el area minima para que se filtren antes.')

if fallos_bool:
    log.append('AVISO: {} resta(s) booleana(s) fallaron y se ignoraron (caras coincidentes).'.format(fallos_bool))
if fallas:
    log.append('--- mensajes de Revit al comitear ---')
    for clave in sorted(fallas.keys()):
        log.append('{} (x{})'.format(clave, fallas[clave]))

log.insert(0, 'Regiones de trama creadas: {} | panos procesados: {} | panos SIN region: {} | assemblies: {}'.format(
    regiones, panos, consumidos, len(targets)))
OUT = log
# ----------------------------------------
log = Watch(py_filled_regions_de_grating_en)  # graph output
