# Dynamo graph 05_Rotulos de perfil.dyn (Dynamo 4.0.2.3852)
# Por assembly: pone un Multi-Category Tag sobre cada perfil, eligiendo entre un tipo corto y uno largo segun lo que entre en la pieza. En las plantas T.A. un tag por viga, girado con la viga; en las elevaciones de eje, un tag por pieza que este sobre el eje.

n01_procesar_todos_los_assemblies = BoolSelector(true)  # "01. Procesar TODOS los assemblies"; graph input
n02_filtro_por_nombre_si_todos = StringInput("")  # "02. Filtro por nombre (si TODOS = False)"; graph input
n03_tipo_de_c_multicat_del_rotulo = StringInput("ETIQUETA TIPO")  # "03. Tipo de C-MultiCat del rotulo CORTO"; graph input
n04_tipo_de_c_multicat_del_rotulo = StringInput("ETIQUETA TIPO")  # "04. Tipo de C-MultiCat del rotulo LARGO"; graph input
n05_margen_libre_a_cada_lado_del = IntegerSlider(2, range=0..20 step 1)  # "05. Margen libre a cada lado del rotulo (mm de papel)"; graph input
n06_familias_a_no_rotular_parcial = StringInput("GRATING")  # "06. Familias a NO rotular (parcial, comas)"; graph input
n07_rehacer_los_rotulos = BoolSelector(false)  # "07. Rehacer los rotulos existentes"; graph input
n08_rotular_tambien_las = BoolSelector(true)  # "08. Rotular tambien las elevaciones de eje"; graph input
n09_elevaciones_solo_lo_que_este = IntegerSlider(30, range=0..100 step 1)  # "09. Elevaciones: solo lo que este a menos de (cm) del eje"; graph input
n10_elevaciones_separacion_del = IntegerSlider(2, range=0..100 step 1)  # "10. Elevaciones: separacion del tag a la pieza (mm de papel)"; graph input
n00_subcarpeta_juego_de_vistas = StringInput("")  # "00. Subcarpeta / juego de vistas (vacio = sin subcarpeta)"; graph input
n11_en_plantas_rotular_tambien = BoolSelector(false)  # "11. En plantas, rotular tambien columnas y familias"; graph input
n12_rotular_las_plantas_apagalo = BoolSelector(true)  # "12. Rotular las plantas (apagalo para hacer solo cortes)"; graph input
py_rotulo_de_perfil_sobre_cada = Python(IN[0]=n01_procesar_todos_los_assemblies, IN[1]=n02_filtro_por_nombre_si_todos, IN[2]=n03_tipo_de_c_multicat_del_rotulo, IN[3]=n04_tipo_de_c_multicat_del_rotulo, IN[4]=n05_margen_libre_a_cada_lado_del, IN[5]=n06_familias_a_no_rotular_parcial, IN[6]=n07_rehacer_los_rotulos, IN[7]=n08_rotular_tambien_las, IN[8]=n09_elevaciones_solo_lo_que_este, IN[9]=n10_elevaciones_separacion_del, IN[10]=n00_subcarpeta_juego_de_vistas, IN[11]=n11_en_plantas_rotular_tambien, IN[12]=n12_rotular_las_plantas_apagalo)  # "PY | Rotulo de perfil sobre cada viga"; PythonNet3
# ---------- py_rotulo_de_perfil_sobre_cada.python (1100 lines) ----------
# 05_Rotulos de perfil - ACERO
#
# Pone un Multi-Category Tag sobre cada perfil, en dos sitios distintos:
#   - PLANTAS T.A.: un tag por viga, girado con la viga y centrado en su eje.
#   - ELEVACIONES de eje: un tag por pieza que este sobre el eje de la vista, horizontal
#     por encima de las vigas y girado 90 grados a la izquierda de las columnas.
# En LOS DOS casos se elige entre un tipo corto y uno largo segun lo que entre en la
# pieza: es el mismo par de tipos para todo el graph.
#
# QUE MUESTRA CADA TAG NO LO DECIDE ESTE SCRIPT (2026-09-19). Un IndependentTag saca su
# texto de la ETIQUETA de su familia, no de nada que se le escriba: aca solo se elige
# QUE TIPO colocar. En C-MultiCat el nombre del tipo dice que parametro lee -Modelo lee
# Model, ELEMENTO_TBL lee ELEMENTO_TBL-, asi que cambiar de parametro es cambiar de tipo.
#
# LOS DOS INPUTS APUNTAN A 'ETIQUETA TIPO' (2026-09-19), que muestra el nombre del TIPO
# de familia -IN50x84,6, PL e=8mm-. Es el unico dato que TODAS las piezas tienen sin que
# nadie lo cargue a mano, y es el mismo que usa la columna DESCRIPCION de la tabla de 06,
# asi que el rotulo del plano y la lista de materiales dicen lo mismo.
#
# POR QUE NO DESCRIPCION_ITEM, que es la regla de la oficina: probado el 2026-09-19 sobre
# una viga que SI lo tenia cargado -IN50x84,6 con 'descripcion item'-, el tag seguia
# mostrando '?'. O sea que ninguno de los tipos de C-MultiCat cargados lee ese parametro.
# Que muestra cada tag se define en la ETIQUETA de la familia, no aca, asi que hasta que
# exista un tipo que apunte a DESCRIPCION_ITEM no hay forma de rotular desde ahi.
#
# CON UN SOLO TIPO NO HAY ELECCION corto/largo: el graph mide los dos -que ahora son el
# mismo-, no encuentra uno mas angosto y pone siempre ese. No se rompe nada; el contador
# de 'cortos' del log deja de significar algo. Cuando haya un segundo tipo con la misma
# fuente y formato mas corto, se pone en el input 03 y la eleccion vuelve sola.
#
# Si un tipo no existe, tipo_de_tag lo dice como ERROR y lista los disponibles.
#
# Un tag cuyo parametro esta VACIO muestra '?'. No es un fallo del graph: es dato que
# falta en el modelo.
#
# POR QUE DOS TIPOS DE TAG Y NO TEXTO CORTADO. Hasta hace poco la planta se rotulaba con
# TextNote: un IndependentTag muestra lo que dice su etiqueta y la API no deja
# sobrescribir ese texto por instancia, asi que con tags no se podia truncar, y en planta
# truncar es obligatorio porque el nombre no entra en el largo de la viga. La familia
# C-MultiCat resuelve eso desde el otro lado: trae un tipo corto y uno largo (los
# parametros TagCorto / TagLargo del propio tipo), asi que "acortar" ya no es cortar un
# string sino elegir el otro tipo de tag. Con eso los rotulos de planta pasan a ser tags
# de verdad -- asociativos, se actualizan solos si alguien le cambia el perfil a la
# pieza -- que es lo que se pidio.
#
# POR QUE LA ELEVACION TAMBIEN ELIGE. Se penso que en la elevacion el nombre entraba
# siempre y no habia nada que decidir, pero el tag se dibuja a lo ancho de la pieza igual
# que en planta -- horizontal sobre la viga, girado sobre la columna -- asi que una viga
# corta o una columna baja desbordan lo mismo. Es el mismo criterio, medido contra la
# dimension que la pieza ocupa EN LA DIRECCION EN QUE SE LEE EL TAG: el largo proyectado
# sobre el "derecha" de la vista para las vigas, sobre el "arriba" para las columnas.
#
# COMO SE DECIDE SI CABE. No se estima el ancho de la fuente ni se cuentan caracteres:
# se MIDE el tag. Por cada tipo de pieza se crea un tag de prueba horizontal fuera del
# crop, se regenera UNA sola vez por vista (el regenerate es lo caro, no el tag) y se lee
# su bounding box. Con eso el "cabe o no cabe" queda en un if contra el largo de la pieza.
#
# ROTULOS VIEJOS. Los TextNote que escribia la version anterior se barren al pasar, pero
# solo aquellos cuyo texto coincide con un nombre de perfil de esa misma vista (entero o
# cortado en la "x", que es como acortaba antes): un TextNote con cualquier otro texto es
# una nota que puso alguien a mano y no se toca.
#
# Revit 2027 / Dynamo 4 / CPython3
# IN[0] = procesar todos los assemblies (bool)
# IN[1] = filtro por nombre si IN[0] es False (parcial, comas)
# IN[2] = tipo de C-MultiCat del rotulo CORTO
# IN[3] = tipo de C-MultiCat del rotulo LARGO
# IN[4] = margen libre a cada lado del rotulo, en mm de papel
# IN[5] = familias a NO rotular (parcial, comas)
# IN[6] = rehacer los rotulos que ya existan (bool)
# IN[7] = rotular tambien las elevaciones de eje (bool)
# IN[8] = en elevacion solo se rotula lo que este a menos de esto del eje, en cm
# IN[9] = separacion del tag a la pieza en la elevacion, en mm de papel

import math
import clr
clr.AddReference('RevitAPI')
clr.AddReference('RevitServices')
from Autodesk.Revit.DB import (FilteredElementCollector, AssemblyInstance, View, XYZ,
                               ElementId, BuiltInCategory, Element,
                               FamilyInstance, FamilySymbol, Line, Reference, Grid,
                               ElementTransformUtils,
                               IndependentTag, TagOrientation, TextNote,
                               FailureProcessingResult, FailureSeverity)
from System.Collections.Generic import List
from RevitServices.Persistence import DocumentManager
from RevitServices.Transactions import TransactionManager

doc = DocumentManager.Instance.CurrentDBDocument

process_all = bool(IN[0])
filter_text = (IN[1] or '').strip()
corto_pedido = (IN[2] or '').strip()
largo_pedido = (IN[3] or '').strip()
margen_mm = float(IN[4])
excluidas = [t.strip().lower() for t in (IN[5] or '').split(',') if t.strip()]
rehacer = bool(IN[6])
hacer_elevaciones = bool(IN[7])
tol_eje_cm = float(IN[8])
sep_tag_mm = float(IN[9])
juego_vistas = (IN[10] or '').strip()
planta_completa = bool(IN[11])
hacer_plantas = bool(IN[12])

# --- juego de vistas (2026-09-19) ---------------------------------------------------------
# 00 escribe el nombre de la subcarpeta al final del nombre de cada vista que crea:
# "ES-1001 - T.A. 01 (REV_B)". Asi correr 00 con otra subcarpeta genera un juego NUEVO en vez
# de caer sobre las vistas ya maquetadas y acotadas.
#
# Este input dice sobre CUAL de esos juegos trabajar. Vacio = el juego sin marca, el que crea
# 00 cuando la subcarpeta se deja en blanco. Sin el, este graph anotaba los dos juegos.
MARCA_JUEGO = ' ({})'.format(juego_vistas) if juego_vistas else ''


def juego_de(vname):
    # la marca que lleva ese nombre al final, o '' si no lleva ninguna
    if vname.endswith(')'):
        i = vname.rfind(' (')
        if i >= 0:
            return vname[i:]
    return ''


def es_de_este_juego(vname):
    # NO alcanza con endswith(MARCA_JUEGO): con la marca vacia, endswith('') da True para
    # TODO y se colarian las vistas de los demas juegos. Hay que comparar la marca completa.
    return juego_de(vname) == MARCA_JUEGO


def sin_marca(nombre):
    # Quita la marca del juego del final. Hace falta porque el nombre del EJE se saca
    # cortando el nombre de la VISTA, y la vista lleva la marca pero el eje del modelo no:
    # "ES-1001 - EJE 1' (test)" -> el eje se llama "1'", no "1' (test)".
    #
    # Sin esto, punto_del_eje no encontraba ningun eje y NINGUNA elevacion se rotulaba,
    # con un 'no existe el eje "1' (test)"' por cada una en el log.
    if MARCA_JUEGO and nombre.endswith(MARCA_JUEGO):
        return nombre[:-len(MARCA_JUEGO)]
    return nombre


log = []

SUF_NIPB = ' - NIPB'
SUF_PT = ' - P.T. '
SUF_TA = ' - T.A. '
SUF_EJE = ' - EJE '
PIE = 304.8
TOL_PLANTA = 0.0033      # pies (~1 mm): por debajo la viga es un punto en planta

# Que categorias reciben rotulo. Barandas y escaleras entran desde el 2026-08-11: antes
# solo estaban vigas y columnas, asi que una baranda no recibia tag ni aunque cayera
# justo sobre el eje. En este modelo la escalera es Structural Framing (ESCALERA
# METALICA), pero OST_Stairs va igual por si algun proyecto la modela como escalera de
# sistema. Los nombres se resuelven con getattr porque no todas esas categorias existen
# en todas las versiones de Revit.
CATS_ROTULABLES = [BuiltInCategory.OST_StructuralFraming,
                   BuiltInCategory.OST_StructuralColumns]
for _n in ('OST_StairsRailing', 'OST_Railings', 'OST_RailingSystem', 'OST_Stairs'):
    try:
        CATS_ROTULABLES.append(getattr(BuiltInCategory, _n))
    except Exception:
        pass
CATS_ROTULABLES = tuple(CATS_ROTULABLES)

# En PLANTA se rotulaba SOLO Structural Framing. No era un descuido: una plataforma es una
# parrilla de vigas bajo el grating, y ahi esa restriccion da el resultado exacto que se
# busca -las columnas se ven como un cuadradito y rotularlas seria ruido-. Una planta de
# estructura completa, en cambio, necesita columnas, conexiones y familias sueltas.
#
# Por eso la diferencia va por input (11) y no por cambio de default: con el apagado, el
# rotulado de plataformas sale identico a como salia antes de esto.
CATS_PLANTA_EXTRA = [BuiltInCategory.OST_GenericModel]
for _n in ('OST_StructConnections', 'OST_SpecialityEquipment', 'OST_MechanicalEquipment'):
    try:
        CATS_PLANTA_EXTRA.append(getattr(BuiltInCategory, _n))
    except Exception:
        pass
CATS_PLANTA_EXTRA = tuple(CATS_PLANTA_EXTRA)


def huella_en_planta(el):
    # (centro, mayor lado en planta) de una pieza que NO tiene eje en planta. Una columna
    # vista desde arriba es un punto: eje_en_planta() devuelve None y hasta ahora eso
    # significaba saltarla sin rotular. El lado del bounding box hace de "largo
    # disponible" para decidir entre rotulo corto y largo.
    p = None
    try:
        loc = el.Location
        if loc is not None and hasattr(loc, 'Point') and loc.Point is not None:
            p = XYZ(loc.Point.X, loc.Point.Y, 0.0)
    except Exception:
        p = None
    lado = 0.0
    try:
        bb = el.get_BoundingBox(None)
        if bb is not None:
            if p is None:
                p = XYZ((bb.Min.X + bb.Max.X) / 2.0, (bb.Min.Y + bb.Max.Y) / 2.0, 0.0)
            lado = max(bb.Max.X - bb.Min.X, bb.Max.Y - bb.Min.Y)
    except Exception:
        pass
    return p, lado

ID_CAT_TAGS = ElementId(BuiltInCategory.OST_MultiCategoryTags)


def encender_tags(v, tname, label):
    # ⚠ Un tag creado en una vista que tiene su categoria APAGADA existe en el modelo
    # pero no se dibuja, y FilteredElementCollector(doc, view.Id) tampoco lo devuelve.
    # Eso rompe dos cosas a la vez: desde el script parece que nunca se creo, y como
    # tags_previos() tampoco lo ve, la idempotencia deja de funcionar y cada corrida
    # apila tags invisibles encima de los anteriores.
    #
    # Medido el 2026-08-04: los 110 tags de las elevaciones estaban en el documento y no
    # se veia ninguno, porque el view template ESTRUCTURAS trae Multi-Category Tags
    # apagada. Es la misma trampa que 03 ya tiene resuelta para Dimensions, Spot
    # Elevations y Lines. Por eso esto va ANTES de tags_previos() y de medir: si no, se
    # borraria sobre una lista vacia y se mediria contra un bounding box que no existe.
    try:
        if not v.GetCategoryHidden(ID_CAT_TAGS):
            return
        v.SetCategoryHidden(ID_CAT_TAGS, False)
        log.append('{}: {} - se encendio la categoria Multi-Category Tags (estaba apagada).'.format(
            tname, label))
    except Exception as e:
        log.append('AVISO {}: la categoria Multi-Category Tags esta apagada en {} y no se pudo '
                   'encender ({}). Los tags se crean pero NO se ven: hay que encenderla en el '
                   'view template.'.format(tname, label, e))


def elem_name(e):
    try:
        return e.Name
    except Exception:
        return Element.Name.__get__(e)


def nombre_tipo(el):
    # el Type Name del perfil. Ya no se escribe en ningun lado: sirve para reconocer
    # los TextNote que dejo la version anterior del script y barrerlos.
    try:
        s = el.Symbol
        if s is not None:
            return elem_name(s)
    except Exception:
        pass
    try:
        t = doc.GetElement(el.GetTypeId())
        if t is not None:
            return elem_name(t)
    except Exception:
        pass
    return ''


def acortar(nombre):
    # como acortaba la version anterior: se tiraba todo lo que va desde la "x" en
    # adelante, que es el peso en kg/m y no el perfil. Insensible a mayusculas porque el
    # modelo tiene L8x7,07 y L8X7,07 conviviendo.
    i = nombre.lower().find('x')
    if i <= 0:
        return nombre
    return nombre[:i].strip()


def nombre_familia(el):
    try:
        return el.Symbol.FamilyName
    except Exception:
        return ''


def excluida(el):
    if not excluidas:
        return False
    n = (nombre_familia(el) + ' ' + nombre_tipo(el)).lower()
    return any(t in n for t in excluidas)


def tipo_de_tag(nombre, para):
    # FamilySymbol de Multi-Category Tag con ese nombre de tipo. Se activa si hacia
    # falta: un simbolo no activado no se puede colocar.
    disponibles = []
    elegido = None
    for fs in (FilteredElementCollector(doc).OfClass(FamilySymbol)
               .OfCategory(BuiltInCategory.OST_MultiCategoryTags)):
        n = elem_name(fs)
        try:
            disponibles.append('{} : {}'.format(fs.FamilyName, n))
        except Exception:
            disponibles.append(n)
        if n.strip().lower() == nombre.strip().lower():
            elegido = fs
    if elegido is None:
        log.append('ERROR: no existe el tag Multi-Category "{}" (era para {}). Disponibles: {}.'.format(
            nombre, para, ', '.join(sorted(set(disponibles))) or '(ninguno)'))
        return None
    try:
        if not elegido.IsActive:
            elegido.Activate()
            doc.Regenerate()
    except Exception as e:
        log.append('AVISO: no se pudo activar el tag "{}": {}'.format(nombre, e))
    return elegido


def eje_en_planta(el):
    try:
        loc = el.Location
        c = loc.Curve if (loc is not None and hasattr(loc, 'Curve')) else None
    except Exception:
        c = None
    if c is None or not isinstance(c, Line):
        return None
    p0 = c.GetEndPoint(0)
    p1 = c.GetEndPoint(1)
    a = XYZ(p0.X, p0.Y, 0.0)
    b = XYZ(p1.X, p1.Y, 0.0)
    if a.DistanceTo(b) < TOL_PLANTA:
        return None
    return a, b


def z_de_vista(v):
    zs = [v.Origin.Z]
    try:
        lv = v.GenLevel
        if lv is not None and abs(lv.ProjectElevation - zs[0]) > 1e-9:
            zs.append(lv.ProjectElevation)
    except Exception:
        pass
    return zs


def tags_previos(v, tipo_ids):
    ids = set(t.Value for t in tipo_ids)
    prev = []
    for t in FilteredElementCollector(doc, v.Id).OfClass(IndependentTag):
        try:
            if t.GetTypeId().Value in ids:
                prev.append(t.Id)
        except Exception:
            pass
    return prev


# ------------------------------------------------- medicion del ancho del tag

_anchos = {}
# alto del rotulo en la vista. Con el ancho arma la huella 2D que hace falta para
# saber si dos tags se pisan: antes solo se medía el ancho, que alcanzaba para
# elegir entre rotulo corto y largo pero no para detectar choques.
_altos = {}


def _clave(el, tag_type, v):
    try:
        tid = el.GetTypeId().Value
    except Exception:
        tid = -1
    return (tag_type.Id.Value, tid, v.Scale)


def medir_tags(v, piezas, tag_type, lejos):
    # largo de lectura del tag EN UNIDADES DE MODELO para la escala de esta vista. Se
    # mide creando un tag de prueba sin girar y lejos del crop, y se borra enseguida. Los
    # de prueba se crean TODOS de una y se regenera una sola vez, porque lo caro es el
    # regenerate y no el tag. Se cachea por (tipo de tag, tipo de pieza, escala): los
    # perfiles se repiten decenas de veces.
    #
    # El bounding box viene en coordenadas de MODELO, asi que no sirve leer Max.X - Min.X:
    # eso solo daria el ancho del tag si el "derecha" de la vista fuera el eje X del
    # modelo. En las plantas suele serlo, pero las elevaciones de eje miran segun el eje
    # del edificio. Se proyecta la diagonal del bbox sobre RightDirection, que para un tag
    # plano y sin girar da el ancho exacto sea cual sea la orientacion de la vista.
    rd = v.RightDirection
    ud = v.UpDirection
    pruebas = []
    nuevos = set()
    for el in piezas:
        k = _clave(el, tag_type, v)
        if k in _anchos or k in nuevos:
            continue
        nuevos.add(k)
        try:
            t = IndependentTag.Create(doc, tag_type.Id, v.Id, Reference(el), False,
                                      TagOrientation.Horizontal, lejos)
            pruebas.append((k, t))
        except Exception:
            _anchos[k] = None
    if not pruebas:
        return
    doc.Regenerate()
    for k, t in pruebas:
        ancho = None
        alto = None
        try:
            bb = t.get_BoundingBox(v)
            if bb is not None:
                d = bb.Max - bb.Min
                ancho = abs(d.X * rd.X) + abs(d.Y * rd.Y) + abs(d.Z * rd.Z)
                # la misma proyeccion pero sobre el "arriba" de la vista
                alto = abs(d.X * ud.X) + abs(d.Y * ud.Y) + abs(d.Z * ud.Z)
        except Exception:
            ancho = None
            alto = None
        _anchos[k] = ancho if (ancho is not None and ancho > 0) else None
        _altos[k] = alto if (alto is not None and alto > 0) else None
    try:
        doc.Delete(List[ElementId]([t.Id for k, t in pruebas]))
    except Exception as e:
        log.append('AVISO: no se pudieron borrar los tags de prueba: {}'.format(e))


# ------------------------------------------------------------ tags en las plantas

def rotulos_texto_viejos(v, nombres):
    # la version anterior rotulaba la planta con TextNote. Se barren al pasar, pero solo
    # los que dicen exactamente un nombre de perfil de esta vista (entero o cortado en la
    # "x"): cualquier otro TextNote es una nota que puso alguien a mano.
    viejos = []
    for tn in FilteredElementCollector(doc, v.Id).OfClass(TextNote):
        try:
            if tn.Text.strip() in nombres:
                viejos.append(tn.Id)
        except Exception:
            pass
    return viejos


def rotular_planta(v, label, ids_miembros, tag_corto, tag_largo, tname):
    # antes que nada, que la vista pueda MOSTRAR lo que se le va a dibujar
    encender_tags(v, tname, label)
    prev = tags_previos(v, [tag_corto.Id, tag_largo.Id])
    if prev:
        if not rehacer:
            log.append('{}: {} ya tiene {} rotulo(s), se salta.'.format(tname, label, len(prev)))
            return 0, 0, 0, 0
        try:
            doc.Delete(List[ElementId](prev))
        except Exception as e:
            log.append('AVISO {}: no se pudieron borrar los rotulos previos de {}: {}'.format(
                tname, label, e))

    # Con el input 11 apagado esto es exactamente la consulta de siempre -solo Structural
    # Framing- y por eso las plantas de plataforma no cambian en nada.
    cats = ((CATS_ROTULABLES + CATS_PLANTA_EXTRA) if planta_completa
            else (BuiltInCategory.OST_StructuralFraming,))
    vigas = []
    for cat in cats:
        try:
            vigas.extend([e for e in (FilteredElementCollector(doc, v.Id)
                                      .OfCategory(cat).WhereElementIsNotElementType())
                          if e.Id.Value in ids_miembros and not excluida(e)])
        except Exception as e:
            log.append('AVISO {}: no se pudo listar una categoria de {}: {}'.format(
                tname, label, e))
    if not vigas:
        extra = ''
        if not planta_completa:
            # tipico de la NIPB: son todas columnas, y con el input 11 apagado el
            # recolector solo junta Structural Framing.
            extra = (' Con el input 11 ("rotular tambien columnas y familias") en True '
                     'quizas si haya que rotular.')
        log.append('{}: {} no muestra piezas rotulables del assembly; sin rotulos.{}'.format(
            tname, label, extra))
        return 0, 0, 0, 0

    esc = v.Scale if v.Scale > 0 else 1
    margen = margen_mm / PIE * esc
    zs = z_de_vista(v)
    # punto de descarte para los tags de medicion, bien fuera del crop
    lejos = XYZ(v.Origin.X + 1.0e5, v.Origin.Y + 1.0e5, zs[0])

    nombres = set()
    for el in vigas:
        n = nombre_tipo(el)
        if n:
            nombres.add(n)
            nombres.add(acortar(n))
    viejos = rotulos_texto_viejos(v, nombres)
    if viejos:
        try:
            doc.Delete(List[ElementId](viejos))
            log.append('{}: {} tenia {} rotulo(s) de texto de la version anterior; se barrieron.'.format(
                tname, label, len(viejos)))
        except Exception as e:
            log.append('AVISO {}: no se pudieron borrar los rotulos de texto viejos de {}: {}'.format(
                tname, label, e))

    medir_tags(v, vigas, tag_largo, lejos)
    medir_tags(v, vigas, tag_corto, lejos)

    # --- colocacion (2026-09-22) ----------------------------------------------------------
    # Las plantas nunca tuvieron deteccion de solape: cada rotulo se plantaba en el punto
    # medio de su viga y no se preguntaba si ya habia otro ahi. Con 130 rotulos en una
    # planta T.A. el resultado era ilegible.
    #
    # Y la eleccion corto/largo miraba la viga equivocada: "¿entra a lo largo de ESTA
    # pieza?", nunca "¿cuanto hay hasta la de al lado?". En un campo de correas paralelas
    # cada rotulo entraba en su viga y juntos se pisaban todos.
    #
    # Mismo criterio que en los cortes: se prueba el largo, si choca se prueba el corto, y
    # si tampoco entra se OMITE. Correrlo de lugar deja el rotulo lejos de su pieza.
    rd = v.RightDirection
    ud = v.UpDirection

    def _uw(p):
        q = p - v.Origin
        return q.DotProduct(rd), q.DotProduct(ud)

    def _huella(el, tipo, ang):
        # lo que ocupa el rotulo en pantalla una vez girado
        a = _anchos.get(_clave(el, tipo, v)) or 0.0
        h = _altos.get(_clave(el, tipo, v)) or 0.0
        ca, sa = abs(math.cos(ang)), abs(math.sin(ang))
        return a * ca + h * sa, a * sa + h * ca

    hechos = 0
    cortos = 0
    apretados = 0
    sin_curva = 0
    puntuales = 0
    fallidos = 0
    ultimo = None

    candidatos = []
    for el in vigas:
        ejes = eje_en_planta(el)
        if ejes is None:
            # Sin eje en planta: una columna vista desde arriba es un punto, no una linea,
            # y no hay direccion que seguir. Con el input 11 apagado se salta, que es lo
            # que hizo este graph desde siempre.
            if not planta_completa:
                sin_curva += 1
                continue
            medio, lado = huella_en_planta(el)
            if medio is None:
                sin_curva += 1
                continue
            ang = 0.0
            # NO se descuenta el margen. El margen existe para que el rotulo no se salga
            # de los extremos de la viga, y una pieza puntual no tiene extremos: con el
            # descuento, una columna de 30 cm a 1:200 daba "disponible" NEGATIVO y
            # terminaba siempre en rotulo corto y contada como "no entra ni corto".
            disponible = lado
            largo = lado
            puntuales += 1
        else:
            a, b = ejes
            largo = a.DistanceTo(b)
            disponible = largo - 2.0 * margen
            d = XYZ(b.X - a.X, b.Y - a.Y, 0.0).Normalize()
            ang = math.atan2(d.Y, d.X)
            # el rotulo nunca se lee de cabeza: se normaliza a (-90, 90]
            if ang > math.pi / 2.0:
                ang -= math.pi
            elif ang <= -math.pi / 2.0:
                ang += math.pi
            medio = XYZ((a.X + b.X) / 2.0, (a.Y + b.Y) / 2.0, 0.0)
        candidatos.append((largo, el, medio, ang, disponible))

    # Las piezas mas largas primero: son la estructura principal y las que de verdad tienen
    # lugar para el rotulo. Asi, cuando dos no caben juntos, el que se cae es el accesorio
    # y no la viga.
    candidatos.sort(key=lambda r: -r[0])

    puestos = []
    omitidos = []
    for largo, el, medio, ang, disponible in candidatos:
        cu, cw = _uw(medio)
        elegido = None
        w = h = 0.0
        for tipo, es_corto in ((tag_largo, False), (tag_corto, True)):
            ancho = _anchos.get(_clave(el, tipo, v))
            if (not es_corto) and ancho is not None and ancho > disponible:
                continue          # no entra a lo largo de la pieza: se prueba el corto
            w, h = _huella(el, tipo, ang)
            if any(abs(cu - ou) * 2.0 < (w + ow) and abs(cw - oz) * 2.0 < (h + oh)
                   for ou, oz, ow, oh in puestos):
                continue          # se pisa con uno ya puesto
            elegido = tipo
            if es_corto:
                cortos += 1
                if ancho is not None and ancho > disponible:
                    apretados += 1
            break
        if elegido is None:
            omitidos.append(nombre_tipo(el) or '?')
            continue

        creado = None
        z_usado = zs[0]
        for z in zs:
            try:
                creado = IndependentTag.Create(doc, elegido.Id, v.Id, Reference(el), False,
                                               TagOrientation.Horizontal,
                                               XYZ(medio.X, medio.Y, z))
                z_usado = z
                break
            except Exception as e:
                ultimo = e
        if creado is None:
            fallidos += 1
            continue
        puestos.append((cu, cw, w, h))
        hechos += 1
        if abs(ang) > 1e-9:
            # el tag se crea horizontal y se gira sobre su propia cabeza, que esta en el
            # medio de la viga: asi queda centrado en el eje, igual que el texto de antes
            try:
                p = XYZ(medio.X, medio.Y, z_usado)
                ElementTransformUtils.RotateElement(
                    doc, creado.Id, Line.CreateBound(p, p.Add(XYZ(0.0, 0.0, 1.0))), ang)
            except Exception as e:
                ultimo = e
    if fallidos:
        log.append('AVISO {}: {} rotulo(s) no se pudieron colocar en {}: {}'.format(
            tname, fallidos, label, ultimo))
    log.append('OK {}: {} rotulo(s) en {} sobre {} pieza(s) [{} cortos, {} no entran ni '
               'cortos, {} sin eje en planta, {} sin rotular por no tener eje, {} omitido(s) '
               'por no tener espacio].'.format(
                   tname, hechos, label, len(vigas), cortos, apretados, puntuales, sin_curva,
                   len(omitidos)))
    if omitidos:
        log.append('   {} \\ {}: sin rotulo por falta de espacio: {}'.format(
            tname, label, ', '.join(sorted(set(omitidos)))))
    return hechos, cortos, apretados, sin_curva


# ------------------------------------------------- tags en las elevaciones

def eje_de_pieza(el):
    # (punto medio, direccion, largo) de la pieza. Las columnas suelen tener LocationPoint
    # en vez de curva, asi que el plan B es el bbox: su centro y su lado mas largo.
    try:
        loc = el.Location
        c = loc.Curve if (loc is not None and hasattr(loc, 'Curve')) else None
        if c is not None:
            a = c.GetEndPoint(0)
            b = c.GetEndPoint(1)
            if a.DistanceTo(b) > TOL_PLANTA:
                return c.Evaluate(0.5, True), (b - a).Normalize(), a.DistanceTo(b)
    except Exception:
        pass
    try:
        bb = el.get_BoundingBox(None)
        if bb is None:
            return None, None, 0.0
        medio = XYZ((bb.Min.X + bb.Max.X) / 2.0, (bb.Min.Y + bb.Max.Y) / 2.0,
                    (bb.Min.Z + bb.Max.Z) / 2.0)
        dx = bb.Max.X - bb.Min.X
        dy = bb.Max.Y - bb.Min.Y
        dz = bb.Max.Z - bb.Min.Z
        if dz >= dx and dz >= dy:
            return medio, XYZ(0.0, 0.0, 1.0), dz
        if dx >= dy:
            return medio, XYZ(1.0, 0.0, 0.0), dx
        return medio, XYZ(0.0, 1.0, 0.0), dy
    except Exception:
        return None, None, 0.0


_grids = {}
_grids_cargados = [False]


def punto_del_eje(gname):
    # Un punto de la linea del eje que esta elevacion documenta.
    #
    # NO se usa v.Origin para esto. 00 arma el crop de la elevacion con una caja que
    # abarca TODO el ancho del assembly en profundidad (de lzmin a lzmax respecto del
    # plano del eje) y ViewSection.CreateSection deja el plano de la vista en la CARA
    # FRONTAL de esa caja. O sea que v.Origin no esta sobre el eje: esta a medio ancho
    # del assembly de distancia -- metros, no centimetros. Medir la tolerancia contra el
    # descartaba el 100% de las piezas (1762 de 1762 en la corrida del 2026-08-04).
    if not _grids_cargados[0]:
        _grids_cargados[0] = True
        for g in FilteredElementCollector(doc).OfClass(Grid):
            try:
                _grids[elem_name(g).strip().lower()] = g
            except Exception:
                pass
    g = _grids.get(gname.strip().lower())
    if g is None:
        return None
    try:
        return g.Curve.GetEndPoint(0)
    except Exception:
        return None


def rotular_elevacion(v, label, gname, ids_miembros, tag_corto, tag_largo, tname):
    # un tag por pieza que este SOBRE el eje de la vista. Una elevacion muestra en
    # profundidad todo lo que entre en el Far Clip - en la vista del modelador son 87
    # vigas - y rotularlas todas seria ilegible: el plano-tipo lleva 10 tags, los del
    # marco que la elevacion documenta.
    p_eje = punto_del_eje(gname)
    if p_eje is None:
        # sin el eje no hay con que filtrar por profundidad, y una elevacion muestra en
        # profundidad decenas de piezas: rotularlas todas seria ilegible
        log.append('ERROR {}: no existe el eje "{}"; no se rotula {}.'.format(tname, gname, label))
        return 0, 0, 0, 0

    # antes que nada, que la vista pueda MOSTRAR lo que se le va a dibujar
    encender_tags(v, tname, label)
    prev = tags_previos(v, [tag_corto.Id, tag_largo.Id])
    if prev:
        if not rehacer:
            log.append('{}: {} ya tiene {} tag(s), se salta.'.format(tname, label, len(prev)))
            return 0, 0, 0, 0
        try:
            doc.Delete(List[ElementId](prev))
        except Exception as e:
            log.append('AVISO {}: no se pudieron borrar los tags previos de {}: {}'.format(
                tname, label, e))
    rd = v.RightDirection
    ud = v.UpDirection
    vd = v.ViewDirection
    esc = v.Scale if v.Scale > 0 else 1
    sep = sep_tag_mm / PIE * esc
    margen = margen_mm / PIE * esc
    tol = tol_eje_cm / 30.48        # cm -> pies
    piezas = []
    for cat in CATS_ROTULABLES:
        try:
            piezas.extend([e for e in (FilteredElementCollector(doc, v.Id)
                                       .OfCategory(cat).WhereElementIsNotElementType())
                           if e.Id.Value in ids_miembros and not excluida(e)])
        except Exception as e:
            log.append('AVISO {}: no se pudieron listar las piezas de {}: {}'.format(tname, label, e))
    if not piezas:
        log.append('{}: {} no muestra piezas del assembly; sin tags.'.format(tname, label))
        return 0, 0, 0, 0

    # UN tag por cada TIPO de familia presente en la vista, no uno por pieza. Una
    # elevacion muestra en profundidad todo lo que entre en el Far Clip -en la vista del
    # modelador son 87 vigas- y rotular pieza por pieza es ilegible: medido el
    # 2026-08-04, sin filtro ES-1002 EJE E daba 51 tags sobre 66 piezas. Con un tag por
    # tipo la cantidad de rotulos deja de depender de cuantas piezas haya, que es
    # justamente lo que hacia falta.
    #
    # El representante de cada tipo es la pieza MAS CERCANA al plano del eje: es la que
    # la elevacion esta documentando. Y tol_eje_cm dejo de ser un filtro DURO para pasar
    # a ser una PREFERENCIA: si de un tipo no hay ninguna pieza sobre el eje se rotula
    # igual la mas cercana, en vez de perder el tipo entero. Sin eso, la escalera y las
    # barandas no recibirian tag nunca, porque casi nunca caen sobre el plano del eje.
    mejores = {}
    cerca = None
    for el in piezas:
        medio, d, largo = eje_de_pieza(el)
        if medio is None:
            continue
        dist = abs((medio - p_eje).DotProduct(vd))
        if cerca is None or dist < cerca:
            cerca = dist
        try:
            k = el.Symbol.Id.Value
        except Exception:
            k = el.GetTypeId().Value
        # sobre el eje le gana siempre a fuera del eje; entre iguales, la mas cercana, y
        # a igual distancia la mas larga, que es a la que mejor le entra el rotulo largo.
        rank = (0 if dist <= tol else 1, dist, -largo)
        if k not in mejores or rank < mejores[k][0]:
            mejores[k] = (rank, el, medio, d, largo)
    representantes = [mejores[k] for k in mejores]
    lejos_del_eje = sum(1 for r in representantes if r[0][0] == 1)

    # punto de descarte para los tags de medicion, bien fuera del crop
    lejos = v.Origin.Add(rd.Multiply(1.0e5)).Add(ud.Multiply(1.0e5))
    elegidas = [r[1] for r in representantes]
    medir_tags(v, elegidas, tag_largo, lejos)
    medir_tags(v, elegidas, tag_corto, lejos)

    # --- colocacion de los rotulos (2026-09-21) -------------------------------------------
    # Antes cada tag se plantaba en el punto medio de su pieza y ahi quedaba. En un corte de
    # un marco completo eso da dos problemas que se ven juntos:
    #
    #   1. El rotulo salia SIEMPRE horizontal o vertical, nunca en diagonal. Una cercha de
    #      techo recibia un rotulo horizontal que no seguia la pieza. Las plantas giran el
    #      tag desde siempre (ver rotular_planta); las elevaciones nunca lo hicieron.
    #   2. Dos piezas a PROFUNDIDADES distintas se proyectan al mismo punto de pantalla y
    #      sus rotulos quedaban encimados. La regla de un-tag-por-tipo limita CUANTOS hay,
    #      no DONDE caen, asi que no podia resolver esto.
    #
    # Ahora se calcula la posicion ideal de cada uno, se comparan las huellas 2D -con el
    # ancho y el alto que medir_tags ya sabe- y el que choca se OMITE.
    #
    # Se probo antes correrlos con leader y quedo peor: en un corte a 1:250 las lineas de
    # referencia cruzan el dibujo entero, y un rotulo desplazado deja de estar sobre la
    # pieza que nombra, que es justo lo que lo hacia legible. Es preferible documentar
    # menos y que se lea. Los omitidos quedan nombrados en el log para poder ponerlos a
    # mano si alguno hacia falta.
    hechos = 0
    cortos = 0
    apretados = 0
    fallidos = 0
    ultimo = None

    def _uw(p):
        # coordenadas 2D de la vista: (derecha, arriba) respecto del origen
        q = p - v.Origin
        return q.DotProduct(rd), q.DotProduct(ud)

    def _huella(el, tipo, ang):
        # lo que ocupa el rotulo EN PANTALLA una vez girado
        a = _anchos.get(_clave(el, tipo, v)) or 0.0
        h = _altos.get(_clave(el, tipo, v)) or 0.0
        ca, sa = abs(math.cos(ang)), abs(math.sin(ang))
        return a * ca + h * sa, a * sa + h * ca

    ideal = []
    for rank, el, medio, d, largo in representantes:
        # el tag es una anotacion de la vista: su punto va en el plano de la elevacion.
        # Aca SI va v.Origin y no p_eje: son dos planos distintos y cada uno cumple su
        # papel. El filtro de arriba pregunta "esta sobre el eje", que se mide contra el
        # eje; esto de aca decide donde se dibuja la anotacion, que va en el plano de la
        # vista -- el plano del eje puede quedar detras del near y el tag se clipearia.
        p = medio.Subtract(vd.Multiply((medio - v.Origin).DotProduct(vd)))
        # direccion de la pieza PROYECTADA al plano de la vista
        du = d.DotProduct(rd)
        dw = d.DotProduct(ud)
        # se normaliza el sentido para que el rotulo caiga siempre del mismo lado
        if du < -1e-9 or (abs(du) <= 1e-9 and dw < 0.0):
            du, dw = -du, -dw
        plano = math.hypot(du, dw)
        if plano < 1e-9:
            # la pieza apunta a la camara: en la vista es un punto y no hay eje que seguir
            du, dw, plano = 1.0, 0.0, 0.0
        ang = math.atan2(dw, du)
        # el rotulo nunca se lee de cabeza: se normaliza a (-90, 90]
        if ang > math.pi / 2.0:
            ang -= math.pi
        elif ang <= -math.pi / 2.0:
            ang += math.pi
        # perpendicular a la pieza en el plano de la vista: por ahi se separa el rotulo.
        # Para una viga horizontal da "arriba" y para una columna da "a la izquierda", que
        # es exactamente lo que hacian las dos ramas que esto reemplaza.
        den = plano if plano > 1e-9 else 1.0
        perp = rd.Multiply(-dw / den).Add(ud.Multiply(du / den))
        p = p.Add(perp.Multiply(sep))
        # el largo util es el de la pieza PROYECTADO, no una sola de sus componentes: para
        # una diagonal las dos ramas anteriores se quedaban cortas y forzaban el rotulo
        # corto sin necesidad.
        disponible = largo * plano - 2.0 * margen

        # sin medida se deja el largo, que es el rotulo completo; el log lo anota
        tipo = tag_largo
        ancho = _anchos.get(_clave(el, tag_largo, v))
        if ancho is not None and ancho > disponible:
            tipo = tag_corto
            cortos += 1
            ancho_corto = _anchos.get(_clave(el, tag_corto, v))
            # si ni el corto entra se pone igual: mejor una pieza rotulada de mas que una
            # sin identificar. Queda contado en el log.
            if ancho_corto is not None and ancho_corto > disponible:
                apretados += 1
        ideal.append((rank, el, tipo, p, ang, perp))

    # Los que estan SOBRE el eje se ubican primero y se quedan con su lugar: son los que la
    # elevacion esta documentando. De los de atras se cae el que no tenga donde entrar.
    ideal.sort(key=lambda r: r[0])
    puestos = []
    omitidos = []
    for _rank, el, tipo, p, ang, _perp in ideal:
        w, h = _huella(el, tipo, ang)
        cu, cw = _uw(p)
        if any(abs(cu - ou) * 2.0 < (w + ow) and abs(cw - oz) * 2.0 < (h + oh)
               for ou, oz, ow, oh in puestos):
            omitidos.append(nombre_tipo(el) or '?')
            continue
        puestos.append((cu, cw, w, h))
        try:
            t = IndependentTag.Create(doc, tipo.Id, v.Id, Reference(el), False,
                                      TagOrientation.Horizontal, p)
            hechos += 1
        except Exception as e:
            fallidos += 1
            ultimo = e
            continue
        if abs(ang) > 1e-9:
            # se crea horizontal y se gira sobre su cabeza para seguir a la pieza, igual
            # que en las plantas. El eje de giro es la direccion de la vista.
            try:
                ElementTransformUtils.RotateElement(
                    doc, t.Id, Line.CreateBound(p, p.Add(vd)), ang)
            except Exception as e:
                ultimo = e
    if fallidos:
        log.append('AVISO {}: {} tag(s) no se pudieron colocar en {}: {}'.format(
            tname, fallidos, label, ultimo))
    log.append('OK {}: {} tag(s) en {} - uno por tipo: {} tipo(s) distinto(s) sobre {} '
               'pieza(s) visibles [{} tipo(s) sin ninguna pieza sobre el eje, {} cortos, '
               '{} no entran ni cortos, {} omitido(s) por no tener espacio].'.format(
                   tname, hechos, label, len(representantes), len(piezas),
                   lejos_del_eje, cortos, apretados, len(omitidos)))
    if omitidos:
        # nombrados uno por uno: si alguno hacia falta se pone a mano, y si se repite en
        # todos los cortes es senal de que sobra un tipo, no de que falte espacio.
        log.append('   {} \\ {}: sin rotulo por falta de espacio: {}'.format(
            tname, label, ', '.join(sorted(set(omitidos)))))
    if cerca is not None and cerca > tol:
        # Ningun tipo tiene una pieza SOBRE el eje. Ya no se pierde ningun rotulo -se
        # rotula igual la mas cercana- pero conviene saberlo: 00 crea una elevacion por
        # cada eje MARCADO, y un eje puede quedar marcado sin tocar ninguna pieza del
        # assembly. Si la mas cercana esta a metros, la elevacion no documenta nada y
        # sobra; si esta a decenas de cm, es el input 09 el que se quedo corto.
        log.append('DIAG {} \\ {}: nada a menos de {:.0f} cm del eje {}; la pieza mas cercana '
                   'esta a {:.0f} cm. Se rotula igual, porque el input 09 ya no descarta nada '
                   'y solo elige representante; pero metros = el eje no toca el assembly y la '
                   'elevacion sobra.'.format(tname, label, tol_eje_cm, gname, cerca * 30.48))
    return hechos, lejos_del_eje, cortos, apretados


def miembros_recursivos(ai):
    res = []
    pila = [doc.GetElement(mid) for mid in ai.GetMemberIds()]
    vistos = set()
    while pila:
        el = pila.pop()
        if el is None:
            continue
        try:
            eid = el.Id.Value
        except Exception:
            eid = None
        if eid is not None:
            if eid in vistos:
                continue
            vistos.add(eid)
        res.append(el)
        if isinstance(el, FamilyInstance):
            try:
                for sid in el.GetSubComponentIds():
                    pila.append(doc.GetElement(sid))
            except Exception:
                pass
    return res


# ------------------------------------------------------------------ main

by_type = {}
for ai in FilteredElementCollector(doc).OfClass(AssemblyInstance):
    by_type.setdefault(ai.AssemblyTypeName, []).append(ai)

if not by_type:
    log.append('AVISO: no hay ningun Assembly en el modelo; nada que rotular.')

if process_all:
    targets = sorted(by_type.keys())
else:
    tokens = [t.strip().lower() for t in filter_text.split(',') if t.strip()]
    if tokens:
        targets = [n for n in sorted(by_type.keys())
                   if any(tok in n.lower() for tok in tokens)]
    else:
        targets = []
        log.append('ERROR: "Todos" esta en False y el filtro esta vacio.')

views = {}
for v in FilteredElementCollector(doc).OfClass(View):
    # solo las del juego pedido: el indice se filtra aca UNA vez y con eso quedan acotadas
    # todas las busquedas de mas abajo, sin tener que tocar cada startswith por separado.
    if not v.IsTemplate and es_de_este_juego(elem_name(v)):
        views[elem_name(v)] = v

puestos = 0
cortados = 0
apretados = 0
sin_eje = 0
tags = 0
fuera_eje = 0
cortados_elev = 0
apretados_elev = 0
fallas = {}


def _resolver_fallas(sender, args):
    try:
        fa = args.GetFailuresAccessor()
        resultado = FailureProcessingResult.Continue
        for f in fa.GetFailureMessages():
            try:
                try:
                    desc = f.GetDescriptionText()
                except Exception:
                    desc = '(sin descripcion)'
                es_aviso = f.GetSeverity() == FailureSeverity.Warning
                clave = '{}: {}'.format('AVISO' if es_aviso else 'ERROR', desc)
                fallas[clave] = fallas.get(clave, 0) + 1
                if es_aviso:
                    fa.DeleteWarning(f)
                    continue
                ids = list(f.GetFailingElementIds())
                if ids:
                    fa.DeleteElements(List[ElementId](ids))
                    resultado = FailureProcessingResult.ProceedWithCommit
                elif f.HasResolutions():
                    fa.ResolveFailure(f)
                    resultado = FailureProcessingResult.ProceedWithCommit
            except Exception:
                pass
        args.SetProcessingResult(resultado)
    except Exception:
        pass


app = doc.Application
app.FailuresProcessing += _resolver_fallas
TransactionManager.Instance.EnsureInTransaction(doc)
try:
    tag_corto = tipo_de_tag(corto_pedido, 'el rotulo corto') if (corto_pedido and targets) else None
    tag_largo = tipo_de_tag(largo_pedido, 'el rotulo largo') if (largo_pedido and targets) else None
    # hacen falta los DOS tipos: sin el corto no habria con que acortar, y rotular
    # decenas de piezas con el tag equivocado es peor que no rotular
    hay_tags = tag_corto is not None and tag_largo is not None
    if targets and not hay_tags:
        log.append('ERROR: faltan los tipos de tag; no se rotulo nada.')
    for tname in targets:
        if not hay_tags:
            break
        ai = by_type[tname][0]
        try:
            ids_miembros = set()
            for el in miembros_recursivos(ai):
                try:
                    ids_miembros.add(el.Id.Value)
                except Exception:
                    pass

            # --- plantas T.A. ---
            # Con los inputs 12 y 08 el modelador elige que rotular: solo plantas, solo
            # cortes, o las dos cosas. Sirve para iterar sobre una mitad sin rehacer la
            # otra, que en un assembly grande son varios minutos de diferencia.
            if hacer_plantas:
                # NIPB, P.T. y T.A. Antes la lista se armaba SOLO con SUF_TA, asi que
                # las otras dos plantas salian sin un rotulo y sin una linea de log que lo
                # dijera. Medido el 2026-09-22: la NIPB de ES-1001 tiene 74 piezas.
                plantas = [(views[n], n[len(tname) + 3:])
                           for n in sorted(k for k in views
                                           if k.startswith(tname + SUF_NIPB)
                                           or k.startswith(tname + SUF_PT)
                                           or k.startswith(tname + SUF_TA))]
                if not plantas:
                    log.append('AVISO {}: no existen las plantas T.A. (corre 00_Vistas de assembly).'.format(tname))
                for v, label in plantas:
                    try:
                        h, c, ap, se = rotular_planta(v, label, ids_miembros,
                                                      tag_corto, tag_largo, tname)
                        puestos += h
                        cortados += c
                        apretados += ap
                        sin_eje += se
                    except Exception as e:
                        log.append('ERROR {}: rotulos en {}: {}'.format(tname, label, e))

            # --- elevaciones de eje ---
            if hacer_elevaciones:
                # label = "EJE B" para el log; gname = "B" para buscar el eje en el modelo
                # el label lleva la marca -es para el log- pero el gname NO: con el va a
                # buscar el eje al modelo, y ahi se llama sin marca.
                elevaciones = [(views[n], n[len(tname) + 3:],
                                sin_marca(n[len(tname) + len(SUF_EJE):]))
                               for n in sorted(k for k in views if k.startswith(tname + SUF_EJE))]
                if not elevaciones:
                    log.append('AVISO {}: no existen las elevaciones de eje (corre 00_Vistas de assembly).'.format(tname))
                for v, label, gname in elevaciones:
                    try:
                        h, f, c, ap = rotular_elevacion(v, label, gname, ids_miembros,
                                                        tag_corto, tag_largo, tname)
                        tags += h
                        fuera_eje += f
                        cortados_elev += c
                        apretados_elev += ap
                    except Exception as e:
                        log.append('ERROR {}: tags en {}: {}'.format(tname, label, e))
        except Exception as e:
            log.append('ERROR {}: {}'.format(tname, e))
finally:
    try:
        TransactionManager.Instance.TransactionTaskDone()
        TransactionManager.Instance.ForceCloseTransaction()
    finally:
        app.FailuresProcessing -= _resolver_fallas

if sin_eje:
    log.append('AVISO: {} viga(s) sin curva de ubicacion recta; no se pudieron rotular.'.format(sin_eje))
if fallas:
    log.append('--- mensajes de Revit al comitear ---')
    for clave in sorted(fallas.keys()):
        log.append('{} (x{})'.format(clave, fallas[clave]))

log.insert(0, 'PLANTAS - tags puestos: {} | con el tipo corto por falta de espacio: {} | no entran ni cortos: {}'.format(
    puestos, cortados, apretados))
log.insert(1, 'ELEVACIONES - tags puestos: {} | con el tipo corto: {} | no entran ni cortos: {} | piezas salteadas por estar fuera del eje: {}'.format(
    tags, cortados_elev, apretados_elev, fuera_eje))
log.insert(2, 'Assemblies procesados: {}'.format(len(targets)))
OUT = log
# ----------------------------------------
log = Watch(py_rotulo_de_perfil_sobre_cada)  # graph output
