# Dynamo graph 06_Tabla de assemblies.dyn (Dynamo 4.0.2.3852)
# Crea una tabla (schedule nativo multi-categoria) por cada ASSEMBLY del modelo y la coloca en la PRIMERA lamina de ese assembly, en la franja que 01/02 dejan reservada a la derecha. Reproduce la LISTA DE MATERIALES del plano tipo: una fila por tipo de familia miembro (recursivo), con DESCRIPCION / CANT-UNIDAD / DIMENSIONES / KG-M / UNIT KG / TOTAL KG / OBSERVACION, encabezados agrupados y fila de totales.

n01_margen_mm = IntegerSlider(20, range=5..50 step 1)  # "01. Margen (mm)"; graph input
n02_reserva_lado_derecho_mm = IntegerSlider(150, range=0..200 step 5)  # "02. Reserva lado derecho (mm)"; graph input
n03_estilo_de_linea_grid_outline = StringInput("Líneas Tablas Finas")  # "03. Estilo de linea (grid/outline)"; graph input
n04_tipo_de_texto_encabezados = StringInput("C_TXT_RomanD2.3mm")  # "04. Tipo de texto encabezados"; graph input
n05_tipo_de_texto_cuerpo = StringInput("C_TXT_RomanD2.3mm_Negrita")  # "05. Tipo de texto cuerpo"; graph input
n06_titulo_de_la_tabla_se_le = StringInput("LISTA DE MATERIALES")  # "06. Titulo de la tabla (se le agrega el assembly; vacio = TBL_)"; graph input
n07_view_template_para_las_tablas = StringInput("TABLA_TIPO")  # "07. View template para las tablas"; graph input
n08_prefijos_de_tipo_que_van_en = StringInput("PL,ARS")  # "08. Prefijos de tipo que van en m2"; graph input
n09_parametro_de_peso_del_tipo_kg = StringInput("PESO_UNIT")  # "09. Parametro de peso del tipo (KG/M - KG/M2)"; graph input
n10_parametro_numerico_para = StringInput("BIDIMENSION")  # "10. Parametro numerico para DIMENSIONES"; graph input
n11_parametro_numerico_para_unit = StringInput("PESO_UNIT_TBL")  # "11. Parametro numerico para UNIT. KG"; graph input
n12_parametro_numerico_para_total = StringInput("PESO_TOTAL_TBL")  # "12. Parametro numerico para TOTAL KG"; graph input
n00_subcarpeta_juego_de_vistas = StringInput("")  # "00. Subcarpeta / juego de vistas (vacio = sin subcarpeta)"; graph input
n13_tabla_plantilla_que_se = StringInput("TABLA BASE ASSEMBLY")  # "13. Tabla plantilla que se duplica (vacio = armar desde cero)"; graph input
py_tabla_de_materiales_por = Python(IN[0]=n01_margen_mm, IN[1]=n02_reserva_lado_derecho_mm, IN[2]=n03_estilo_de_linea_grid_outline, IN[3]=n04_tipo_de_texto_encabezados, IN[4]=n05_tipo_de_texto_cuerpo, IN[5]=n06_titulo_de_la_tabla_se_le, IN[6]=n07_view_template_para_las_tablas, IN[7]=n08_prefijos_de_tipo_que_van_en, IN[8]=n09_parametro_de_peso_del_tipo_kg, IN[9]=n10_parametro_numerico_para, IN[10]=n11_parametro_numerico_para_unit, IN[11]=n12_parametro_numerico_para_total, IN[12]=n00_subcarpeta_juego_de_vistas, IN[13]=n13_tabla_plantilla_que_se)  # "PY | Tabla de materiales por assembly"; PythonNet3
# ---------- py_tabla_de_materiales_por.python (1561 lines) ----------
# 06_Tabla de materiales - Una tabla (schedule nativo) por ASSEMBLY, colocada en la
# PRIMERA lamina de ese assembly. Reproduce la "LISTA DE MATERIALES" del plano tipo:
#
#   +-------------------------------------------------------------------------------+
#   |                     LISTA DE MATERIALES TOLVA ES-1004                          |
#   +-------------+---------+------------+--------------------------------+----------+
#   |             |  CANT/  | DIMENSIONES|             PESO               |          |
#   | DESCRIPCION | UNIDAD  |  L (m)m2   | KG/M  | UNIT. KG  | TOTAL KG   |OBSERVACION
#   +-------------+---------+------------+-------+-----------+------------+----------+
#   | ES-1004                                                                        |
#   | CANT=1                                                                         |
#   | []15x26,4   |   16    |   68,35    |  26,4 | 1.804,42  | 1.804,42   |ASTM A572 |
#   |    ...                                                                         |
#   +-------------+---------+------------+-------+-----------+------------+----------+
#   |                568    |  567,45    |       | 27.539,16 | 27.539,16  |          |
#   +-------------------------------------------------------------------------------+
#
# Reglas de negocio (definidas por el usuario, 2026-08-04):
# - UNA tabla por assembly (no por lamina). Un assembly puede ocupar varias laminas; la
#   tabla va solo en la PRIMERA. Por eso ya no hay input de "sheets destino": la lamina se
#   deduce buscando la primera (orden natural de SheetNumber) que tenga una vista del
#   assembly, segun el contrato de nombres "{assembly} - ..." que fija 00.
# - Una FILA por TIPO DE FAMILIA miembro del assembly (recursivo, incluye anidadas). Solo
#   las HOJAS generan fila: un elemento que contiene sub-componentes es un envoltorio.
# - Las filas se ordenan por FAMILIA y despues por TIPO, para que los tipos de una misma
#   familia queden juntos.
# - DESCRIPCION = nombre del tipo. CANT/UNIDAD = cuantas instancias de ese tipo hay en UN
#   assembly (campo nativo Count).
# - DIMENSIONES: metros lineales para todo, EXCEPTO los tipos cuyo nombre empieza con
#   alguno de los prefijos de IN[7] (por defecto "PL" -pletinas- y "ARS" -grating-), que
#   van en m2. El largo lineal es el del EJE (LocationCurve), no el del solido: decision
#   del usuario, ver el README ("una pieza de acero tiene dos largos").
# - KG/M o KG/M2 = parametro de TIPO (IN[8], por defecto PESO_UNIT). No se calcula.
# - UNIT. KG = DIMENSIONES x PESO, sumado sobre las instancias del tipo dentro del assembly.
# - TOTAL KG = UNIT. KG x cantidad de instancias de ESE TIPO DE ASSEMBLY en el proyecto
#   (el mismo numero que muestra el encabezado "CANT=N").
# - OBSERVACION = parametro compartido MATERIAL, tal cual (no se calcula).
#
# Por que columnas NUMERICAS y no texto: la fila de totales del pie solo existe si los
# campos son numericos con DisplayType = Totals. La version anterior de este graph escribia
# los valores como texto (Status Vendor) y por eso no podia tener totales. Consecuencia: se
# necesitan 3 parametros de instancia tipo Number (DIMENSIONES, UNIT. KG, TOTAL KG). Si
# alguno no existe en el modelo, el graph lo CREA como parametro de proyecto (ver
# asegurar_param_numerico) con un GUID derivado del nombre, para que sea el mismo en todos
# los modelos de la oficina.
#
# Mecanica de agrupacion (heredada, sigue valiendo): no existe un campo nativo confiable que
# diga "a que assembly pertenezco" (se probo "Assembly Name"/"Assembly Description"/
# "Assembly Code": ninguno trae un valor real por elemento). Tampoco sirve escribir en el
# esquema _TBL de las familias anidadas mas profundas: ahi esos campos quedan BLOQUEADOS por
# formula de familia. Se reutiliza el parametro compartido `TAG` (fuera del esquema _TBL,
# sin formula, confirmado editable en hojas y contenedores) para el nombre del assembly
# (encabezado nivel 1) y `Part Number` para el "CANT=N" (encabezado nivel 2). TAG es ademas
# el filtro de la tabla - ya no se usa Comments para nada.
#
# Solo se recorren los miembros de la PRIMERA instancia de cada tipo de assembly (misma
# convencion del resto del pipeline: se documenta un solo representante por tipo).
#
# Revit 2027 / Dynamo 4 / CPython3
# IN[0]  = margen (mm), misma convencion que 01/02
# IN[1]  = reserva lado derecho (mm) - debe coincidir con 01 y 02
# IN[2]  = nombre del estilo de linea para grid/outline del schedule (vacio = no tocar)
# IN[3]  = nombre del tipo de texto para encabezados (vacio = no tocar)
# IN[4]  = nombre del tipo de texto para el cuerpo (vacio = no tocar)
# IN[5]  = titulo de la tabla; se le agrega el nombre del assembly al final
# IN[6]  = nombre del view template para las tablas (vacio = no aplicar)
# IN[7]  = prefijos de tipo que se miden en m2 en vez de metros lineales (coma)
# IN[8]  = parametro de TIPO con el peso unitario (KG/M o KG/M2)
# IN[9]  = parametro numerico de instancia donde se escribe DIMENSIONES
# IN[10] = parametro numerico de instancia donde se escribe UNIT. KG
# IN[11] = parametro numerico de instancia donde se escribe TOTAL KG

import clr
import os
import re
import hashlib
import tempfile
clr.AddReference('RevitAPI')
clr.AddReference('RevitServices')
from Autodesk.Revit.DB import (FilteredElementCollector, AssemblyInstance, ViewSheet,
                               ScheduleSheetInstance, ViewSchedule, ScheduleFilter,
                               ScheduleFilterType, ScheduleSortGroupField, BuiltInCategory,
                               BuiltInParameter, ElementId, XYZ, Element, TextNoteType,
                               GraphicsStyle, StorageType, FamilyInstance, SharedParameterElement,
                               UnitUtils, UnitTypeId, SpecTypeId, GroupTypeId, FormatOptions,
                               ScheduleFieldType, ScheduleFieldDisplayType, Options,
                               ViewDetailLevel, Solid, GeometryInstance, Transform,
                               CategorySet, CategoryType, ExternalDefinitionCreationOptions,
                               SectionType, TableMergedCell, ViewDuplicateOption,
                               View3D, ViewFamilyType, ViewFamily)
from RevitServices.Persistence import DocumentManager
from RevitServices.Transactions import TransactionManager
from System import Guid
from System.Collections.Generic import List

doc = DocumentManager.Instance.CurrentDBDocument
app = doc.Application

margin = float(IN[0]) / 304.8
right_reserve = float(IN[1]) / 304.8
grid_style_name = (IN[2] or '').strip()
header_text_name = (IN[3] or '').strip()
body_text_name = (IN[4] or '').strip()
titulo_prefijo = (IN[5] or '').strip()
template_nombre = (IN[6] or '').strip()
prefijos_m2 = [p.strip().upper() for p in (IN[7] or '').split(',') if p.strip()]
NOMBRE_PESO = (IN[8] or 'PESO_UNIT').strip()
NOMBRE_DIM = (IN[9] or 'BIDIMENSION').strip()
NOMBRE_UNIT = (IN[10] or 'PESO_UNIT_TBL').strip()
NOMBRE_TOTAL = (IN[11] or 'PESO_TOTAL_TBL').strip()
# tabla que se duplica por assembly; vacio = armar la tabla campo por campo, como antes
nombre_plantilla = (IN[13] or '').strip()
juego_vistas = (IN[12] or '').strip()

# --- juego de vistas (2026-09-19) ---------------------------------------------------------
# 00 escribe el nombre de la subcarpeta al final del nombre de cada vista que crea:
# "ES-1001 - T.A. 01 (REV_B)". Asi correr 00 con otra subcarpeta genera un juego NUEVO en vez
# de caer sobre las vistas ya maquetadas y acotadas.
#
# Este input dice sobre CUAL de esos juegos trabajar. Vacio = el juego sin marca, el que crea
# 00 cuando la subcarpeta se deja en blanco. Sin el, este graph anotaba los dos juegos.
MARCA_JUEGO = ' ({})'.format(juego_vistas) if juego_vistas else ''


def juego_de(vname):
    # la marca que lleva ese nombre al final, o '' si no lleva ninguna
    if vname.endswith(')'):
        i = vname.rfind(' (')
        if i >= 0:
            return vname[i:]
    return ''


def es_de_este_juego(vname):
    # NO alcanza con endswith(MARCA_JUEGO): con la marca vacia, endswith('') da True para
    # TODO y se colarian las vistas de los demas juegos. Hay que comparar la marca completa.
    return juego_de(vname) == MARCA_JUEGO


# GUIDs de parametros compartidos del proyecto (esquema de la oficina). Se accede por GUID y
# no por nombre para evitar la ambiguedad con parametros built-in homonimos (el caso clasico
# es el built-in "Material" conviviendo con el compartido "MATERIAL").
GUID_MATERIAL = Guid('28f7af94-3948-4837-8d3a-f84a69791961')
# ASSEMBLY: el GUID NO es fijo. El parametro se rehizo el 2026-09-21 para separarlo de
# DESCRIPCION_ITEM -compartian el mismo GUID, asi que escribir el nombre del assembly pisaba
# la descripcion del elemento, y le paso a 1.269 de ellos-. Los proyectos anteriores siguen
# con el GUID viejo, asi que se prueban los dos y gana el primero que exista en el modelo.
GUIDS_ASSEMBLY = [Guid('93330cd2-7f31-401b-91b7-106c6c1d4454'),   # separado de DESCRIPCION_ITEM
                  Guid('92fdc373-364b-4440-8198-f8093299f73a')]   # el viejo, que la pisaba
#
# ^ compartido, creado por la oficina el 2026-09-16 y vinculado a las categorias de modelo.
# Antes se reusaba TAG (7e3a03e3-...), que no estaba en el esquema y significaba otra cosa.
#
# OJO: hay un SEGUNDO parametro llamado ASSEMBLY, NO compartido, vinculado solo a Grids, que
# es el que el modelador llena a mano y que leen 00 y 03 para saber que eje lleva elevacion.
# Son parametros distintos que hoy conviven porque estan en categorias disjuntas. Aca se
# accede por GUID, asi que no hay ambiguedad posible; 00 y 03 lo buscan por NOMBRE y por eso
# encuentran el de los ejes.
GUID_PART_NUMBER = Guid('d74d29ed-8dd8-404b-b16d-6d5c110b7f67')  # reusado: "CANT=N"

PREFIJO_SCHEDULE = 'TBL_'


def limpiar_nombre_vista(s):
    # Revit rechaza estos caracteres en el nombre de una vista
    return re.sub(r'[\\:{}\[\]|;<>?`~]', '_', s or '')


def nombre_de_tabla(tname):
    # OJO: el titulo que se ve en la lamina ES EL NOMBRE DE LA VISTA.
    #
    # Un ViewSchedule NO tiene el parametro "Title on Sheet" (VIEW_DESCRIPTION):
    # get_Parameter() devuelve None y el intento de escribirlo se saltaba en silencio. Por
    # eso el input 06 no hacia nada desde que existe y en las laminas salia el nombre
    # tecnico. Ahora ese input arma el nombre, que es lo unico que Revit muestra.
    #
    # Vacio = el nombre tecnico de siempre, para no cambiarle el nombre a las tablas de un
    # proyecto que ya estaba andando.
    base = limpiar_nombre_vista(tname)
    if titulo_prefijo:
        return '{} {}'.format(titulo_prefijo, base).strip()
    return PREFIJO_SCHEDULE + base


def es_tabla_generada(nombre):
    # no ofrecer como plantilla una tabla que genero este mismo graph
    if nombre.startswith(PREFIJO_SCHEDULE):
        return True
    return bool(titulo_prefijo) and nombre.startswith(titulo_prefijo)
# vista 3D de diagnostico: las piezas del assembly que no llegaron a la tabla, aisladas
PREFIJO_DIAG = 'VERIFICAR - sin ASSEMBLY - '
MULTI_CAT_ID = ElementId.InvalidElementId

# encabezados exactos del plano tipo
H_DESC = 'DESCRIPCION'
H_CANT = 'CANT/UNIDAD'
H_DIM = 'L  (m)m2'
H_PESO = 'KG/M  KG/M2'
H_UNIT = 'UNIT. KG'
H_TOTAL = 'TOTAL KG'
H_OBS = 'OBSERVACION'
H_GRUPO_DIM = 'DIMENSIONES'
H_GRUPO_PESO = 'PESO'

# el ancho de cada columna se calcula del texto mas largo que va a mostrar ESA tabla, no de
# una fraccion fija del ancho reservado - evita que un valor largo pase a una segunda linea
# (o quede cortado) dentro de la celda e infle el alto de toda esa fila (2026-07-13). Se
# probaron dos formas de estimarlo: fraccion fija del ancho reservado, y medir el ancho REAL
# con un TextNote temporal (TextNote.Width) - ninguna funciono de forma confiable (la
# medicion con TextNote no reproducia como Revit dibuja el texto DENTRO de una celda de
# schedule). Se opto por un ancho fijo y generoso por caracter: mejor una columna un poco mas
# ancha de lo necesario que texto cortado.
ANCHO_POR_CARACTER_MM = 2.5
ANCHO_COL_MINIMO = 10.0 / 304.8  # piso absoluto por columna (10 mm)

log = []
# piezas que son miembros del assembly pero que NO se pudieron marcar con ASSEMBLY. Se
# juntan de todos los assemblies para sacar un bloque de alerta al principio del log: es
# una perdida SILENCIOSA de material en la lista, y el modelador tiene que enterarse.
alertas_marcado = {}


def resolver_guid_assembly():
    # Por GUID primero y por NOMBRE solo como ultimo recurso, no al reves: existe un segundo
    # parametro llamado ASSEMBLY -no compartido, vinculado unicamente a Grids- que el
    # modelador llena a mano y que leen 00 y 03. Buscar por nombre de entrada podria devolver
    # ese y el graph filtraria por el parametro equivocado sin dar ningun error.
    #
    # El nombre queda de respaldo para que un proyecto que vuelva a rehacer el parametro siga
    # funcionando sin tener que editar este graph; lo avisa en el log para poder agregarlo.
    for g in GUIDS_ASSEMBLY:
        if SharedParameterElement.Lookup(doc, g) is not None:
            return g, None
    for spe in FilteredElementCollector(doc).OfClass(SharedParameterElement):
        try:
            if spe.Name != 'ASSEMBLY':
                continue
            return spe.GuidValue, (
                'AVISO: el parametro compartido ASSEMBLY tiene un GUID que este graph no '
                'conoce ({}). Se usa igual, pero conviene agregarlo a GUIDS_ASSEMBLY.'.format(
                    spe.GuidValue))
        except Exception:
            continue
    # ninguno existe: se devuelve el mas nuevo para que el mensaje de error de mas abajo
    # hable del parametro que el proyecto deberia tener, no del que ya se descarto.
    return GUIDS_ASSEMBLY[0], None


GUID_ASSEMBLY, _aviso_assembly = resolver_guid_assembly()
if _aviso_assembly:
    log.append(_aviso_assembly)


def elem_name(e):
    try:
        return e.Name
    except Exception:
        return Element.Name.__get__(e)


def clave_natural(s):
    # "E-9" antes que "E-10"; mismo criterio de orden natural que usan 00/02 para los ejes.
    return [int(p) if p.isdigit() else p.lower() for p in re.split(r'(\d+)', s or '')]


def formatear_numero(n):
    # solo para el log; en la tabla el formato lo pone Revit via FormatOptions
    if abs(n - round(n)) < 1e-9:
        return str(int(round(n)))
    return '{:.2f}'.format(n).replace('.', ',')


def leer_double(p):
    # devuelve el valor en unidades DE USUARIO: si el parametro declara un spec con unidades
    # (Length, Area, ...) hay que sacarlo de los pies internos de Revit; si es Number, la
    # conversion es la identidad.
    if p is None:
        return None
    try:
        if p.StorageType == StorageType.Double:
            try:
                spec = p.GetUnitTypeId()
                if spec is not None and not spec.Empty():
                    return UnitUtils.ConvertFromInternalUnits(p.AsDouble(), spec)
            except Exception:
                pass
            return p.AsDouble()
        if p.StorageType == StorageType.Integer:
            return float(p.AsInteger())
        if p.StorageType == StorageType.String:
            t = (p.AsString() or '').strip()
            if not t:
                return None
            # convencion chilena: "3.919,52". Si hay coma, el punto es separador de miles.
            if ',' in t:
                t = t.replace('.', '').replace(',', '.')
            return float(t)
    except Exception:
        return None
    return None


def set_double(p, valor_real):
    if p is None or p.IsReadOnly:
        return False
    try:
        try:
            spec = p.GetUnitTypeId()
            if spec is not None and not spec.Empty():
                p.Set(UnitUtils.ConvertToInternalUnits(valor_real, spec))
                return True
        except Exception:
            pass
        p.Set(valor_real)
        return True
    except Exception:
        return False


def set_string(p, valor):
    if p is None or p.IsReadOnly:
        return False
    try:
        if p.AsString() != valor:
            p.Set(valor)
        return True
    except Exception:
        return False


# --- geometria -------------------------------------------------------------------------

def solidos(el):
    opt = Options()
    opt.DetailLevel = ViewDetailLevel.Fine
    encontrados = []

    def recorrer(geo):
        if geo is None:
            return
        for g in geo:
            if isinstance(g, Solid):
                if g.Volume > 1e-9:
                    encontrados.append(g)
            elif isinstance(g, GeometryInstance):
                try:
                    recorrer(g.GetInstanceGeometry())
                except Exception:
                    pass

    try:
        recorrer(el.get_Geometry(opt))
    except Exception:
        pass
    return encontrados


def vista_diagnostico(tname, ids):
    # Vista 3D con SOLO las piezas que no llegaron a la tabla. El log dice cuantas son y de
    # que familia, pero el modelador igual no las puede encontrar: son 104 placas entre 390
    # identicas repartidas por todo el modelo. Aca las abre, las ve aisladas y las
    # selecciona con un rectangulo.
    #
    # Se rehace SIEMPRE, incluso cuando ya no falta nada: en ese caso la vista se borra, y
    # que no exista es la senal de que ese assembly quedo completo.
    nombre = PREFIJO_DIAG + tname
    previa = next((v for v in FilteredElementCollector(doc).OfClass(View3D)
                   if not v.IsTemplate and elem_name(v) == nombre), None)
    if previa is not None:
        try:
            doc.Delete(previa.Id)
        except Exception as e:
            log.append('AVISO {}: no se pudo borrar la vista "{}": {}'.format(tname, nombre, e))
    if not ids:
        return None

    vft = next((t for t in FilteredElementCollector(doc).OfClass(ViewFamilyType)
                if t.ViewFamily == ViewFamily.ThreeDimensional), None)
    if vft is None:
        log.append('AVISO {}: no hay ningun tipo de vista 3D en el proyecto; no se pudo crear '
                   'la vista con las piezas que faltan.'.format(tname))
        return None
    try:
        v3d = View3D.CreateIsometric(doc, vft.Id)
        v3d.Name = nombre
        try:
            v3d.DetailLevel = ViewDetailLevel.Fine
        except Exception:
            pass
        v3d.IsolateElementsTemporary(List[ElementId](ids))
        # sin esto el aislamiento se pierde: IsolateElementsTemporary es, literalmente,
        # temporal. Hay que fijarlo para que la vista siga sirviendo al volver a abrirla.
        v3d.ConvertTemporaryHideIsolateToPermanent()
        return nombre
    except Exception as e:
        log.append('AVISO {}: no se pudo crear la vista con las piezas que faltan: {}'.format(
            tname, e))
        return None


def dims_locales(el):
    # las tres dimensiones (pies, de mayor a menor) de la caja que envuelve la geometria EN EL
    # SISTEMA LOCAL de la instancia, no el bounding box del mundo: asi tambien vale para
    # pletinas y paños de grating girados. Es el mismo criterio con el que 04 saca el contorno
    # del grating, que no es una plancha sino un peine de barras y por eso no se puede medir
    # cara por cara.
    sols = solidos(el)
    if not sols:
        return None
    try:
        inv = el.GetTransform().Inverse
    except Exception:
        inv = Transform.Identity
    mn = [1e12, 1e12, 1e12]
    mx = [-1e12, -1e12, -1e12]
    hay = False
    for s in sols:
        for e in s.Edges:
            try:
                puntos = e.Tessellate()
            except Exception:
                continue
            for pt in puntos:
                q = inv.OfPoint(pt)
                for i, c in enumerate((q.X, q.Y, q.Z)):
                    if c < mn[i]:
                        mn[i] = c
                    if c > mx[i]:
                        mx[i] = c
                hay = True
    if not hay:
        return None
    return sorted([mx[i] - mn[i] for i in range(3)], reverse=True)


def area_m2(el):
    d = dims_locales(el)
    if not d:
        return 0.0, 'sin geometria'
    return UnitUtils.ConvertFromInternalUnits(d[0] * d[1], UnitTypeId.SquareMeters), 'bbox local'


def largo_m(el):
    # el largo del EJE (de nudo a nudo), no el del solido. Decision del usuario: el solido
    # viene recortado en las puntas por Join Cutback / Start-End Extension y en una diagonal
    # medida daba 302 mm menos (ver README).
    try:
        loc = el.Location
        curva = getattr(loc, 'Curve', None)
        if curva is not None:
            return UnitUtils.ConvertFromInternalUnits(curva.Length, UnitTypeId.Meters), 'eje'
    except Exception:
        pass
    for nombre in ('System Length', 'Length', 'Cut Length'):
        try:
            p = el.LookupParameter(nombre)
        except Exception:
            p = None
        if p is not None and p.StorageType == StorageType.Double:
            v = leer_double(p)
            if v:
                return v, nombre
    d = dims_locales(el)
    if d:
        return UnitUtils.ConvertFromInternalUnits(d[0], UnitTypeId.Meters), 'bbox local'
    return 0.0, 'sin geometria'


# --- parametros numericos que la tabla necesita -------------------------------------------

_guids_derivados = {}


def guid_para(nombre):
    # GUID derivado del nombre: el parametro creado es el MISMO en todos los modelos de la
    # oficina sin depender de un archivo de parametros compartidos versionado.
    g = _guids_derivados.get(nombre)
    if g is None:
        h = hashlib.md5(('T003_TBL::' + nombre.upper()).encode('utf-8')).hexdigest()
        g = Guid(h)
        _guids_derivados[nombre] = g
    return g


def asegurar_param_numerico(nombre, nombres_existentes):
    # si ya hay un parametro con ese nombre disponible para el schedule, no se toca nada.
    if nombre in nombres_existentes:
        return True
    ruta = os.path.join(tempfile.gettempdir(), 'T003_params_tabla.txt')
    if not os.path.exists(ruta):
        with open(ruta, 'w') as f:
            f.write('# This is a Revit shared parameter file.\n')
            f.write('*META\tVERSION\tMINVERSION\n')
            f.write('META\t2\t1\n')
            f.write('*GROUP\tID\tNAME\n')
            f.write('*PARAM\tGUID\tNAME\tDATATYPE\tDATACATEGORY\tGROUP\tVISIBLE\tDESCRIPTION\tUSERMODIFIABLE\tHIDEWHENNOVALUE\n')
    anterior = None
    try:
        anterior = app.SharedParametersFilename
    except Exception:
        pass
    try:
        app.SharedParametersFilename = ruta
        df = app.OpenSharedParameterFile()
        if df is None:
            log.append('ERROR: no se pudo abrir el archivo temporal de parametros compartidos.')
            return False
        grupo = next((g for g in df.Groups if g.Name == 'TABLA_ACERO'), None)
        if grupo is None:
            grupo = df.Groups.Create('TABLA_ACERO')
        defn = next((d for d in grupo.Definitions if d.Name == nombre), None)
        if defn is None:
            opts = ExternalDefinitionCreationOptions(nombre, SpecTypeId.Number)
            opts.GUID = guid_para(nombre)
            opts.Visible = True
            defn = grupo.Definitions.Create(opts)
        cats = CategorySet()
        for c in doc.Settings.Categories:
            try:
                if c.AllowsBoundParameters and c.CategoryType == CategoryType.Model:
                    cats.Insert(c)
            except Exception:
                continue
        binding = app.Create.NewInstanceBinding(cats)
        ok = False
        try:
            ok = doc.ParameterBindings.Insert(defn, binding, GroupTypeId.Data)
        except Exception:
            try:
                ok = doc.ParameterBindings.Insert(defn, binding)
            except Exception:
                ok = False
        if not ok:
            try:
                ok = doc.ParameterBindings.ReInsert(defn, binding)
            except Exception:
                ok = False
        if ok:
            log.append('Se creo el parametro de proyecto "{}" (Number, instancia, todas las categorias de modelo).'.format(nombre))
        else:
            log.append('ERROR: no se pudo crear ni vincular el parametro "{}".'.format(nombre))
        return ok
    except Exception as e:
        log.append('ERROR creando el parametro "{}": {}'.format(nombre, e))
        return False
    finally:
        try:
            if anterior is not None:
                app.SharedParametersFilename = anterior
        except Exception:
            pass


def param_de(el, nombre):
    # primero por el GUID que este graph usa al crearlo (exacto), y si no por nombre - asi
    # funciona tanto con el parametro creado aca como con uno que ya trajera la oficina.
    p = None
    try:
        p = el.get_Parameter(guid_para(nombre))
    except Exception:
        p = None
    if p is None:
        try:
            p = el.LookupParameter(nombre)
        except Exception:
            p = None
    verificar_instancia(el, nombre, p)
    return p


_verificados = set()


def verificar_instancia(el, nombre, p):
    # Las tres columnas numericas se escriben por INSTANCIA y se muestran con DisplayType =
    # Totals, o sea SUMADAS. Si el parametro resultara ser de TIPO, las N instancias del tipo
    # comparten un unico valor: la ultima escritura pisa a las demas y la fila mostraria ese
    # valor multiplicado por N. Es un error silencioso (los numeros salen, pero mal), asi que
    # se detecta una sola vez por parametro comparando quien es el dueño del parametro.
    if p is None or nombre in _verificados:
        return
    _verificados.add(nombre)
    try:
        if p.Element.Id.Value != el.Id.Value:
            log.append(('ERROR: "{}" es un parametro de TIPO, no de instancia. La columna va a '
                        'sumar el mismo valor una vez por pieza. Apuntar el input a un '
                        'parametro de INSTANCIA (o dejar el default, que el graph crea).').format(nombre))
        elif p.IsReadOnly:
            # No es un fallo: si el parametro lo calcula una formula de familia -como
            # BIDIMENSION en este modelo- es de solo lectura A PROPOSITO y el valor bueno ya
            # esta puesto. Se avisa una vez y se sigue.
            log.append('AVISO: "{}" es de solo lectura, asi que este graph no lo escribe. Si lo '
                       'calcula una formula del modelo, esta bien: el valor sale de ahi.'.format(nombre))
    except Exception:
        pass


# --- miembros del assembly ----------------------------------------------------------------

def miembros_recursivos(ai):
    # miembros del assembly + sus sub-componentes anidados (cualquier profundidad).
    #
    # Es FILA todo lo que aporte VOLUMEN PROPIO, tenga hijos o no. Lo unico que no genera fila
    # es el contenedor sin geometria: la familia "envoltorio" que se llama igual que el
    # assembly y solo existe para agrupar. Esos se devuelven aparte para limpiarles el
    # ASSEMBLY.
    #
    # Antes la pregunta era "¿tiene sub-componentes?", que NO es lo mismo. Una placa de
    # conexion tiene pernos anidados Y chapa propia, asi que caia del lado equivocado: no
    # generaba fila y encima se le BORRABA el ASSEMBLY. Medido el 2026-09-21 en ES-1001: de
    # sus 132 miembros de categoria Structural Connections solo 4 llegaban a la tabla.
    #
    # Se baja igual a los hijos en los dos casos: un perno anidado en una placa es una fila
    # mas, no parte de la placa.
    vistos = set()
    hojas = []
    contenedores = []
    diag = {'no_familyinstance': 0, 'sin_geometria': 0, 'con_hijos': 0}
    stack = list(ai.GetMemberIds())
    while stack:
        eid = stack.pop()
        if eid.Value in vistos:
            continue
        vistos.add(eid.Value)
        el = doc.GetElement(eid)
        if el is None:
            continue
        if not isinstance(el, FamilyInstance):
            # No se puede bajar a sus hijos: GetSubComponentIds es de FamilyInstance. Queda
            # contado para el log, que es lo unico que puede decir si esta rama se esta
            # comiendo miembros de verdad.
            diag['no_familyinstance'] += 1
            continue
        subs = []
        try:
            subs = list(el.GetSubComponentIds())
        except Exception:
            pass
        if subs:
            diag['con_hijos'] += 1
            stack.extend(subs)
        # la pregunta es por la geometria, no por los hijos. Un elemento SIN hijos se cuenta
        # igual que antes aunque no se le encuentre solido: asi este cambio nunca saca de la
        # tabla algo que hoy si aparece.
        if subs and not solidos(el):
            diag['sin_geometria'] += 1
            contenedores.append(el)
        else:
            hojas.append(el)
    return hojas, contenedores, diag


# --- assemblies y su primera lamina -------------------------------------------------------

by_type = {}
for ai in FilteredElementCollector(doc).OfClass(AssemblyInstance):
    by_type.setdefault(ai.AssemblyTypeName, []).append(ai)

if not by_type:
    log.append('ERROR: no hay ningun Assembly en el modelo.')
    OUT = log
else:
    sheets = sorted(FilteredElementCollector(doc).OfClass(ViewSheet),
                    key=lambda s: clave_natural(s.SheetNumber))

    # primera lamina de cada assembly: la de numero mas bajo que tenga alguna de sus vistas.
    # El vinculo es por NOMBRE de vista, siguiendo el contrato que fija 00
    # ("{assembly} - NIPB", "{assembly} - T.A. NN", "{assembly} - EJE {eje}"): las plantas no
    # son vistas de assembly sino ViewPlan aisladas, asi que AssociatedAssemblyInstanceId no
    # sirve para encontrarlas.
    primera_lamina = {}
    for sh in sheets:
        for vpid in sh.GetAllViewports():
            vp = doc.GetElement(vpid)
            if vp is None:
                continue
            v = doc.GetElement(vp.ViewId)
            if v is None:
                continue
            n = elem_name(v)
            for tname in by_type:
                if tname in primera_lamina:
                    continue
                # solo las vistas del juego pedido: si no, la tabla podria anclarse a
                # la primera lamina de OTRO juego del mismo assembly.
                if es_de_este_juego(n) and (n == tname or n.startswith(tname + ' - ')):
                    primera_lamina[tname] = sh

    def usable_rect(sheet):
        # misma funcion que 01/02: area util = bbox de la viñeta menos margenes (y reserva
        # derecha); la tabla se ancla justo a la derecha de x1.
        col = FilteredElementCollector(doc, sheet.Id).OfCategory(BuiltInCategory.OST_TitleBlocks)
        tb = col.FirstElement()
        if tb is not None:
            bb = tb.get_BoundingBox(sheet)
            if bb is not None:
                return (bb.Min.X + margin, bb.Min.Y + margin,
                        bb.Max.X - margin - right_reserve, bb.Max.Y - margin)
        o = sheet.Outline
        return (o.Min.U + margin, o.Min.V + margin,
                o.Max.U - margin - right_reserve, o.Max.V - margin)

    estilos_linea = list(FilteredElementCollector(doc).OfClass(GraphicsStyle))
    tipos_texto = list(FilteredElementCollector(doc).OfClass(TextNoteType))

    def buscar_por_nombre(coleccion, nombre, etiqueta):
        if not nombre:
            return None
        low = nombre.lower()
        for e in coleccion:
            if elem_name(e).lower() == low:
                return e
        log.append('AVISO: no se encontro {} "{}"; se deja el valor por defecto del schedule.'.format(etiqueta, nombre))
        return None

    estilo_grid = buscar_por_nombre(estilos_linea, grid_style_name, 'el estilo de linea')
    tipo_header = buscar_por_nombre(tipos_texto, header_text_name, 'el tipo de texto de encabezados')
    tipo_body = buscar_por_nombre(tipos_texto, body_text_name, 'el tipo de texto de cuerpo')

    # TABLA PLANTILLA (2026-09-21). En vez de construir la tabla campo por campo, 06 puede
    # DUPLICAR una tabla que alguien armo a mano en el proyecto y cambiarle solo el filtro y
    # el titulo. Es la unica forma de tener valores calculados por formula: la API de Revit no
    # los puede crear -ScheduleField.IsCalculatedField es de solo lectura y no hay SetFormula-,
    # asi que se escriben una vez en la plantilla y el duplicado se los lleva.
    #
    # De paso trae los encabezados agrupados ya armados, que es lo que este graph nunca pudo
    # resolver a ciegas.
    plantilla_tabla = None
    if nombre_plantilla:
        low_pl = nombre_plantilla.lower()
        plantilla_tabla = next((v for v in FilteredElementCollector(doc).OfClass(ViewSchedule)
                                if not v.IsTemplate and elem_name(v).lower() == low_pl), None)
        if plantilla_tabla is None:
            log.append('AVISO: no existe la tabla plantilla "{}"; las tablas se arman desde cero.'.format(
                nombre_plantilla))
            otras = sorted(elem_name(v) for v in FilteredElementCollector(doc).OfClass(ViewSchedule)
                           if not v.IsTemplate and not es_tabla_generada(elem_name(v)))
            if otras:
                log.append('Tablas disponibles para usar como plantilla: ' + ', '.join(otras[:40]))
        else:
            log.append('Tabla plantilla: "{}" (se duplica por assembly; solo se le cambia el '
                       'filtro y el titulo).'.format(elem_name(plantilla_tabla)))

    templates_schedule = [v for v in FilteredElementCollector(doc).OfClass(ViewSchedule) if v.IsTemplate]
    template_tabla = None
    if template_nombre:
        low_t = template_nombre.lower()
        template_tabla = next((v for v in templates_schedule if elem_name(v).lower() == low_t), None)
        if template_tabla is None:
            log.append('AVISO: no se encontro el view template de schedule "{}"; las tablas quedan sin template.'.format(template_nombre))
            if templates_schedule:
                log.append('Templates de schedule disponibles: ' + ', '.join(sorted(elem_name(v) for v in templates_schedule)))

    def buscar_parametro_fuzzy(el, nombre):
        # LookupParameter exige coincidencia EXACTA de mayusculas/formato; los parametros de
        # Appearance del schedule (Grid lines, Show Title, ...) no siempre calzan asi.
        low = nombre.lower().strip()
        try:
            for p in el.Parameters:
                try:
                    if p.Definition.Name.lower().strip() == low:
                        return p
                except Exception:
                    continue
        except Exception:
            pass
        return None

    def set_param_by_name(el, nombre, valor):
        try:
            p = buscar_parametro_fuzzy(el, nombre)
            if p is None or p.IsReadOnly:
                return False
            if p.StorageType == StorageType.ElementId:
                p.Set(valor.Id if hasattr(valor, 'Id') else valor)
            elif p.StorageType == StorageType.Integer:
                p.Set(int(valor))
            elif p.StorageType == StorageType.String:
                p.Set(str(valor))
            else:
                return False
            return True
        except Exception:
            return False

    def campo_por_guid(schedulable, guid):
        spe = SharedParameterElement.Lookup(doc, guid)
        if spe is None:
            return None
        for f in schedulable:
            if f.ParameterId == spe.Id:
                return f
        return None

    def campo_por_nombre(schedulable, nombre):
        for f in schedulable:
            try:
                if f.GetName(doc) == nombre:
                    return f
            except Exception:
                continue
        return None

    def campo_primero_de(schedulable, nombres):
        for n in nombres:
            f = campo_por_nombre(schedulable, n)
            if f is not None:
                return f
        return None

    def campo_count(schedulable):
        for f in schedulable:
            try:
                if f.FieldType == ScheduleFieldType.Count:
                    return f
            except Exception:
                continue
        return campo_por_nombre(schedulable, 'Count')

    existing_schedules = {elem_name(v): v for v in FilteredElementCollector(doc).OfClass(ViewSchedule)}
    instancias_por_schedule = {}
    for ssi in FilteredElementCollector(doc).OfClass(ScheduleSheetInstance):
        instancias_por_schedule.setdefault(ssi.ScheduleId.Value, []).append(ssi)

    def limpiar_definicion(definition):
        # retrofit: deja la definicion en blanco para reconfigurarla desde cero, sin importar
        # como haya quedado en una corrida anterior.
        while definition.GetSortGroupFieldCount() > 0:
            definition.RemoveSortGroupField(0)
        while definition.GetFilterCount() > 0:
            definition.RemoveFilter(0)
        for i in range(definition.GetFieldCount() - 1, -1, -1):
            definition.RemoveField(definition.GetField(i).FieldId)

    def texto_ancho_columna(textos):
        candidatos = [t for t in textos if t]
        if not candidatos:
            return ANCHO_COL_MINIMO
        max_texto = max(candidatos, key=len)
        return max(len(max_texto) * ANCHO_POR_CARACTER_MM / 304.8, ANCHO_COL_MINIMO)

    def anchos_desde_textos(textos_col):
        # ancho ideal por columna segun su propio contenido; si la suma excede el ancho
        # reservado se escala TODO proporcionalmente para no invadir la grilla de plantas y
        # elevaciones (mismo right_reserve que usan 01/02).
        ideal = {clave: texto_ancho_columna(textos) for clave, textos in textos_col.items()}
        suma = sum(ideal.values())
        if suma > right_reserve and suma > 0:
            escala = right_reserve / suma
            return {clave: v * escala for clave, v in ideal.items()}
        return ideal

    def aplicar_formato(campo, decimales, agrupar):
        # 1.804,42 en las columnas de peso y 26,4 (sin miles, sin ceros de mas) en KG/M: el
        # plano tipo los formatea distinto, y el formato es por CAMPO del schedule, asi que no
        # depende de las unidades del proyecto.
        try:
            fo = FormatOptions(UnitTypeId.General)
            fo.Accuracy = 10.0 ** (-decimales) if decimales > 0 else 1.0
            try:
                fo.UseGrouping = agrupar
            except Exception:
                pass
            try:
                fo.SuppressTrailingZeros = not agrupar
            except Exception:
                pass
            campo.SetFormatOptions(fo)
            return True
        except Exception:
            return False

    def agrupar_encabezados(sched, nombre_tabla):
        # Encabezados de dos niveles ("DIMENSIONES" sobre L, "PESO" sobre KG/M + UNIT + TOTAL),
        # como el plano tipo. En la UI de Revit esto es el boton "Group" de la fila de titulos;
        # por API hay que insertar una fila en la seccion de encabezado del TableData y fusionar
        # celdas. No hay forma de verificarlo sin Revit abierto, asi que el log deja constancia
        # de la geometria real de la seccion y de si la fusion se pudo hacer.
        try:
            td = sched.GetTableData()
        except Exception as e:
            log.append('AVISO {}: no se pudo leer el TableData ({}); los encabezados quedan en una sola fila.'.format(nombre_tabla, e))
            return False
        for stype in (SectionType.Header, SectionType.Body):
            try:
                sd = td.GetSectionData(stype)
            except Exception:
                continue
            if sd is None:
                continue
            try:
                filas = sd.NumberOfRows
                cols = sd.NumberOfColumns
            except Exception:
                continue
            fila_titulos = None
            for r in range(filas):
                try:
                    if sd.GetCellText(r, 0) == H_DESC:
                        fila_titulos = r
                        break
                except Exception:
                    continue
            if fila_titulos is None:
                continue
            log.append('DEBUG {}: fila de titulos en {} = {} (seccion de {}x{}).'.format(
                nombre_tabla, stype, fila_titulos, filas, cols))
            # idempotencia: si la fila de arriba ya es la de grupos, no se inserta otra. Sin
            # esto cada corrida apilaria una fila de encabezado mas.
            if fila_titulos > 0:
                try:
                    if sd.GetCellText(fila_titulos - 1, 2) == H_GRUPO_DIM:
                        log.append('OK {}: los encabezados agrupados ya estaban.'.format(nombre_tabla))
                        return True
                except Exception:
                    pass
            if cols < 7:
                log.append('AVISO {}: la seccion tiene {} columnas, se esperaban 7; no se agrupan encabezados.'.format(nombre_tabla, cols))
                return False
            try:
                sd.InsertRow(fila_titulos)
            except Exception as e:
                # Revit NO deja insertar filas en la seccion de datos de un schedule normal
                # -solo en Key Schedule, Sheet List y Room/Area/MEP Space-. O sea que el
                # encabezado agrupado NO SE PUEDE crear por API, y no es cuestion de insistir.
                # La unica salida es armarlo a mano una vez en una tabla y usarla como
                # plantilla (input 13), que es de donde el duplicado se lo lleva.
                if 'can' in str(e) and 'insert' in str(e):
                    log.append('AVISO {}: los encabezados agrupados NO se pueden crear por API '
                               'en un schedule normal; la tabla queda con los encabezados en '
                               'una sola fila. Para tenerlos, arma una tabla a mano con esa '
                               'fila y pasala en el input 13 (Tabla plantilla).'.format(nombre_tabla))
                else:
                    log.append('AVISO {}: no se pudo insertar la fila de encabezado agrupado ({}).'.format(nombre_tabla, e))
                return False
            r0 = fila_titulos
            r1 = fila_titulos + 1

            def fusionar(top, left, bottom, right, texto):
                try:
                    mc = TableMergedCell()
                    mc.Top = top
                    mc.Left = left
                    mc.Bottom = bottom
                    mc.Right = right
                    sd.MergeCells(mc)
                    if texto is not None:
                        sd.SetCellText(top, left, texto)
                    return True
                except Exception as e:
                    log.append('AVISO {}: no se pudo fusionar ({},{})-({},{}): {}'.format(
                        nombre_tabla, top, left, bottom, right, e))
                    return False

            # columnas que no se agrupan: se estiran verticalmente sobre las dos filas
            fusionar(r0, 0, r1, 0, H_DESC)
            fusionar(r0, 1, r1, 1, H_CANT)
            fusionar(r0, 6, r1, 6, H_OBS)
            # DIMENSIONES sobre L, PESO sobre KG/M + UNIT. KG + TOTAL KG
            fusionar(r0, 2, r0, 2, H_GRUPO_DIM)
            fusionar(r0, 3, r0, 5, H_GRUPO_PESO)
            log.append('OK {}: encabezados agrupados (DIMENSIONES / PESO).'.format(nombre_tabla))
            return True
        log.append('AVISO {}: no se encontro la fila de titulos en el TableData; encabezados en una sola fila.'.format(nombre_tabla))
        return False

    def configurar_desde_plantilla(sched, tname, nombre_tabla):
        # La plantilla ya trae los campos, la agrupacion, los encabezados agrupados, los
        # anchos y el grafismo. Aca se cambia SOLO lo que es propio de este assembly -el
        # filtro y el titulo- justamente para no deshacer lo que alguien armo a mano.
        definition = sched.Definition
        spe = SharedParameterElement.Lookup(doc, GUID_ASSEMBLY)
        if spe is None:
            log.append('ERROR {}: el parametro compartido ASSEMBLY no esta cargado; no hay '
                       'como filtrar la tabla por assembly.'.format(nombre_tabla))
            return False

        fid = None
        for i in range(definition.GetFieldCount()):
            try:
                f = definition.GetField(i)
                if f.ParameterId == spe.Id:
                    fid = f.FieldId
                    break
            except Exception:
                continue
        if fid is None:
            # La plantilla no lo trae. Se agrega OCULTO a la COPIA -nunca a la plantilla- en
            # vez de fallar: un campo oculto no cambia nada de lo que se ve, y sin el no hay
            # forma de filtrar la tabla por assembly. Asi nadie tiene que acordarse de
            # incluirlo al armar la plantilla.
            campo = None
            for sf in definition.GetSchedulableFields():
                try:
                    if sf.ParameterId == spe.Id:
                        campo = sf
                        break
                except Exception:
                    continue
            if campo is None:
                log.append('ERROR {}: el parametro ASSEMBLY no esta disponible como campo en '
                           'esta tabla. Suele ser que la plantilla es de una categoria a la '
                           'que ASSEMBLY no esta vinculado.'.format(nombre_tabla))
                return False
            try:
                f = definition.AddField(campo)
                f.IsHidden = True
                fid = f.FieldId
                log.append('{}: se agrego el campo ASSEMBLY (oculto) a la copia de la '
                           'plantilla, para poder filtrar por assembly.'.format(nombre_tabla))
            except Exception as e:
                log.append('ERROR {}: no se pudo agregar el campo ASSEMBLY a la copia: {}'.format(
                    nombre_tabla, e))
                return False

        # solo los filtros SOBRE ESE CAMPO: los demas son de la plantilla y se respetan.
        for i in range(definition.GetFilterCount() - 1, -1, -1):
            try:
                if definition.GetFilter(i).FieldId == fid:
                    definition.RemoveFilter(i)
            except Exception:
                continue
        definition.AddFilter(ScheduleFilter(fid, ScheduleFilterType.Equal, tname))

        # FASE. Un schedule solo muestra elementos de SU fase, y eso NO se ve en la pestana
        # Filter: es un parametro de la vista. La plantilla puede estar en otra fase y el
        # duplicado la hereda, con lo que la tabla sale vacia sin ningun error.
        #
        # Visto el 2026-09-21: TABLA INSERTOS estaba en la fase "TERMINO" (5 elementos en todo
        # el modelo) mientras la estructura vive en "New Construction" (1.226). La tabla se
        # creaba, se colocaba en la lamina y no mostraba una sola fila.
        try:
            ai_fase = by_type[tname][0]
            p_fase_asm = ai_fase.get_Parameter(BuiltInParameter.PHASE_CREATED)
            p_fase_tbl = sched.get_Parameter(BuiltInParameter.VIEW_PHASE)
            if (p_fase_asm is not None and p_fase_tbl is not None
                    and not p_fase_tbl.IsReadOnly
                    and p_fase_tbl.AsElementId() != p_fase_asm.AsElementId()):
                nombre_fase = elem_name(doc.GetElement(p_fase_asm.AsElementId()))
                p_fase_tbl.Set(p_fase_asm.AsElementId())
                log.append('{}: fase de la tabla ajustada a la del assembly ("{}"); la '
                           'plantilla venia de otra y la tabla habria salido vacia.'.format(
                               nombre_tabla, nombre_fase))
        except Exception as e:
            log.append('AVISO {}: no se pudo ajustar la fase de la tabla: {}'.format(nombre_tabla, e))

        # el titulo es el NOMBRE de la vista; ver nombre_de_tabla()
        return True

    def configurar_schedule(sched, tname, textos_col, nombre_tabla):
        # (re)configura campos, agrupacion, filtro, anchos y grafismo. Se llama SIEMPRE, para
        # que re-correr el graph tambien retrofitee tablas ya colocadas.
        #
        # Con plantilla NO se reconfigura nada: se respeta lo que trae el duplicado.
        if plantilla_tabla is not None:
            return configurar_desde_plantilla(sched, tname, nombre_tabla)
        definition = sched.Definition
        definition.IsItemized = False
        limpiar_definicion(definition)

        schedulable = list(definition.GetSchedulableFields())

        campo_assembly = campo_por_guid(schedulable, GUID_ASSEMBLY)
        campo_cant_str = campo_por_guid(schedulable, GUID_PART_NUMBER)
        campo_material = campo_por_guid(schedulable, GUID_MATERIAL)
        campo_familia = campo_por_nombre(schedulable, 'Family')
        campo_tipo = campo_primero_de(schedulable, ['Type', 'Family and Type'])
        campo_cuenta = campo_count(schedulable)
        campo_dim = campo_por_nombre(schedulable, NOMBRE_DIM)
        campo_peso = campo_por_nombre(schedulable, NOMBRE_PESO)
        campo_unit = campo_por_nombre(schedulable, NOMBRE_UNIT)
        campo_total = campo_por_nombre(schedulable, NOMBRE_TOTAL)

        requeridos = (
            ('TAG (nombre del assembly)', campo_assembly),
            ('Part Number (CANT=N)', campo_cant_str),
            ('Type', campo_tipo), ('Count', campo_cuenta),
            (NOMBRE_DIM, campo_dim), (NOMBRE_PESO, campo_peso),
            (NOMBRE_UNIT, campo_unit), (NOMBRE_TOTAL, campo_total),
            ('MATERIAL (compartido)', campo_material))
        faltantes = [n for n, c in requeridos if c is None]
        if faltantes:
            log.append('ERROR {}: faltan los campos {} en el schedule multi-categoria.'.format(nombre_tabla, faltantes))
            todos = sorted(set(f.GetName(doc) for f in schedulable))
            log.append('Campos disponibles (primeros 60): ' + ', '.join(todos[:60]))
            return False

        # ocultos: agrupan y ordenan, pero no son columnas. Family es opcional: si el schedule
        # multi-categoria no lo ofrece, las filas quedan ordenadas solo por tipo.
        f_assembly = definition.AddField(campo_assembly)
        f_assembly.IsHidden = True
        f_cant_str = definition.AddField(campo_cant_str)
        f_cant_str.IsHidden = True
        f_familia = None
        if campo_familia is not None:
            f_familia = definition.AddField(campo_familia)
            f_familia.IsHidden = True
        else:
            log.append('AVISO {}: no hay campo "Family"; las filas se ordenan solo por tipo.'.format(nombre_tabla))

        # las 7 columnas visibles, en el orden del plano tipo
        idx = {}
        idx['desc'] = definition.GetFieldCount()
        f_desc = definition.AddField(campo_tipo)
        f_desc.ColumnHeading = H_DESC
        idx['cant'] = definition.GetFieldCount()
        f_cuenta = definition.AddField(campo_cuenta)
        f_cuenta.ColumnHeading = H_CANT
        idx['dim'] = definition.GetFieldCount()
        f_dim = definition.AddField(campo_dim)
        f_dim.ColumnHeading = H_DIM
        idx['peso'] = definition.GetFieldCount()
        f_peso = definition.AddField(campo_peso)
        f_peso.ColumnHeading = H_PESO
        idx['unit'] = definition.GetFieldCount()
        f_unit = definition.AddField(campo_unit)
        f_unit.ColumnHeading = H_UNIT
        idx['total'] = definition.GetFieldCount()
        f_total = definition.AddField(campo_total)
        f_total.ColumnHeading = H_TOTAL
        idx['obs'] = definition.GetFieldCount()
        f_material = definition.AddField(campo_material)
        f_material.ColumnHeading = H_OBS

        # DIMENSIONES / UNIT. KG / TOTAL KG se escriben por INSTANCIA: la fila del tipo tiene
        # que mostrar la SUMA de sus instancias (68,35 m entre 16 piezas), no el valor de una.
        # Ese "mostrar la suma" es justamente DisplayType.Totals, y es tambien lo que habilita
        # la fila de totales del pie. La version anterior escribia texto y por eso no podia
        # tener ni sumas por fila ni total general.
        for campo in (f_cuenta, f_dim, f_unit, f_total):
            try:
                campo.DisplayType = ScheduleFieldDisplayType.Totals
            except Exception as e:
                log.append('AVISO {}: no se pudo poner {} en modo Totals ({}).'.format(nombre_tabla, campo.ColumnHeading, e))

        aplicar_formato(f_dim, 2, True)
        aplicar_formato(f_peso, 2, False)
        aplicar_formato(f_unit, 2, True)
        aplicar_formato(f_total, 2, True)

        # encabezados de grupo: "ES-1004" y debajo "CANT=1"; despues se ordena por familia y
        # por tipo, sin encabezado, para que los tipos de una misma familia queden juntos.
        sg_assembly = ScheduleSortGroupField(f_assembly.FieldId)
        sg_assembly.ShowHeader = True
        definition.AddSortGroupField(sg_assembly)
        sg_cant = ScheduleSortGroupField(f_cant_str.FieldId)
        sg_cant.ShowHeader = True
        definition.AddSortGroupField(sg_cant)
        if f_familia is not None:
            sg_familia = ScheduleSortGroupField(f_familia.FieldId)
            sg_familia.ShowHeader = False
            definition.AddSortGroupField(sg_familia)
        sg_desc = ScheduleSortGroupField(f_desc.FieldId)
        sg_desc.ShowHeader = False
        definition.AddSortGroupField(sg_desc)

        # fila de totales al pie, sin la palabra "Total" ni el recuento que Revit agrega solo
        # (en el plano tipo la primera celda de esa fila va vacia). Cada propiedad va en su
        # propio try: si una no existiera, las otras igual tienen que aplicarse.
        for prop, valor in (('ShowGrandTotal', True), ('ShowGrandTotalTitle', False),
                            ('ShowGrandTotalCount', False)):
            try:
                setattr(definition, prop, valor)
            except Exception as e:
                log.append('AVISO {}: no se pudo fijar {} ({}).'.format(nombre_tabla, prop, e))

        # el filtro es ASSEMBLY: cada tabla muestra un solo assembly
        definition.AddFilter(ScheduleFilter(f_assembly.FieldId, ScheduleFilterType.Equal, tname))

        doc.Regenerate()

        # el template se aplica ANTES de los anchos y del grafismo: si controla algun ajuste,
        # el template gana primero y lo que fijamos explicitamente despues es lo que queda en
        # pantalla. 2026-07-14: estaba al reves (bug de orden que traia el graph) y el template
        # pisaba los anchos apenas se aplicaba, por eso ningun calculo de ancho cambiaba nada.
        if template_tabla is not None and sched.ViewTemplateId != template_tabla.Id:
            sched.ViewTemplateId = template_tabla.Id
            doc.Regenerate()

        if estilo_grid is not None:
            if not set_param_by_name(sched, 'Grid lines', estilo_grid):
                log.append('AVISO: no se pudo asignar el estilo de linea de grilla a {}.'.format(nombre_tabla))
            set_param_by_name(sched, 'Outline', estilo_grid)
        if tipo_header is not None:
            set_param_by_name(sched, 'Header text', tipo_header)
        if tipo_body is not None:
            set_param_by_name(sched, 'Body text', tipo_body)
        set_param_by_name(sched, 'Show Title', 1)
        set_param_by_name(sched, 'Show Headers', 1)

        anchos = anchos_desde_textos(textos_col)
        d = sched.Definition
        for clave, i in idx.items():
            try:
                d.GetField(i).Width = anchos[clave]
            except Exception as e:
                log.append('ERROR {} fijando ancho de {}: {}'.format(nombre_tabla, clave, e))

        # El titulo NO se toca aca. Un ViewSchedule no tiene "Title on Sheet"
        # (VIEW_DESCRIPTION) -get_Parameter devuelve None- asi que lo que Revit muestra es
        # el NOMBRE de la vista, y ese lo arma nombre_de_tabla() con el input 06.

        doc.Regenerate()
        agrupar_encabezados(sched, nombre_tabla)
        return True

    creados = 0
    ya_estaban = 0
    limpiados = 0
    sin_lamina = []

    TransactionManager.Instance.EnsureInTransaction(doc)
    try:
        # los 3 parametros numericos tienen que existir ANTES de recorrer nada: sin ellos no
        # hay columnas L / UNIT. KG / TOTAL KG ni fila de totales. Se sondean con un schedule
        # descartable, mismo patron con que 01 mide el area util con una lamina de prueba.
        _probe = ViewSchedule.CreateSchedule(doc, MULTI_CAT_ID)
        nombres_existentes = set()
        for f in _probe.Definition.GetSchedulableFields():
            try:
                nombres_existentes.add(f.GetName(doc))
            except Exception:
                continue
        doc.Delete(_probe.Id)

        # sin estos tres compartidos no hay agrupacion por assembly, ni "CANT=N", ni
        # OBSERVACION; y como get_Parameter(guid) devuelve None en silencio, sin este chequeo
        # la tabla saldria vacia sin decir por que.
        for etiqueta, guid in (('ASSEMBLY', GUID_ASSEMBLY), ('Part Number', GUID_PART_NUMBER),
                               ('MATERIAL', GUID_MATERIAL)):
            if SharedParameterElement.Lookup(doc, guid) is None:
                log.append('ERROR: el parametro compartido {} ({}) no esta cargado en el modelo.'.format(etiqueta, guid))

        if NOMBRE_PESO not in nombres_existentes:
            log.append('ERROR: no existe el parametro de peso "{}" en el modelo. Sin el no hay columna KG/M ni UNIT. KG.'.format(NOMBRE_PESO))
        faltaba = [n for n in (NOMBRE_DIM, NOMBRE_UNIT, NOMBRE_TOTAL) if n not in nombres_existentes]
        for nombre in faltaba:
            asegurar_param_numerico(nombre, nombres_existentes)
        if faltaba:
            doc.Regenerate()

        # ASSEMBLY de corridas anteriores: al borrar un assembly sus miembros quedan sueltos
        # en el modelo pero conservan el valor que se les escribio, y reapareceran como filas
        # fantasma. Se releva una sola vez todo el modelo y despues, por assembly, se limpia lo
        # que ya no sea miembro legitimo. Solo se toca ASSEMBLY cuando su valor es EXACTAMENTE
        # el nombre de un tipo de assembly: cualquier otro valor es del modelador y no se pisa.
        tagueados = {}
        for el in FilteredElementCollector(doc).OfClass(FamilyInstance).WhereElementIsNotElementType():
            try:
                p = el.get_Parameter(GUID_ASSEMBLY)
            except Exception:
                continue
            if p is None:
                continue
            v = p.AsString()
            if v and v in by_type:
                tagueados.setdefault(v, []).append(el)

        for tname in sorted(by_type, key=clave_natural):
            sh = primera_lamina.get(tname)
            if sh is None:
                sin_lamina.append(tname)
                continue

            ai = by_type[tname][0]
            cant_assembly = len(by_type[tname])
            cant_str = 'CANT={}'.format(cant_assembly)
            hojas, contenedores, diag = miembros_recursivos(ai)
            if diag['no_familyinstance']:
                log.append('DIAG {}: {} miembro(s) del assembly no son FamilyInstance y se '
                           'saltan sin poder recorrer sus hijos (tipico de los '
                           'StructuralConnectionHandler). Si faltan piezas en la tabla, la '
                           'causa esta aca.'.format(tname, diag['no_familyinstance']))
            if diag['con_hijos']:
                log.append('DIAG {}: {} miembro(s) tienen sub-componentes; {} de ellos no '
                           'aportan volumen propio y se tratan como envoltorio (sin fila). El '
                           'resto SI genera fila, ademas de sus hijos.'.format(
                               tname, diag['con_hijos'], diag['sin_geometria']))

            if not hojas:
                log.append('AVISO {}: el assembly no tiene miembros con geometria propia; no se genera tabla.'.format(tname))
                continue

            # OJO: aca se le BORRABA el ASSEMBLY a los envoltorios, para que no salieran
            # como fila. Ya no. Las piezas anidadas dentro de una familia tienen ese
            # parametro de SOLO LECTURA a proposito y HEREDAN el valor del padre: el
            # envoltorio es justamente el padre. Borrarselo deja sin marcar a todos sus
            # hijos, que es lo que dejaba 128 piezas de ES-1001 fuera de la tabla.
            #
            # 00 marca los miembros apenas se corre; esto los desmarcaba despues.

            # "legitimas" es TODO lo que pertenece al assembly, no solo lo que genera fila.
            # Con hojas a secas, la limpieza de abajo borraba la marca de los envoltorios
            # -y por herencia la de sus hijos- en cada corrida.
            legitimas = set(el.Id.Value for el in hojas)
            legitimas.update(el.Id.Value for el in contenedores)
            for el in tagueados.get(tname, []):
                if el.Id.Value in legitimas:
                    continue
                p = el.get_Parameter(GUID_ASSEMBLY)
                if p is not None and not p.IsReadOnly:
                    p.Set('')
                    limpiados += 1

            grupos = {}
            for el in hojas:
                try:
                    grupos.setdefault(el.Symbol.Id.Value, []).append(el)
                except Exception:
                    continue

            textos_col = {'desc': [H_DESC], 'cant': [H_CANT], 'dim': [H_DIM],
                          'peso': [H_PESO], 'unit': [H_UNIT], 'total': [H_TOTAL],
                          'obs': [H_OBS]}
            sin_peso = []
            # piezas a las que NO se les pudo escribir ASSEMBLY, por tipo y motivo. Sin ese
            # parametro la pieza no aparece en la tabla, porque el filtro del schedule es
            # justamente por el.
            no_marcados = {}
            ids_sin_marcar = []
            fuentes_largo = {}
            suma_unit = 0.0
            suma_dim = 0.0
            suma_piezas = 0

            for sym_id, els in grupos.items():
                sym = els[0].Symbol
                nombre_tipo = elem_name(sym)
                es_m2 = any(nombre_tipo.strip().upper().startswith(p) for p in prefijos_m2)

                peso = leer_double(sym.LookupParameter(NOMBRE_PESO))
                if peso is None:
                    peso = 0.0
                    sin_peso.append(nombre_tipo)

                dim_grupo = 0.0
                unit_grupo = 0.0
                for el in els:
                    if es_m2:
                        dim, fuente = area_m2(el)
                    else:
                        dim, fuente = largo_m(el)
                    fuentes_largo[fuente] = fuentes_largo.get(fuente, 0) + 1
                    unit = dim * peso
                    dim_grupo += dim
                    unit_grupo += unit

                    p_asm = el.get_Parameter(GUID_ASSEMBLY)
                    if not set_string(p_asm, tname):
                        if p_asm is None:
                            motivo = 'el parametro no llega a esa categoria'
                        elif p_asm.IsReadOnly:
                            motivo = 'es de SOLO LECTURA en la familia'
                        else:
                            motivo = 'Revit rechazo el valor'
                        # la FAMILIA es el dato que hace falta: es el archivo que hay
                        # que abrir para arreglarlo. El tipo solo no alcanza.
                        try:
                            familia = elem_name(el.Symbol.Family)
                        except Exception:
                            familia = '(familia desconocida)'
                        k = (motivo, familia, nombre_tipo)
                        no_marcados[k] = no_marcados.get(k, 0) + 1
                        ids_sin_marcar.append(el.Id)
                    set_string(el.get_Parameter(GUID_PART_NUMBER), cant_str)
                    set_double(param_de(el, NOMBRE_DIM), dim)
                    set_double(param_de(el, NOMBRE_UNIT), unit)
                    set_double(param_de(el, NOMBRE_TOTAL), unit * cant_assembly)

                suma_unit += unit_grupo
                suma_dim += dim_grupo
                suma_piezas += len(els)
                material_val = ''
                pm = els[0].get_Parameter(GUID_MATERIAL)
                if pm is not None:
                    material_val = pm.AsString() or ''

                # el texto REAL que va a mostrar cada columna, para calcular el ancho
                textos_col['desc'].append(nombre_tipo)
                textos_col['cant'].append(str(len(els)))
                textos_col['dim'].append(formatear_numero(dim_grupo))
                textos_col['peso'].append(formatear_numero(peso))
                textos_col['unit'].append(formatear_numero(unit_grupo))
                textos_col['total'].append(formatear_numero(unit_grupo * cant_assembly))
                textos_col['obs'].append(material_val)

            # la fila de totales del pie suele traer el numero mas largo de toda la columna
            # (27.539,16 contra 1.804,42), asi que tambien pesa en el ancho
            textos_col['cant'].append(str(suma_piezas))
            textos_col['dim'].append(formatear_numero(suma_dim))
            textos_col['unit'].append(formatear_numero(suma_unit))
            textos_col['total'].append(formatear_numero(suma_unit * cant_assembly))

            # se llama siempre, tambien con la lista vacia: asi la vista de una corrida
            # anterior se borra cuando el problema ya se arreglo.
            nombre_vista = vista_diagnostico(tname, ids_sin_marcar)
            if no_marcados:
                # el detalle se junta para el bloque de alerta del principio del log
                alertas_marcado[tname] = (no_marcados, nombre_vista)
            if sin_peso:
                log.append('AVISO {}: {} tipo(s) sin "{}" (peso 0): {}'.format(
                    tname, len(sin_peso), NOMBRE_PESO, ', '.join(sorted(set(sin_peso))[:8])))
            if fuentes_largo:
                log.append('DEBUG {}: origen de la dimension -> {}'.format(
                    tname, ', '.join('{}={}'.format(k, v) for k, v in sorted(fuentes_largo.items()))))

            nombre_schedule = nombre_de_tabla(tname)
            sched = existing_schedules.get(nombre_schedule)
            if sched is None:
                # Una corrida anterior pudo dejarla con otro titulo. Se RENOMBRA en vez de
                # crear una segunda tabla del mismo assembly, que quedaria duplicada en el
                # Project Browser y huerfana en la lamina.
                base_tname = limpiar_nombre_vista(tname)
                anterior = None
                for n in list(existing_schedules):
                    if n == nombre_schedule:
                        continue
                    if plantilla_tabla is not None and n == elem_name(plantilla_tabla):
                        continue
                    if n == PREFIJO_SCHEDULE + base_tname or n.endswith(' ' + base_tname):
                        anterior = n
                        break
                if anterior is not None:
                    candidata = existing_schedules.pop(anterior)
                    try:
                        candidata.Name = nombre_schedule
                        existing_schedules[nombre_schedule] = candidata
                        sched = candidata
                        log.append('{}: la tabla se renombro de "{}" a "{}".'.format(
                            tname, anterior, nombre_schedule))
                    except Exception as e:
                        existing_schedules[anterior] = candidata
                        log.append('AVISO {}: no se pudo renombrar "{}" a "{}" ({}); se crea '
                                   'una tabla nueva y la anterior queda suelta.'.format(
                                       tname, anterior, nombre_schedule, e))

            # la categoria de un ViewSchedule no se puede cambiar una vez creado: si quedo uno
            # de una version anterior del graph (categoria Assemblies) hay que rehacerlo.
            # Con plantilla no se controla: la categoria la decide ella.
            if (plantilla_tabla is None and sched is not None
                    and sched.Definition.CategoryId != MULTI_CAT_ID):
                doc.Delete(sched.Id)
                existing_schedules.pop(nombre_schedule, None)
                sched = None
                log.append('AVISO: se recreo la tabla de {} (era de una version anterior).'.format(tname))

            if sched is None:
                if plantilla_tabla is not None:
                    try:
                        sched = doc.GetElement(
                            plantilla_tabla.Duplicate(ViewDuplicateOption.Duplicate))
                    except Exception as e:
                        log.append('ERROR {}: no se pudo duplicar la tabla plantilla "{}": {}'.format(
                            tname, elem_name(plantilla_tabla), e))
                        continue
                else:
                    sched = ViewSchedule.CreateSchedule(doc, MULTI_CAT_ID)
                sched.Name = nombre_schedule
                existing_schedules[nombre_schedule] = sched

            if not configurar_schedule(sched, tname, textos_col, nombre_schedule):
                continue

            # la tabla va en la PRIMERA lamina del assembly: si una corrida anterior la dejo en
            # otra (porque cambio la cantidad de laminas o el orden), se mueve.
            instancias = [ssi for ssi in instancias_por_schedule.get(sched.Id.Value, [])
                          if doc.GetElement(ssi.Id) is not None]
            ya_en_sitio = any(ssi.OwnerViewId == sh.Id for ssi in instancias)
            for ssi in instancias:
                if ssi.OwnerViewId != sh.Id:
                    doc.Delete(ssi.Id)
                    log.append('AVISO {}: la tabla estaba en otra lamina; se movio a {}.'.format(tname, sh.SheetNumber))

            if ya_en_sitio:
                ya_estaban += 1
                log.append('OK: tabla de {} actualizada en la lamina {} ({} tipo(s), {} pieza(s), {} kg).'.format(
                    tname, sh.SheetNumber, len(grupos), len(hojas), formatear_numero(suma_unit)))
                continue

            x0, y0, x1, y1 = usable_rect(sh)
            try:
                nueva = ScheduleSheetInstance.Create(doc, sh.Id, sched.Id, XYZ(x1, y1, 0.0))
                instancias_por_schedule.setdefault(sched.Id.Value, []).append(nueva)
                creados += 1
                log.append('OK: tabla de {} creada en la lamina {} ({} tipo(s), {} pieza(s), {} kg).'.format(
                    tname, sh.SheetNumber, len(grupos), len(hojas), formatear_numero(suma_unit)))
            except Exception as e:
                log.append('ERROR colocando la tabla de {} en la lamina {}: {}'.format(tname, sh.SheetNumber, e))
    finally:
        TransactionManager.Instance.TransactionTaskDone()

    if sin_lamina:
        log.append('AVISO: sin lamina todavia (corre 01 y 02): ' + ', '.join(sin_lamina))
    log.insert(0, 'Tablas creadas: {} | actualizadas: {} | assemblies sin lamina: {} | TAG limpiados: {}'.format(
        creados, ya_estaban, len(sin_lamina), limpiados))

    # --- alerta de material que NO llega a la tabla -------------------------------------
    # Va ARRIBA DE TODO y no mezclada entre los avisos: es la unica falla de este paso que
    # no se ve por ningun lado. La tabla se crea, se coloca, el log dice OK, y adentro
    # faltan piezas. Nadie la descubre salvo que sume los kilos a mano.
    if alertas_marcado:
        # Orden deliberado: primero QUE HACER AHORA -abrir la vista-, despues que paso y
        # recien al final el arreglo de fondo. La version anterior explicaba el mecanismo
        # antes de decir donde mirar, y era ilegible para el modelador.
        RAYA = '=' * 78
        # cada valor es (detalle_por_tipo, nombre_de_la_vista)
        total_global = sum(sum(det.values()) for det, _v in alertas_marcado.values())
        bloque = [RAYA,
                  'ATENCION: faltan {} pieza(s) en la lista de materiales.'.format(total_global),
                  '']
        solo_lectura = False
        sin_categoria = False
        for tname in sorted(alertas_marcado):
            detalle, nombre_vista = alertas_marcado[tname]
            bloque.append('  {}: faltan {} pieza(s)'.format(tname, sum(detalle.values())))
            if nombre_vista:
                bloque.append('    -> abri la vista 3D "{}"'.format(nombre_vista))
                bloque.append('       (Project Browser). Ahi estan esas piezas, y solo esas.')
            else:
                bloque.append('    -> no se pudo crear la vista para verlas; mira los AVISO.')
            # agrupadas por familia: la familia es el archivo que hay que abrir, asi que
            # una linea por familia es mas util que una por tipo.
            por_familia = {}
            for (motivo, familia, tipo), n in detalle.items():
                por_familia.setdefault((motivo, familia), []).append((n, tipo))
                if motivo.startswith('es de SOLO LECTURA'):
                    solo_lectura = True
                elif motivo.startswith('el parametro no llega'):
                    sin_categoria = True
            for (motivo, familia), tipos in sorted(por_familia.items(),
                                                   key=lambda x: -sum(n for n, _t in x[1])):
                piezas = ', '.join('{} x{}'.format(t, n)
                                   for n, t in sorted(tipos, key=lambda y: -y[0]))
                bloque.append('       familia "{}": {}'.format(familia, piezas))
                bloque.append('         ({})'.format(motivo))
            bloque.append('')

        bloque.append('QUE PASO')
        bloque.append('  Esas piezas son del assembly, pero su parametro ASSEMBLY quedo vacio')
        bloque.append('  y el script no lo pudo escribir. La tabla FILTRA por ese parametro:')
        bloque.append('  sin el, la pieza no entra y su material no se cuenta.')
        if solo_lectura:
            bloque.append('')
            bloque.append('QUE HAY QUE HACER con lo de SOLO LECTURA (es en la FAMILIA)')
            bloque.append('  1. Selecciona una de esas piezas y anda a Edit Family.')
            bloque.append('  2. En Family Types, BORRA el parametro ASSEMBLY de la familia.')
            bloque.append('     Borrarlo, no quitarle la formula: ASSEMBLY es dato del')
            bloque.append('     PROYECTO. Si la familia lo define, tapa al del proyecto y')
            bloque.append('     queda de solo lectura en todo el modelo.')
            bloque.append('  3. Carga la familia y volve a correr este paso.')
        if sin_categoria:
            bloque.append('')
            bloque.append('QUE HAY QUE HACER con lo de la categoria')
            bloque.append('  Manage > Project Parameters > ASSEMBLY, y marca la categoria que')
            bloque.append('  aparece arriba. Sin eso el parametro no llega a esas piezas.')
        bloque.append('')
        bloque.append('La vista se borra sola cuando ya no falta nada.')
        bloque.append(RAYA)
        for i, linea in enumerate(bloque):
            log.insert(i, linea)
    OUT = log
# ----------------------------------------
log = Watch(py_tabla_de_materiales_por)  # graph output
