# Dynamo graph 06_Titulos de vistas.dyn (Dynamo 4.0.2.3852)
# Muestra el titulo (nombre de la vista) bajo cada viewport: crea el tipo de viewport con titulo si no existe, lo aplica a los viewports de los sheets destino y alinea el titulo justo debajo de cada vista.

sheets_destino_numeros_con_coma = StringInput("test hoja 2")  # "Sheets destino (numeros con coma, o prefijo)"; graph input
tipo_de_viewport_con_titulo_se = StringInput("C_ConTitulo")  # "Tipo de viewport con titulo (se crea si no existe)"; graph input
separacion_vista_titulo_mm = IntegerSlider(5, range=2..15 step 1)  # graph input
py_crear_tipo_aplicar_y_alinear = Python(IN[0]=sheets_destino_numeros_con_coma, IN[1]=tipo_de_viewport_con_titulo_se, IN[2]=separacion_vista_titulo_mm)  # "PY | Crear tipo, aplicar y alinear titulos"; PythonNet3
# ---------- py_crear_tipo_aplicar_y_alinear.python (125 lines) ----------
# 06_Titulos de vistas - Muestra el titulo (nombre de la vista) bajo cada viewport
# 1) Si el tipo de viewport indicado no existe, LO CREA duplicando un tipo existente.
# 2) Activa Show Title = Yes en ese tipo.
# 3) Lo aplica a todos los viewports de los sheets destino.
# 4) Alinea el titulo justo debajo de cada vista, con la linea al ancho de la vista.
# Revit 2027 / Dynamo 4 / CPython3
# IN[0] = sheets destino: numeros separados por coma, o un prefijo comun
# IN[1] = nombre del tipo de viewport con titulo (se crea si no existe)
# IN[2] = separacion vista-titulo en mm de papel

import clr
clr.AddReference('RevitAPI')
clr.AddReference('RevitServices')
from Autodesk.Revit.DB import (FilteredElementCollector, ViewSheet, Viewport,
                               ElementType, Element, BuiltInParameter, XYZ,
                               BuiltInCategory, FamilySymbol)
from RevitServices.Persistence import DocumentManager
from RevitServices.Transactions import TransactionManager

doc = DocumentManager.Instance.CurrentDBDocument

sheets_text = (IN[0] or '').strip()
type_text = (IN[1] or '').strip()
if not type_text:
    type_text = 'C_ConTitulo'
gap = float(IN[2]) / 304.8

log = []

def elem_name(e):
    try:
        return e.Name
    except Exception:
        return Element.Name.__get__(e)

vp_types = [t for t in FilteredElementCollector(doc).OfClass(ElementType)
            if t.FamilyName == 'Viewport']

vp_type = None
low = type_text.lower()
for t in vp_types:
    if elem_name(t).lower() == low:
        vp_type = t
        break

# --- sheets destino ---
all_sheets = {}
for s in FilteredElementCollector(doc).OfClass(ViewSheet):
    all_sheets[s.SheetNumber] = s

target_sheets = []
seen = set()
for tok in [t.strip() for t in sheets_text.split(',') if t.strip()]:
    if tok in all_sheets:
        matches = [all_sheets[tok]]
    else:
        matches = [s for n, s in all_sheets.items() if n.startswith(tok)]
    for s in matches:
        if s.SheetNumber not in seen:
            seen.add(s.SheetNumber)
            target_sheets.append(s)
target_sheets.sort(key=lambda s: s.SheetNumber)

if not target_sheets:
    log.append('ERROR: ningun sheet coincide con {}.'.format(sheets_text))
    log.append('Sheets del proyecto: ' + ', '.join(sorted(all_sheets.keys())[:30]))
    OUT = log
elif not vp_types:
    log.append('ERROR: el proyecto no tiene tipos de viewport.')
    OUT = log
else:
    cambiados = 0
    alineados = 0
    TransactionManager.Instance.EnsureInTransaction(doc)
    try:
        # 1) crear el tipo si no existe
        if vp_type is None:
            base = vp_types[0]
            vp_type = base.Duplicate(type_text)
            log.append('Tipo {} creado (duplicado de {}).'.format(type_text, elem_name(base)))
        # 2) Show Title = Yes
        p = vp_type.get_Parameter(BuiltInParameter.VIEWPORT_ATTR_SHOW_LABEL)
        if p is not None and not p.IsReadOnly and p.AsInteger() != 1:
            p.Set(1)
            log.append('Show Title activado en el tipo {}.'.format(elem_name(vp_type)))
        # 2b) asignar la familia de titulo de vista (el texto) si el tipo no tiene
        pt = vp_type.get_Parameter(BuiltInParameter.VIEWPORT_ATTR_LABEL_TAG)
        if pt is not None and (pt.AsElementId() is None or pt.AsElementId().Value < 0):
            labels = list(FilteredElementCollector(doc).OfClass(FamilySymbol)
                          .OfCategory(BuiltInCategory.OST_ViewportLabel))
            if labels:
                pt.Set(labels[0].Id)
                log.append('Familia de titulo asignada al tipo: {} : {}.'.format(
                    labels[0].FamilyName, elem_name(labels[0])))
            else:
                log.append('AVISO: no hay ninguna familia View Title cargada en el proyecto.')
                log.append('Carga una (Insertar > Cargar familia > Anotaciones > titulo de vista) y re-corre; sin ella la linea aparece pero no el texto.')
        # 3) aplicar el tipo
        vps = []
        for sh in target_sheets:
            for vpid in sh.GetAllViewports():
                vp = doc.GetElement(vpid)
                vps.append((sh, vp))
                try:
                    if vp.GetTypeId() != vp_type.Id:
                        vp.ChangeTypeId(vp_type.Id)
                        cambiados += 1
                except Exception as e:
                    log.append('ERROR cambiando tipo en sheet {}: {}'.format(sh.SheetNumber, e))
        doc.Regenerate()
        # 4) alinear el titulo bajo cada vista
        for sh, vp in vps:
            try:
                o = vp.GetBoxOutline()
                ancho = o.MaximumPoint.X - o.MinimumPoint.X
                vp.LabelOffset = XYZ(0.0, -gap, 0.0)
                vp.LabelLineLength = ancho
                alineados += 1
            except Exception as e:
                log.append('ERROR alineando titulo en sheet {}: {}'.format(sh.SheetNumber, e))
    finally:
        TransactionManager.Instance.TransactionTaskDone()
    log.insert(0, 'Tipo: {} | tipo cambiado en {} viewports | titulos alineados: {} | sheets: {}'.format(
        elem_name(vp_type), cambiados, alineados, len(target_sheets)))
    OUT = log
# ----------------------------------------
log = Watch(py_crear_tipo_aplicar_y_alinear)  # graph output
