# Dynamo graph 07_Tags en plantas.dyn (Dynamo 4.0.2.3852)
# Coloca un Multi-Category Tag sobre cada elemento individual del assembly (no sobre el assembly) en su vista de PLANTA. El usuario solo elige el tipo de tag en el dropdown.

tipo_de_tag_multi_category_tag = FamilyTypes(index=0)  # graph input
procesar_todos_los_assemblies = BoolSelector(true)  # graph input
filtro_por_nombre_si_todos_false = StringInput("")  # graph input
tags_con_leader = BoolSelector(false)  # graph input
py_tag_multicategoria_por = Python(IN[0]=tipo_de_tag_multi_category_tag, IN[1]=procesar_todos_los_assemblies, IN[2]=filtro_por_nombre_si_todos_false, IN[3]=tags_con_leader)  # "PY | Tag multicategoria por elemento"; PythonNet3
# ---------- py_tag_multicategoria_por.python (121 lines) ----------
# 07_Tags en plantas - Multi-Category Tag a cada elemento del assembly (solo planta)
# Los tags apuntan a los COMPONENTES individuales (GetMemberIds), no al assembly.
# Revit 2027 / Dynamo 4 / CPython3
# IN[0] = tipo de tag (dropdown Family Types; debe ser Multi-Category Tag)
# IN[1] = procesar todos los assemblies (bool)
# IN[2] = filtro por nombre si IN[1] es False (parcial, comas)
# IN[3] = tags con leader (bool)

import clr
clr.AddReference('RevitAPI')
clr.AddReference('RevitServices')
from Autodesk.Revit.DB import (FilteredElementCollector, AssemblyInstance, View,
                               IndependentTag, Reference, TagOrientation,
                               BuiltInCategory, ElementId, XYZ, Element)
from RevitServices.Persistence import DocumentManager
from RevitServices.Transactions import TransactionManager

doc = DocumentManager.Instance.CurrentDBDocument

tag_type = UnwrapElement(IN[0])
process_all = bool(IN[1])
filter_text = (IN[2] or '').strip()
leader = bool(IN[3])

log = []

def elem_name(e):
    try:
        return e.Name
    except Exception:
        return Element.Name.__get__(e)

def tag_label(t):
    try:
        return '{} : {}'.format(t.FamilyName, elem_name(t))
    except Exception:
        return 'Id ' + str(t.Id)

# --- validar que lo elegido sea un Multi-Category Tag ---
mc_cat = ElementId(BuiltInCategory.OST_MultiCategoryTags)
valido = (tag_type is not None and tag_type.Category is not None
          and tag_type.Category.Id == mc_cat)

if not valido:
    log.append('ERROR: el tipo seleccionado NO es un Multi-Category Tag.')
    log.append('Tags multicategoria cargados en el proyecto:')
    tt = list(FilteredElementCollector(doc)
              .OfCategory(BuiltInCategory.OST_MultiCategoryTags)
              .WhereElementIsElementType())
    if not tt:
        log.append('  (ninguno - carga una familia de Multi-Category Tag al proyecto)')
    for t in tt:
        log.append('  - ' + tag_label(t))
    OUT = log
else:
    # --- assemblies objetivo (unicos por tipo, igual que 02) ---
    by_type = {}
    for ai in FilteredElementCollector(doc).OfClass(AssemblyInstance):
        by_type.setdefault(ai.AssemblyTypeName, []).append(ai)

    if process_all:
        targets = sorted(by_type.keys())
    else:
        tokens = [t.strip().lower() for t in filter_text.split(',') if t.strip()]
        if tokens:
            targets = [n for n in sorted(by_type.keys())
                       if any(tok in n.lower() for tok in tokens)]
        else:
            targets = []
            log.append('ERROR: \"Todos\" esta en False y el filtro esta vacio.')

    views = {}
    for v in FilteredElementCollector(doc).OfClass(View):
        if not v.IsTemplate:
            views[elem_name(v)] = v

    total = 0
    TransactionManager.Instance.EnsureInTransaction(doc)
    try:
        if hasattr(tag_type, 'IsActive') and not tag_type.IsActive:
            tag_type.Activate()
        for tname in targets:
            ai = by_type[tname][0]
            vplan = views.get(tname)
            if vplan is None:
                log.append('AVISO {}: no existe la vista de planta (corre 02_Vistas de assembly).'.format(tname))
                continue
            # idempotencia: si la planta ya tiene tags, se salta
            existentes = FilteredElementCollector(doc, vplan.Id).OfClass(IndependentTag).GetElementCount()
            if existentes > 0:
                log.append('{}: la planta ya tiene {} tags, se salta.'.format(tname, existentes))
                continue
            n = 0
            no_tageables = 0
            for mid in ai.GetMemberIds():
                el = doc.GetElement(mid)
                try:
                    if el is None or el.Category is None:
                        continue
                    bb = el.get_BoundingBox(None)
                    if bb is None:
                        continue
                    centro = XYZ((bb.Min.X + bb.Max.X) / 2.0,
                                 (bb.Min.Y + bb.Max.Y) / 2.0,
                                 (bb.Min.Z + bb.Max.Z) / 2.0)
                    IndependentTag.Create(doc, tag_type.Id, vplan.Id, Reference(el),
                                          leader, TagOrientation.Horizontal, centro)
                    n += 1
                except Exception:
                    no_tageables += 1
            total += n
            msg = 'OK {}: {} tags en la planta.'.format(tname, n)
            if no_tageables:
                msg += ' ({} elementos no admiten este tag)'.format(no_tageables)
            log.append(msg)
    finally:
        TransactionManager.Instance.TransactionTaskDone()

    log.insert(0, 'Tags creados: {} | assemblies procesados: {} | tag: {}'.format(
        total, len(targets), tag_label(tag_type)))
    OUT = log
# ----------------------------------------
log = Watch(py_tag_multicategoria_por)  # graph output
