# Dynamo graph 98_Test callout de assembly.dyn (Dynamo 4.0.2.3852)
# SOLO PRUEBA REVERSIBLE: intenta crear un ViewSection.CreateCallout sobre la planta de un assembly (Detail View) y lo borra en la misma corrida si funciona, sin dejar rastro. Objetivo: confirmar si los callouts son viables en este tipo de vista antes de construir la iniciativa de callouts de pedestales.

nombre_de_la_planta_assembly = StringInput("FN-1001")  # graph input
py_test_createcallout_reversible = Python(IN[0]=nombre_de_la_planta_assembly)  # PythonNet3
# ---------- py_test_createcallout_reversible.python (80 lines) ----------
# 98_Test callout de assembly - test REVERSIBLE (crea el callout, lo confirma
# y lo BORRA en la misma corrida, sin dejar rastro en el modelo). Objetivo:
# confirmar si ViewSection.CreateCallout funciona sobre la planta de un
# assembly (AssemblyViewUtils.CreateDetailSection(..., HorizontalDetail) - es
# una Detail View, nunca antes probamos un callout sobre este tipo de vista
# en este pipeline). Etapa previa a la iniciativa de callouts de pedestales.
import clr
clr.AddReference('RevitAPI')
clr.AddReference('RevitServices')
from Autodesk.Revit.DB import (Element, FilteredElementCollector, View,
                               ViewSection, ViewFamilyType, ViewFamily, XYZ)
from RevitServices.Persistence import DocumentManager
from RevitServices.Transactions import TransactionManager

doc = DocumentManager.Instance.CurrentDBDocument

nombre_planta = (IN[0] or '').strip() or 'FN-1001'
log = []

def elem_name(e):
    try:
        return e.Name
    except Exception:
        return Element.Name.__get__(e)

target = None
for v in FilteredElementCollector(doc).OfClass(View):
    if v.IsTemplate:
        continue
    if elem_name(v) == nombre_planta:
        target = v
        break

if target is None:
    log.append('no existe la vista "{}" (corre 00_Vistas de assembly)'.format(nombre_planta))
    OUT = log
else:
    log.append('Vista encontrada: "{}" | ViewType={} | Clase={}'.format(
        elem_name(target), target.ViewType, target.GetType().Name))

    vftype = None
    tipos_detail = []
    for t in FilteredElementCollector(doc).OfClass(ViewFamilyType):
        if t.ViewFamily == ViewFamily.Detail:
            tipos_detail.append(elem_name(t))
            if vftype is None:
                vftype = t
    log.append('ViewFamilyType de Detail disponibles: {}'.format(', '.join(tipos_detail) or 'NINGUNO'))

    if vftype is None:
        log.append('ERROR: no hay ningun ViewFamilyType de tipo Detail en el proyecto, no se puede probar.')
        OUT = log
    else:
        cb = target.CropBox
        tr = cb.Transform
        mn, mx = cb.Min, cb.Max
        w, h = mx.X - mn.X, mx.Y - mn.Y
        # rectangulo chico (20%-40% del crop) para no depender de la geometria real
        p1 = tr.OfPoint(XYZ(mn.X + w * 0.2, mn.Y + h * 0.2, 0.0))
        p2 = tr.OfPoint(XYZ(mn.X + w * 0.4, mn.Y + h * 0.4, 0.0))
        log.append('Rectangulo de prueba (mundo): p1={} p2={}'.format(p1, p2))

        TransactionManager.Instance.EnsureInTransaction(doc)
        try:
            callout = ViewSection.CreateCallout(doc, target.Id, vftype.Id, p1, p2)
            doc.Regenerate()
            log.append('OK: callout creado. Id={} Name="{}" ViewType={}'.format(
                callout.Id, elem_name(callout), callout.ViewType))
            try:
                cb2 = callout.CropBox
                log.append('  CropBox del callout: Min={} Max={}'.format(cb2.Min, cb2.Max))
            except Exception as e2:
                log.append('  (no se pudo leer CropBox del callout: {})'.format(e2))
            doc.Delete(callout.Id)
            log.append('Callout de prueba eliminado, sin dejar rastro en el modelo.')
        except Exception as e:
            log.append('ERROR creando callout: {}: {}'.format(type(e).__name__, e))
        TransactionManager.Instance.TransactionTaskDone()

        OUT = log
# ----------------------------------------
log = Watch(py_test_createcallout_reversible)  # graph output
