# Dynamo graph 99_Diagnostico pedestales.dyn (Dynamo 4.0.2.3852)
# SOLO LECTURA: reporta que assemblies tienen 2 o mas TIPOS distintos de la familia de pedestal (default C-Pedestal), con el conteo de instancias por tipo. Etapa de validacion previa a los callouts de pedestales (00 crea, 02 coloca).

familia_de_pedestal = StringInput("C-Pedestal")  # graph input
py_diagnostico_de_tipos_de = Python(IN[0]=familia_de_pedestal)  # "PY | Diagnostico de tipos de pedestal por assembly"; PythonNet3
# ---------- py_diagnostico_de_tipos_de.python (96 lines) ----------
# 99_Diagnostico pedestales - SOLO LECTURA (no modifica el modelo, sin transaccion).
# Identifica que assemblies tienen 2 o mas TIPOS distintos de la familia de
# pedestal (input, default C-Pedestal). Un assembly con 0 o 1 tipo NO es candidato.
# Recorre los miembros a CUALQUIER profundidad de anidamiento INCLUYENDO
# contenedores: un C-Pedestal tiene hijos anidados (G35, etc.), no es hoja,
# por eso NO se usa el patron hojas_recursivas de 03/06/07 (solo hojas).
# Etapa 1 de la iniciativa de callouts de pedestales: validar el criterio de
# identificacion antes de crear ningun callout (despues: 00 crea, 02 coloca).
import clr
clr.AddReference('RevitAPI')
clr.AddReference('RevitServices')
from Autodesk.Revit.DB import (Element, FilteredElementCollector, AssemblyInstance,
                               FamilyInstance)
from RevitServices.Persistence import DocumentManager

doc = DocumentManager.Instance.CurrentDBDocument

fam_obj = (IN[0] or '').strip() or 'C-Pedestal'
fam_low = fam_obj.lower()

def elem_name(e):
    try:
        return e.Name
    except Exception:
        return Element.Name.__get__(e)

def instancias_recursivas(ai):
    # TODAS las FamilyInstance del assembly (contenedores y hojas, cualquier
    # profundidad de anidamiento).
    vistos = set()
    resultado = []
    stack = list(ai.GetMemberIds())
    while stack:
        eid = stack.pop()
        if eid.Value in vistos:
            continue
        vistos.add(eid.Value)
        el = doc.GetElement(eid)
        if el is None or not isinstance(el, FamilyInstance):
            continue
        resultado.append(el)
        try:
            stack.extend(list(el.GetSubComponentIds()))
        except Exception:
            pass
    return resultado

log = []
by_type = {}
for ai in FilteredElementCollector(doc).OfClass(AssemblyInstance):
    by_type.setdefault(ai.AssemblyTypeName, []).append(ai)

if not by_type:
    log.append('No hay assemblies en el proyecto.')

candidatos = []
familias_vistas = set()
hubo_pedestales = False
for tname in sorted(by_type):
    # primera instancia del tipo, mismo criterio que el resto del pipeline
    ai = by_type[tname][0]
    tipos = {}
    for el in instancias_recursivas(ai):
        try:
            fam = el.Symbol.Family.Name
        except Exception:
            continue
        familias_vistas.add(fam)
        if fam.lower() != fam_low:
            continue
        tn = elem_name(el.Symbol)
        tipos[tn] = tipos.get(tn, 0) + 1
    if not tipos:
        log.append('{}: sin miembros de la familia {}'.format(tname, fam_obj))
        continue
    hubo_pedestales = True
    desc = ', '.join('{} x{}'.format(k, tipos[k]) for k in sorted(tipos))
    if len(tipos) >= 2:
        candidatos.append(tname)
        log.append('{}: {} TIPOS -> {}   <== CANDIDATO'.format(tname, len(tipos), desc))
    else:
        log.append('{}: 1 tipo -> {}'.format(tname, desc))

log.append('')
if candidatos:
    log.append('CANDIDATOS ({} de {} assemblies): {}'.format(
        len(candidatos), len(by_type), ', '.join(candidatos)))
else:
    log.append('CANDIDATOS: ninguno ({} assemblies revisados).'.format(len(by_type)))
if by_type and not hubo_pedestales:
    log.append('OJO: NINGUN assembly tiene miembros de la familia "{}".'.format(fam_obj))
    log.append('Familias encontradas en los assemblies (para comparar el nombre):')
    for f in sorted(familias_vistas):
        log.append('  - ' + f)

OUT = log
# ----------------------------------------
log = Watch(py_diagnostico_de_tipos_de)  # graph output
